# Grasshopper definition Terrain modeling helper.gh (Grasshopper 1.0.7)
# Copyright: Co-de-iT
# plug-ins: Kangaroo2 Components, froGH, Human

# <title>
# 
# <description>
# 
# code by Alessio Erioli
# 
# v 0.1
# terrain mesh (with holes)
mesh = Mesh(<mesh referenced from the Rhino model>)
# contact surfaces for the holes
mesh_2 = Mesh([<mesh referenced from the Rhino model> x9])

# ---- group: extract naked edges
f_medges = ExtractMeshEdges(Mesh=mesh_2)  # -> Edges, WeldStatus, EdgeStatus
equals = Equality(FirstNumber=f_medges.EdgeStatus, SecondNumber="0")  # -> Equality, Inequality
cull = CullPattern(List=f_medges.Edges, CullPattern=equals.Equality)  # -> flatten(List)

# ---- group: extract naked points
# © a3 2021 / Creative Commons Attribution-Non Commercial-ShareAlike 4.0 International License
nv = NakedVertices(Mesh=mesh)  # -> ClothedIndex, NakedIndex, ClothedPts, NakedPts

# ----
# Project vertices and edges on a common plane to find nearest edge for each vertex
project = Project(Geometry=nv.NakedPts, Plane=PlaneXY(0, 0, 0))  # -> Geometry, Transform
project_2 = Project(Geometry=cull, Plane=PlaneXY(0, 0, 0))  # -> Geometry, Transform
pull = PullPoint(Point=project.Geometry, Geometry=project_2.Geometry, ClosestOnly=True)  # -> ClosestPoint, Distance
smaller = SmallerThan(FirstNumber=pull.Distance, SecondNumber="0.1")  # -> SmallerThan, OrEqualTo

# ---- group: cull nearest vertices only (exclude external vertices)
cull_2 = CullPattern(List=nv.NakedIndex, CullPattern=smaller.SmallerThan)
cull_3 = CullPattern(List=pull.ClosestPoint, CullPattern=smaller.SmallerThan)

# ---- group: find corresponding points on contact surfaces' edge curves
crv_cp = CurveClosestPoint(Point=graft(cull_3), Curve=project_2.Geometry)  # -> Point, Parameter, Distance
f_ifroml = IndexesFromList(Data=crv_cp.Point)
sort = SortList(Keys=crv_cp.Distance, ValuesA=crv_cp.Parameter, ValuesB=f_ifroml)  # -> Keys, ValuesA, ValuesB
item = ListItem(List=sort.ValuesB, Index=0, Wrap=True)
item_2 = ListItem(List=sort.ValuesA, Index=0, Wrap=True)  # -> flatten(Item)
item_3 = ListItem(List=cull, Index=item, Wrap=True)  # -> flatten(Item)
eval = EvaluateCurve(Curve=item_3, Parameter=item_2)  # -> Point, Tangent, Angle

# ---- group: replace vertices with moved ones
demesh = DeconstructMesh(Mesh=mesh)  # -> Vertices, Faces, Colours, Normals
replace = ReplaceItems(List=demesh.Vertices, Item=eval.Point, Indices=cull_2, Wrap=False)
conmesh = ConstructMesh(Vertices=replace, Faces=demesh.Faces)

# ---- group: Bake me!
mesh_3 = Mesh(conmesh)

# ----
medges = MeshEdges(Mesh=mesh_3)  # -> NakedEdges, InteriorEdges, NonManifoldEdges
preview = CustomPreview(Geometry=mesh_3, Material=ColourSwatch(SwatchColor=RGB(255, 255, 255)))
previewlw = CustomPreviewLineweights(Geometry=[medges.NakedEdges, medges.InteriorEdges], Shader=ColourSwatch(SwatchColor=RGB(0, 0, 0)), Absolute=False)
