# Grasshopper definition in class.gh (Grasshopper 1.0.7)
# Copyright: Co-de-iT

pt = ConstructPoint(XCoordinate="10.5", YCoordinate=Slider(2.508, range=0..10), ZCoordinate=Slider(4.252, range=0..10))

pt_2 = Point()
box = Box()
pt_3 = Point(<point referenced from the Rhino model>)
# <title>
# 
# <description>
# 
# code by Alessio Erioli
# 
# v 0.1
# © a3 2021 / Creative Commons Attribution-Non Commercial-ShareAlike 4.0 International License
panel = Panel("Box component")
pt_4 = Point(<point referenced from the Rhino model>)
# create line from points
ln = Line(StartPoint=pt_4, EndPoint=pt)
