# Grasshopper definition in class_orient.gh (Grasshopper 1.0.7)
# Copyright: Co-de-iT

# ----
# geometry to orient
# Brep (actual geometry)
# mesh (collision geometry)
brep = Brep(<brep referenced from the Rhino model>)
mesh = Mesh(<mesh referenced from the Rhino model>)

# ----
# handle 1
crv = Curve(<curve referenced from the Rhino model>)

# ----
# handle 2
crv_2 = Curve(<curve referenced from the Rhino model>)

# ----
# polyline to plane
panel = Panel("1")
explode = Explode(Curve=crv, Recursive=True)  # -> Segments, Vertices
points = PointList(Points=explode.Vertices, Size=panel)
item = ListItem(List=explode.Vertices, Index=0, Wrap=True)  # -> Item, Item1, Item2
# il receiver plane si ottiene invertendo la direzione dell'asse X (l'asse Z cambia direzione di conseguenza)
panel_2 = Panel(explode.Vertices)
vec2pt = Vector2Pt(PointA=item.Item1, PointB=item.Item2, Unitize=False)  # -> Vector, Length
vec2pt_2 = Vector2Pt(PointA=item.Item1, PointB=item.Item, Unitize=False)  # -> Vector, Length

# ----
# polyline to plane
panel_3 = Panel("1")
explode_2 = Explode(Curve=crv_2, Recursive=True)  # -> Segments, Vertices
points_2 = PointList(Points=explode_2.Vertices, Size=panel_3)
item_2 = ListItem(List=explode_2.Vertices, Index=0, Wrap=True)  # -> Item, Item1, Item2
panel_4 = Panel(explode_2.Vertices)
vec2pt_3 = Vector2Pt(PointA=item_2.Item1, PointB=item_2.Item2, Unitize=False)  # -> Vector, Length
vec2pt_4 = Vector2Pt(PointA=item_2.Item1, PointB=item_2.Item, Unitize=False)  # -> Vector, Length

# ----
# <title>
# 
# <description>
# 
# code by Alessio Erioli
# 
# v 0.1
# © a3 2021 / Creative Commons Attribution-Non Commercial-ShareAlike 4.0 International License
# dato singolo
# lista
geo = Geometry([brep, mesh])

# ---- group: sender plane
pl = ConstructPlane(Origin=item.Item1, XAxis=vec2pt_2.Vector, YAxis=vec2pt.Vector)

pl_2 = ConstructPlane(Origin=item_2.Item1, XAxis=vec2pt_4.Vector, YAxis=vec2pt_3.Vector)

# ---- group: receiver plane
pflip = FlipPlane(Plane=pl, ReverseX="True", ReverseY="False", SwapAxes="False")
rad = Radians(Degrees=Slider(0, range=0..180))
# Questo componente ruota il piano attorno al proprio asse Z.
# 
# Gli angoli in Grasshopper sono in radianti, per questo è necessario un componente che traduca i gradi decimali in radianti.
# 
# Potete sempre trovare la posizione dei componenti sul ribbon posizionandovi con il mouse sul componente da trovare e usando la combinazione:
# 
# CTRL+ALT+RMB(premuto)
prot = RotatePlane(Plane=pflip, Angle=rad)

pflip_2 = FlipPlane(Plane=pl_2, ReverseX="True", ReverseY="False", SwapAxes="False")
rad_2 = Radians(Degrees=Slider(0, range=0..180))
prot_2 = RotatePlane(Plane=pflip_2, Angle=rad_2)

# ----
# geometry
geo_2 = Geometry(geo)

# ----
# sender plane
pln = Plane(pl_2)

# ----
# receiver plane
pln_2 = Plane(prot)

# ----
# handles
crv_3 = Curve([crv, crv_2])

# ----
# transform geometry
orient = Orient(Geometry=geo_2, Source=pln, Target=pln_2)  # -> Geometry, Transform

# ----
# transform handles
orient_2 = Orient(Geometry=crv_3, Source=pln, Target=pln_2)  # -> Geometry, Transform

# ----
# transformed geometry
# bake & repeat
geo_3 = Geometry(orient.Geometry)

# ----
# transformed handles
crv_4 = Curve(orient_2.Geometry)

explode_3 = Explode(Curve=crv_4, Recursive=True)  # -> Segments, Vertices
panel_5 = Panel(explode_3.Vertices)
# data tree (lo vedremo la prossima settimana)
points_3 = PointList(Points=explode_3.Vertices, Size="1")
