# Grasshopper definition base part.gh (Grasshopper 1.0.7)
# Copyright: Co-de-iT
# plug-ins: Assembler

# Handle che sembrano visivamente identiche potrebbero non esserlo: la normale potrebbe puntare all'interno della Collision Mesh.
# 
# In questi casi, potete usare il comando "Flip" in Rhino per invertire il verso della polilinea.
crv = Curve(<curve referenced from the Rhino model>)
crv_2 = Curve(<curve referenced from the Rhino model>)

# ----
# Handles
# 0
# 1
# referenziare qui le vostre Handles
crv_3 = Curve(<curve referenced from the Rhino model>)
# parti editabili
# Setup
# bake
# preview on/off
# nel disegnare le L polylines per le Handles la sequenza dei punti è fondamentale, e deve essere fatta in modo che la normale sia sempre USCENTE relativamente alla Collision Mesh
# normale al piano
# 2
crv_4 = Curve(<curve referenced from the Rhino model>)
panel = Panel("""0
90""")
handcon = ConstructHandle(Polyline=crv_3, RotationAngles=0, Type=0, Weight=1)
handcon_2 = ConstructHandle(Polyline=crv_4, RotationAngles=0, Type=0, Weight=1)

# ----
# piano descritto dalla polilinea
# Il componente Display Handle visualizza la normale come una linea nera puntinata. Utilizzatelo per verificate la direzione della normale
crv_5 = Curve(<curve referenced from the Rhino model>)
handcon_3 = ConstructHandle(Polyline=crv, RotationAngles=0, Type="1", Weight=1)
handcon_4 = ConstructHandle(Polyline=crv_2, RotationAngles=0, Type="1", Weight=1)
handcon_5 = ConstructHandle(Polyline=crv_5, RotationAngles=0, Type=0, Weight=1)
merge = Merge(Data1=handcon_2)

# ----
# Collision mesh (spazio occupato)
mesh = Mesh(<mesh referenced from the Rhino model>)

# ----
# <title>
# 
# <description>
# 
# code by Alessio Erioli
# 
# v 0.1
# © a3 2021 / Creative Commons Attribution-Non Commercial-ShareAlike 4.0 International License
name = Panel("Part_01")
handdisp = DisplayHandles(Handles=merge, DisplaySize=Slider(0.355, range=0..1), absHTextSize=False)

# ---- group: floor
mesh_2 = Mesh(<mesh referenced from the Rhino model>)

# ---- group: short wall 1
mesh_3 = Mesh(<mesh referenced from the Rhino model>)

# ---- group: short wall 2
mesh_4 = Mesh(<mesh referenced from the Rhino model>)

# ---- group: ceiling
mesh_5 = Mesh(<mesh referenced from the Rhino model>)

# ---- group: long wall 1
mesh_6 = Mesh(<mesh referenced from the Rhino model>)

# ---- group: long wall 2
# referenziare qui le geometrie costruite (mesh)
mesh_7 = Mesh(<mesh referenced from the Rhino model>)

# ----
# AssemblyObject
aocon = ConstructAssemblyObject(Name=name, CollisionMesh=mesh, Direction=Vector(1, 0, 0), Handles=merge, Weight=1, ZLockAO=False)

# ----
# XData
merge_2 = Merge(Data1=mesh_2, Data2=mesh_3, Data3=mesh_4)
merge_3 = Merge(Data1=mesh_2, Data2=mesh_5, Data3=mesh_6, Data4=mesh_7)
mjoin = MeshJoin(Meshes=flatten(merge_2))
mjoin_2 = MeshJoin(Meshes=flatten(merge_3))
xdcon = ConstructXData(Label="geometry2", AssemblyObject=aocon, Data=mjoin_2)
xdcon_2 = ConstructXData(Label="geometry1", AssemblyObject=aocon, Data=mjoin)

# ----
# RMB click > reference one geometry o reference multiple geometries
geo = Geometry()

# ----
# Se le vostre geometrie non sono Mesh (ma, ad esempio, estrusioni o polisuperfici), referenziarle in un componente Geometry e poi attaccarlo ad un componente Mesh (come sopra).
# 
# Poi connettere l'output della Mesh al Merge.
mesh_8 = Mesh(geo)

# ---- group: origin point
pt = Point(Point(0, 20, 0))

# ----
# Rules (Heuristics)
heuwri = HeuristicsWriter(AssemblyObjectsSet=aocon, noSH=False, noSO=False, xHT=False)
# Simulation
heud = HeuristicDisplay(
    OriginPoint=pt,
    AssemblyObjectsSet=aocon,
    HeuristicsSet=heuwri,
    XSize=1.2,
    YSize=1.2,
    NRows=Slider(4, range=2..10),
    DisplayType="AO Types",
    ZLockFilter=False,
    OutputType="AO Types")

# ----
# Heuristics
# Settings
heuset = HeuristicsSettings(HeuristicsSet=heuwri, CurrentHeuristics=0, HeuristicsMode=0, ReceiverSelectionMode=0, SenderRuleSelectionMode=0)

step = Button()
target_number = Panel("1000")

# ----
# se si cambia qualcosa a monte (eccetto per gli XData) resettare l'engine
reset = Button()

# ---- group: starting plane (XY implicito)
pt_2 = Point(Point(-62.53285728, -28.21013159, 0))

# ----
aoaengine = AssemblerEngine(
    AssemblyObjectsSet=aocon,
    StartingPlane=pt_2,
    StartingObjectType=0,
    HeuristicsSettings=heuset,
    Go=False,
    Step=step,
    NIterations=Slider(10, range=10..100),
    TargetMaxNObjects=target_number,
    ResetSettings=False,
    Reset=reset,
    UseSupports=False,
    ZLockCheck=False)  # -> Assemblage, AssemblageCount
n_of_ao = Panel(aoaengine.AssemblageCount)
# Post-processing
aoadisp = DisplayAssemblage(Assemblage=aoaengine.Assemblage, ColorsOnly=False, OutputType="Occupancy")  # -> ColoredCollisionMeshes, Edges, Colors, Values
aoadecon = DeconstructAssemblage(Assemblage=aoaengine.Assemblage)  # -> AssemblageObjects, AssemblageRules, ReceiverObjectsIndexes, AvailableObjectIndexes, UnreachableObjectIndexes
associate_xdata = AssociateXData(AssemblyObjects=aoadecon.AssemblageObjects, XData=xdcon_2)  # "AO<>XD"
xddecon = DeconstructXData(XData=associate_xdata)  # -> Label, AssemblyObjectNameReference, ReferencePlane, Data

# ----
# Utilizzate questo componente per fare il bake su Rhino
mesh_9 = Mesh(xddecon.Data)

# ----
# edges (bordi) delle collision Meshes
medges = MeshEdges(Mesh=aoadisp.ColoredCollisionMeshes)  # -> NakedEdges, InteriorEdges, NonManifoldEdges
# edges (bordi) delle geometrie effettive
medges_2 = MeshEdges(Mesh=mesh_9)  # -> NakedEdges, InteriorEdges, NonManifoldEdges
# visualizzazione delle geometrie effettive
preview = CustomPreview(Geometry=mesh_9, Material=graft(aoadisp.Colors))
