# Grasshopper definition base_in class.gh (Grasshopper 1.0.7)
# Copyright: Co-de-iT
# plug-ins: Assembler

panel = Panel("""0
90""")
crv = Curve(<curve referenced from the Rhino model>)
crv_2 = Curve(<curve referenced from the Rhino model>)
crv_3 = Curve(<curve referenced from the Rhino model>)
crv_4 = Curve(<curve referenced from the Rhino model>)
crv_5 = Curve(<curve referenced from the Rhino model>)
handcon = ConstructHandle(Polyline=crv, RotationAngles=0, Type=0, Weight=1)
handcon_2 = ConstructHandle(Polyline=crv_2, RotationAngles=0, Type=0, Weight=1)
handcon_3 = ConstructHandle(Polyline=crv_3, RotationAngles=0, Type=0, Weight=1)
handcon_4 = ConstructHandle(Polyline=crv_5, RotationAngles=panel, Type="1", Weight=1)
handcon_5 = ConstructHandle(Polyline=crv_4, RotationAngles=panel, Type="1", Weight=1)
merge = Merge(Data1=handcon_3, Data2=handcon_2, Data3=handcon, Data4=handcon_5, Data5=handcon_4)
# <title>
# 
# <description>
# 
# code by Alessio Erioli
# 
# v 0.1
panel_2 = Panel("Part_01")
mesh = Mesh(<mesh referenced from the Rhino model>)
# © a3 2021 / Creative Commons Attribution-Non Commercial-ShareAlike 4.0 International License
aocon = ConstructAssemblyObject(Name=panel_2, CollisionMesh=mesh, Direction=Vector(1, 0, 0), Handles=merge, Weight=1, ZLockAO=False)
handdisp = DisplayHandles(Handles=merge, DisplaySize=Slider(0.365, range=0..1), absHTextSize=False)
heuwri = HeuristicsWriter(AssemblyObjectsSet=aocon, noSH=False, noSO=False, xHT=False)
pt = Point(Point(0, 17.29302457, 0))
heuset = HeuristicsSettings(HeuristicsSet=heuwri, CurrentHeuristics=0, HeuristicsMode=0, ReceiverSelectionMode=0, SenderRuleSelectionMode=0)
step = Button()
reset = Button()
panel_3 = Panel(heuwri)
pt_2 = Point(Point(-40.22422855, 0, 0))
heud = HeuristicDisplay(
    OriginPoint=pt,
    AssemblyObjectsSet=aocon,
    HeuristicsSet=heuwri,
    XSize=1.2,
    YSize=1.2,
    NRows=10,
    DisplayType="AO Types",
    ZLockFilter=False)
aoaengine = AssemblerEngine(
    AssemblyObjectsSet=aocon,
    StartingPlane=pt_2,
    StartingObjectType=0,
    HeuristicsSettings=heuset,
    Go=False,
    Step=step,
    NIterations=10,
    TargetMaxNObjects=1000,
    ResetSettings=False,
    Reset=reset,
    UseSupports=False,
    ZLockCheck=False)  # -> Assemblage, AssemblageCount
aoadisp = DisplayAssemblage(Assemblage=aoaengine.Assemblage, ColorsOnly=False, OutputType="Objects")  # -> ColoredCollisionMeshes, Edges, Colors, Values
