# Grasshopper definition base part_environment.gh (Grasshopper 1.0.7)
# Copyright: Co-de-iT
# plug-ins: Assembler, Human, froGH, MeshEdit Components

# ----
# Handles
# Handle che sembrano visivamente identiche potrebbero non esserlo: la normale potrebbe puntare all'interno della Collision Mesh.
# 
# In questi casi, potete usare il comando "Flip" in Rhino per invertire il verso della polilinea.
crv = Curve(<curve referenced from the Rhino model>)
crv_2 = Curve(<curve referenced from the Rhino model>)
# 0
# 1
# piano descritto dalla polilinea
crv_3 = Curve(<curve referenced from the Rhino model>)
# parti editabili
# Setup
# bake
# preview on/off
# nel disegnare le L polylines per le Handles la sequenza dei punti è fondamentale, e deve essere fatta in modo che la normale sia sempre USCENTE relativamente alla Collision Mesh
# normale al piano
# 2
crv_4 = Curve(<curve referenced from the Rhino model>)
# Il componente Display Handle visualizza la normale come una linea nera puntinata. Utilizzatelo per verificate la direzione della normale
crv_5 = Curve(<curve referenced from the Rhino model>)
panel = Panel("""0
90""")
panel_2 = Panel("""0
90""")
panel_3 = Panel("""0
90""")
handcon = ConstructHandle(Polyline=crv, RotationAngles=panel, Type="1", Weight=1)
handcon_2 = ConstructHandle(Polyline=crv_2, RotationAngles=panel_2, Type="1", Weight=1)
handcon_3 = ConstructHandle(Polyline=crv_3, RotationAngles=0, Type=0, Weight=1)
handcon_4 = ConstructHandle(Polyline=crv_5, RotationAngles=0, Type=0, Weight=1)
handcon_5 = ConstructHandle(Polyline=crv_4, RotationAngles=0, Type=0, Weight=1)

mesh = Mesh(<mesh referenced from the Rhino model>)

# ----
# Environment
mesh_2 = Mesh(<mesh referenced from the Rhino model>)
mesh_3 = Mesh(<mesh referenced from the Rhino model>)
mesh_4 = Mesh(<mesh referenced from the Rhino model>)
mesh_5 = Mesh(<mesh referenced from the Rhino model>)
merge = Merge(Data1=mesh_2, Data2=mesh_3, Data3=mesh_4, Data4=mesh, Data5=mesh_5)

# ----
# This is only to show what's inside the cluster
mesh_6 = Mesh()

# ----
# Collision mesh (spazio occupato)
mesh_7 = Mesh(<mesh referenced from the Rhino model>)

# ----
# AssemblyObject 01
number_slider = Slider(0.355, range=0..1)
merge_2 = Merge(Data1=handcon_5, Data2=handcon_3, Data3=handcon_4, Data4=handcon_2, Data5=handcon)
# <title>
# 
# <description>
# 
# code by Alessio Erioli
# 
# v 0.1
# © a3 2021 / Creative Commons Attribution-Non Commercial-ShareAlike 4.0 International License
name = Panel("Part_01")
handdisp = DisplayHandles(Handles=merge_2, DisplaySize=number_slider, absHTextSize=False)
aocon = ConstructAssemblyObject(Name=name, CollisionMesh=mesh_7, Direction=Vector(1, 0, 0), Handles=merge_2, Weight=1, ZLockAO=False)

# ---- group: floor
mesh_8 = Mesh(<mesh referenced from the Rhino model>)

# ---- group: short wall 1
mesh_9 = Mesh(<mesh referenced from the Rhino model>)

# ---- group: short wall 2
mesh_10 = Mesh(<mesh referenced from the Rhino model>)

# ----
# display environment geometries names
# IMPORTANT: Objects must be named in Rhino
cluster = Cluster(environment_geometries=merge)

# ----
# XData
merge_3 = Merge(Data1=mesh_8, Data2=mesh_9, Data3=mesh_10)
mjoin = MeshJoin(Meshes=flatten(merge_3))
xdcon = ConstructXData(Label="geometry1", AssemblyObject=aocon, Data=mjoin)

merge_4 = Merge(Data1=xdcon)
merge_5 = Merge(Data1=aocon)

# ---- group: origin point
pt = Point(Point(0, 20, 0))

# ----
# Rules (Heuristics)
heuwri = HeuristicsWriter(AssemblyObjectsSet=merge_5, noSH=False, noSO=False, xHT=False)
# Simulation
heud = HeuristicDisplay(
    OriginPoint=pt,
    AssemblyObjectsSet=merge_5,
    XData=merge_4,
    HeuristicsSet=heuwri,
    XSize=1.2,
    YSize=1.2,
    NRows=Slider(5, range=2..10),
    DisplayType="AO Types",
    ZLockFilter=False,
    OutputType="AO Types")

# ----
# Heuristics
# Settings
heuset = HeuristicsSettings(HeuristicsSet=heuwri, CurrentHeuristics=0, HeuristicsMode=0, ReceiverSelectionMode=0, SenderRuleSelectionMode=0)

# ----
# Exogenous
# (environment)
# Settings
exoset = ExogenousSettings(
    EnvironmentMeshes=merge,
    EnvironmentMode="2",
    FieldScalarThreshold=0.5,
    Sandbox={Plane=PlaneXY(0, 0, 0), X=Domain(-1, 1), Y=Domain(0, 0), Z=Domain(0, 0)},
    HasContainer=False)

step = Button()
target_number = Panel("1000")

# ----
# se si cambia qualcosa a monte (eccetto per gli XData) resettare l'engine
reset = Button()

# ---- group: starting plane (XY implicito)
pt_2 = Point(Point(-62.53285728, -28.21013159, 0))

# ----
aoaengine = AssemblerEngine(
    AssemblyObjectsSet=merge_5,
    StartingPlane=pt_2,
    StartingObjectType=0,
    HeuristicsSettings=heuset,
    ExogenousSettings=exoset,
    Go=False,
    Step=step,
    NIterations=Slider(100, range=10..100),
    TargetMaxNObjects=target_number,
    ResetSettings=False,
    Reset=reset,
    UseSupports=False,
    ZLockCheck=False)  # -> Assemblage, AssemblageCount
n_of_ao = Panel(aoaengine.AssemblageCount)
# Post-processing
aoadisp = DisplayAssemblage(Assemblage=aoaengine.Assemblage, ColorsOnly=False, OutputType="Occupancy")  # -> ColoredCollisionMeshes, Edges, Colors, Values
aoadecon = DeconstructAssemblage(Assemblage=aoaengine.Assemblage)  # -> AssemblageObjects, AssemblageRules, ReceiverObjectsIndexes, AvailableObjectIndexes, UnreachableObjectIndexes
associate_xdata = AssociateXData(AssemblyObjects=aoadecon.AssemblageObjects, XData=merge_4)  # "AO<>XD"
xddecon = DeconstructXData(XData=associate_xdata)  # -> Label, AssemblyObjectNameReference, ReferencePlane, Data

# ----
# Utilizzate questo componente per fare il bake su Rhino
mesh_11 = Mesh(xddecon.Data)

# ----
# edges (bordi) delle collision Meshes
previewlw = CustomPreviewLineweights(Geometry=aoadisp.Edges, Shader=ColourSwatch(SwatchColor=RGB(128, 128, 128)), Absolute=False)

f_mmeea = MeshesExtractEdgesWithToleranceAngle(Mesh=mesh_11, Angle=45)  # -> InternalEdges, NakedEdges
# edges (bordi) delle geometrie effettive
previewlw_2 = CustomPreviewLineweights(Geometry=[f_mmeea.InternalEdges, f_mmeea.NakedEdges], Shader=ColourSwatch(SwatchColor=RGB(0, 0, 0)), Absolute=False)

# ----
# visualizzazione delle geometrie effettive
preview = CustomPreview(Geometry=mesh_11, Material=graft(aoadisp.Colors))

# ----
# display environment geometries names
# IMPORTANT: Objects must be named in Rhino
# This component from Human gets object attributes (name, layer, color)
objatts = ObjectAttributes(ObjectOrAttributes=mesh_6)  # -> Name, LayerName, LayerFullPath, Color, MaterialName, LinetypeName, GroupIndices, PlotWeight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

# ----
# If an object is a void (if it's in the "voids" layer), flips the mesh before computing volume (otherwise the centroid is out of place)
panel_6 = Panel("voids")
tmatch = MatchText(Text=objatts.LayerName, Pattern=panel_6, Case=True)
dispatch = Dispatch(List=mesh_6, DispatchPattern=tmatch)  # -> ListA, ListB
flip = MeshFlip(Mesh=dispatch.ListA)
weave = Weave(Pattern=tmatch, Stream0=dispatch.ListB, Stream1=flip, NullGaps=False)

volume = Volume(Geometry=weave)  # -> Volume, Centroid
tag = TextTag(Location=volume.Centroid, Text=objatts.Name, Colour=objatts.Color)

# ==== cluster Cluster
environment_geometries = ClusterInput()

# ----
# display environment geometries names
# IMPORTANT: Objects must be named in Rhino
# This component from Human gets object attributes (name, layer, color)
objatts = ObjectAttributes(ObjectOrAttributes=environment_geometries)  # -> Name, LayerName, LayerFullPath, Color, MaterialName, LinetypeName, GroupIndices, PlotWeight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

# ----
# If an object is a void (if it's in the "voids" layer), flips the mesh before computing volume (otherwise the centroid is out of place)
panel = Panel("voids")
tmatch = MatchText(Text=objatts.LayerName, Pattern=panel, Case=True)
dispatch = Dispatch(List=environment_geometries, DispatchPattern=tmatch)  # -> ListA, ListB
flip = MeshFlip(Mesh=dispatch.ListA)
weave = Weave(Pattern=tmatch, Stream0=dispatch.ListB, Stream1=flip, NullGaps=False)

volume = Volume(Geometry=weave)  # -> Volume, Centroid

tag = TextTag(Location=volume.Centroid, Text=objatts.Name, Colour=objatts.Color)
