# Grasshopper definition base part_extended_H-V.gh (Grasshopper 1.0.7)
# Copyright: Co-de-iT
# plug-ins: Assembler, Human, froGH

# ----
# Handles
# Handle che sembrano visivamente identiche potrebbero non esserlo: la normale potrebbe puntare all'interno della Collision Mesh.
# 
# In questi casi, potete usare il comando "Flip" in Rhino per invertire il verso della polilinea.
crv = Curve(<curve referenced from the Rhino model>)
crv_2 = Curve(<curve referenced from the Rhino model>)
# 0
# 1
# piano descritto dalla polilinea
crv_3 = Curve(<curve referenced from the Rhino model>)
# parti editabili
# Setup
# bake
# preview on/off
# nel disegnare le L polylines per le Handles la sequenza dei punti è fondamentale, e deve essere fatta in modo che la normale sia sempre USCENTE relativamente alla Collision Mesh
# normale al piano
# 2
crv_4 = Curve(<curve referenced from the Rhino model>)
# Il componente Display Handle visualizza la normale come una linea nera puntinata. Utilizzatelo per verificate la direzione della normale
crv_5 = Curve(<curve referenced from the Rhino model>)
panel = Panel("""0
90""")
panel_4 = Panel("""0
90""")
handcon = ConstructHandle(Polyline=crv, RotationAngles=0, Type="1", Weight=1)
handcon_2 = ConstructHandle(Polyline=crv_2, RotationAngles=0, Type="1", Weight=1)
handcon_3 = ConstructHandle(Polyline=crv_3, RotationAngles=0, Type=0, Weight=1)
handcon_4 = ConstructHandle(Polyline=crv_5, RotationAngles=0, Type=0, Weight=1)
handcon_5 = ConstructHandle(Polyline=crv_4, RotationAngles=panel_4, Type=0, Weight=1)

# ----
# Handles
crv_6 = Curve(<curve referenced from the Rhino model>)
crv_7 = Curve(<curve referenced from the Rhino model>)
crv_8 = Curve(<curve referenced from the Rhino model>)
crv_9 = Curve(<curve referenced from the Rhino model>)
panel_6 = Panel("""0
180""")
handcon_6 = ConstructHandle(Polyline=crv_6, RotationAngles=panel_6, Type="2", Weight=1)
handcon_7 = ConstructHandle(Polyline=crv_7, RotationAngles=0, Type=0, Weight=1)
handcon_8 = ConstructHandle(Polyline=crv_9, RotationAngles=0, Type=0, Weight=1)
handcon_9 = ConstructHandle(Polyline=crv_8, RotationAngles=0, Type=0, Weight=1)

# ----
# Collision mesh (spazio occupato)
mesh = Mesh(<mesh referenced from the Rhino model>)

# ----
# AssemblyObject 01
number_slider = Slider(0.355, range=0..1)
merge = Merge(Data1=handcon_5, Data2=handcon_3, Data3=handcon_4, Data4=handcon_2, Data5=handcon)
# <title>
# 
# <description>
# 
# code by Alessio Erioli
# 
# v 0.1
# © a3 2021 / Creative Commons Attribution-Non Commercial-ShareAlike 4.0 International License
name = Panel("Part_01")
handdisp = DisplayHandles(Handles=merge, DisplaySize=number_slider, absHTextSize=False)
aocon = ConstructAssemblyObject(Name=name, CollisionMesh=mesh, Direction=Vector(1, 0, 0), Handles=merge, Weight=1, ZLockAO=False)

# ----
# Collision mesh (spazio occupato)
mesh_2 = Mesh(<mesh referenced from the Rhino model>)

# ----
# AssemblyObject 02
number_slider_2 = Slider(0.355, range=0..1)
merge_2 = Merge(Data1=handcon_9, Data2=handcon_7, Data3=handcon_8, Data4=handcon_6)
name_2 = Panel("Part_02")
handdisp_2 = DisplayHandles(Handles=merge_2, DisplaySize=number_slider_2, absHTextSize=False)
aocon_2 = ConstructAssemblyObject(Name=name_2, CollisionMesh=mesh_2, Direction=Vector(1, 0, 0), Handles=merge_2, Weight=1, ZLockAO=False)

# ---- group: floor
mesh_3 = Mesh(<mesh referenced from the Rhino model>)

# ---- group: short wall 1
mesh_4 = Mesh(<mesh referenced from the Rhino model>)

# ---- group: short wall 2
mesh_5 = Mesh(<mesh referenced from the Rhino model>)

# ---- group: floor 1
mesh_6 = Mesh(<mesh referenced from the Rhino model>)

# ---- group: floor
mesh_7 = Mesh(<mesh referenced from the Rhino model>)

# ---- group: floor 2
mesh_8 = Mesh(<mesh referenced from the Rhino model>)

# ---- group: floor 3
mesh_9 = Mesh(<mesh referenced from the Rhino model>)

# ---- group: wall
mesh_10 = Mesh(<mesh referenced from the Rhino model>)

# ---- group: pillars
mesh_11 = Mesh([<mesh referenced from the Rhino model> x2])

# ----
# XData
merge_3 = Merge(Data1=mesh_7, Data2=mesh_10)
merge_4 = Merge(Data1=mesh_6, Data2=mesh_8, Data3=mesh_9, Data4=mesh_11)
mjoin = MeshJoin(Meshes=flatten(merge_3))
mjoin_2 = MeshJoin(Meshes=flatten(merge_4))
xdcon = ConstructXData(Label="geometryV", AssemblyObject=aocon_2, Data=mjoin_2)
xdcon_2 = ConstructXData(Label="geometryH", AssemblyObject=aocon_2, Data=mjoin)

# ----
# XData
merge_5 = Merge(Data1=mesh_3, Data2=mesh_4, Data3=mesh_5)
mjoin_3 = MeshJoin(Meshes=flatten(merge_5))
xdcon_3 = ConstructXData(Label="geometry1", AssemblyObject=aocon, Data=mjoin_3)

merge_6 = Merge(Data1=xdcon_2, Data2=xdcon)
merge_7 = Merge(Data1=aocon, Data2=aocon_2)
merge_8 = Merge(Data1=xdcon_3, Data2=merge_6)

# ---- group: origin point
pt = Point(Point(0, 20, 0))

# ----
# Rules (Heuristics)
heuwri = HeuristicsWriter(AssemblyObjectsSet=merge_7, noSH=False, noSO=False, xHT=False)
# Simulation
heud = HeuristicDisplay(
    OriginPoint=pt,
    AssemblyObjectsSet=merge_7,
    XData=merge_8,
    HeuristicsSet=heuwri,
    XSize=1.2,
    YSize=1.2,
    NRows=Slider(9, range=2..10),
    DisplayType="AO Types",
    ZLockFilter=False,
    OutputType="AO Types")

# ----
# Heuristics
# Settings
heuset = HeuristicsSettings(HeuristicsSet=heuwri, CurrentHeuristics=0, HeuristicsMode=0, ReceiverSelectionMode=0, SenderRuleSelectionMode=0)

step = Button()
target_number = Panel("1000")

# ----
# se si cambia qualcosa a monte (eccetto per gli XData) resettare l'engine
reset = Button()

# ---- group: starting plane (XY implicito)
pt_2 = Point(Point(-62.53285728, -28.21013159, 0))

# ----
aoaengine = AssemblerEngine(
    AssemblyObjectsSet=merge_7,
    StartingPlane=pt_2,
    StartingObjectType=0,
    HeuristicsSettings=heuset,
    Go=False,
    Step=step,
    NIterations=Slider(100, range=10..100),
    TargetMaxNObjects=target_number,
    ResetSettings=False,
    Reset=reset,
    UseSupports=False,
    ZLockCheck=False)  # -> Assemblage, AssemblageCount
n_of_ao = Panel(aoaengine.AssemblageCount)
# Post-processing
aoadisp = DisplayAssemblage(Assemblage=aoaengine.Assemblage, ColorsOnly=False, OutputType="AO Types")  # -> ColoredCollisionMeshes, Edges, Colors, Values
aoadecon = DeconstructAssemblage(Assemblage=aoaengine.Assemblage)  # -> AssemblageObjects, AssemblageRules, ReceiverObjectsIndexes, AvailableObjectIndexes, UnreachableObjectIndexes

# ----
# identify type 1 Horizontal-Vertical
data = Data(aoadecon.AssemblageObjects)

associate_xdata = AssociateXData(AssemblyObjects=aoadecon.AssemblageObjects, XData=merge_8)  # "AO<>XD"

# ---- group: identify type
aoetype = ExtractType(AssemblyObject=data)
equals = Equality(FirstNumber=aoetype, SecondNumber="1")  # -> Equality, Inequality

# ----
panel_10 = Panel(associate_xdata)

# ---- group: separate types
dispatch = Dispatch(List=data, DispatchPattern=equals.Equality)  # -> ListA, ListB

# ---- group: identify horizontal-vertical alignment
aoerplane = ExtractReferencePlane(AssemblyObject=dispatch.ListA)
deplane = DeconstructPlane(Plane=aoerplane)  # -> Origin, XAxis, YAxis, ZAxis
Z = UnitZ(Factor=1)
dprod = DotProduct(VectorA=deplane.XAxis, VectorB=Z, Unitize=False)
abs = Absolute(Value=dprod)

# ----
lng = ListLength(List=dispatch.ListB)
repeat = RepeatData(Data="0", Length=lng)

# ---- group: regroup types
weave = Weave(Pattern=equals.Equality, Stream0=repeat, Stream1=abs, NullGaps=False)

# ----
item = ListItem(List=associate_xdata, Index=weave, Wrap=True)
xddecon = DeconstructXData(XData=item)  # -> Label, AssemblyObjectNameReference, ReferencePlane, Data

# ----
# Utilizzate questo componente per fare il bake su Rhino
mesh_12 = Mesh(xddecon.Data)

# ----
# edges (bordi) delle collision Meshes
previewlw = CustomPreviewLineweights(Geometry=aoadisp.Edges, Shader=ColourSwatch(SwatchColor=RGB(128, 128, 128)), Absolute=False)

f_mmeea = MeshesExtractEdgesWithToleranceAngle(Mesh=mesh_12, Angle=45)  # -> InternalEdges, NakedEdges
# visualizzazione delle geometrie effettive
# edges (bordi) delle geometrie effettive
previewlw_2 = CustomPreviewLineweights(Geometry=[f_mmeea.InternalEdges, f_mmeea.NakedEdges], Shader=ColourSwatch(SwatchColor=RGB(0, 0, 0)), Absolute=False)

preview = CustomPreview(Geometry=mesh_12, Material=graft(aoadisp.Colors))
