# Grasshopper definition base part_2 AO_env-Field-iWeight - find rule.gh (Grasshopper 1.0.7)
# Copyright: Co-de-iT
# plug-ins: Assembler, Human, froGH

# ----
# Handles
# Handle che sembrano visivamente identiche potrebbero non esserlo: la normale potrebbe puntare all'interno della Collision Mesh.
# 
# In questi casi, potete usare il comando "Flip" in Rhino per invertire il verso della polilinea.
crv = Curve(<curve referenced from the Rhino model>)
crv_2 = Curve(<curve referenced from the Rhino model>)
# 0
# 1
crv_3 = Curve(<curve referenced from the Rhino model>)
# parti editabili
# Setup
# bake
# preview on/off
# nel disegnare le L polylines per le Handles la sequenza dei punti è fondamentale, e deve essere fatta in modo che la normale sia sempre USCENTE relativamente alla Collision Mesh
# 2
crv_4 = Curve(<curve referenced from the Rhino model>)
# Il componente Display Handle visualizza la normale come una linea nera puntinata. Utilizzatelo per verificate la direzione della normale
crv_5 = Curve(<curve referenced from the Rhino model>)
panel = Panel("""0
90""")
handcon = ConstructHandle(Polyline=crv, RotationAngles=0, Type="1", Weight=1)
handcon_2 = ConstructHandle(Polyline=crv_2, RotationAngles=0, Type="1", Weight=1)
handcon_3 = ConstructHandle(Polyline=crv_3, RotationAngles=0, Type=0, Weight=1)
handcon_4 = ConstructHandle(Polyline=crv_5, RotationAngles=0, Type=0, Weight=1)
handcon_5 = ConstructHandle(Polyline=crv_4, RotationAngles=0, Type=0, Weight=1)

# ----
# Handles
crv_6 = Curve(<curve referenced from the Rhino model>)
crv_7 = Curve(<curve referenced from the Rhino model>)
crv_8 = Curve(<curve referenced from the Rhino model>)
crv_9 = Curve(<curve referenced from the Rhino model>)
panel_6 = Panel("""0
180""")
handcon_6 = ConstructHandle(Polyline=crv_6, RotationAngles=panel_6, Type="2", Weight=1)
handcon_7 = ConstructHandle(Polyline=crv_7, RotationAngles=0, Type=0, Weight=1)
handcon_8 = ConstructHandle(Polyline=crv_9, RotationAngles=0, Type=0, Weight=1)
handcon_9 = ConstructHandle(Polyline=crv_8, RotationAngles=0, Type=0, Weight=1)

# ----
# Environment
mesh = Mesh(<mesh referenced from the Rhino model>)
mesh_2 = Mesh(<mesh referenced from the Rhino model>)
mesh_3 = Mesh(<mesh referenced from the Rhino model>)
mesh_4 = Mesh(<mesh referenced from the Rhino model>)
mesh_5 = Mesh(<mesh referenced from the Rhino model>)
merge = Merge(Data1=mesh_2, Data2=mesh_3, Data3=mesh_5, Data4=mesh, Data5=mesh_4)

crv_10 = Curve(<curve referenced from the Rhino model>)
crv_11 = Curve(<curve referenced from the Rhino model>)
crv_12 = Curve(<curve referenced from the Rhino model>)

# ---- group: Field box
mesh_6 = Mesh(<mesh referenced from the Rhino model>)

# ---- group: compute scalar values / Scalar values curve
crv_13 = Curve(crv_12)

# ----
previewlw = CustomPreviewLineweights(Geometry=crv_13, Shader=ColourSwatch(SwatchColor=RGB(255, 0, 255)), Thickness="5", Absolute=False)

# ----
# Collision mesh (spazio occupato)
mesh_7 = Mesh(<mesh referenced from the Rhino model>)

# ----
# AssemblyObject 01
number_slider = Slider(0.355, range=0..1)
merge_2 = Merge(Data1=handcon_5, Data2=handcon_3, Data3=handcon_4, Data4=handcon_2, Data5=handcon)
# <title>
# 
# <description>
# 
# code by Alessio Erioli
# 
# v 0.1
# © a3 2021 / Creative Commons Attribution-Non Commercial-ShareAlike 4.0 International License
name = Panel("Part_01")
handdisp = DisplayHandles(Handles=merge_2, DisplaySize=number_slider, absHTextSize=False)
aocon = ConstructAssemblyObject(Name=name, CollisionMesh=mesh_7, Direction=Vector(1, 0, 0), Handles=merge_2, Weight=1, ZLockAO=False)

# ----
# Collision mesh (spazio occupato)
mesh_8 = Mesh(<mesh referenced from the Rhino model>)

# ----
# AssemblyObject 02
number_slider_2 = Slider(0.355, range=0..1)
merge_3 = Merge(Data1=handcon_9, Data2=handcon_7, Data3=handcon_8, Data4=handcon_6)
name_2 = Panel("Part_02")
handdisp_2 = DisplayHandles(Handles=merge_3, DisplaySize=number_slider_2, absHTextSize=False)
aocon_2 = ConstructAssemblyObject(Name=name_2, CollisionMesh=mesh_8, Direction=Vector(1, 0, 0), Handles=merge_3, Weight=1, ZLockAO=False)

# ---- group: floor
mesh_9 = Mesh(<mesh referenced from the Rhino model>)

# ---- group: short wall 1
mesh_10 = Mesh(<mesh referenced from the Rhino model>)

# ---- group: short wall 2
mesh_11 = Mesh(<mesh referenced from the Rhino model>)

# ---- group: floor 1
mesh_12 = Mesh(<mesh referenced from the Rhino model>)

# ---- group: floor
mesh_13 = Mesh(<mesh referenced from the Rhino model>)

# ---- group: floor 2
mesh_14 = Mesh(<mesh referenced from the Rhino model>)

# ---- group: floor 3
mesh_15 = Mesh(<mesh referenced from the Rhino model>)

# ---- group: wall
mesh_16 = Mesh(<mesh referenced from the Rhino model>)

# ---- group: pillars
mesh_17 = Mesh([<mesh referenced from the Rhino model> x2])

# ----
# XData
merge_4 = Merge(Data1=mesh_13, Data2=mesh_16)
merge_5 = Merge(Data1=mesh_12, Data2=mesh_14, Data3=mesh_15, Data4=mesh_17)
mjoin = MeshJoin(Meshes=flatten(merge_4))
mjoin_2 = MeshJoin(Meshes=flatten(merge_5))
xdcon = ConstructXData(Label="geometryV", AssemblyObject=aocon_2, Data=mjoin_2)
xdcon_2 = ConstructXData(Label="geometryH", AssemblyObject=aocon_2, Data=mjoin)

# ----
# XData
merge_6 = Merge(Data1=mesh_9, Data2=mesh_10, Data3=mesh_11)
mjoin_3 = MeshJoin(Meshes=flatten(merge_6))
xdcon_3 = ConstructXData(Label="geometry1", AssemblyObject=aocon, Data=mjoin_3)

merge_7 = Merge(Data1=xdcon_2, Data2=xdcon)
swatch = ColourSwatch(SwatchColor=RGBA(204, 204, 204, 75))
merge_8 = Merge(Data1=aocon)
merge_9 = Merge(Data1=xdcon_3, Data2=merge_7)

# ----
# define criteria to create multiple Rules Sets (1 for each iWeight value).
# 
# Make a Heuristic Tree Set using Entwine
entwine = Entwine(FlattenInputs=True)

# ---- group: origin point
pt = Point(Point(0, 20, 0))

# ----
# Rules (Heuristics)
heuwri = HeuristicsWriter(AssemblyObjectsSet=merge_8, noSH=False, noSO=False, xHT=False)
# Simulation
heud = HeuristicDisplay(
    OriginPoint=pt,
    AssemblyObjectsSet=merge_8,
    XData=merge_9,
    HeuristicsSet=heuwri,
    XSize=1.2,
    YSize=1.2,
    NRows=Slider(5, range=2..10),
    DisplayType="AO Types",
    ZLockFilter=False,
    OutputType="AO Types")

split = SplitList(List=heuwri, Index="9")  # -> ListA, ListB
item = ListItem(List=heuwri, Index="4", Wrap=True)
merge_10 = Merge(Data1=split.ListB, Data2=item)  # -> flatten(Result)
entwine_2 = Entwine(Branch00=split.ListA, Branch01=merge_10, FlattenInputs=True)

# ----
# Heuristics
# Settings
sender_selection_mode = ValueList({"Random": 0, "Scalar Field nearest": 1, "Scalar Field interpolated": 2, "Vector Field > nearest": 3, "Vector Field > interpolated": 4, "Vector Field <> nearest": 5, "Vector Field <> interpolated": 6, "Minimum local AABB volume": 7, "Minimum local AABB diagonal": 8, "Weighted Random Choice": 9}, selected="Vector Field <> nearest")
receiver_selection_mode = ValueList({"Random": 0, "Scalar Field nearest": 1, "Scalar Field interpolated": 2, "Dense Packing": 3}, selected="Scalar Field nearest")
heuristics_mode = ValueList({"manual": 0, "Field driven": 1}, selected="Field driven")
heuset = HeuristicsSettings(
    HeuristicsSet=entwine_2,
    CurrentHeuristics=0,
    HeuristicsMode=heuristics_mode,
    ReceiverSelectionMode=receiver_selection_mode,
    SenderRuleSelectionMode=sender_selection_mode)

# ----
# display environment geometries names
# IMPORTANT: Objects must be named in Rhino
cluster = Cluster(environment_geometries=merge)

step = Button()
go = BooleanToggle(False)
target_number = Panel("2000")

reset_settings = Button()

# ---- group: starting plane (XY implicito)
pt_2 = Point(Point(-62.53285728, -28.21013159, 0))

# ----
# se si cambia qualcosa a monte (eccetto per gli XData) resettare l'engine
reset = Button()

# ----
# Field
number_slider_3 = Slider(20, range=10..30)
afieldn = ConstructFieldN(Geometry=mesh_6, Plane=PlaneXY(0, 0, 0), NCells=number_slider_3)  # -> Field, FieldPoints
merge_11 = Merge(Data1=ColourSwatch(SwatchColor=RGB(255, 0, 255)), Data2=ColourSwatch(SwatchColor=RGB(0, 0, 0)))

# ---- group: compute vector values
pdecon = Deconstruct(Point=afieldn.FieldPoints)  # -> XComponent, YComponent, ZComponent
larger = LargerThan(FirstNumber=pdecon.ZComponent, SecondNumber=Slider(35.544, range=0..100))  # -> LargerThan, OrEqualTo
Y = UnitY(Factor=1)
X = UnitX(Factor=1)
weave = Weave(Pattern=graft(larger.LargerThan), Stream0=Y, Stream1=X, NullGaps=False)  # -> flatten(Weave)

# ---- group: iWeights
pt_3 = Point(Point(-55.06715, -64.95677007, 0))
pt_4 = Point(Point(-87.52231766, 96.04004555, 92.07695168))
panel_10 = Panel("""Red
Blue""")
merge_12 = Merge(Data1=pt_3, Data2=pt_4)
cp = ClosestPoint(Point=afieldn.FieldPoints, Cloud=merge_12)  # -> ClosestPoint, CPIndex, Distance
dots = DotDisplay(Point=merge_12, Colour=panel_10, Size=Slider(2, range=1..5))

# ---- group: compute scalar values
crv_cp = CurveClosestPoint(Point=afieldn.FieldPoints, Curve=crv_13)  # -> Point, Parameter, Distance

# ----
sqr = Square(Value=crv_cp.Distance)
sqrt = SquareRoot(Value=crv_cp.Distance)

afpop = PopulateField(Field=afieldn.Field, ScalarValues=sqrt, VectorValues=weave, IWeightValues=cp.CPIndex)

# ----
# Exogenous
# (environment)
# Settings
field_scalar_threshold = Slider(0.5, range=0..1)

afcol = ColorField(Field=afpop, Colors=merge_11, Index=0, Threshold=field_scalar_threshold, FieldColorBlend=False)  # -> Field, Colors
afdecon = DeconstructField(Field=afcol.Field)  # -> Points, flatten(ScalarValues), flatten(Vectors), flatten(IWeights), Colors, Topology, TopologyWeights
multiplication = Multiplication(A=afdecon.Vectors, B=Slider(3.63, range=1..5))
vdisex = VectorDisplayEx(Point=afdecon.Points, Vector=multiplication, Colour=afdecon.Vectors, Width=2)

# ---- group: Text Scalar
expression = Expression(x=afdecon.ScalarValues, Expression="Format(\"{0:0.00}\", x)")
tag = TextTag3D(Location=afdecon.Points, Text=expression, Size=Slider(1.5, range=1..3), Justification=7)  # disabled

# ---- group: Text iWeights
item_2 = ListItem(List=panel_10, Index=afdecon.IWeights, Wrap=True)
tag_2 = TextTag3D(Location=afdecon.Points, Text=afdecon.IWeights, Size=Slider(2, range=1..3), Colour=item_2, Justification=7)

# ----
exoset = ExogenousSettings(
    EnvironmentMode="2",
    Field=afcol.Field,
    FieldScalarThreshold=field_scalar_threshold,
    Sandbox={Plane=PlaneXY(0, 0, 0), X=Domain(-1, 1), Y=Domain(0, 0), Z=Domain(0, 0)},
    HasContainer=False)

aoaengine = AssemblerEngine(
    AssemblyObjectsSet=merge_8,
    StartingPlane=pt_2,
    StartingObjectType=0,
    HeuristicsSettings=heuset,
    ExogenousSettings=exoset,
    Go=go,
    Step=step,
    NIterations=Slider(100, range=10..100),
    TargetMaxNObjects=target_number,
    ResetSettings=reset_settings,
    Reset=reset,
    UseSupports=False,
    ZLockCheck=False)  # -> Assemblage, AssemblageCount

# ---- group: autostop condition
larger_2 = LargerThan(FirstNumber=aoaengine.AssemblageCount, SecondNumber=target_number)  # -> LargerThan, OrEqualTo
f_tas = ToggleAutostop(Toggle=go, Condition=larger_2.OrEqualTo)

# ----
n_of_ao = Panel(aoaengine.AssemblageCount)
aoadecon = DeconstructAssemblage(Assemblage=aoaengine.Assemblage)  # -> AssemblageObjects, AssemblageRules, ReceiverObjectsIndexes, AvailableObjectIndexes, UnreachableObjectIndexes
# Post-processing
aoadisp = DisplayAssemblage(Assemblage=aoaengine.Assemblage, ColorsOnly=False, OutputType="Objects")  # -> ColoredCollisionMeshes, Edges, Colors, Values

lng = ListLength(List=heuwri)
subtraction = Subtraction(A=lng, B="1")
multiplication_2 = Multiplication(A=subtraction, B=Slider(0.889, range=0..1))
int = Integer(multiplication_2)
item_3 = ListItem(List=heuwri, Index=int, Wrap=True)
panel_11 = Panel(int)
aoadecon_2 = DeconstructAssemblage(Assemblage=aoaengine.Assemblage)  # -> AssemblageObjects, AssemblageRules, ReceiverObjectsIndexes, AvailableObjectIndexes, UnreachableObjectIndexes
rule_observed = Panel(item_3)
tstat = TreeStatistics(Tree=aoadecon_2.AssemblageRules)  # -> Paths, Length, Count
tmatch = MatchText(Text=aoadecon_2.AssemblageRules, Pattern=item_3, Case=True)
cull = CullPattern(List=tstat.Paths, CullPattern=flatten(tmatch))
branch = TreeBranch(Tree=aoadecon_2.ReceiverObjectsIndexes, Path=cull, MaintainPaths=True)  # -> flatten(Branch)
isolate_aos = BooleanToggle(False)
sift = SiftPattern(List=aoadisp.Colors, SiftPattern=isolate_aos)  # -> Output0, Output1

associate_xdata = AssociateXData(AssemblyObjects=aoadecon.AssemblageObjects, XData=merge_9)  # "AO<>XD"

# ---- group: color senders
lng_2 = ListLength(List=cull)
dpath = DeconstructPath(Branch=cull)  # -> flatten(Indices)
repeat = RepeatData(Data=ColourSwatch(SwatchColor=RGB(199, 160, 32)), Length=lng_2)
replace = ReplaceItems(List=sift.Output0, Item=repeat, Indices=dpath, Wrap=False)

# ---- group: AOs / senders
branch_2 = TreeBranch(Tree=aoadecon_2.AssemblageObjects, Path=cull, MaintainPaths=True)

# ---- group: AOs / receivers
branch_3 = TreeBranch(Tree=aoadecon_2.AssemblageObjects, Path=branch, MaintainPaths=True)

# ----
preview = CustomPreview(
    Geometry=aoadisp.ColoredCollisionMeshes,
    Material={diffuse=RGB(221, 160, 221), emission=RGB(66, 48, 66), shine=0.5, specular=RGB(255, 255, 255), transparency=0})  # disabled
# edges (bordi) delle collision Meshes
previewlw_2 = CustomPreviewLineweights(Geometry=aoadisp.Edges, Shader=ColourSwatch(SwatchColor=RGB(128, 128, 128)), Absolute=False)

# ----
# identify type 1 Horizontal-Vertical
data = Data(aoadecon.AssemblageObjects)

# ---- group: identify type
aoetype = ExtractType(AssemblyObject=data)
equals = Equality(FirstNumber=aoetype, SecondNumber="1")  # -> Equality, Inequality

# ---- group: separate types
dispatch = Dispatch(List=data, DispatchPattern=equals.Equality)  # -> ListA, ListB

# ---- group: identify horizontal-vertical alignment
aoerplane = ExtractReferencePlane(AssemblyObject=dispatch.ListA)
deplane = DeconstructPlane(Plane=aoerplane)  # -> Origin, XAxis, YAxis, ZAxis
Z = UnitZ(Factor=1)
dprod = DotProduct(VectorA=deplane.XAxis, VectorB=Z, Unitize=False)
abs = Absolute(Value=dprod)

# ----
lng_3 = ListLength(List=dispatch.ListB)
repeat_2 = RepeatData(Data="0", Length=lng_3)

# ---- group: regroup types
weave_2 = Weave(Pattern=equals.Equality, Stream0=repeat_2, Stream1=abs, NullGaps=False)

# ----
item_4 = ListItem(List=associate_xdata, Index=weave_2, Wrap=True)
xddecon = DeconstructXData(XData=item_4)  # -> Label, AssemblyObjectNameReference, ReferencePlane, Data

# ----
# Utilizzate questo componente per fare il bake su Rhino
mesh_18 = Mesh(xddecon.Data)

f_mmeea = MeshesExtractEdgesWithToleranceAngle(Mesh=mesh_18, Angle=45)  # -> InternalEdges, NakedEdges
# edges (bordi) delle geometrie effettive
previewlw_3 = CustomPreviewLineweights(Geometry=[f_mmeea.InternalEdges, f_mmeea.NakedEdges], Shader=ColourSwatch(SwatchColor=RGB(0, 0, 0)), Absolute=False)

# ---- group: color receivers
lng_4 = ListLength(List=branch)
repeat_3 = RepeatData(Data=ColourSwatch(SwatchColor=RGB(91, 112, 138)), Length=lng_4)

# ---- group: color receivers / components that have been both s & r
mindex = MemberIndex(Set=dpath, Member=branch)  # -> Index, Count
larger_3 = LargerThan(FirstNumber=mindex.Count, SecondNumber="0")  # -> LargerThan, OrEqualTo
weave_3 = Weave(
    Pattern=graft(larger_3.LargerThan),
    Stream0=graft(repeat_3),
    Stream1=ColourSwatch(SwatchColor=RGB(153, 124, 137)),
    NullGaps=False)  # -> flatten(Weave)

# ---- group: color receivers (continued)
replace_2 = ReplaceItems(List=replace, Item=weave_3, Indices=branch, Wrap=False)

# ----
# visualizzazione delle geometrie effettive
preview_2 = CustomPreview(Geometry=mesh_18, Material=graft(replace_2))

# ==== cluster Cluster
environment_geometries = ClusterInput()

# ----
# display environment geometries names
# IMPORTANT: Objects must be named in Rhino
# This component from Human gets object attributes (name, layer, color)
objatts = ObjectAttributes(ObjectOrAttributes=environment_geometries)  # -> Name, LayerName, LayerFullPath, Color, MaterialName, LinetypeName, GroupIndices, PlotWeight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

# ----
# If an object is a void (if it's in the "voids" layer), flips the mesh before computing volume (otherwise the centroid is out of place)
panel = Panel("voids")
tmatch = MatchText(Text=objatts.LayerName, Pattern=panel, Case=True)
dispatch = Dispatch(List=environment_geometries, DispatchPattern=tmatch)  # -> ListA, ListB
flip = MeshFlip(Mesh=dispatch.ListA)
weave = Weave(Pattern=tmatch, Stream0=dispatch.ListB, Stream1=flip, NullGaps=False)

volume = Volume(Geometry=weave)  # -> Volume, Centroid

tag = TextTag(Location=volume.Centroid, Text=objatts.Name, Colour=objatts.Color)
