# Grasshopper definition base part_2 AO_Handle compatibility-evolved XData choice 2.gh (Grasshopper 1.0.7)
# Copyright: Co-de-iT
# plug-ins: Assembler, Human, froGH

# ----
# Handles
crv = Curve([<curve referenced from the Rhino model> x2])
# Handle che sembrano visivamente identiche potrebbero non esserlo: la normale potrebbe puntare all'interno della Collision Mesh.
# 
# In questi casi, potete usare il comando "Flip" in Rhino per invertire il verso della polilinea.
crv_2 = Curve([<curve referenced from the Rhino model> x2])
# 0
# 1
crv_3 = Curve(<curve referenced from the Rhino model>)
# parti editabili
# Setup
# bake
# preview on/off
# nel disegnare le L polylines per le Handles la sequenza dei punti è fondamentale, e deve essere fatta in modo che la normale sia sempre USCENTE relativamente alla Collision Mesh
# 2
crv_4 = Curve(<curve referenced from the Rhino model>)
# Il componente Display Handle visualizza la normale come una linea nera puntinata. Utilizzatelo per verificate la direzione della normale
crv_5 = Curve(<curve referenced from the Rhino model>)
panel = Panel("""0
90""")
panel_2 = Panel("""0
90""")
panel_3 = Panel("""0
90""")
handcon = ConstructHandle(Polyline=crv, RotationAngles=panel, Type="1", Weight=1)
handcon_2 = ConstructHandle(Polyline=crv_2, RotationAngles=panel_2, Type="2", Weight=1)
handcon_3 = ConstructHandle(Polyline=crv_3, RotationAngles=0, Type=0, Weight=1)
handcon_4 = ConstructHandle(Polyline=crv_5, RotationAngles=0, Type=0, Weight=1)
handcon_5 = ConstructHandle(Polyline=crv_4, RotationAngles=0, Type=0, Weight=1)

# ----
# Handles
crv_6 = Curve(<curve referenced from the Rhino model>)
crv_7 = Curve(<curve referenced from the Rhino model>)
crv_8 = Curve(<curve referenced from the Rhino model>)
crv_9 = Curve(<curve referenced from the Rhino model>)
panel_6 = Panel("""0
180""")
handcon_6 = ConstructHandle(Polyline=crv_6, RotationAngles=panel_6, Type="3", Weight=1)
handcon_7 = ConstructHandle(Polyline=crv_7, RotationAngles=0, Type=0, Weight=1)
handcon_8 = ConstructHandle(Polyline=crv_9, RotationAngles=0, Type=0, Weight=1)
handcon_9 = ConstructHandle(Polyline=crv_8, RotationAngles=0, Type=0, Weight=1)

# ----
# Environment
mesh = Mesh(<mesh referenced from the Rhino model>)
mesh_2 = Mesh(<mesh referenced from the Rhino model>)
mesh_3 = Mesh(<mesh referenced from the Rhino model>)
mesh_4 = Mesh(<mesh referenced from the Rhino model>)
mesh_5 = Mesh(<mesh referenced from the Rhino model>)
merge = Merge(Data1=mesh_2, Data2=mesh_3, Data3=mesh_5, Data4=mesh, Data5=mesh_4)

crv_10 = Curve(<curve referenced from the Rhino model>)
crv_11 = Curve(<curve referenced from the Rhino model>)
crv_12 = Curve(<curve referenced from the Rhino model>)

# ---- group: Field box
mesh_6 = Mesh(<mesh referenced from the Rhino model>)

# ---- group: compute scalar values / Scalar values curve
crv_13 = Curve(crv_10)

# ----
previewlw = CustomPreviewLineweights(Geometry=crv_13, Shader=ColourSwatch(SwatchColor=RGB(255, 0, 255)), Thickness="5", Absolute=False)

# ----
# Collision mesh (spazio occupato)
mesh_7 = Mesh(<mesh referenced from the Rhino model>)

# ----
# AssemblyObject 01
number_slider = Slider(0.355, range=0..1)
merge_2 = Merge(Data1=handcon_5, Data2=handcon_3, Data3=handcon_4, Data4=handcon_2, Data5=handcon)
# <title>
# 
# <description>
# 
# code by Alessio Erioli
# 
# v 0.1
# © a3 2021 / Creative Commons Attribution-Non Commercial-ShareAlike 4.0 International License
name = Panel("Part_01")
handdisp = DisplayHandles(Handles=merge_2, DisplaySize=number_slider, absHTextSize=False)
aocon = ConstructAssemblyObject(Name=name, CollisionMesh=mesh_7, Direction=Vector(1, 0, 0), Handles=merge_2, Weight=1, ZLockAO=False)

# ----
# Collision mesh (spazio occupato)
mesh_8 = Mesh(<mesh referenced from the Rhino model>)

# ----
# AssemblyObject 02
number_slider_2 = Slider(0.355, range=0..1)
merge_3 = Merge(Data1=handcon_9, Data2=handcon_7, Data3=handcon_8, Data4=handcon_6)
name_2 = Panel("Part_02")
handdisp_2 = DisplayHandles(Handles=merge_3, DisplaySize=number_slider_2, absHTextSize=False)
aocon_2 = ConstructAssemblyObject(Name=name_2, CollisionMesh=mesh_8, Direction=Vector(1, 0, 0), Handles=merge_3, Weight=1, ZLockAO=False)

# ---- group: config c1
mesh_9 = Mesh([<mesh referenced from the Rhino model> x26])

# ---- group: config c2
mesh_10 = Mesh([<mesh referenced from the Rhino model> x13])

# ---- group: floor
mesh_11 = Mesh(<mesh referenced from the Rhino model>)

# ---- group: short wall 1
mesh_12 = Mesh(<mesh referenced from the Rhino model>)

# ---- group: short wall 2
mesh_13 = Mesh(<mesh referenced from the Rhino model>)

# ---- group: floor 1
mesh_14 = Mesh(<mesh referenced from the Rhino model>)

# ---- group: floor
mesh_15 = Mesh(<mesh referenced from the Rhino model>)

# ---- group: floor 2
mesh_16 = Mesh(<mesh referenced from the Rhino model>)

# ---- group: floor 3
mesh_17 = Mesh(<mesh referenced from the Rhino model>)

# ---- group: wall
mesh_18 = Mesh(<mesh referenced from the Rhino model>)

# ---- group: pillars
mesh_19 = Mesh([<mesh referenced from the Rhino model> x2])

# ----
# XData
merge_4 = Merge(Data1=mesh_11, Data2=mesh_12, Data3=mesh_13)
mjoin = MeshJoin(Meshes=flatten(merge_4))
xdcon = ConstructXData(Label="geometry1", AssemblyObject=aocon, Data=mjoin)
xdcon_2 = ConstructXData(Label="c1", AssemblyObject=aocon, Data=mesh_9)
xdcon_3 = ConstructXData(Label="c2", AssemblyObject=aocon, Data=mesh_10)

# ----
# XData
merge_5 = Merge(Data1=mesh_15, Data2=mesh_18)
merge_6 = Merge(Data1=mesh_14, Data2=mesh_16, Data3=mesh_17, Data4=mesh_19)
mjoin_2 = MeshJoin(Meshes=flatten(merge_5))
mjoin_3 = MeshJoin(Meshes=flatten(merge_6))
xdcon_4 = ConstructXData(Label="geometryV", AssemblyObject=aocon_2, Data=mjoin_3)
xdcon_5 = ConstructXData(Label="geometryH", AssemblyObject=aocon_2, Data=mjoin_2)

merge_7 = Merge(Data1=xdcon_5, Data2=xdcon_4)
swatch = ColourSwatch(SwatchColor=RGBA(204, 204, 204, 75))
merge_8 = Merge(Data1=aocon, Data2=aocon_2)
merge_9 = Merge(Data1=xdcon, Data2=xdcon_2, Data3=xdcon_3, Data4=merge_7)

# ---- group: Handle compatibility
# 0<0 means type 0 can receive type 0
# 1<2 means type 1 can receive type 2
# 
# These rules take precedence over single-type compatibility. In this case type 1 cannot receive itself!
panel_10 = Panel("""0<0
1<2
2<1
3<3""")

# ---- group: origin point
pt = Point(Point(0, 20, 0))

# ----
# Rules (Heuristics)
heuwri = HeuristicsWriter(AssemblyObjectsSet=merge_8, HandleCompatibility=panel_10, noSH=False, noSO=False, xHT=False)
# Simulation
heud = HeuristicDisplay(
    OriginPoint=pt,
    AssemblyObjectsSet=merge_8,
    XData=merge_9,
    HeuristicsSet=heuwri,
    XSize=1.2,
    YSize=1.2,
    NRows=Slider(5, range=2..10),
    DisplayType="AO Types",
    ZLockFilter=False,
    OutputType="AO Types")

# ----
# Heuristics
# Settings
sender_selection_mode = ValueList({"Random": 0, "Scalar Field nearest": 1, "Scalar Field interpolated": 2, "Vector Field > nearest": 3, "Vector Field > interpolated": 4, "Vector Field <> nearest": 5, "Vector Field <> interpolated": 6, "Minimum local AABB volume": 7, "Minimum local AABB diagonal": 8, "Weighted Random Choice": 9}, selected="Vector Field > nearest")
receiver_selection_mode = ValueList({"Random": 0, "Scalar Field nearest": 1, "Scalar Field interpolated": 2, "Dense Packing": 3}, selected="Scalar Field nearest")
heuset = HeuristicsSettings(
    HeuristicsSet=heuwri,
    CurrentHeuristics=0,
    HeuristicsMode=0,
    ReceiverSelectionMode=receiver_selection_mode,
    SenderRuleSelectionMode=sender_selection_mode)

# ----
# display environment geometries names
# IMPORTANT: Objects must be named in Rhino
cluster = Cluster(environment_geometries=merge)

step = Button()
go = BooleanToggle(False)
target_number = Panel("2000")

reset_settings = Button()

# ---- group: starting plane (XY implicito)
pt_2 = Point(Point(-62.53285728, -28.21013159, 0))

# ----
# se si cambia qualcosa a monte (eccetto per gli XData) resettare l'engine
reset = Button()

# ---- group: Orientation Colour Legend
# Post-processing
# Orientation Display: Orientation colors components according to their Direction Vector (input D in Construct AO)
# 
# Colors are represented as RGB (Red, Green, Blue channels), with values from 0 to 255 for each channel.
# 
# Direction vectors coordinates range from -1 to 1. Es: 1,0,0 is the X direction vector, 0,0,-1 is the negative Z direction.
# 
# Colors use the x, y, z coordinates as R, G, B respectively, with coordinate -1 corresponding to a color value of 0 and 1 to 255; 0 corresponds to 128.
# 
# Ex: the direction vector X is translated into the color 255, 128, 128 (salmon red), while -X is 0, 128, 128 (blue-green).
image = ImageSampler(
    FilePath="C:\Users\aless\Documents\_Università\a3\a3 2023-24\_GitHub copy\code\20231031_c05_GH-Assembler 3\Orientation Colour legend.png",
    Filter="Colour",
    Interpolate=False,
    Umax=1,
    Umin=0,
    Vmax=1,
    Vmin=0,
    Wrap=1)

# ---- group: colors by XData type / colors for AO type 0
geometry_1 = ColourSwatch(SwatchColor=RGB(71, 0, 0))
c1 = ColourSwatch(SwatchColor=RGB(255, 0, 0))
c2 = ColourSwatch(SwatchColor=RGB(255, 186, 186))
merge_10 = Merge(Data1=geometry_1, Data2=c1, Data3=c2)

# ---- group: colors by XData type / color for AO type 1
horizontal = ColourSwatch(SwatchColor=RGB(0, 45, 71))
vertical = ColourSwatch(SwatchColor=RGB(0, 185, 209))
merge_11 = Merge(Data1=horizontal, Data2=vertical)

# ----
list = ValueList({"from Assembler": 0, "by XData option": 1}, selected="by XData option")

# ----
# Field
number_slider_3 = Slider(20, range=10..30)
afieldn = ConstructFieldN(Geometry=mesh_6, Plane=PlaneXY(0, 0, 0), NCells=number_slider_3)  # -> Field, FieldPoints
merge_12 = Merge(Data1=ColourSwatch(SwatchColor=RGB(255, 0, 255)), Data2=ColourSwatch(SwatchColor=RGB(0, 0, 0)))

# ---- group: compute vector values
pdecon = Deconstruct(Point=afieldn.FieldPoints)  # -> XComponent, YComponent, ZComponent
larger = LargerThan(FirstNumber=pdecon.ZComponent, SecondNumber=Slider(35.544, range=0..100))  # -> LargerThan, OrEqualTo
Y = UnitY(Factor=1)
X = UnitX(Factor=1)
weave = Weave(Pattern=graft(larger.LargerThan), Stream0=Y, Stream1=X, NullGaps=False)  # -> flatten(Weave)

# ---- group: compute scalar values
crv_cp = CurveClosestPoint(Point=afieldn.FieldPoints, Curve=crv_13)  # -> Point, Parameter, Distance

# ----
sqr = Square(Value=crv_cp.Distance)
sqrt = SquareRoot(Value=crv_cp.Distance)

afpop = PopulateField(Field=afieldn.Field, ScalarValues=sqrt, VectorValues=weave)

# ----
# Exogenous
# (environment)
# Settings
field_scalar_threshold = Slider(0.5, range=0..1)

afcol = ColorField(Field=afpop, Colors=merge_12, Index=0, Threshold=field_scalar_threshold, FieldColorBlend=False)  # -> Field, Colors
afdecon = DeconstructField(Field=afcol.Field)  # -> Points, flatten(ScalarValues), flatten(Vectors), IWeights, Colors, Topology, TopologyWeights
multiplication = Multiplication(A=afdecon.Vectors, B=Slider(3.63, range=1..5))
vdisex = VectorDisplayEx(Point=afdecon.Points, Vector=multiplication, Colour=afdecon.Vectors, Width=2)

# ---- group: Text Scalar
expression = Expression(x=afdecon.ScalarValues, Expression="Format(\"{0:0.00}\", x)")
tag = TextTag3D(Location=afdecon.Points, Text=expression, Size=Slider(1.5, range=1..3), Justification=7)  # disabled

# ----
exoset = ExogenousSettings(
    EnvironmentMode="2",
    Field=afcol.Field,
    FieldScalarThreshold=field_scalar_threshold,
    Sandbox={Plane=PlaneXY(0, 0, 0), X=Domain(-1, 1), Y=Domain(0, 0), Z=Domain(0, 0)},
    HasContainer=False)

aoaengine = AssemblerEngine(
    AssemblyObjectsSet=merge_8,
    StartingPlane=pt_2,
    StartingObjectType=0,
    HeuristicsSettings=heuset,
    ExogenousSettings=exoset,
    Go=go,
    Step=step,
    NIterations=Slider(100, range=10..100),
    TargetMaxNObjects=target_number,
    ResetSettings=reset_settings,
    Reset=reset,
    UseSupports=False,
    ZLockCheck=False)  # -> Assemblage, AssemblageCount

# ---- group: autostop condition
larger_2 = LargerThan(FirstNumber=aoaengine.AssemblageCount, SecondNumber=target_number)  # -> LargerThan, OrEqualTo
f_tas = ToggleAutostop(Toggle=go, Condition=larger_2.OrEqualTo)

# ----
n_of_ao = Panel(aoaengine.AssemblageCount)
aoadisp = DisplayAssemblage(Assemblage=aoaengine.Assemblage, ColorsOnly=False, OutputType="Objects")  # -> ColoredCollisionMeshes, Edges, Colors, Values
aoadecon = DeconstructAssemblage(Assemblage=aoaengine.Assemblage)  # -> AssemblageObjects, AssemblageRules, ReceiverObjectsIndexes, AvailableObjectIndexes, UnreachableObjectIndexes
associate_xdata = AssociateXData(AssemblyObjects=aoadecon.AssemblageObjects, XData=merge_9)  # "AO<>XD"

preview = CustomPreview(
    Geometry=aoadisp.ColoredCollisionMeshes,
    Material={diffuse=RGB(221, 160, 221), emission=RGB(66, 48, 66), shine=0.5, specular=RGB(255, 255, 255), transparency=0})  # disabled
# edges (bordi) delle collision Meshes
previewlw_2 = CustomPreviewLineweights(Geometry=aoadisp.Edges, Shader=ColourSwatch(SwatchColor=RGB(128, 128, 128)), Absolute=False)

# ---- group: check if certain Handles are occupied
panel_11 = Panel("""3
4
5
6""")

# ----
# identify type 1 Horizontal-Vertical
data = Data(aoadecon.AssemblageObjects)

# ---- group: identify type
aoetype = ExtractType(AssemblyObject=data)
equals = Equality(FirstNumber=aoetype, SecondNumber="1")  # -> Equality, Inequality

# ---- group: separate types
dispatch = Dispatch(List=data, DispatchPattern=equals.Equality)  # -> ListA, ListB

# ---- group: check if certain Handles are occupied (continued)
aoehandles = ExtractHandles(AssemblyObject=dispatch.ListB)  # -> HandlesSenderPlanes, HandlesTypes, HandlesWeights, HandleOccupancy, NeighbourObjectIndex, NeighbourHandleIndex
item = ListItem(List=aoehandles.HandleOccupancy, Index=panel_11, Wrap=True)
equals_2 = Equality(FirstNumber=item, SecondNumber="1")  # -> Equality, Inequality
f_massbool = MassBoolean(Values=equals_2.Equality, BooleanOperator="AND")

# ----
dispatch_2 = Dispatch(List=dispatch.ListB, DispatchPattern=f_massbool)  # -> ListA, ListB

# ---- group: identify horizontal-vertical alignment
aoerplane = ExtractReferencePlane(AssemblyObject=dispatch.ListA)
deplane = DeconstructPlane(Plane=aoerplane)  # -> Origin, XAxis, YAxis, ZAxis
Z = UnitZ(Factor=1)
dprod = DotProduct(VectorA=deplane.XAxis, VectorB=Z, Unitize=False)
abs = Absolute(Value=dprod)

# ----
lng = ListLength(List=dispatch.ListB)
repeat = RepeatData(Data="0", Length=lng)

# ---- group: colors by XData type
weave_2 = Weave(Pattern=equals.Equality, Stream0=merge_10, Stream1=merge_11, NullGaps=False)

# ---- group: Choose geometries by height
aoerplane_2 = ExtractReferencePlane(AssemblyObject=dispatch_2.ListB)
pdecon_2 = Deconstruct(Point=aoerplane_2)  # -> XComponent, YComponent, ZComponent
bar_graph = BarGraph(pdecon_2.ZComponent, BarColor=RGB(255, 0, 90))
bnd = Bounds(Numbers=flatten(pdecon_2.ZComponent))
remap = RemapNumbers(Value=pdecon_2.ZComponent, Source=bnd, Target=Domain(0, 1))  # -> Mapped, Clipped
n_of_options_1 = Panel("2")

# ----
# graph mapper affects data distribution.
# 
# Use it with normalized data (range 0-1)
graph = GraphMapper(remap.Mapped)

# ---- group: Choose geometries by height (continued)
bar_graph_2 = BarGraph(graph, BarColor=RGB(0, 217, 255))
multiplication_2 = Multiplication(A=graph, B=n_of_options_1)
int = Integer(multiplication_2)

# ----
weave_3 = Weave(Pattern=f_massbool, Stream0=int, Stream1="-1", NullGaps=False)

# ---- group: regroup types
weave_4 = Weave(Pattern=equals.Equality, Stream0=weave_3, Stream1=abs, NullGaps=False)

# ----
item_2 = ListItem(List=associate_xdata, Index=weave_4, Wrap="False")
xddecon = DeconstructXData(XData=item_2)  # -> Label, AssemblyObjectNameReference, ReferencePlane, Data

# ----
# Utilizzate questo componente per fare il bake su Rhino
mesh_20 = Mesh(xddecon.Data)

f_mmeea = MeshesExtractEdgesWithToleranceAngle(Mesh=mesh_20, Angle=45)  # -> InternalEdges, NakedEdges
# edges (bordi) delle geometrie effettive
previewlw_3 = CustomPreviewLineweights(Geometry=[f_mmeea.InternalEdges, f_mmeea.NakedEdges], Shader=ColourSwatch(SwatchColor=RGB(0, 0, 0)), Absolute=False)

item_3 = ListItem(List=weave_2, Index=weave_4, Wrap="False")
filter = StreamFilter(Gate=list, Stream0=aoadisp.Colors, Stream1=item_3)
# visualizzazione delle geometrie effettive
preview_2 = CustomPreview(Geometry=mesh_20, Material=graft(filter))

# ==== cluster Cluster
environment_geometries = ClusterInput()

# ----
# display environment geometries names
# IMPORTANT: Objects must be named in Rhino
# This component from Human gets object attributes (name, layer, color)
objatts = ObjectAttributes(ObjectOrAttributes=environment_geometries)  # -> Name, LayerName, LayerFullPath, Color, MaterialName, LinetypeName, GroupIndices, PlotWeight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

# ----
# If an object is a void (if it's in the "voids" layer), flips the mesh before computing volume (otherwise the centroid is out of place)
panel = Panel("voids")
tmatch = MatchText(Text=objatts.LayerName, Pattern=panel, Case=True)
dispatch = Dispatch(List=environment_geometries, DispatchPattern=tmatch)  # -> ListA, ListB
flip = MeshFlip(Mesh=dispatch.ListA)
weave = Weave(Pattern=tmatch, Stream0=dispatch.ListB, Stream1=flip, NullGaps=False)

volume = Volume(Geometry=weave)  # -> Volume, Centroid

tag = TextTag(Location=volume.Centroid, Text=objatts.Name, Colour=objatts.Color)
