# Grasshopper definition boundary distance field.gh (Grasshopper 1.0.7)
# Copyright: Co-de-iT
# plug-ins: Weaverbird, Kangaroo2 Components

# <title>
# 
# <description>
# 
# code by Alessio Erioli
# 
# v 0.1
mesh = Mesh(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)
Z = UnitZ(Factor="50")
# © a3 2021 / Creative Commons Attribution-Non Commercial-ShareAlike 4.0 International License
wbloop = WeaverbirdsLoopSubdivision(MeshCurves=mesh, Level="3", SmoothNakedEdges="0")
move = Move(Geometry=wbloop, Motion=Z)  # -> Geometry, Transform
nv = NakedVertices(Mesh=move.Geometry)  # -> ClothedIndex, NakedIndex, ClothedPts, NakedPts
demesh = DeconstructMesh(Mesh=wbloop)  # -> Vertices, Faces, Colours, Normals
cp = ClosestPoint(Point=demesh.Vertices, Cloud=nv.NakedPts)  # -> ClosestPoint, CPIndex, Distance
num = Number(cp.Distance)
bnd = Bounds(Numbers=num)
remap = RemapNumbers(Value=num, Source=bnd, Target=Domain(0, 1))  # -> Mapped, Clipped
gradient = Gradient(LowerLimit=0, UpperLimit=1, Parameter=remap.Mapped, stops=[0: RGB(255, 255, 255), 1: RGB(255, 0, 0)])
gradient_2 = Gradient(LowerLimit=0, UpperLimit=1, Parameter=remap.Mapped, stops=[0: RGB(0, 255, 255), 1: RGB(255, 0, 255)])
conmesh = ConstructMesh(Vertices=demesh.Vertices, Faces=demesh.Faces, Colours=gradient_2)
