# Grasshopper definition base maisonnette extended - multiple AO_E-F-H-V_circulation.gh (Grasshopper 1.0.7)
# Copyright: Co-de-iT
# plug-ins: Assembler, Human, froGH

# ----
# Handles type 0
# referenziare qui le vostre Handles
crv = Curve(<curve referenced from the Rhino model>)
crv_2 = Curve(<curve referenced from the Rhino model>)
crv_3 = Curve(<curve referenced from the Rhino model>)
panel = Panel("""0
90""")
panel_2 = Panel("""0
90""")
panel_3 = Panel("""0
90""")
handcon = ConstructHandle(Polyline=crv_2, RotationAngles=panel_2, Type=0, Weight=1)
handcon_2 = ConstructHandle(Polyline=crv, RotationAngles=panel, Type=0, Weight=1)
handcon_3 = ConstructHandle(Polyline=crv_3, RotationAngles=panel_3, Type=0, Weight=1)

# ----
# Handles type 1
# referenziare qui le vostre Handles
crv_4 = Curve(<curve referenced from the Rhino model>)
panel_4 = Panel("""0
180""")
handcon_4 = ConstructHandle(Polyline=crv_4, RotationAngles=panel_4, Type="1", Weight=1)

# ----
# obstacles
mesh = Mesh(<mesh referenced from the Rhino model>)
mesh_2 = Mesh(<mesh referenced from the Rhino model>)
mesh_3 = Mesh(<mesh referenced from the Rhino model>)

# ----
# voids
# referenziare qui le mesh dell'ambiente (ostacoli, vuoti)
mesh_4 = Mesh(<mesh referenced from the Rhino model>)

# ----
# Environment
merge = Merge(Data1=mesh, Data2=mesh_2, Data3=mesh_3, Data4=mesh_4)

# ----
# Collision mesh (spazio occupato)
mesh_5 = Mesh(<mesh referenced from the Rhino model>)

# ----
# maisonnette extended
# 
# <description>
# 
# code by Alessio Erioli
# 
# v 0.1
# © a3 2021 / Creative Commons Attribution-Non Commercial-ShareAlike 4.0 International License
# Collision mesh (spazio occupato)
mesh_6 = Mesh(<mesh referenced from the Rhino model>)

# ----
# non modificare queste impostazioni (per ora)
volume = Volume(Geometry=mesh_5)  # -> Volume, Centroid
X = UnitX(Factor=1)

# ----
# referenziare qui le geometrie costruite (mesh)
mesh_7 = Mesh(<mesh referenced from the Rhino model>)
mesh_8 = Mesh(<mesh referenced from the Rhino model>)
mesh_9 = Mesh(<mesh referenced from the Rhino model>)

mesh_10 = Mesh(<mesh referenced from the Rhino model>)

# ----
# referenziare qui le geometrie costruite (mesh)
mesh_11 = Mesh(<mesh referenced from the Rhino model>)
mesh_12 = Mesh(<mesh referenced from the Rhino model>)
mesh_13 = Mesh(<mesh referenced from the Rhino model>)

mesh_14 = Mesh(<mesh referenced from the Rhino model>)
mesh_15 = Mesh(<mesh referenced from the Rhino model>)
merge_2 = Merge(Data1=mesh_9, Data2=mesh_15, Data3=mesh_10)

# ----
# AssemblyObject 2
# XData
number_slider = Slider(0.355, range=0..1)
merge_3 = Merge(Data1=handcon_2, Data2=handcon, Data3=handcon_3, Data4=handcon_4)
handdisp = DisplayHandles(Handles=merge_3, DisplaySize=number_slider, absHTextSize=False)
name = Panel("Stick")
xy = XYPlane(Origin=volume.Centroid)
merge_4 = Merge(Data1=mesh_7, Data2=mesh_8)
aocon = ConstructAssemblyObject(Name=name, CollisionMesh=mesh_5, Direction=Vector(1, 0, 0), Handles=merge_3, Weight=1, ZLockAO=False)
xdcon = ConstructXData(Label="geometry V", AssemblyObject=aocon, Data=merge_2)
xdcon_2 = ConstructXData(Label="geometry H", AssemblyObject=aocon, Data=merge_4)

crv_5 = Curve([<curve referenced from the Rhino model> x8])
crv_6 = Curve([<curve referenced from the Rhino model> x7])
xdcon_3 = ConstructXData(Label="cp_V", AssemblyObject=aocon, Data=crv_5)
xdcon_4 = ConstructXData(Label="cp_H", AssemblyObject=aocon, Data=crv_6)

merge_5 = Merge(Data1=xdcon_4, Data2=xdcon_3)
merge_6 = Merge(Data1=xdcon_2, Data2=xdcon)

# ---- group: selective geometry - stair
mesh_16 = Mesh(<mesh referenced from the Rhino model>)

# ----
# display environment geometries names
# IMPORTANT: Objects must be named in Rhino
cluster = Cluster(environment_geometries=merge)

step = Button()
target_number = Panel("1000")
go = BooleanToggle(False)

reset_settings = Button()
reset = Button()

# ---- group: starting plane (XY implicito)
pt = Point(Point(-75.48844058, 18.92322177, 0))

# ----
# Handles
# referenziare qui le vostre Handles
crv_7 = Curve(<curve referenced from the Rhino model>)
# parti editabili
# Setup
# bake
# preview on/off
crv_8 = Curve(<curve referenced from the Rhino model>)
crv_9 = Curve(<curve referenced from the Rhino model>)
crv_10 = Curve(<curve referenced from the Rhino model>)
panel_5 = Panel("""0
90""")
panel_6 = Panel("""0
90""")
panel_7 = Panel("""0
90""")
panel_8 = Panel("""0
90""")
handcon_5 = ConstructHandle(Polyline=crv_8, RotationAngles=panel_5, Type=0, Weight=1)

handcon_6 = ConstructHandle(Polyline=crv_9, RotationAngles=panel_6, Type=0, Weight=1)
handcon_7 = ConstructHandle(Polyline=crv_7, RotationAngles=panel_7, Type=0, Weight=1)
handcon_8 = ConstructHandle(Polyline=crv_10, RotationAngles=panel_8, Type=0, Weight=1)

merge_7 = Merge(Data1=handcon_5, Data2=handcon_6, Data3=handcon_7, Data4=handcon_8)
handdisp_2 = DisplayHandles(Handles=merge_7, DisplaySize=Slider(0.355, range=0..1), absHTextSize=False)

# ----
# AssemblyObject 1
volume_2 = Volume(Geometry=mesh_6)  # -> Volume, Centroid
name_2 = Panel("Maison")
xy_2 = XYPlane(Origin=volume_2.Centroid)
merge_8 = Merge(Data1=mesh_11, Data2=mesh_12, Data3=mesh_13, Data4=mesh_14)
aocon_2 = ConstructAssemblyObject(Name=name_2, CollisionMesh=mesh_6, Direction=Vector(1, 0, 0), Handles=merge_7, Weight=1, ZLockAO=False)
xdcon_5 = ConstructXData(Label="actual geometry", AssemblyObject=aocon_2, Data=merge_8)

# ----
# XData
panel_9 = Panel("cP")
crv_11 = Curve([<curve referenced from the Rhino model> x14])
xdcon_6 = ConstructXData(Label=panel_9, AssemblyObject=aocon_2, Data=crv_11)

# ----
# XData - selective geometry
panel_10 = Panel("stair clash lines")
crv_12 = Curve([<curve referenced from the Rhino model> x6])
xdcon_7 = ConstructXData(Label="stair", AssemblyObject=aocon_2, Data=mesh_16)
xdcon_8 = ConstructXData(Label=panel_10, AssemblyObject=aocon_2, Data=crv_12)

crv_13 = Curve([<curve referenced from the Rhino model> x3])
xdcon_9 = ConstructXData(Label="stair CP", AssemblyObject=aocon_2, Data=crv_13)

merge_9 = Merge(Data1=aocon_2, Data2=aocon)
merge_10 = Merge(Data1=xdcon_6, Data2=merge_5)
merge_11 = Merge(Data1=xdcon_5, Data2=merge_6)
merge_12 = Merge(Data1=merge_10, Data2=merge_11)

# ----
# Rules (Heuristics)
heuwri = HeuristicsWriter(AssemblyObjectsSet=merge_9, noSH=False, noSO=False, xHT=False)
pt_2 = Point(Point(0, 22.64105822, 0))
# Simulate
heud = HeuristicDisplay(
    OriginPoint=pt_2,
    AssemblyObjectsSet=merge_9,
    XData=merge_12,
    HeuristicsSet=heuwri,
    XSize=1.2,
    YSize=1.2,
    TextSize=1,
    NRows=Slider(10, range=2..10),
    DisplayType="AO Types",
    ZLockFilter=False)

# ----
# Heuristics
# Settings
sender_selection_mode = ValueList({"Random": 0, "Scalar Field nearest": 1, "Scalar Field interpolated": 2, "Vector Field > nearest": 3, "Vector Field > interpolated": 4, "Vector Field <> nearest": 5, "Vector Field <> interpolated": 6, "Minimum local AABB volume": 7, "Minimum local AABB diagonal": 8, "Weighted Random Choice": 9}, selected="Vector Field > interpolated")
receiver_selection_mode = ValueList({"Random": 0, "Scalar Field nearest": 1, "Scalar Field interpolated": 2, "Dense Packing": 3}, selected="Scalar Field nearest")
heuset = HeuristicsSettings(
    HeuristicsSet=heuwri,
    CurrentHeuristics=0,
    HeuristicsMode=0,
    ReceiverSelectionMode=receiver_selection_mode,
    SenderRuleSelectionMode=sender_selection_mode)

# ----
# Field
number_slider_2 = Slider(20, range=10..20)
mesh_17 = Mesh(<mesh referenced from the Rhino model>)
merge_13 = Merge(Data1=ColourSwatch(SwatchColor=RGB(255, 255, 255)), Data2=ColourSwatch(SwatchColor=RGB(0, 0, 0)))

afieldn = ConstructFieldN(Geometry=mesh_17, Plane=PlaneXY(0, 0, 0), NCells=number_slider_2)  # -> Field, FieldCellsDimensions, FieldPoints

# ---- group: compute scalar values
crv_14 = Curve(<curve referenced from the Rhino model>)
crv_cp = CurveClosestPoint(Point=afieldn.FieldPoints, Curve=crv_14)  # -> Point, Parameter, Distance

# ----
previewlw = CustomPreviewLineweights(Geometry=crv_14, Shader=ColourSwatch(SwatchColor=RGB(255, 0, 255)), Thickness="5", Absolute=False)

# ---- group: compute vector values
pdecon = Deconstruct(Point=afieldn.FieldPoints)  # -> XComponent, YComponent, ZComponent
larger = LargerThan(FirstNumber=pdecon.YComponent, SecondNumber=Slider(35.544, range=0..100))  # -> LargerThan, OrEqualTo
Z = UnitZ(Factor=1)
Y = UnitY(Factor=1)
weave = Weave(Pattern=graft(larger.LargerThan), Stream0=Y, Stream1=Z, NullGaps=False)  # -> flatten(Weave)

# ----
afpop = PopulateField(Field=afieldn.Field, ScalarValues=crv_cp.Distance, VectorValues=weave)

# ----
# Exogenous
# (environment)
# Settings
field_scalar_threshold = Slider(0.198, range=0..1)

afcol = ColorField(Field=afpop, Colors=merge_13, Index=0, Threshold=field_scalar_threshold, FieldColorBlend=False)  # -> Field, Colors
afdecon = DeconstructField(Field=afcol.Field)  # -> Points, ScalarValues, flatten(Vectors), IWeights, Colors, Topology, TopologyWeights
multiplication = Multiplication(A=afdecon.Vectors, B=Slider(3.63, range=1..5))
vdisex = VectorDisplayEx(Point=afdecon.Points, Vector=multiplication, Colour=afdecon.Vectors, Width=2)

exoset = ExogenousSettings(
    EnvironmentMeshes=merge,
    EnvironmentMode="2",
    Field=afcol.Field,
    FieldScalarThreshold=field_scalar_threshold,
    Sandbox={Plane=PlaneXY(0, 0, 0), X=Domain(-1, 1), Y=Domain(0, 0), Z=Domain(0, 0)},
    HasContainer=False)

aoaengine = AssemblerEngine(
    AssemblyObjectsSet=merge_9,
    StartingPlane=pt,
    StartingObjectType=0,
    HeuristicsSettings=heuset,
    ExogenousSettings=exoset,
    Go=go,
    Step=step,
    NIterations=Slider(100, range=10..100),
    TargetMaxNObjects=target_number,
    ResetSettings=reset_settings,
    Reset=reset,
    UseSupports=False,
    ZLockCheck=False)  # -> Assemblage, AssemblageCount

# ---- group: autostop condition
larger_2 = LargerThan(FirstNumber=aoaengine.AssemblageCount, SecondNumber=target_number)  # -> LargerThan, OrEqualTo
f_tas = ToggleAutostop(Toggle=go, Condition=larger_2.OrEqualTo)

# ----
panel_11 = Panel(aoaengine.AssemblageCount)
# Post-process
aoadisp = DisplayAssemblage(Assemblage=aoaengine.Assemblage, ColorsOnly=False, OutputType="Occupancy")  # -> ColoredCollisionMeshes, Edges, Colors, Values
aoadecon = DeconstructAssemblage(Assemblage=aoaengine.Assemblage)  # -> AssemblageObjects, AssemblageRules, ReceiverObjectsIndexes, AvailableObjectIndexes, UnreachableObjectIndexes

# ----
# Adding selective geometry (stair)
# Press play to start placing selective geometries
dam = DataDam(DataA=aoadecon.AssemblageObjects, BufferDelay=10000000, BufferMode=0)

# ---- group: identify type
aoetype = ExtractType(AssemblyObject=dam)
equals = Equality(FirstNumber=aoetype, SecondNumber="0")  # -> Equality, Inequality

# ----
associate_xdata = AssociateXData(AssemblyObjects=aoadecon.AssemblageObjects, XData=merge_11)  # "AO<>XD"
associate_xdata_2 = AssociateXData(AssemblyObjects=aoadecon.AssemblageObjects, XData=merge_10)  # "AO<>XD"

# ---- group: identify type
aoetype_2 = ExtractType(AssemblyObject=aoadecon.AssemblageObjects)
equals_2 = Equality(FirstNumber=aoetype_2, SecondNumber="1")  # -> Equality, Inequality

# ----
# 1st selection filter
cull = CullPattern(List=dam, CullPattern=equals.Equality)

# ---- group: separate types
dispatch = Dispatch(List=aoadecon.AssemblageObjects, DispatchPattern=equals_2.Equality)  # -> ListA, ListB

# ---- group: identify horizontal alignment
aoerplane = ExtractReferencePlane(AssemblyObject=cull)
deplane = DeconstructPlane(Plane=aoerplane)  # -> Origin, XAxis, YAxis, ZAxis
Z_2 = UnitZ(Factor=1)
dprod = DotProduct(VectorA=deplane.ZAxis, VectorB=Z_2, Unitize=False)
similar = Similarity(FirstNumber=dprod, SecondNumber="1", Threshold=0.1)  # -> Similarity, AbsoluteDifference

# ---- group: identify horizontal-vertical alignment
aoerplane_2 = ExtractReferencePlane(AssemblyObject=dispatch.ListA)
deplane_2 = DeconstructPlane(Plane=aoerplane_2)  # -> Origin, XAxis, YAxis, ZAxis
Z_3 = UnitZ(Factor=1)
dprod_2 = DotProduct(VectorA=deplane_2.XAxis, VectorB=Z_3, Unitize=False)
abs = Absolute(Value=dprod_2)

# ----
# identify type 1 Horizontal-Vertical
lng = ListLength(List=dispatch.ListB)
repeat = RepeatData(Data="0", Length=lng)

# ----
# 2nd selection filter
cull_2 = CullPattern(List=cull, CullPattern=similar.Similarity)

# ---- group: regroup types
weave_2 = Weave(Pattern=equals_2.Equality, Stream0=repeat, Stream1=abs, NullGaps=False)

# ----
item = ListItem(List=associate_xdata, Index=weave_2, Wrap=True)
item_2 = ListItem(List=associate_xdata_2, Index=weave_2, Wrap=True)
xddecon = DeconstructXData(XData=item)  # -> Label, AssemblyObjectNameReference, ReferencePlane, Data

# ----
# controlla se le clash lines si scontrano con la geometria effettiva
associate_xdata_3 = AssociateXData(AssemblyObjects=cull_2, XData=xdcon_8)  # "AO<>XD"
mesh_18 = Mesh(xddecon.Data)
xddecon_2 = DeconstructXData(XData=associate_xdata_3)  # -> Label, AssemblyObjectNameReference, ReferencePlane, Data
mjoin = MeshJoin(Meshes=flatten(mesh_18))
pshift = ShiftPaths(Data=xddecon_2.Data, Offset="-2")
clean = CleanTree(RemoveNulls=True, RemoveInvalid=True, RemoveEmpty="true", Tree=pshift)
mcx = MeshCurve(Mesh=mjoin, Curve=clean)  # -> Points, Faces
pshift_2 = ShiftPaths(Data=mcx.Points, Offset=-1)
lng_2 = ListLength(List=pshift_2)
equals_3 = Equality(FirstNumber=lng_2, SecondNumber="0")  # -> Equality, Inequality

# ----
# Utilizzate questo componente per fare il bake su Rhino
mesh_19 = Mesh(xddecon.Data)

# ---- group: rebuild whole data tree
lng_3 = ListLength(List=cull_2)
equals_4 = Equality(FirstNumber=lng_3, SecondNumber="-1")  # -> Equality, Inequality
merge_14 = Merge(Data1=equals_4.Equality, Data2=equals_3.Equality)
f_massbool = MassBoolean(Values=merge_14, BooleanOperator="OR", Boolean_Operator="OR")

# ---- group: display clash points
number_slider_3 = Slider(0.25, range=0.1..1)  # disabled
viewer = ParamViewer(pshift_2)  # disabled
panel_12 = Panel("2")  # disabled
multiplication_2 = Multiplication(A=number_slider_3, B=panel_12)  # disabled
f_ifroml = IndexesFromList(Data=pshift_2)  # disabled
number_slider_4 = Slider(0.25, range=0..1)  # disabled
swatch = ColourSwatch(SwatchColor=RGB(255, 0, 0))  # disabled
Z_4 = UnitZ(Factor=multiplication_2)  # disabled
concat = Concatenate(FragmentA=graft(viewer), FragmentB=f_ifroml)  # disabled
move = Move(Geometry=pshift_2, Motion=Z_4)  # -> Geometry, Transform; disabled
dots = DotDisplay(Point=pshift_2, Colour=swatch, Size=number_slider_3)  # disabled
tag = TextTag3D(Location=move.Geometry, Text=concat, Size=number_slider_4, Colour=swatch, Justification=7)  # disabled

# ----
# Display
swatch_2 = ColourSwatch(SwatchColor=RGB(97, 97, 97))
previewlw_2 = CustomPreviewLineweights(Geometry=aoadisp.Edges, Shader=swatch_2, Absolute=False)

f_mmeea = MeshesExtractEdgesWithToleranceAngle(Mesh=mesh_19, Angle=45)  # -> InternalEdges, NakedEdges
previewlw_3 = CustomPreviewLineweights(Geometry=[f_mmeea.InternalEdges, f_mmeea.NakedEdges], Shader=ColourSwatch(SwatchColor=RGB(0, 0, 0)), Absolute=False)

# ----
# Actual geometries
preview = CustomPreview(Geometry=mesh_19, Material=graft(aoadisp.Colors))

# ----
# Collision meshes
preview_2 = CustomPreview(
    Geometry=aoadisp.ColoredCollisionMeshes,
    Material={diffuse=RGB(221, 160, 221), emission=RGB(66, 48, 66), shine=0.5, specular=RGB(255, 255, 255), transparency=0})  # disabled

cull_3 = CullPattern(List=cull_2, CullPattern=f_massbool)
associate_xdata_4 = AssociateXData(AssemblyObjects=cull_3, XData=xdcon_7)  # "AO<>XD"

# ----
# Circulation path
associate_xdata_5 = AssociateXData(AssemblyObjects=cull_3, XData=xdcon_9)  # "AO<>XD"
xddecon_3 = DeconstructXData(XData=item_2)  # -> Label, AssemblyObjectNameReference, ReferencePlane, Data
xddecon_4 = DeconstructXData(XData=associate_xdata_5)  # -> Label, AssemblyObjectNameReference, ReferencePlane, Data
merge_15 = Merge(Data1=xddecon_3.Data, Data2=xddecon_4.Data)
pshift_3 = ShiftPaths(Data=merge_15, Offset="-2")

xddecon_5 = DeconstructXData(XData=associate_xdata_4)  # -> Label, AssemblyObjectNameReference, ReferencePlane, Data

# ----
# Utilizzate questo componente per fare il bake su Rhino
mesh_20 = Mesh(xddecon_5.Data)

f_mmeea_2 = MeshesExtractEdgesWithToleranceAngle(Mesh=mesh_20, Angle=45)  # -> InternalEdges, NakedEdges
preview_3 = CustomPreview(Geometry=mesh_20, Material=graft(ColourSwatch(SwatchColor=RGB(0, 229, 255))))
previewlw_4 = CustomPreviewLineweights(Geometry=[f_mmeea_2.InternalEdges, f_mmeea_2.NakedEdges], Shader=ColourSwatch(SwatchColor=RGB(0, 0, 0)), Absolute=False)

# ----
# da utilizzare per circulation analysis
previewlw_5 = CustomPreviewLineweights(Geometry=pshift_3, Shader=ColourSwatch(SwatchColor=RGB(0, 17, 255)), Thickness="2", Absolute=False)

crv_15 = Curve(pshift_3)

# ----
# another possible filter
aos = Relay()

# ---- group: filter within distance from an attractor point
aoerplane_3 = ExtractReferencePlane(AssemblyObject=aos)
pt_3 = Point(Point(-109.082227, 5.769564398, -52.52912492))
distance_threshold = Slider(23.708, range=1..100)
project = Project(Geometry=aoerplane_3, Plane=pt_3)  # -> Geometry, Transform
dist = Distance(PointA=project.Geometry, PointB=pt_3)
smaller = SmallerThan(FirstNumber=dist, SecondNumber=distance_threshold)  # -> SmallerThan, OrEqualTo

# ----
cull_4 = CullPattern(List=aos, CullPattern=smaller.SmallerThan)

# ==== cluster Cluster
environment_geometries = ClusterInput()
panel = Panel("""115,124,148
146,51,51""")

# ----
# display environment geometries names
# IMPORTANT: Objects must be named in Rhino
# This component from Human gets object attributes (name, layer, color)
objatts = ObjectAttributes(ObjectOrAttributes=environment_geometries)  # -> Name, LayerName, LayerFullPath, Color, MaterialName, LinetypeName, GroupIndices, PlotWeight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

# ----
# If an object is a void (if it's in the "voids" layer), flips the mesh before computing volume (otherwise the centroid is out of place)
panel_2 = Panel("voids")
tmatch = MatchText(Text=objatts.LayerName, Pattern=panel_2, Case=True)
dispatch = Dispatch(List=environment_geometries, DispatchPattern=tmatch)  # -> ListA, ListB
flip = MeshFlip(Mesh=dispatch.ListA)
weave = Weave(Pattern=tmatch, Stream0=dispatch.ListB, Stream1=flip, NullGaps=False)

item = ListItem(List=panel, Index=tmatch, Wrap=True)

volume = Volume(Geometry=weave)  # -> Volume, Centroid

tag = TextTag(Location=volume.Centroid, Text=objatts.Name, Colour=item)
