# Grasshopper definition PP path clustering and filtering.gh (Grasshopper 1.0.7)
# Copyright: Co-de-iT
# plug-ins: Human, froGH

plugins_needed = Panel(""". froGH
. Human""")
# circulation path operations
# circulation path clustering and filtering
line = Line()

# ---- group: path topology
f_tln = Topologizer(LinesNetwork=line, Decimals=3)  # -> Points, LinePointsData, PointsConnectivity, LineDirectionAtEachPoint

# ----
f_clstr = Clusterizer(TopologyData=f_tln.PointsConnectivity)

# ---- group: find clusters
f_tinv = TopologyInverter(TopologyData=f_tln.LinePointsData)
# <title>
# 
# <description>
# 
# code by Alessio Erioli
# 
# v 0.1
# © a3 2021 / Creative Commons Attribution-Non Commercial-ShareAlike 4.0 International License
item = ListItem(List=line, Index=f_tinv, Wrap=True)
tstat = TreeStatistics(Tree=f_clstr)  # -> Paths, Length, Count
group = Group(Objects=item)  # -> flatten(Group)
n_of_clusters = Panel(tstat.Count)
item_2 = ListItem(List=group, Index=f_clstr, Wrap=True)

# ---- group: isolate horizontal and vertical path lines
Z = UnitZ(Factor=1)
angle = Angle(VectorA=line, VectorB=Z)  # -> Angle, Reflex
similar = Similarity(FirstNumber=angle.Angle, SecondNumber="0", Threshold=0.1)  # -> Similarity, AbsoluteDifference
similar_2 = Similarity(FirstNumber=angle.Angle, SecondNumber="0.5 * Pi", Threshold=0.1)  # -> Similarity, AbsoluteDifference
cull = CullPattern(List=line, CullPattern=similar.Similarity)
cull_2 = CullPattern(List=line, CullPattern=similar_2.Similarity)

# ---- group: find largest cluster
lng = ListLength(List=item_2)  # -> flatten(Length)
f_ifroml = IndexesFromList(Data=lng)
sort = SortList(Keys=lng, ValuesA=f_ifroml)  # -> Keys, ValuesA
item_3 = ListItem(List=sort.ValuesA, Index="-1", Wrap=True)
branch = TreeBranch(Tree=item_2, Path=item_3, MaintainPaths=True)

# ---- group: display clusters
wheel = ColourWheel(
    tstat.Count,
    ColourGrips_Style=10,
    ColourGrips_Grip=[3.34820233, 2.094395102, 4.188790205, 3.141592654],
    ColourGrips_Lum=[0.1, 0.6959162562],
    ColourGrips_Range=[0.2980456393, 0.2980456393, 0.2980456393, 0.2980456393],
    ColourGrips_Sat=[0.1889716777, 0.7131070986])
previewlw = CustomPreviewLineweights(Geometry=item_2, Shader=graft(wheel), Thickness="3", Absolute=False)

# ---- group: display largest cluster
previewlw_2 = CustomPreviewLineweights(Geometry=branch, Shader=ColourSwatch(SwatchColor=RGB(237, 85, 194)), Thickness="4", Absolute=False)

# ---- group: display line network
previewlw_3 = CustomPreviewLineweights(Geometry=line, Shader=ColourSwatch(SwatchColor=RGB(204, 180, 102)), Absolute=False)
