# Grasshopper definition PP_circulation - frequency_ShortestWalk.gh (Grasshopper 1.0.7)
# Copyright: Co-de-iT
# plug-ins: Assembler, Human, Shortest Walk in Gh, froGH

required_plugins = Panel(""". froGH
. Human
. ShortestWalk""")
assemblage = Relay()
circulation_graph_lines = Relay()
# Data Dam: Click on the play symbol (when present) to manually update the data
dam = DataDam(DataA=assemblage, BufferDelay=10000000, BufferMode=0)
# <title>
# 
# <description>
# 
# code by Alessio Erioli
# 
# v 0.1
# © a3 2021 / Creative Commons Attribution-Non Commercial-ShareAlike 4.0 International License
# shortest walk - AssemblyObjects connections
# Assemblage Topology: hO - Handle Occupancy
# 
# 0 - available
# 1 - connected
# -1 - occluded
# 
# nO - neighbour AssemblyObject index (-1 if Handle is available)
# 
# nH - neighbour Handle index (-1 if Handle is available or occluded)
aoadecon = DeconstructAssemblage(Assemblage=dam)  # -> AssemblageObjects, AssemblageRules, ReceiverObjectsIndexes, AvailableObjectIndexes, UnreachableObjectIndexes

# ---- group: Extract Reference Planes
# AO connectivity network: Creates the connectivity network between AssemblyObjects by connecting centres of reference planes with connected handles.
# 
# This network does not necessarily coincide with the spatial connectivity network, just tells how the Assembly Objects are connected to each other.
aoplane = ExtractReferencePlane(AssemblyObject=aoadecon.AssemblageObjects)  # -> graft(ReferencePlane)

# ----
list = ValueList({"AO connectivity graph": 0, "Circulation graph": 1}, selected="AO connectivity graph")

aoehandles = ExtractHandles(AssemblyObject=aoadecon.AssemblageObjects)  # -> HandlesSenderPlanes, HandlesTypes, HandlesWeights, HandleOccupancy, NeighbourObjectIndex, NeighbourHandleIndex

# ---- group: select free Handles
equals = Equality(FirstNumber=aoehandles.HandleOccupancy, SecondNumber="0")  # -> Equality, Inequality
cull = CullPattern(List=aoehandles.HandlesSenderPlanes, CullPattern=equals.Equality)  # -> flatten(List)

# ---- group: exclude occluded Handles
equals_2 = Equality(FirstNumber=aoehandles.HandleOccupancy, SecondNumber="-1")  # -> Equality, Inequality
cull_2 = CullPattern(List=aoehandles.HandlesSenderPlanes, CullPattern=equals_2.Inequality)

# ---- group: select vertical handles only
Z = UnitZ(Factor=1)
deplane = DeconstructPlane(Plane=cull)  # -> Origin, XAxis, YAxis, ZAxis
dprod = DotProduct(VectorA=deplane.ZAxis, VectorB=Z, Unitize=False)
abs = Absolute(Value=dprod)
int = Integer("0")
int_2 = Integer(abs)
equals_3 = Equality(FirstNumber=int_2, SecondNumber=int)  # -> Equality, Inequality
cull_3 = CullPattern(List=cull, CullPattern=equals_3.Equality)

# ----
ln = Line(StartPoint=aoplane, EndPoint=cull_2)

filter = StreamFilter(Gate=list, Stream0=ln, Stream1=circulation_graph_lines)

# ---- group: display line network
previewlw = CustomPreviewLineweights(Geometry=filter, Shader=ColourSwatch(SwatchColor=RGB(255, 0, 0)), Absolute=False)  # disabled

# ---- group: generate all possible connections
crossref = CrossReference(ListA=cull_3, ListB=cull_3, CrossMode=5)  # -> ListA, ListB
ln_2 = Line(StartPoint=crossref.ListA, EndPoint=crossref.ListB)

# ----
line = Line(flatten(filter))

# ---- group: sub-selection (for testing) / scramble to get even sampling
jitter = Jitter(List=ln_2, Jitter=1, Seed=2)  # -> Values, Indices

# ---- group: sub-selection (for testing)
subset = SubList(List=jitter.Values, Domain="10000", Wrap=True)  # -> List, Index

# ----
# circulation frequency
# because Member Index is very slow in this case
number_slider = Slider(0.352, range=0..1)
shortwalk = ShortestWalk(Curves=line, WantedPath=subset.List)  # -> ShortestWalk, Succession, Direction, Length
f_ifroml = IndexesFromList(Data=line)
dom = ConstructDomain(DomainStart="1", DomainEnd=Slider(15, range=5..15))

# ---- group: counts occurrences in a list
c_script = CSharpScript(L=flatten(shortwalk.Succession), M=f_ifroml)  # -> out, N; inputs L: list of Int32, M: list of Int32
# ---------- c_script: C# usings ----------
using System.Threading.Tasks;
# ---------- c_script: C# ----------
    int[] occurrences = new int[M.Count];

    //Parallel.For(0, M.Count, i =>
    for(int i = 0; i < M.Count; i++)
    {
      int count = 0;
      for (int j = 0; j < L.Count; j++)
      {
        if(L[j] == M[i]) count++;
      }
      occurrences[i] = count;
    }
    //);

    N = occurrences;
# ---------- end c_script ----------

# ----
pow = Power(A=c_script.N, B=number_slider)
log = Logarithm(Value=c_script.N)
sqrt = SquareRoot(Value=c_script.N)
num = Number(pow)
bnd = Bounds(Numbers=num)
remap = RemapNumbers(Value=num, Source=bnd, Target=Domain(0, 1))  # -> Mapped, Clipped
gradient = Gradient(LowerLimit=0, UpperLimit=1, Parameter=remap.Mapped, stops=[0: RGB(0, 128, 0), 0.5: RGB(255, 255, 0), 1: RGB(255, 0, 0)])
remap_2 = RemapNumbers(Value=remap.Mapped, Source=Domain(0, 1), Target=dom)  # -> Mapped, Clipped
previewlw_2 = CustomPreviewLineweights(Geometry=line, Shader=gradient, Thickness=remap_2.Mapped, Absolute=False)

# ---- group: original distribution
bar_graph = BarGraph(c_script.N, BarColor=RGB(255, 0, 90))

# ---- group: logarithmic distrbution
bar_graph_2 = BarGraph(log, BarColor=RGB(255, 0, 90))

# ---- group: inverse square distribution
bar_graph_3 = BarGraph(sqrt, BarColor=RGB(255, 0, 90))

# ---- group: inverse power distribution
bar_graph_4 = BarGraph(pow, BarColor=RGB(255, 0, 90))
