# Grasshopper definition maisonnette extended_blocks.gh (Grasshopper 1.0.7)
# Copyright: Co-de-iT
# plug-ins: Assembler, Human, EleFront, froGH

# ----
# Handles type 0
# referenziare qui le vostre Handles
crv = Curve(<curve referenced from the Rhino model>)
crv_2 = Curve(<curve referenced from the Rhino model>)
crv_3 = Curve(<curve referenced from the Rhino model>)
panel = Panel("""0
90""")
panel_2 = Panel("""0
90""")
panel_3 = Panel("""0
90""")
handcon = ConstructHandle(Polyline=crv_2, RotationAngles=panel, Type=0, Weight=1)
handcon_2 = ConstructHandle(Polyline=crv_3, RotationAngles=panel_2, Type=0, Weight=1)
handcon_3 = ConstructHandle(Polyline=crv, RotationAngles=panel_3, Type=0, Weight=1)

# ----
# Handles type 1
# referenziare qui le vostre Handles
crv_4 = Curve(<curve referenced from the Rhino model>)
panel_4 = Panel("""0
180""")
handcon_4 = ConstructHandle(Polyline=crv_4, RotationAngles=panel_4, Type="1", Weight=1)

# ----
# Handles
# referenziare qui le vostre Handles
crv_5 = Curve(<curve referenced from the Rhino model>)
# parti editabili
# Setup
# bake
# preview on/off
# blocks
crv_6 = Curve(<curve referenced from the Rhino model>)
crv_7 = Curve(<curve referenced from the Rhino model>)
crv_8 = Curve(<curve referenced from the Rhino model>)
panel_5 = Panel("""0
90""")
panel_6 = Panel("""0
90""")
panel_7 = Panel("""0
90""")
panel_8 = Panel("""0
90""")
handcon_5 = ConstructHandle(Polyline=crv_6, RotationAngles=panel_5, Type=0, Weight=1)
handcon_6 = ConstructHandle(Polyline=crv_7, RotationAngles=panel_6, Type=0, Weight=1)
handcon_7 = ConstructHandle(Polyline=crv_5, RotationAngles=panel_7, Type=0, Weight=1)
handcon_8 = ConstructHandle(Polyline=crv_8, RotationAngles=panel_8, Type=0, Weight=1)
merge = Merge(Data1=handcon_5, Data2=handcon_6, Data3=handcon_7, Data4=handcon_8)
handdisp = DisplayHandles(Handles=merge, DisplaySize=Slider(0.355, range=0..1), absHTextSize=False)

# ----
# obstacles
mesh = Mesh(<mesh referenced from the Rhino model>)
mesh_2 = Mesh(<mesh referenced from the Rhino model>)
mesh_3 = Mesh(<mesh referenced from the Rhino model>)

# ----
# voids
# referenziare qui le mesh dell'ambiente (ostacoli, vuoti)
mesh_4 = Mesh(<mesh referenced from the Rhino model>)

# ----
# Environment
merge_2 = Merge(Data1=mesh, Data2=mesh_2, Data3=mesh_3, Data4=mesh_4)

# ----
# Collision mesh (spazio occupato)
mesh_5 = Mesh(<mesh referenced from the Rhino model>)

# ----
# maisonnette extended
# 
# <description>
# 
# code by Alessio Erioli
# 
# v 0.1
# © a3 2021 / Creative Commons Attribution-Non Commercial-ShareAlike 4.0 International License
# Collision mesh (spazio occupato)
mesh_6 = Mesh(<mesh referenced from the Rhino model>)

# ----
# non modificare queste impostazioni (per ora)
volume = Volume(Geometry=mesh_5)  # -> Volume, Centroid
X = UnitX(Factor=1)

# ----
# non modificare queste impostazioni (per ora)
volume_2 = Volume(Geometry=mesh_6)  # -> Volume, Centroid
X_2 = UnitX(Factor=1)

# ----
# referenziare qui le geometrie costruite (mesh)
mesh_7 = Mesh(<mesh referenced from the Rhino model>)
mesh_8 = Mesh(<mesh referenced from the Rhino model>)
mesh_9 = Mesh(<mesh referenced from the Rhino model>)

mesh_10 = Mesh(<mesh referenced from the Rhino model>)

# ----
# referenziare qui le geometrie costruite (mesh)
mesh_11 = Mesh(<mesh referenced from the Rhino model>)
mesh_12 = Mesh(<mesh referenced from the Rhino model>)
mesh_13 = Mesh(<mesh referenced from the Rhino model>)

mesh_14 = Mesh(<mesh referenced from the Rhino model>)

# ----
# AssemblyObject 1
name = Panel("Object1")
pt = Point(Point(1, 0, 0))
pt_2 = Point(Point(0, 0, 1))
vec = Vector(pt)
crv_9 = Curve(<curve referenced from the Rhino model>)
xy = XYPlane(Origin=volume_2.Centroid)
merge_3 = Merge(Data1=mesh_11, Data2=mesh_12, Data3=mesh_13, Data4=mesh_14)
merge_4 = Merge(Data1="3.5", Data2=pt_2, Data3=vec, Data4=crv_9)
aocon = ConstructAssemblyObject(Name=name, CollisionMesh=mesh_6, ReferencePlane=xy, Direction=X_2, Handles=merge, Weight=1, ZLockAO=False)
mjoin = MeshJoin(Meshes=merge_3)
xdcon = ConstructXData(Label="data", AssemblyObject=aocon, Data=merge_4)
xdcon_2 = ConstructXData(Label="actual geometry", AssemblyObject=aocon, Data=mjoin)
merge_5 = Merge(Data1=xdcon_2, Data2=xdcon)

mesh_15 = Mesh(<mesh referenced from the Rhino model>)
merge_6 = Merge(Data1=mesh_9, Data2=mesh_15, Data3=mesh_10)

# ----
# AssemblyObject 2
number_slider = Slider(0.355, range=0..1)
merge_7 = Merge(Data1=handcon, Data2=handcon_2, Data3=handcon_3, Data4=handcon_4)
handdisp_2 = DisplayHandles(Handles=merge_7, DisplaySize=number_slider, absHTextSize=False)
name_2 = Panel("Object2")
xy_2 = XYPlane(Origin=volume.Centroid)
merge_8 = Merge(Data1=mesh_7, Data2=mesh_8)
aocon_2 = ConstructAssemblyObject(Name=name_2, CollisionMesh=mesh_5, ReferencePlane=xy_2, Direction=X, Handles=merge_7, Weight=1, ZLockAO=False)
mjoin_2 = MeshJoin(Meshes=merge_8)
mjoin_3 = MeshJoin(Meshes=merge_6)
xdcon_3 = ConstructXData(Label="geometry_H", AssemblyObject=aocon_2, Data=mjoin_2)

panel_9 = Panel("""Stick-H_LOW
Stick-V_LOW""")
xdcon_4 = ConstructXData(Label="Block Names B", AssemblyObject=aocon_2, Data=panel_9)

xdcon_5 = ConstructXData(Label="Block Name A", AssemblyObject=aocon, Data="Maisonnette_LOW")

xdcon_6 = ConstructXData(Label="geometry_V", AssemblyObject=aocon_2, Data=mjoin_3)
merge_9 = Merge(Data1=xdcon_3, Data2=xdcon_6)
merge_10 = Merge(Data1=aocon, Data2=aocon_2)
merge_11 = Merge(Data1=xdcon_2, Data2=merge_9)
merge_12 = Merge(Data1=xdcon_5, Data2=xdcon_4)
merge_13 = Merge(Data1=merge_11, Data2=xdcon)

# ----
# Rules (Heuristics)
heuwri = HeuristicsWriter(AssemblyObjectsSet=merge_10, noSH=False, noSO=False, xHT=False)
pt_3 = Point(Point(0, 22.64105822, 0))
# Simulate
heud = HeuristicDisplay(
    OriginPoint=pt_3,
    AssemblyObjectsSet=merge_10,
    XData=merge_13,
    HeuristicsSet=heuwri,
    XSize=1.2,
    YSize=1.2,
    TextSize=1,
    NRows=Slider(10, range=2..10),
    DisplayType="S-R",
    ZLockFilter=False,
    OutputType="S-R")

# ----
# Heuristics
# Settings
sender_selection_mode = ValueList({"Random": 0, "Scalar Field nearest": 1, "Scalar Field interpolated": 2, "Vector Field > nearest": 3, "Vector Field > interpolated": 4, "Vector Field <> nearest": 5, "Vector Field <> interpolated": 6, "Minimum local AABB volume": 7, "Minimum local AABB diagonal": 8, "Weighted Random Choice": 9}, selected="Vector Field > interpolated")
receiver_selection_mode = ValueList({"Random": 0, "Scalar Field nearest": 1, "Scalar Field interpolated": 2, "Dense Packing": 3}, selected="Scalar Field nearest")
heuset = HeuristicsSettings(
    HeuristicsSet=heuwri,
    CurrentHeuristics=0,
    HeuristicsMode=0,
    ReceiverSelectionMode=receiver_selection_mode,
    SenderRuleSelectionMode=sender_selection_mode)

# ----
# display environment geometries names
# IMPORTANT: Objects must be named in Rhino
cluster = Cluster(environment_geometries=merge_2)

step = Button()
target_number = Panel("1000")
go = BooleanToggle(False)

reset_settings = Button()
reset = Button()

# ---- group: starting plane (XY implicito)
pt_4 = Point(Point(-75.48844058, 18.92322177, 0))

# ----
# Field
number_slider_2 = Slider(20, range=10..20)
mesh_16 = Mesh(<mesh referenced from the Rhino model>)
merge_14 = Merge(Data1=ColourSwatch(SwatchColor=RGB(255, 255, 255)), Data2=ColourSwatch(SwatchColor=RGB(0, 0, 0)))

afieldn = ConstructFieldN(Geometry=mesh_16, Plane=PlaneXY(0, 0, 0), NCells=number_slider_2)  # -> Field, FieldCellsDimensions, FieldPoints

# ---- group: compute scalar values
crv_10 = Curve(<curve referenced from the Rhino model>)
crv_cp = CurveClosestPoint(Point=afieldn.FieldPoints, Curve=crv_10)  # -> Point, Parameter, Distance

# ----
previewlw = CustomPreviewLineweights(Geometry=crv_10, Shader=ColourSwatch(SwatchColor=RGB(255, 0, 255)), Thickness="5", Absolute=False)

# ---- group: compute vector values
pdecon = Deconstruct(Point=afieldn.FieldPoints)  # -> XComponent, YComponent, ZComponent
larger = LargerThan(FirstNumber=pdecon.YComponent, SecondNumber=Slider(35.544, range=0..100))  # -> LargerThan, OrEqualTo
Z = UnitZ(Factor=1)
Y = UnitY(Factor=1)
weave = Weave(Pattern=graft(larger.LargerThan), Stream0=Y, Stream1=Z, NullGaps=False)  # -> flatten(Weave)

# ----
afpop = PopulateField(Field=afieldn.Field, ScalarValues=crv_cp.Distance, VectorValues=weave)

# ----
# Exogenous
# (environment)
# Settings
field_scalar_threshold = Slider(0.198, range=0..1)

afcol = ColorField(Field=afpop, Colors=merge_14, Index=0, Threshold=field_scalar_threshold, FieldColorBlend=False)  # -> Field, Colors
afdecon = DeconstructField(Field=afcol.Field)  # -> Points, ScalarValues, flatten(Vectors), IWeights, Colors, Topology, TopologyWeights
multiplication = Multiplication(A=afdecon.Vectors, B=Slider(3.63, range=1..5))
vdisex = VectorDisplayEx(Point=afdecon.Points, Vector=multiplication, Colour=afdecon.Vectors, Width=2)

exoset = ExogenousSettings(
    EnvironmentMeshes=merge_2,
    EnvironmentMode="2",
    Field=afcol.Field,
    FieldScalarThreshold=field_scalar_threshold,
    Sandbox={Plane=PlaneXY(0, 0, 0), X=Domain(-1, 1), Y=Domain(0, 0), Z=Domain(0, 0)},
    HasContainer=False)

# ----
# Post-process
aoaengine = AssemblerEngine(
    AssemblyObjectsSet=merge_10,
    StartingPlane=pt_4,
    StartingObjectType=0,
    HeuristicsSettings=heuset,
    ExogenousSettings=exoset,
    Go=go,
    Step=step,
    NIterations=Slider(50, range=10..100),
    TargetMaxNObjects=target_number,
    ResetSettings=reset_settings,
    Reset=reset,
    UseSupports=False,
    ZLockCheck=False)  # -> Assemblage, AssemblageCount

# ---- group: autostop condition
larger_2 = LargerThan(FirstNumber=aoaengine.AssemblageCount, SecondNumber=target_number)  # -> LargerThan, OrEqualTo
f_tas = ToggleAutostop(Toggle=go, Condition=larger_2.OrEqualTo)

# ----
aoadecon = DeconstructAssemblage(Assemblage=aoaengine.Assemblage)  # -> AssemblageObjects, AssemblageRules, ReceiverObjectsIndexes, AvailableObjectIndexes, UnreachableObjectIndexes
associate_xdata = AssociateXData(AssemblyObjects=aoadecon.AssemblageObjects, XData=merge_11)  # "AO<>XD"

# ----
# Display
aoadisp = DisplayAssemblage(Assemblage=aoaengine.Assemblage, ColorsOnly=False, OutputType="Occupancy")  # -> ColoredCollisionMeshes, Edges, Colors, Values

previewlw_2 = CustomPreviewLineweights(Geometry=aoadisp.Edges, Shader=ColourSwatch(SwatchColor=RGB(97, 97, 97)), Absolute=False)

# ----
# Collision meshes
preview = CustomPreview(
    Geometry=aoadisp.ColoredCollisionMeshes,
    Material={diffuse=RGB(221, 160, 221), emission=RGB(66, 48, 66), shine=0.5, specular=RGB(255, 255, 255), transparency=0})

# ----
# place blocks
associate_xdata_2 = AssociateXData(AssemblyObjects=aoadecon.AssemblageObjects, XData=merge_12)  # "AO<>XD"

# ----
# Press play to start placing blocks
dam = DataDam(DataA=associate_xdata_2, BufferDelay=10000000, BufferMode=0)

# ----
# identify type 1 Horizontal-Vertical
data = Data(aoadecon.AssemblageObjects)

# ---- group: identify type
aoetype = ExtractType(AssemblyObject=data)
equals = Equality(FirstNumber=aoetype, SecondNumber="1")  # -> Equality, Inequality

# ---- group: separate types
dispatch = Dispatch(List=data, DispatchPattern=equals.Equality)  # -> ListA, ListB

# ---- group: identify horizontal-vertical alignment
aoerplane = ExtractReferencePlane(AssemblyObject=dispatch.ListA)
deplane = DeconstructPlane(Plane=aoerplane)  # -> Origin, XAxis, YAxis, ZAxis
Z_2 = UnitZ(Factor=1)
dprod = DotProduct(VectorA=deplane.XAxis, VectorB=Z_2, Unitize=False)
abs = Absolute(Value=dprod)

# ----
lng = ListLength(List=dispatch.ListB)
repeat = RepeatData(Data="0", Length=lng)

# ---- group: regroup types
weave_2 = Weave(Pattern=equals.Equality, Stream0=repeat, Stream1=abs, NullGaps=False)

# ----
item = ListItem(List=associate_xdata, Index=weave_2, Wrap=True)
xddecon = DeconstructXData(XData=item)  # -> Label, AssemblyObjectNameReference, ReferencePlane, Data

xddecon_2 = DeconstructXData(XData=dam)  # -> Label, AssemblyObjectNameReference, ReferencePlane, Data
item_2 = ListItem(List=xddecon_2.Data, Index=weave_2, Wrap=True)
item_3 = ListItem(List=xddecon.ReferencePlane, Index=weave_2, Wrap=True)
inblock = InsertBlock(BlockName=item_2, SourcePlane=item_3)
bake = BakeObjects(Geometry=inblock, Bake=Toggle(False))

# ----
# Utilizzate questo componente per fare il bake su Rhino
mesh_17 = Mesh(xddecon.Data)

f_mmeea = MeshesExtractEdgesWithToleranceAngle(Mesh=mesh_17, Angle=45)  # -> InternalEdges, NakedEdges
previewlw_3 = CustomPreviewLineweights(Geometry=[f_mmeea.InternalEdges, f_mmeea.NakedEdges], Shader=ColourSwatch(SwatchColor=RGB(0, 0, 0)), Absolute=False)

# ----
# Actual geometries
preview_2 = CustomPreview(Geometry=mesh_17, Material=graft(aoadisp.Colors))

# ==== cluster Cluster
environment_geometries = ClusterInput()
panel = Panel("""115,124,148
146,51,51""")

# ----
# display environment geometries names
# IMPORTANT: Objects must be named in Rhino
# This component from Human gets object attributes (name, layer, color)
objatts = ObjectAttributes(ObjectOrAttributes=environment_geometries)  # -> Name, LayerName, LayerFullPath, Color, MaterialName, LinetypeName, GroupIndices, PlotWeight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

# ----
# If an object is a void (if it's in the "voids" layer), flips the mesh before computing volume (otherwise the centroid is out of place)
panel_2 = Panel("voids")
tmatch = MatchText(Text=objatts.LayerName, Pattern=panel_2, Case=True)
dispatch = Dispatch(List=environment_geometries, DispatchPattern=tmatch)  # -> ListA, ListB
flip = MeshFlip(Mesh=dispatch.ListA)
weave = Weave(Pattern=tmatch, Stream0=dispatch.ListB, Stream1=flip, NullGaps=False)

item = ListItem(List=panel, Index=tmatch, Wrap=True)

volume = Volume(Geometry=weave)  # -> Volume, Centroid

tag = TextTag(Location=volume.Centroid, Text=objatts.Name, Colour=item)
