# Grasshopper definition env-field setup display.gh (Grasshopper 1.0.7)
# Copyright: Co-de-iT
# plug-ins: Assembler, Human, froGH

# ----
# Environment
mesh = Mesh(<mesh referenced from the Rhino model>)
# parti editabili
# Setup
# bake
# preview on/off
mesh_2 = Mesh(<mesh referenced from the Rhino model>)
mesh_3 = Mesh(<mesh referenced from the Rhino model>)
mesh_4 = Mesh(<mesh referenced from the Rhino model>)
mesh_5 = Mesh(<mesh referenced from the Rhino model>)
# <title>
# 
# <description>
# 
# code by Alessio Erioli
# 
# v 0.1
# © a3 2021 / Creative Commons Attribution-Non Commercial-ShareAlike 4.0 International License
merge = Merge(Data1=mesh_2, Data2=mesh_3, Data3=mesh_5, Data4=mesh, Data5=mesh_4)

crv = Curve(<curve referenced from the Rhino model>)
crv_2 = Curve(<curve referenced from the Rhino model>)
crv_3 = Curve(<curve referenced from the Rhino model>)

# ---- group: Field geometry
mesh_6 = Mesh(<mesh referenced from the Rhino model>)

# ---- group: compute scalar values / Scalar values curve
crv_4 = Curve(reparameterize(crv_3))

# ----
previewlw = CustomPreviewLineweights(Geometry=crv_4, Shader=ColourSwatch(SwatchColor=RGB(255, 0, 255)), Thickness="5", Absolute=False)

swatch = ColourSwatch(SwatchColor=RGBA(204, 204, 204, 75))

# ----
# display environment geometries names
# IMPORTANT: Objects must be named in Rhino
cluster = Cluster(environment_geometries=merge)

# ----
# Field
number_slider = Slider(20, range=10..30)
afieldn = ConstructFieldN(Geometry=mesh_6, Plane=PlaneXY(0, 0, 0), NCells=number_slider)  # -> Field, FieldCellsDimensions, FieldPoints
merge_2 = Merge(Data1=ColourSwatch(SwatchColor=RGB(255, 0, 255)), Data2=ColourSwatch(SwatchColor=RGB(0, 0, 0)))

# ---- group: compute vector values
pdecon = Deconstruct(Point=afieldn.FieldPoints)  # -> XComponent, YComponent, ZComponent
larger = LargerThan(FirstNumber=pdecon.ZComponent, SecondNumber=Slider(45.348, range=0..100))  # -> LargerThan, OrEqualTo
X = UnitX(Factor=1)
Y = UnitY(Factor=1)
weave = Weave(Pattern=graft(larger.LargerThan), Stream0=Y, Stream1=X, NullGaps=False)  # -> flatten(Weave)

# ---- group: iWeights
pt = Point(Point(-87.52231766, 96.04004555, 92.07695168))
pt_2 = Point(Point(-55.06715, -64.95677007, 0))
pt_3 = Point(Point(-20.25061685, 36.14307289, 14.12463086))
merge_3 = Merge(Data1=pt_2, Data2=pt, Data3=pt_3)
panel = Panel("""Red
Green
Blue""")
cp = ClosestPoint(Point=afieldn.FieldPoints, Cloud=merge_3)  # -> ClosestPoint, CPIndex, Distance
dots = DotDisplay(Point=merge_3, Colour=panel, Size=Slider(2, range=1..5))

# ---- group: compute scalar values
crv_cp = CurveClosestPoint(Point=afieldn.FieldPoints, Curve=crv_4)  # -> Point, Parameter, Distance

# ----
sqrt = SquareRoot(Value=crv_cp.Distance)
sqr = Square(Value=crv_cp.Distance)
afpop = PopulateField(Field=afieldn.Field, ScalarValues=sqrt, VectorValues=weave, IWeightValues=cp.CPIndex)

# ----
# Exogenous
# (environment)
# Settings
field_scalar_threshold = Slider(0.544, range=0..1)

afcol = ColorField(Field=afpop, Colors=merge_2, Index=0, Threshold=field_scalar_threshold, FieldColorBlend=False)  # -> Field, Colors

exoset = ExogenousSettings(
    EnvironmentMeshes=merge,
    EnvironmentMode="2",
    Field=afcol.Field,
    FieldScalarThreshold=field_scalar_threshold,
    Sandbox={Plane=PlaneXY(0, 0, 0), X=Domain(-1, 1), Y=Domain(0, 0), Z=Domain(0, 0)},
    HasContainer=False)

# ----
# Setup display
expansion_factor = Slider(1.404, range=0..2)
bbox = BoundingBox(Content=mesh_6, Plane=PlaneXY(0, 0, 0))  # -> Box, Box_2
boxprop = BoxProperties(Box=bbox.Box)  # -> Center, Diagonal, Area, Volume, Degeneracy
multiplication = Multiplication(A=expansion_factor, B=boxprop.Diagonal)
box = EvaluateBox(Box=bbox.Box, UParameter="0", VParameter="0", WParameter="0")  # -> Plane, Point, Include
series = Series(Start="1", Step=1, Count="3")
devec = DeconstructVector(Vector=multiplication)  # -> XComponent, YComponent, ZComponent
X_2 = UnitX(Factor=1)
Y_2 = UnitY(Factor=1)
Z = UnitZ(Factor=1)
afdecon = DeconstructField(Field=afcol.Field)  # -> Points, flatten(ScalarValues), flatten(Vectors), flatten(IWeights), Colors, Topology, TopologyWeights
multiplication_2 = Multiplication(A=devec.XComponent, B=series)
merge_4 = Merge(Data1=X_2, Data2=Y_2, Data3=Z)
X_3 = UnitX(Factor=multiplication_2)
panel_2 = Panel("""Scalar Field
Vector Field
iWeights""")
line = LineSDL(Start=box.Plane, Direction=merge_4, Length=Slider(20, range=1..50))
move = Move(Geometry=afdecon.Points, Motion=graft(X_3))  # -> Geometry, Transform
bang = ExplodeTree(Data=move.Geometry)  # -> Branch0, Branch1, Branch2

move_2 = Move(Geometry=box.Plane, Motion=X_3)  # -> Geometry, Transform

# ---- group: axis tripod
panel_3 = Panel("""Red
Green
Blue""")
previewlw_2 = CustomPreviewLineweights(Geometry=line, Shader=panel_3, Thickness=Slider(4, range=1..10), Absolute=False)

# ---- group: Text labels
tag = TextTag3D(
    Location=move_2.Geometry,
    Text=panel_2,
    Size=Slider(8.091, range=1..10),
    Colour=ColourSwatch(SwatchColor=RGB(0, 0, 0)),
    Justification=1)

# ---- group: scalar
f_pcd = PointCloudDisplay(Points=bang.Branch0, Colors=afcol.Colors, Size=Slider(3, range=1..5))

# ---- group: vector
multiplication_3 = Multiplication(A=afdecon.Vectors, B=Slider(5, range=1..5))
vdisex = VectorDisplayEx(Point=bang.Branch1, Vector=multiplication_3, Colour=afdecon.Vectors, Width=Slider(5, range=1..5))

# ---- group: iWeights colors
item = ListItem(List=panel, Index=afdecon.IWeights, Wrap=True)
f_pcd_2 = PointCloudDisplay(Points=bang.Branch2, Colors=item, Size=Slider(3, range=1..5))

# ---- group: Text iWeights
tag_2 = TextTag3D(Location=bang.Branch2, Text=afdecon.IWeights, Size=Slider(2, range=1..3), Colour=item, Justification=7)  # disabled

# ==== cluster Cluster
environment_geometries = ClusterInput()

# ----
# display environment geometries names
# IMPORTANT: Objects must be named in Rhino
# This component from Human gets object attributes (name, layer, color)
objatts = ObjectAttributes(ObjectOrAttributes=environment_geometries)  # -> Name, LayerName, LayerFullPath, Color, MaterialName, LinetypeName, GroupIndices, PlotWeight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

# ----
# If an object is a void (if it's in the "voids" layer), flips the mesh before computing volume (otherwise the centroid is out of place)
panel = Panel("voids")
tmatch = MatchText(Text=objatts.LayerName, Pattern=panel, Case=True)
dispatch = Dispatch(List=environment_geometries, DispatchPattern=tmatch)  # -> ListA, ListB
flip = MeshFlip(Mesh=dispatch.ListA)
weave = Weave(Pattern=tmatch, Stream0=dispatch.ListB, Stream1=flip, NullGaps=False)

volume = Volume(Geometry=weave)  # -> Volume, Centroid

tag = TextTag(Location=volume.Centroid, Text=objatts.Name, Colour=objatts.Color)
