# Grasshopper definition field benchmarks.gh (Grasshopper 1.0.7)
# Copyright: Co-de-iT
# plug-ins: Assembler, Human, froGH

crv = Curve(<curve referenced from the Rhino model>)

# ---- group: Field geometry
# Setup
mesh = Mesh(<mesh referenced from the Rhino model>)

# ---- group: compute scalar values / Scalar values curve
crv_2 = Curve(reparameterize(crv))

# ----
previewlw = CustomPreviewLineweights(Geometry=crv_2, Shader=ColourSwatch(SwatchColor=RGB(255, 0, 255)), Thickness="5", Absolute=False)

field_scalar_threshold = Slider(0.143, range=0..1)
swatch = ColourSwatch(SwatchColor=RGBA(204, 204, 204, 75))

# ---- group: iWeights
n_of_rule_sets = Slider(3, range=1..5)
div = DivideDomain(Domain=Domain(0, 1), Count=n_of_rule_sets)
subtraction = Subtraction(A=n_of_rule_sets, B="1")
merge = Merge(
    Data1=ColourSwatch(SwatchColor=RGB(255, 255, 255)),
    Data2=ColourSwatch(SwatchColor=RGB(255, 0, 0)),
    Data3=ColourSwatch(SwatchColor=RGB(108, 227, 30)),
    Data4=ColourSwatch(SwatchColor=RGB(45, 151, 196)),
    Data5=ColourSwatch(SwatchColor=RGB(214, 199, 32)))

# ----
# parti editabili
# bake
# preview on/off
# Field
number_slider = Slider(30, range=10..30)
# <title>
# 
# <description>
# 
# code by Alessio Erioli
# 
# v 0.1
# © a3 2021 / Creative Commons Attribution-Non Commercial-ShareAlike 4.0 International License
afieldn = ConstructFieldN(Geometry=mesh, Plane=PlaneXY(0, 0, 0), NCells=number_slider)  # -> Field, FieldCellsDimensions, FieldPoints
merge_2 = Merge(Data1=ColourSwatch(SwatchColor=RGB(255, 0, 255)), Data2=ColourSwatch(SwatchColor=RGB(0, 0, 0)))

# ---- group: "Metaballs"
pt = Point(Point(-120.8529332, -51.24999442, 64.36055306))
pt_2 = Point(Point(-48.42769313, 50.24567265, 31.36876526))
pt_3 = Point(Point(-92.02850704, 116.6706337, 136.2374086))
merge_3 = Merge(Data1=pt, Data2=pt_2, Data3=pt_3)
dist = Distance(PointA=graft(afieldn.FieldPoints), PointB=merge_3)
sqrt = SquareRoot(Value=dist)
addition = Addition(A=sqrt, B="0.001")
one_over_x = OneOverX(Value=addition)
avr = Average(Input=one_over_x)  # -> flatten(ArithmeticMean)

# ---- group: compute vector values
pdecon = Deconstruct(Point=afieldn.FieldPoints)  # -> XComponent, YComponent, ZComponent
num = Number(pdecon.YComponent)
bnd = Bounds(Numbers=num)
remap = RemapNumbers(Value=num, Source=bnd, Target=Domain(0, 1))  # -> Mapped, Clipped
larger = LargerThan(FirstNumber=remap.Mapped, SecondNumber=Slider(0.5, range=0..1))  # -> LargerThan, OrEqualTo
X = UnitX(Factor=1)
Y = UnitY(Factor=1)
weave = Weave(Pattern=graft(larger.LargerThan), Stream0=Y, Stream1=X, NullGaps=False)  # -> flatten(Weave)

# ---- group: iWeights (continued)
num_2 = Number(pdecon.YComponent)
bnd_2 = Bounds(Numbers=num_2)
remap_2 = RemapNumbers(Value=num_2, Source=bnd_2, Target=Domain(0, 1))  # -> Mapped, Clipped
graph = GraphMapper(remap_2.Mapped)
fdom = FindDomain(Domains=div, Number=remap_2.Mapped, Strict=False)  # -> Index, Neighbour
multiplication = Multiplication(A=graph, B=subtraction)
round = Round(Number=multiplication)  # -> Nearest, Floor, Ceiling
int = Integer(fdom.Neighbour)

# ---- group: compute scalar values
pull = PullPoint(Point=afieldn.FieldPoints, Geometry=crv_2, ClosestOnly=True)  # -> ClosestPoint, Distance

# ----
sqrt_2 = SquareRoot(Value=pull.Distance)
sqr = Square(Value=pull.Distance)
afpop = PopulateField(Field=afieldn.Field, ScalarValues=pull.Distance, VectorValues=weave, IWeightValues=int)
afcol = ColorField(Field=afpop, Colors=merge_2, Index=0, Threshold=field_scalar_threshold, FieldColorBlend=False)  # -> Field, Colors

# ----
# Setup display
expansion_factor = Slider(1.404, range=0..2)
bbox = BoundingBox(Content=mesh, Plane=PlaneXY(0, 0, 0))  # -> Box, Box_2
boxprop = BoxProperties(Box=bbox.Box)  # -> Center, Diagonal, Area, Volume, Degeneracy
multiplication_2 = Multiplication(A=expansion_factor, B=boxprop.Diagonal)
box = EvaluateBox(Box=bbox.Box, UParameter="0", VParameter="0", WParameter="0")  # -> Plane, Point, Include
series = Series(Start="1", Step=1, Count="3")
devec = DeconstructVector(Vector=multiplication_2)  # -> XComponent, YComponent, ZComponent
X_2 = UnitX(Factor=1)
Y_2 = UnitY(Factor=1)
Z = UnitZ(Factor=1)
afdecon = DeconstructField(Field=afcol.Field)  # -> Points, flatten(ScalarValues), flatten(Vectors), flatten(IWeights), Colors, Topology, TopologyWeights
multiplication_3 = Multiplication(A=devec.XComponent, B=series)
merge_4 = Merge(Data1=X_2, Data2=Y_2, Data3=Z)
X_3 = UnitX(Factor=multiplication_3)
panel = Panel("""Scalar Field
Vector Field
iWeights""")
line = LineSDL(Start=box.Plane, Direction=merge_4, Length=Slider(20, range=1..50))
move = Move(Geometry=afdecon.Points, Motion=graft(X_3))  # -> Geometry, Transform
move_2 = Move(Geometry=box.Plane, Motion=X_3)  # -> Geometry, Transform
bang = ExplodeTree(Data=move.Geometry)  # -> Branch0, Branch1, Branch2

# ---- group: axis tripod
panel_2 = Panel("""Red
Green
Blue""")
previewlw_2 = CustomPreviewLineweights(Geometry=line, Shader=panel_2, Thickness=Slider(4, range=1..10), Absolute=False)

# ---- group: Text labels
tag = TextTag3D(
    Location=move_2.Geometry,
    Text=panel,
    Size=Slider(8.091, range=1..10),
    Colour=ColourSwatch(SwatchColor=RGB(0, 0, 0)),
    Justification=1)

# ---- group: scalar
f_pcd = PointCloudDisplay(Points=bang.Branch0, Colors=afcol.Colors, Size=Slider(3, range=1..5))

# ---- group: vector
multiplication_4 = Multiplication(A=afdecon.Vectors, B=Slider(5, range=1..5))
vdisex = VectorDisplayEx(Point=bang.Branch1, Vector=multiplication_4, Colour=afdecon.Vectors, Width=Slider(5, range=1..5))

# ---- group: iWeights colors
item = ListItem(List=merge, Index=afdecon.IWeights, Wrap=True)
f_pcd_2 = PointCloudDisplay(Points=bang.Branch2, Colors=item, Size=Slider(3, range=1..5))

# ---- group: Text iWeights
tag_2 = TextTag3D(Location=bang.Branch2, Text=afdecon.IWeights, Size=Slider(2, range=1..3), Colour=item, Justification=7)  # disabled
