# Grasshopper definition 01-08_base envelope_Assemblage random - face orientation_Elefront.gh (Grasshopper 1.0.7)
# Copyright: Co-de-iT
# plug-ins: Assembler, MeshEdit Components, froGH, EleFront, Human

# ---- group: all polylines
# ASSEMBLAGES IN BRIEF: GENERAL STEPS
# 
# . choose WHERE to add
# 
# . choose WHAT to add
# 
# 
# PROCESS STEPS
# 
# 
# 
# . select receiver object in the assemblage
# 
# . list all possible combinations of free handles and related compatible candidates
# 
# . choose a winnig candidate according to given criteria
# DEFINITION ANATOMY: 00 - constuct
# 
# Construct the object and relationships necessary for the Assemblage
# 
# 
# 
# 01 - simulate
# 
# Simulate the Assemblage growth
# 
# 
# 
# 02 - analyze/post-process
# 
# Analyze results and post-process the obtained assemblage
crv = Curve([<curve referenced from the Rhino model> x10])

# ----
# Assembler
# 
# Framework for Iterative Assemblages workflow
# 
# code by Alessio Erioli
# 
# v 1.0
# © Co-de-iT 2021 / Creative Commons Attribution-Non Commercial-ShareAlike 4.0 International License
# 0 - construct
rotations = Panel("90")
lng = ListLength(List=crv)
repeat = RepeatData(Data=graft(rotations), Length=lng)
flip = FlipMatrix(Data=repeat)  # -> simplify(Data)
type = Panel("1")

# ---- group: Construct Handles
handcon = ConstructHandle(Polyline=graft(crv), RotationAngles=flip, Type=type, Weight=1)  # -> flatten(Handle)

# ---- group: Display Handles
handdisp = DisplayHandles(Handles=handcon, DisplaySize=Slider(0.1, range=0..0.5), absHTextSize=False)

# ----
name = Panel("block 01")
X = UnitX(Factor=1)
mesh = Mesh(<mesh referenced from the Rhino model>)
aocon = ConstructAssemblyObject(Name=name, CollisionMesh=mesh, Direction=X, Handles=handcon, Weight=1, ZLockAO=False)

# ---- group: curve for envelope elements
crv_2 = Curve([<curve referenced from the Rhino model> x10])

# ----
xdcon = ConstructXData(Label="block 01 body", AssemblyObject=aocon, Data=crv_2)

# ---- group: heuristics
heuw = HeuristicsWriter(AssemblyObjectsSet=aocon, noSH=False, noSO=False, xHT=False)
pt = Point(Point(0, 20, 0))

# ----
heuset = HeuristicsSettings(HeuristicsSet=heuw, CurrentHeuristics=0, HeuristicsMode=0, ReceiverSelectionMode=0, SenderRuleSelectionMode=0)
# Reset the system to apply setup changes
reset = Button()
max_objects = Panel("2000")
step = Button()

# ---- group: heuristics / Heuristics Display
heud = HeuristicDisplay(
    OriginPoint=pt,
    AssemblyObjectsSet=aocon,
    HeuristicsSet=heuw,
    XSize=1.2,
    YSize=1.2,
    TextSize=1,
    NRows=10,
    DisplayType="AO Types",
    ZLockFilter=False)

# ----
# 1 - simulate
pt_2 = Point(Point(0, -50, 0))

# ---- group: Assemblage Engine
aoaengine = AssemblerEngine(
    AssemblyObjectsSet=aocon,
    StartingPlane=pt_2,
    StartingObjectType=Slider(0, range=0..1),
    HeuristicsSettings=heuset,
    Go=False,
    Step=step,
    NIterations=Slider(100, range=10..100),
    TargetMaxNObjects=max_objects,
    ResetSettings=False,
    Reset=reset,
    UseSupports=False,
    ZLockCheck=False)  # -> Assemblage, AssemblageCount

# ----
n_of_objects = Panel(aoaengine.AssemblageCount)
dam = DataDam(DataA=aoaengine.Assemblage, BufferDelay=10000000, BufferMode=0)
aoadisp = DisplayAssemblage(Assemblage=aoaengine.Assemblage, ColorsOnly=False, OutputType="Objects")  # -> ColoredCollisionMeshes, Edges, Colors, Values
# How to check face orientation (up, horizontal and down): Check the vector angle between the face normal and the absolute Z vector:
# 
# . an angle close to 0 means the 2 vectors are parallel and pointing in the same direction: face is pointing up
# 
# . an angle close to 90 (half Pi) means the 2 vectors are perpendicular: face is vertical
# 
# . an angle close to 180 (Pi) means the two vectors are parallel but pointing in opposite directions:  face is pointing down
aoadecon = DeconstructAssemblage(Assemblage=dam)  # -> AssemblageObjects, AssemblageRules, ReceiverObjectsIndexes, AvailableObjectIndexes, UnreachableObjectIndexes

# ---- group: Extract Topology
aotopo = ExtractTopology(Assemblage=dam)  # -> HandleOccupancy, NeighbourObjectIndex, NeighbourHandleIndex

# ---- group: display components
# 2 - analyze/post-process
mjoin = MeshJoin(Meshes=aoadisp.ColoredCollisionMeshes)  # disabled
preview = CustomPreview(Geometry=mjoin, Material=ColourSwatch(SwatchColor=RGB(255, 255, 255)))  # disabled

# ---- group: display components / display edges
previewlw = CustomPreviewLineweights(Geometry=aoadisp.Edges, Shader=ColourSwatch(SwatchColor=RGB(0, 0, 0)), Absolute=False)

# ---- group: find free handles
equals = Equality(FirstNumber=aotopo.HandleOccupancy, SecondNumber="0")  # -> Equality, Inequality

# ----
associate_xdata = AssociateXData(AssemblyObjects=aoadecon.AssemblageObjects, XData=xdcon)  # "AO<>XD"
aoehandles = ExtractHandles(AssemblyObject=aoadecon.AssemblageObjects)  # -> HandlesSenderPlanes, HandlesTypes, HandlesWeights, HandleOccupancy, NeighbourObjectIndex, NeighbourHandleIndex

# ----
# 0
# global Z vector
# 1
# 1
# 2
# mesh normals
# Pi/2
# Pi
panel = Panel("""0 horizontal - ceiling
1 - vertical
2 horizontal - bottom""")

xddecon = DeconstructXData(XData=associate_xdata)  # -> Label, AssemblyObjectNameReference, ReferencePlane, Data
cull = CullPattern(List=aoehandles.HandlesSenderPlanes, CullPattern=equals.Equality)
cull_2 = CullPattern(List=xddecon.Data, CullPattern=equals.Equality)

# ---- group: separate horizontal/vertical condition
deplane = DeconstructPlane(Plane=cull)  # -> Origin, XAxis, YAxis, ZAxis
Z = UnitZ(Factor=1)
# 0
panel_2 = Panel("3")
angle = Angle(VectorA=deplane.ZAxis, VectorB=Z)  # -> Angle, Reflex
div = DivideDomain(Domain="0 to Pi", Count=panel_2)
panel_3 = Panel(div)
panel_4 = Panel("""0 horizontal - ceiling
1 - vertical
2 horizontal - bottom""")
fdom = FindDomain(Domains=div, Number=angle.Angle, Strict=False)  # -> Index, Neighbour

# ---- group: simple envelope
smesh = SimpleMesh(Brep=cull_2)
mjoin_2 = MeshJoin(Meshes=flatten(smesh))
flip_2 = MeshFlip(Mesh=mjoin_2)
f_mrenorm = MeshRebuildNormals(Mesh=smesh)
f_mrenorm_2 = MeshRebuildNormals(Mesh=flip_2)
sift = SiftPattern(List=f_mrenorm, SiftPattern=fdom.Index)  # -> Output0, Output1, Output2
preview_2 = CustomPreview(
    Geometry=f_mrenorm_2,
    Material={diffuse=RGB(221, 160, 221), emission=RGB(66, 48, 66), shine=0.5, specular=RGB(255, 255, 255), transparency=0})  # disabled
mesh_2 = Mesh(sift.Output0)
mesh_3 = Mesh(sift.Output1)
mesh_4 = Mesh(sift.Output2)
roof = ColourSwatch(SwatchColor=RGB(255, 212, 0))
facade = ColourSwatch(SwatchColor=RGB(255, 0, 0))
slab = ColourSwatch(SwatchColor=RGB(0, 55, 255))
preview_3 = CustomPreview(Geometry=mesh_2, Material=roof)
preview_4 = CustomPreview(Geometry=mesh_3, Material=facade)
preview_5 = CustomPreview(Geometry=mesh_4, Material=slab)

# ----
sift_2 = SiftPattern(List=cull, SiftPattern=fdom.Index)  # -> flatten(Output0), flatten(Output1), flatten(Output2)
dam_2 = DataDam(DataA=sift_2.Output0, BufferDelay=10000000, BufferMode=0)
dam_3 = DataDam(DataA=sift_2.Output1, BufferDelay=10000000, BufferMode=0)
dam_4 = DataDam(DataA=sift_2.Output2, BufferDelay=10000000, BufferMode=0)
lng_2 = ListLength(List=dam_3)
random = Random(Range="0 to 1", Number=lng_2, Seed="2", Integers=True)
multiplication = Multiplication(A=random, B="0.5")
pi = Pi(Factor=multiplication)
prot = RotatePlane(Plane=dam_3, Angle=pi)

# ---- group: apply roof blocks
panel_5 = Panel("roof element")
bake = BooleanToggle(False)

# ----
panel_6 = Panel("facade2")

# ---- group: apply facade blocks
panel_7 = Panel("facade")
bake_2 = BooleanToggle(False)

# ----
panel_8 = Panel("facade1")

# ---- group: apply slab blocks
panel_9 = Panel("slab")
bake_3 = BooleanToggle(False)

# ---- group: EleFront insert block
inblock = InsertBlock(BlockName=panel_5, SourcePlane=dam_2)

inblock_2 = InsertBlock(BlockName=panel_7, SourcePlane=prot)

inblock_3 = InsertBlock(BlockName=panel_9, SourcePlane=dam_4)

# ---- group: EleFront bake objects
bake_4 = BakeObjects(Geometry=inblock, Bake=bake)

bake_5 = BakeObjects(Geometry=inblock_2, Bake=bake_2)

bake_6 = BakeObjects(Geometry=inblock_3, Bake=bake_3)
