# Grasshopper definition Area analysis - Field from buildings distance.gh (Grasshopper 1.0.7)
# Copyright: Co-de-iT
# plug-ins: froGH, Human, Assembler

# ---- group: Area mesh
mesh = Mesh(<mesh referenced from the Rhino model>)

# ----
# Automatic reference geometry by layer & type
pipeline = GeometryPipeline(
    GroupByLayer=False,
    GroupByType=False,
    IncludeHidden=True,
    IncludeLocked=True,
    LayerFilter="Environment::buildings::mesh",
    NameFilter="*",
    SublayerFiltering=True,
    TypeFilter=32)
disjoint = DisjointMesh(Mesh=pipeline)
distance_threshold = Slider(150, range=1..1000)
volume = Volume(Geometry=disjoint)  # -> Volume, Centroid
pull = PullPoint(Point=volume.Centroid, Geometry=mesh, ClosestOnly=True)  # -> ClosestPoint, Distance
smaller = SmallerThan(FirstNumber=pull.Distance, SecondNumber=distance_threshold)  # -> SmallerThan, OrEqualTo
cull = CullPattern(List=disjoint, CullPattern=smaller.SmallerThan)
mjoin = MeshJoin(Meshes=cull)

# ----
# <title>
# 
# <description>
# 
# code by Alessio Erioli
# 
# v 0.1
# © a3 2021 / Creative Commons Attribution-Non Commercial-ShareAlike 4.0 International License
number_slider = Slider(0, range=0..90)
xy = XYPlane(Origin=Point(0, 0, 0))
prot = RotatePlane(Plane=xy, Angle=degrees(number_slider))
pt = Point(Point(526.4019271, 368.9412563, 27.83160385))
pt_2 = Point(Point(396.2753648, 498.6113996, -12.02968631))
pt_3 = Point(Point(504.6038347, 655.8265663, 79.32546237))
afieldn = ConstructFieldN(Geometry=mesh, Plane=prot, NCells=Slider(40, range=10..50))  # -> Field, FieldCellsDimensions, FieldPoints
merge = Merge(Data1=pt, Data2=pt_2, Data3=pt_3)
pull_2 = PullPoint(Point=afieldn.FieldPoints, Geometry=mjoin, ClosestOnly=True)  # -> ClosestPoint, Distance

mesh_2 = Mesh(mjoin)
f_mseea = MeshExtractEdgesWithToleranceAngle(Mesh=mesh_2, Angle=45)  # -> InternalEdges, NakedEdges
preview = CustomPreview(Geometry=mesh_2, Material=ColourSwatch(SwatchColor=RGB(138, 150, 145)))
previewlw = CustomPreviewLineweights(Geometry=[f_mseea.InternalEdges, f_mseea.NakedEdges], Shader=ColourSwatch(SwatchColor=RGB(0, 0, 0)), Absolute=False)

afpop = PopulateField(Field=afieldn.Field, ScalarValues=pull_2.Distance)
afcol = ColorField(
    Field=afpop,
    Colors=[RGB(255, 0, 0), RGB(0, 128, 255)],
    Index=0,
    Threshold=Slider(0.25, range=0..1),
    FieldColorBlend=False)  # -> Field, Colors
