# Grasshopper definition Clash_geometry - edge detection.gh (Grasshopper 1.0.7)
# plug-ins: Assembler, Human, froGH

# ----
# Handles
number_slider = Slider(0.355, range=0..1)
# parti editabili
# bake
# preview on/off
crv = Curve([<curve referenced from the Rhino model> x4])
handcon = ConstructHandle(Polyline=crv, RotationAngles=0, Type=0, Weight=1)
handdisp = DisplayHandles(Handles=handcon, DisplaySize=number_slider, absHTextSize=False)

# ----
# XData
mesh = Mesh(<mesh referenced from the Rhino model>)
mesh_2 = Mesh(<mesh referenced from the Rhino model>)
mesh_3 = Mesh(<mesh referenced from the Rhino model>)
mesh_4 = Mesh(<mesh referenced from the Rhino model>)
mesh_5 = Mesh(<mesh referenced from the Rhino model>)

# ----
# Setup
# AssemblyObject 1
mesh_6 = Mesh(<mesh referenced from the Rhino model>)
# <title>
# 
# <description>
# 
# code by Alessio Erioli
# 
# v 0.1
# © a3 2021 / Creative Commons Attribution-Non Commercial-ShareAlike 4.0 International License
name = Panel("Box")
aocon = ConstructAssemblyObject(Name=name, CollisionMesh=mesh_6, Direction=Vector(1, 0, 0), Handles=handcon, Weight=1, ZLockAO=False)
merge = Merge(Data1=mesh, Data2=mesh_2, Data3=mesh_3, Data4=mesh_4, Data5=mesh_5)
xdcon = ConstructXData(Label="actual geometry", AssemblyObject=aocon, Data=merge)

mesh_7 = Mesh([<mesh referenced from the Rhino model> x4])
crv_2 = Curve([<curve referenced from the Rhino model> x4])
xdcon_2 = ConstructXData(Label="clash line", AssemblyObject=aocon, Data=crv_2)
xdcon_3 = ConstructXData(Label="clash meshes", AssemblyObject=aocon, Data=mesh_7)

# ---- group: selective geometry
mesh_8 = Mesh([<mesh referenced from the Rhino model> x4])

# ----
# XData - selective geometry
panel = Panel("geom+")
xdcon_4 = ConstructXData(Label=panel, AssemblyObject=aocon, Data=mesh_8)

# ----
# Rules (Heuristics)
heuwri = HeuristicsWriter(AssemblyObjectsSet=aocon, noSH=False, noSO=False, xHT=False)
pt = Point(Point(0, 22.64105822, 0))
# Simulate
heud = HeuristicDisplay(
    OriginPoint=pt,
    AssemblyObjectsSet=aocon,
    XData=xdcon,
    HeuristicsSet=heuwri,
    XSize=1.2,
    YSize=1.2,
    TextSize=1,
    NRows=Slider(4, range=2..10),
    DisplayType="AO Types",
    ZLockFilter=False)

# ----
# Heuristics
# Settings
sender_selection_mode = ValueList({"Random": 0, "Scalar Field nearest": 1, "Scalar Field interpolated": 2, "Vector Field > nearest": 3, "Vector Field > interpolated": 4, "Vector Field <> nearest": 5, "Vector Field <> interpolated": 6, "Minimum local AABB volume": 7, "Minimum local AABB diagonal": 8, "Weighted Random Choice": 9}, selected="Scalar Field nearest")
receiver_selection_mode = ValueList({"Random": 0, "Scalar Field nearest": 1, "Scalar Field interpolated": 2, "Dense Packing": 3}, selected="Scalar Field nearest")
heuset = HeuristicsSettings(
    HeuristicsSet=heuwri,
    CurrentHeuristics=0,
    HeuristicsMode=0,
    ReceiverSelectionMode=receiver_selection_mode,
    SenderRuleSelectionMode=sender_selection_mode)

step = Button()
target_number = Panel("300")
go = BooleanToggle(False)

reset_settings = Button()
reset = Button()

# ---- group: starting plane (XY implicito)
pt_2 = Point(Point(-67.19070642, -0.4783107325, 0))

# ----
collision_check = ValueList({"lines": 0, "meshes": 1}, selected="lines")

# ----
# Field
number_slider_2 = Slider(20, range=10..20)
mesh_9 = Mesh(<mesh referenced from the Rhino model>)
afieldn = ConstructFieldN(Geometry=mesh_9, Plane=PlaneXY(0, 0, 0), NCells=number_slider_2)  # -> Field, FieldCellsDimensions, FieldPoints
merge_2 = Merge(Data1=ColourSwatch(SwatchColor=RGB(255, 255, 255)), Data2=ColourSwatch(SwatchColor=RGB(0, 0, 0)))

# ---- group: compute scalar values
crv_3 = Curve(<curve referenced from the Rhino model>)
crv_cp = CurveClosestPoint(Point=afieldn.FieldPoints, Curve=crv_3)  # -> Point, Parameter, Distance

# ----
previewlw = CustomPreviewLineweights(Geometry=crv_3, Shader=ColourSwatch(SwatchColor=RGB(255, 0, 255)), Thickness="5", Absolute=False)

afpop = PopulateField(Field=afieldn.Field, ScalarValues=crv_cp.Distance)

# ----
# Exogenous
# (environment)
# Settings
field_scalar_threshold = Slider(0.25, range=0..1)

afcol = ColorField(Field=afpop, Colors=merge_2, Index=0, Threshold=field_scalar_threshold, FieldColorBlend=False)  # -> Field, Colors

exoset = ExogenousSettings(
    EnvironmentMode="2",
    Field=afcol.Field,
    FieldScalarThreshold=field_scalar_threshold,
    Sandbox={Plane=PlaneXY(0, 0, 0), X=Domain(-1, 1), Y=Domain(0, 0), Z=Domain(0, 0)},
    HasContainer=False)

aoaengine = AssemblerEngine(
    AssemblyObjectsSet=aocon,
    StartingPlane=pt_2,
    StartingObjectType=0,
    HeuristicsSettings=heuset,
    ExogenousSettings=exoset,
    Go=go,
    Step=step,
    NIterations=Slider(10, range=10..100),
    TargetMaxNObjects=target_number,
    ResetSettings=reset_settings,
    Reset=reset,
    UseSupports=False,
    ZLockCheck=False)  # -> Assemblage, AssemblageCount

# ---- group: autostop condition
larger = LargerThan(FirstNumber=aoaengine.AssemblageCount, SecondNumber=target_number)  # -> LargerThan, OrEqualTo
f_tas = ToggleAutostop(Toggle=go, Condition=larger.OrEqualTo)

# ----
panel_2 = Panel(aoaengine.AssemblageCount)
# Post-process
aoadisp = DisplayAssemblage(Assemblage=aoaengine.Assemblage, ColorsOnly=False, OutputType="Orientation")  # -> ColoredCollisionMeshes, Edges, Colors, Values
aoadecon = DeconstructAssemblage(Assemblage=aoaengine.Assemblage)  # -> AssemblageObjects, AssemblageRules, ReceiverObjectsIndexes, AvailableObjectIndexes, UnreachableObjectIndexes
gate = StreamGate(Stream=aoadecon.AssemblageObjects, Gate=collision_check)  # -> Target0, Target1
associate_xdata = AssociateXData(AssemblyObjects=aoadecon.AssemblageObjects, XData=xdcon)  # "AO<>XD"
associate_xdata_2 = AssociateXData(AssemblyObjects=aoadecon.AssemblageObjects, XData=xdcon_4)  # "AO<>XD"
xddecon = DeconstructXData(XData=associate_xdata)  # -> Label, AssemblyObjectNameReference, ReferencePlane, Data
xddecon_2 = DeconstructXData(XData=associate_xdata_2)  # -> Label, AssemblyObjectNameReference, ReferencePlane, Data
mjoin = MeshJoin(Meshes=flatten(xddecon.Data))

# ---- group: clash check lines
associate_xdata_3 = AssociateXData(AssemblyObjects=gate.Target0, XData=xdcon_2)  # "AO<>XD"
xddecon_3 = DeconstructXData(XData=associate_xdata_3)  # -> Label, AssemblyObjectNameReference, ReferencePlane, Data
mcx = MeshCurve(Mesh=mjoin, Curve=graft(xddecon_3.Data))  # -> Points, Faces

# ---- group: clash check meshes
associate_xdata_4 = AssociateXData(AssemblyObjects=gate.Target1, XData=xdcon_3)  # "AO<>XD"
xddecon_4 = DeconstructXData(XData=associate_xdata_4)  # -> Label, AssemblyObjectNameReference, ReferencePlane, Data
mmx = MeshMesh(MeshA=graft(xddecon_4.Data), MeshB=mjoin)

# ----
filter = StreamFilter(Gate=collision_check, Stream0=mcx.Points, Stream1=mmx)
pshift = ShiftPaths(Data=filter, Offset=-1)
lng = ListLength(List=pshift)
equals = Equality(FirstNumber=lng, SecondNumber="0")  # -> Equality, Inequality
pshift_2 = ShiftPaths(Data=equals.Equality, Offset=-1)
cull = CullPattern(List=xddecon_2.Data, CullPattern=pshift_2)

f_mmeea = MeshesExtractEdgesWithToleranceAngle(Mesh=flatten(xddecon.Data), Angle=45)  # -> InternalEdges, NakedEdges
preview = CustomPreview(Geometry=xddecon.Data, Material=graft(aoadisp.Colors))
previewlw_2 = CustomPreviewLineweights(Geometry=[f_mmeea.InternalEdges, f_mmeea.NakedEdges], Shader=ColourSwatch(SwatchColor=RGB(0, 0, 0)), Absolute=False)

f_mmeea_2 = MeshesExtractEdgesWithToleranceAngle(Mesh=flatten(cull), Angle=45)  # -> InternalEdges, NakedEdges
preview_2 = CustomPreview(Geometry=cull, Material=ColourSwatch(SwatchColor=RGB(81, 255, 0)))
previewlw_3 = CustomPreviewLineweights(Geometry=[f_mmeea_2.InternalEdges, f_mmeea_2.NakedEdges], Shader=ColourSwatch(SwatchColor=RGB(0, 0, 0)), Absolute=False)
