# Grasshopper definition PP_cluster connected objects.gh (Grasshopper 1.0.7)
# Copyright: Co-de-iT
# plug-ins: froGH, Assembler, Kangaroo2 Components

required_plugins = Panel(". froGH")

# ----
# This snippet is useful for assemblages starting from different points (i.e. when using AOpa with sparse starting AO)
# display clusters of connected objects
# This part considers connected clusters of objects (objects that are connected through their handles), displaying each cluster in a different color. If two cluster establish a connection, they will become one cluster. The definition starts with 3 colors, decreasing to 2 and then 1 if the clusters connect as the assemblage grows.
geometry_to_display = Relay()
assemblage = Relay()
aoadecon = DeconstructAssemblage(Assemblage=assemblage)  # -> flatten(AssemblageObjects), AssemblageRules, ReceiverObjectsIndexes, AvailableObjectIndexes, UnreachableObjectIndexes
# Assembler
# 
# Framework for Iterative Assemblages workflow
# 
# code by Alessio Erioli
# 
# v 1.0
# © Co-de-iT 2021 / Creative Commons Attribution-Non Commercial-ShareAlike 4.0 International License
geo = Geometry(flatten(geometry_to_display))
aoplane = ExtractReferencePlane(AssemblyObject=aoadecon.AssemblageObjects)

# ---- group: Extract Topology
aoatopo = ExtractTopology(Assemblage=assemblage)  # -> HandleOccupancy, NeighbourObjectIndex, NeighbourHandleIndex

# ----
cset = CreateSet(List=aoatopo.NeighbourObjectIndex)  # -> Set, Map
equals = Equality(FirstNumber=cset.Set, SecondNumber="-1")  # -> Equality, Inequality
cull = CullPattern(List=cset.Set, CullPattern=equals.Inequality)  # -> simplify(List)
item = ListItem(List=aoadecon.AssemblageObjects, Index=cull, Wrap=True)
aoplane_2 = ExtractReferencePlane(AssemblyObject=item)
ln = Line(StartPoint=graft(aoplane), EndPoint=aoplane_2)  # -> flatten(Line)
dupln = RemoveDuplicateLines(Lines=ln, Tolerance=0.01)

# ---- group: froGH - Topologizer
f_tln = Topologizer(LinesNetwork=dupln, Decimals=3)  # -> Points, LinePointsData, Point2PointsConnectivity, LineDirectionAtEachPoint

# ---- group: froGH - Clusterizer
f_clstr = Clusterizer(TopologyData=f_tln.Point2PointsConnectivity)

# ----
cp = ClosestPoint(Point=f_tln.Points, Cloud=aoplane)  # -> ClosestPoint, CPIndex, Distance
item_2 = ListItem(List=cp.CPIndex, Index=f_clstr, Wrap=True)
tstat = TreeStatistics(Tree=item_2)  # -> Paths, Length, Count
item_3 = ListItem(List=flatten(geo), Index=item_2, Wrap=True)
wheel = ColourWheel(
    tstat.Count,
    ColourGrips_Style=41,
    ColourGrips_Grip=[0, 3.141592654, 1.570796327, 4.71238898],
    ColourGrips_Lum=[0.1, 0.5],
    ColourGrips_Range=[0.2617993878, 0.2617993878, 0.2617993878, 0.2617993878],
    ColourGrips_Sat=[0.2, 0.6])
n_of_clusters = Panel(tstat.Count)
preview = CustomPreview(Geometry=item_3, Material=graft(wheel))
