# Grasshopper definition Assemblage Save Data.gh (Grasshopper 1.0.7)
# Copyright: Co-de-iT
# plug-ins: Assembler, froGH

# method 1
# unique file
assemblage = Relay()
# method 2
# single files
assemblage_2 = Relay()
aoadecon = DeconstructAssemblage(Assemblage=assemblage)  # -> AssemblageObjects, AssemblageRules, ReceiverObjectsIndexes, AvailableObjectIndexes, UnreachableObjectIndexes
aoadisp = DisplayAssemblage(Assemblage=assemblage, ColorsOnly=False, OutputType="Local Density")  # -> ColoredCollisionMeshes, Edges, Colors, Values
aoadisp_2 = DisplayAssemblage(Assemblage=assemblage_2, ColorsOnly=False, OutputType="Local Density")  # -> ColoredCollisionMeshes, Edges, Colors, Values
aoadecon_2 = DeconstructAssemblage(Assemblage=assemblage_2)  # -> AssemblageObjects, AssemblageRules, ReceiverObjectsIndexes, AvailableObjectIndexes, UnreachableObjectIndexes
assemblage_name = Panel("Assemblage 01")
viewer = ParamViewer(aoadecon_2.AssemblageObjects)
viewer_2 = ParamViewer(aoadecon.AssemblageObjects)
# <title>
# 
# <description>
# 
# code by Alessio Erioli
# 
# v 0.1
# © a3 2021 / Creative Commons Attribution-Non Commercial-ShareAlike 4.0 International License
assemblage_name_2 = Panel("Assemblage 01")
f_ghfilepath = GHFilePathInfo()  # -> FileName, FilePath
save = Button()
save_2 = Button()
dpath = DeconstructPath(Branch=viewer)
ins = InsertItems(List=flatten(aoadecon_2.AssemblageRules), Item="-", Indices="0", Wrap=True)
ins_2 = InsertItems(List=flatten(aoadecon_2.ReceiverObjectsIndexes), Item="-", Indices="0", Wrap=True)
concat = Concatenate(FragmentA=f_ghfilepath.FilePath, FragmentB=assemblage_name, FragmentC="\")
dpath_2 = DeconstructPath(Branch=viewer_2)
f_ghfilepath_2 = GHFilePathInfo()  # -> FileName, FilePath
concat_2 = Concatenate(FragmentA=f_ghfilepath_2.FilePath, FragmentB=assemblage_name_2, FragmentC="\")
merge = Merge(Data1=simplify("-"), Data2=aoadecon.AssemblageRules)
merge_2 = Merge(Data1=simplify("-"), Data2=aoadecon.ReceiverObjectsIndexes)
match = MatchTree(Tree=graft(aoadisp.Colors), Guide=aoadecon.AssemblageObjects)
match_2 = MatchTree(Tree=graft(aoadisp.Values), Guide=aoadecon.AssemblageObjects)
match_3 = MatchTree(Tree=dpath_2, Guide=aoadecon.AssemblageObjects)
labels = Panel("""AIndexes
Rules
Receivers AIndexes
colors
recValues""")
merge_3 = Merge(Data1=match_3, Data2=merge, Data3=merge_2, Data4=match, Data5=match_2)
text_separator = Panel(";")
concat_3 = Concatenate(FragmentA=assemblage_name, FragmentB="_AOs")
concat_4 = Concatenate(FragmentA=assemblage_name, FragmentB="_AIndexes.txt")
concat_5 = Concatenate(FragmentA=assemblage_name, FragmentB="_colors.txt")
concat_6 = Concatenate(FragmentA=assemblage_name, FragmentB="_recValues.txt")
concat_7 = Concatenate(FragmentA=assemblage_name, FragmentB="_rules.txt")
concat_8 = Concatenate(FragmentA=assemblage_name, FragmentB="_receivers.txt")
ao_json = AssemblyObjectsToJSON(AssemblyObjects=flatten(aoadecon_2.AssemblageObjects), Directory=concat, FileName=concat_3, Save=save)
join = TextJoin(Text=labels, Join=text_separator)  # -> flatten(Result)
join_2 = TextJoin(Text=merge_3, Join=text_separator)  # -> flatten(Result)
f_str2file = SaveStringToFile(String=flatten(dpath), FilePath=concat, FileName=concat_4, SaveTrigger=save_2)
f_str2file_2 = SaveStringToFile(String=flatten(ins), FilePath=concat, FileName=concat_7, SaveTrigger=save_2)
f_str2file_3 = SaveStringToFile(String=flatten(ins_2), FilePath=concat, FileName=concat_8, SaveTrigger=save_2)
f_str2file_4 = SaveStringToFile(String=aoadisp_2.Colors, FilePath=concat, FileName=concat_5, SaveTrigger=save_2)
f_str2file_5 = SaveStringToFile(String=aoadisp_2.Values, FilePath=concat, FileName=concat_6, SaveTrigger=save_2)
save_3 = Button()
save_4 = Button()
merge_4 = Merge(Data1=join, Data2=join_2)
concat_9 = Concatenate(FragmentA=assemblage_name_2, FragmentB="_AOs")
concat_10 = Concatenate(FragmentA=assemblage_name_2, FragmentB="_data.txt")
ao_json_2 = AssemblyObjectsToJSON(AssemblyObjects=flatten(aoadecon.AssemblageObjects), Directory=concat_2, FileName=concat_9, Save=save_3)
f_str2file_6 = SaveStringToFile(String=merge_4, FilePath=concat_2, FileName=concat_10, SaveTrigger=save_4)
# Retrieve data - method 2
# Insert full path+file name
# 
# ex:
# 
# C:\MyData\Assemblage_values.txt
# do this for each individual file you need
file = ReadFile(PerLineParse=True)
# Retrieve data - method 1
# Insert full path+file name
# 
# ex:
# 
# C:\MyData\Assemblage_data.txt
file_2 = ReadFile(PerLineParse=True)
# Retrieve AOs (both methods)
text_separator_2 = Panel(";")
# Insert full path+file name to the JSON file
# 
# ex:
# 
# C:\MyData\Assemblage_000_d.JSON
json_ao = AssemblyObjectsFromJSON()
split = SplitList(List=file_2, Index="1")  # -> ListA, ListB
split_2 = TextSplit(Text=split.ListA, Separators=text_separator_2)
split_3 = TextSplit(Text=split.ListB, Separators=text_separator_2)
labels_2 = Panel(split_2)
data = Panel(split_3)
