# Grasshopper definition base part_2 AO_E-F-Weights.gh (Grasshopper 1.0.7)
# Copyright: Co-de-iT
# plug-ins: Assembler, Human, froGH

# ----
# introducing weights
# Weights of Handles, AssemblyObjects, and Rules are used in Assembler to determine precedence in case 2 or more candidates have same Field values. By default they are all set to 1
# 
# In case of equal computed value for 2 or more candidates, a cadidate factor is computed as:
# 
# Cf = Rw + AOw + Hw
# 
#  (the sum of Rule, AssemblyObject and Handle weights - highest weight prevails). Rule weights are integers, while AO and Handle weights are floating point numbers.
# 
# This example uses weights in Handles and AssemblyObjects
# 
# Play with the values and see how the Assemblage changes as a result
# candidate factor
# Cf = Rw + AOw + Hw
more_info_on_weights_in_assembler_docume = Panel("https://ale2x72.notion.site/Weights-5d31bef855d941509af1ef9291273dba?pvs=4")  # "More info on weights in Assembler documentation"

# ----
# parti editabili
# Setup
# bake
# preview on/off
# Handles
crv = Curve(<curve referenced from the Rhino model>)
crv_2 = Curve(<curve referenced from the Rhino model>)
crv_3 = Curve(<curve referenced from the Rhino model>)
crv_4 = Curve(<curve referenced from the Rhino model>)
crv_5 = Curve(<curve referenced from the Rhino model>)
panel = Panel("""0
90""")
panel_2 = Panel("1.5")
panel_5 = Panel("0.5")
panel_8 = Panel("1")
handcon = ConstructHandle(Polyline=crv, RotationAngles=0, Type=0, Weight=1)
handcon_2 = ConstructHandle(Polyline=crv_2, RotationAngles=0, Type=0, Weight=1)
handcon_3 = ConstructHandle(Polyline=crv_3, RotationAngles=0, Type=0, Weight=1)
handcon_4 = ConstructHandle(Polyline=crv_4, RotationAngles=0, Type="1", Weight=1)
handcon_5 = ConstructHandle(Polyline=crv_5, RotationAngles=0, Type="1", Weight=1)

# ----
# Handles
crv_6 = Curve(<curve referenced from the Rhino model>)
crv_7 = Curve(<curve referenced from the Rhino model>)
crv_8 = Curve(<curve referenced from the Rhino model>)
crv_9 = Curve(<curve referenced from the Rhino model>)
panel_11 = Panel("""0
180""")
handcon_6 = ConstructHandle(Polyline=crv_7, RotationAngles=0, Type=0, Weight=1)
handcon_7 = ConstructHandle(Polyline=crv_8, RotationAngles=0, Type=0, Weight=1)
handcon_8 = ConstructHandle(Polyline=crv_9, RotationAngles=0, Type=0, Weight=1)
handcon_9 = ConstructHandle(Polyline=crv_6, RotationAngles=panel_11, Type="2", Weight=1)

# ----
# Environment
mesh = Mesh(<mesh referenced from the Rhino model>)
mesh_2 = Mesh(<mesh referenced from the Rhino model>)
mesh_3 = Mesh(<mesh referenced from the Rhino model>)
mesh_4 = Mesh(<mesh referenced from the Rhino model>)
mesh_5 = Mesh(<mesh referenced from the Rhino model>)
merge = Merge(Data1=mesh_2, Data2=mesh_3, Data3=mesh_5, Data4=mesh, Data5=mesh_4)

crv_10 = Curve(<curve referenced from the Rhino model>)
crv_11 = Curve(<curve referenced from the Rhino model>)

# ---- group: compute scalar values / Scalar values curve
crv_12 = Curve(crv_10)

# ---- group: Field boxes
mesh_6 = Mesh(<mesh referenced from the Rhino model>)
mesh_7 = Mesh(<mesh referenced from the Rhino model>)

# ----
previewlw = CustomPreviewLineweights(Geometry=crv_12, Shader=ColourSwatch(SwatchColor=RGB(255, 0, 255)), Thickness="5", Absolute=False)

# ----
# Collision mesh (spazio occupato)
mesh_8 = Mesh(<mesh referenced from the Rhino model>)

# ----
# AssemblyObject 01
number_slider = Slider(0.355, range=0..1)
merge_2 = Merge(Data1=handcon, Data2=handcon_2, Data3=handcon_3, Data4=handcon_4, Data5=handcon_5)
# <title>
# 
# <description>
# 
# code by Alessio Erioli
# 
# v 0.1
# © a3 2021 / Creative Commons Attribution-Non Commercial-ShareAlike 4.0 International License
name = Panel("Part_01")
handdisp = DisplayHandles(Handles=merge_2, DisplaySize=number_slider, absHTextSize=False)
aocon = ConstructAssemblyObject(Name=name, CollisionMesh=mesh_8, Direction=Vector(1, 0, 0), Handles=merge_2, Weight=1, ZLockAO=False)

# ----
# Collision mesh (spazio occupato)
mesh_9 = Mesh(<mesh referenced from the Rhino model>)

# ----
# AssemblyObject 02
number_slider_2 = Slider(0.355, range=0..1)
merge_3 = Merge(Data1=handcon_6, Data2=handcon_7, Data3=handcon_8, Data4=handcon_9)
name_2 = Panel("Part_02")
handdisp_2 = DisplayHandles(Handles=merge_3, DisplaySize=number_slider_2, absHTextSize=False)
aocon_2 = ConstructAssemblyObject(Name=name_2, CollisionMesh=mesh_9, Direction=Vector(1, 0, 0), Handles=merge_3, Weight=1, ZLockAO=False)

# ---- group: floor
mesh_10 = Mesh(<mesh referenced from the Rhino model>)

# ---- group: short wall 1
mesh_11 = Mesh(<mesh referenced from the Rhino model>)

# ---- group: short wall 2
mesh_12 = Mesh(<mesh referenced from the Rhino model>)

# ---- group: config c1
mesh_13 = Mesh([<mesh referenced from the Rhino model> x26])

# ---- group: config c2
mesh_14 = Mesh([<mesh referenced from the Rhino model> x13])

# ---- group: floor 1
mesh_15 = Mesh(<mesh referenced from the Rhino model>)

# ---- group: floor
mesh_16 = Mesh(<mesh referenced from the Rhino model>)

# ---- group: floor 2
mesh_17 = Mesh(<mesh referenced from the Rhino model>)

# ---- group: floor 3
mesh_18 = Mesh(<mesh referenced from the Rhino model>)

# ---- group: wall
mesh_19 = Mesh(<mesh referenced from the Rhino model>)

# ---- group: pillars
mesh_20 = Mesh([<mesh referenced from the Rhino model> x2])

# ----
# XData
merge_4 = Merge(Data1=mesh_16, Data2=mesh_19)
merge_5 = Merge(Data1=mesh_15, Data2=mesh_17, Data3=mesh_18, Data4=mesh_20)
mjoin = MeshJoin(Meshes=flatten(merge_4))
mjoin_2 = MeshJoin(Meshes=flatten(merge_5))
xdcon = ConstructXData(Label="geometryV", AssemblyObject=aocon_2, Data=mjoin_2)
xdcon_2 = ConstructXData(Label="geometryH", AssemblyObject=aocon_2, Data=mjoin)

# ----
# XData
merge_6 = Merge(Data1=mesh_10, Data2=mesh_11, Data3=mesh_12)
mjoin_3 = MeshJoin(Meshes=flatten(merge_6))
xdcon_3 = ConstructXData(Label="c0", AssemblyObject=aocon, Data=mjoin_3)
xdcon_4 = ConstructXData(Label="c1", AssemblyObject=aocon, Data=mesh_13)
xdcon_5 = ConstructXData(Label="c2", AssemblyObject=aocon, Data=mesh_14)

merge_7 = Merge(Data1=xdcon_2, Data2=xdcon)
swatch = ColourSwatch(SwatchColor=RGBA(204, 204, 204, 75))
merge_8 = Merge(Data1=aocon, Data2=aocon_2)
merge_9 = Merge(Data1=xdcon_3, Data2=merge_7)

# ---- group: origin point
pt = Point(Point(0, 20, 0))

# ----
# Rules (Heuristics)
heuwri = HeuristicsWriter(AssemblyObjectsSet=merge_8, noSH=False, noSO=False, xHT=False)
# Simulation
heud = HeuristicDisplay(
    OriginPoint=pt,
    AssemblyObjectsSet=merge_8,
    XData=merge_9,
    HeuristicsSet=heuwri,
    XSize=1.2,
    YSize=1.2,
    TextSize=1,
    NRows=Slider(5, range=2..10),
    DisplayType="AO Types",
    ZLockFilter=False)

# ----
# Heuristics
# Settings
sender_selection_mode = ValueList({"Random": 0, "Scalar Field nearest": 1, "Scalar Field interpolated": 2, "Vector Field > nearest": 3, "Vector Field > interpolated": 4, "Vector Field <> nearest": 5, "Vector Field <> interpolated": 6, "Minimum local AABB volume": 7, "Minimum local AABB diagonal": 8, "Weighted Random Choice": 9}, selected="Vector Field <> nearest")
receiver_selection_mode = ValueList({"Random": 0, "Scalar Field nearest": 1, "Scalar Field interpolated": 2, "Dense Packing": 3}, selected="Scalar Field nearest")
heuristics_mode = ValueList({"manual": 0, "Field driven": 1}, selected="manual")
heuset = HeuristicsSettings(
    HeuristicsSet=heuwri,
    CurrentHeuristics=0,
    HeuristicsMode=heuristics_mode,
    ReceiverSelectionMode=receiver_selection_mode,
    SenderRuleSelectionMode=sender_selection_mode)

# ----
# Input one integer weight per Rule
heuweigh = WeighHeuristics(HeuristicsSet=heuwri)

# ----
# display environment geometries names
# IMPORTANT: Objects must be named in Rhino
cluster = Cluster(environment_geometries=merge)

step = Button()
go = BooleanToggle(False)
target_number = Panel("1000")

reset_settings = Button()

# ---- group: starting plane (XY implicito)
pt_2 = Point(Point(-100, 28, 80))

# ----
# se si cambia qualcosa a monte (eccetto per gli XData) resettare l'engine
reset = Button()

# ----
# Field
number_slider_3 = Slider(20, range=10..50)
afieldn = ConstructFieldN(Geometry=mesh_6, Plane=PlaneXY(0, 0, 0), NCells=number_slider_3)  # -> Field, FieldCellsDimensions, FieldPoints
merge_10 = Merge(Data1=ColourSwatch(SwatchColor=RGB(255, 0, 255)), Data2=ColourSwatch(SwatchColor=RGB(0, 0, 0)))

# ---- group: iWeights
pt_3 = Point(Point(-55.06715, -64.95677007, 0))  # disabled
pt_4 = Point(Point(-87.52231766, 96.04004555, 92.07695168))  # disabled
number_slider_4 = Slider(2, range=1..5)  # disabled
panel_21 = Panel("""Red
Blue""")  # disabled
merge_11 = Merge(Data1=pt_3, Data2=pt_4)  # disabled
cp = ClosestPoint(Point=afieldn.FieldPoints, Cloud=merge_11)  # -> ClosestPoint, CPIndex, Distance; disabled
dots = DotDisplay(Point=merge_11, Colour=panel_21, Size=number_slider_4)  # disabled

# ---- group: compute vector values
pdecon = Deconstruct(Point=afieldn.FieldPoints)  # -> XComponent, YComponent, ZComponent
num = Number(pdecon.ZComponent)
bnd = Bounds(Numbers=num)
remap = RemapNumbers(Value=num, Source=bnd, Target=Domain(0, 1))  # -> Mapped, Clipped
larger = LargerThan(FirstNumber=remap.Mapped, SecondNumber=Slider(0.5, range=0..1))  # -> LargerThan, OrEqualTo
Y = UnitY(Factor=1)
X = UnitX(Factor=1)
weave = Weave(Pattern=graft(larger.LargerThan), Stream0=Y, Stream1=Y, NullGaps=False)  # -> flatten(Weave)

# ----
num_2 = Number(pdecon.YComponent)
bnd_2 = Bounds(Numbers=num_2)
dom = ConstructDomain(DomainStart=Slider(0, range=-180..0), DomainEnd=Slider(90, range=0..180))
remap_2 = RemapNumbers(Value=num_2, Source=bnd_2, Target=dom)  # -> Mapped, Clipped
Z = UnitZ(Factor=1)
X_2 = UnitX(Factor=1)
vrot = Rotate(Vector=X_2, Axis=Z, Angle=degrees(remap_2.Mapped))

# ---- group: compute scalar values
crv_cp = CurveClosestPoint(Point=afieldn.FieldPoints, Curve=crv_12)  # -> Point, Parameter, Distance

# ----
item = ListItem(List=afieldn.FieldPoints, Index=0, Wrap=True)  # -> Item, Item1
dist = Distance(PointA=item.Item, PointB=item.Item1)
cell_distance = Panel(dist)

sqrt = SquareRoot(Value=crv_cp.Distance)
sqr = Square(Value=crv_cp.Distance)

afpop = PopulateField(Field=afieldn.Field, ScalarValues=sqrt, VectorValues=weave, IWeightValues=cp.CPIndex)

# ---- group: iWeights colors
number_slider_5 = Slider(2, range=1..5)  # disabled

# ----
# Exogenous
# (environment)
# Settings
field_scalar_threshold = Slider(0.1, range=0..1)

afcol = ColorField(Field=afpop, Colors=merge_10, Index=0, Threshold=field_scalar_threshold, FieldColorBlend=False)  # -> Field, Colors
afdecon = DeconstructField(Field=afcol.Field)  # -> Points, flatten(ScalarValues), flatten(Vectors), flatten(IWeights), Colors, Topology, TopologyWeights
multiplication = Multiplication(A=afdecon.Vectors, B=Slider(3.63, range=1..5))
vdisex = VectorDisplayEx(Point=afdecon.Points, Vector=multiplication, Colour=afdecon.Vectors, Width=2)

# ---- group: Text Scalar
expression = Expression(x=afdecon.ScalarValues, Expression="Format(\"{0:0.00}\", x)")
tag = TextTag3D(Location=afdecon.Points, Text=expression, Size=Slider(1.5, range=1..3), Justification=7)  # disabled

# ---- group: iWeights colors (continued)
item_2 = ListItem(List=panel_21, Index=afdecon.IWeights, Wrap=True)  # disabled
f_pcd = PointCloudDisplay(Points=afdecon.Points, Colors=item_2, Size=number_slider_5)  # disabled

# ----
exoset = ExogenousSettings(
    EnvironmentMode="2",
    Field=afcol.Field,
    FieldScalarThreshold=field_scalar_threshold,
    Sandbox={Plane=PlaneXY(0, 0, 0), X=Domain(-1, 1), Y=Domain(0, 0), Z=Domain(0, 0)},
    HasContainer=False)

aoaengine = AssemblerEngine(
    AssemblyObjectsSet=merge_8,
    StartingPlane=pt_2,
    StartingObjectType=0,
    HeuristicsSettings=heuset,
    ExogenousSettings=exoset,
    Go=go,
    Step=step,
    NIterations=Slider(100, range=10..100),
    TargetMaxNObjects=target_number,
    ResetSettings=reset_settings,
    Reset=reset,
    UseSupports=False,
    ZLockCheck=False)  # -> Assemblage, AssemblageCount

# ---- group: autostop condition
larger_2 = LargerThan(FirstNumber=aoaengine.AssemblageCount, SecondNumber=target_number)  # -> LargerThan, OrEqualTo
f_tas = ToggleAutostop(Toggle=go, Condition=larger_2.OrEqualTo)

# ----
n_of_ao = Panel(aoaengine.AssemblageCount)
# Post-processing
aoadisp = DisplayAssemblage(Assemblage=aoaengine.Assemblage, ColorsOnly=False, OutputType="AO Types")  # -> ColoredCollisionMeshes, Edges, Colors, Values
aoadecon = DeconstructAssemblage(Assemblage=aoaengine.Assemblage)  # -> AssemblageObjects, AssemblageRules, ReceiverObjectsIndexes, AvailableObjectIndexes, UnreachableObjectIndexes
associate_xdata = AssociateXData(AssemblyObjects=aoadecon.AssemblageObjects, XData=merge_9)  # "AO<>XD"

preview = CustomPreview(
    Geometry=aoadisp.ColoredCollisionMeshes,
    Material={diffuse=RGB(221, 160, 221), emission=RGB(66, 48, 66), shine=0.5, specular=RGB(255, 255, 255), transparency=0})  # disabled
# edges (bordi) delle collision Meshes
previewlw_2 = CustomPreviewLineweights(Geometry=aoadisp.Edges, Shader=ColourSwatch(SwatchColor=RGB(128, 128, 128)), Absolute=False)

# ----
# identify type 1 Horizontal-Vertical
data = Data(aoadecon.AssemblageObjects)

# ---- group: identify type
aoetype = ExtractType(AssemblyObject=data)
equals = Equality(FirstNumber=aoetype, SecondNumber="1")  # -> Equality, Inequality

# ---- group: separate types
dispatch = Dispatch(List=data, DispatchPattern=equals.Equality)  # -> ListA, ListB

# ---- group: identify horizontal-vertical alignment
aoerplane = ExtractReferencePlane(AssemblyObject=dispatch.ListA)
deplane = DeconstructPlane(Plane=aoerplane)  # -> Origin, XAxis, YAxis, ZAxis
Z_2 = UnitZ(Factor=1)
dprod = DotProduct(VectorA=deplane.XAxis, VectorB=Z_2, Unitize=False)
abs = Absolute(Value=dprod)

# ----
lng = ListLength(List=dispatch.ListB)
repeat = RepeatData(Data="0", Length=lng)

# ---- group: regroup types
weave_2 = Weave(Pattern=equals.Equality, Stream0=repeat, Stream1=abs, NullGaps=False)

# ----
item_3 = ListItem(List=associate_xdata, Index=weave_2, Wrap=True)
xddecon = DeconstructXData(XData=item_3)  # -> Label, AssemblyObjectNameReference, ReferencePlane, Data

# ----
# Utilizzate questo componente per fare il bake su Rhino
mesh_21 = Mesh(xddecon.Data)

f_mmeea = MeshesExtractEdgesWithToleranceAngle(Mesh=mesh_21, Angle=45)  # -> InternalEdges, NakedEdges
# edges (bordi) delle geometrie effettive
previewlw_3 = CustomPreviewLineweights(Geometry=[f_mmeea.InternalEdges, f_mmeea.NakedEdges], Shader=ColourSwatch(SwatchColor=RGB(0, 0, 0)), Absolute=False)

# ----
# visualizzazione delle geometrie effettive
preview_2 = CustomPreview(Geometry=mesh_21, Material=graft(aoadisp.Colors))

# ==== cluster Cluster
environment_geometries = ClusterInput()

# ----
# display environment geometries names
# IMPORTANT: Objects must be named in Rhino
# This component from Human gets object attributes (name, layer, color)
objatts = ObjectAttributes(ObjectOrAttributes=environment_geometries)  # -> Name, LayerName, LayerFullPath, Color, MaterialName, LinetypeName, GroupIndices, PlotWeight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

# ----
# If an object is a void (if it's in the "voids" layer), flips the mesh before computing volume (otherwise the centroid is out of place)
panel = Panel("voids")
tmatch = MatchText(Text=objatts.LayerName, Pattern=panel, Case=True)
dispatch = Dispatch(List=environment_geometries, DispatchPattern=tmatch)  # -> ListA, ListB
flip = MeshFlip(Mesh=dispatch.ListA)
weave = Weave(Pattern=tmatch, Stream0=dispatch.ListB, Stream1=flip, NullGaps=False)

volume = Volume(Geometry=weave)  # -> Volume, Centroid

tag = TextTag(Location=volume.Centroid, Text=objatts.Name, Colour=objatts.Color)
