# Grasshopper definition Bake with materials.gh (Grasshopper 1.0.7)
# Copyright: Co-de-iT
# plug-ins: Assembler, Human, eleFront Rhino 6 Legacy, froGH

# ----
# Handles type 0
crv = Curve(<curve referenced from the Rhino model>)
crv_2 = Curve(<curve referenced from the Rhino model>)
crv_3 = Curve(<curve referenced from the Rhino model>)
panel = Panel("""0
90""")
panel_2 = Panel("""0
90""")
panel_3 = Panel("""0
90""")
handcon = ConstructHandle(Polyline=crv_2, RotationAngles=panel, Type=0, Weight=1)
handcon_2 = ConstructHandle(Polyline=crv_3, RotationAngles=panel_2, Type=0, Weight=1)
handcon_3 = ConstructHandle(Polyline=crv, RotationAngles=panel_3, Type=0, Weight=1)

# ----
# Handles type 1
crv_4 = Curve(<curve referenced from the Rhino model>)
panel_4 = Panel("""0
180""")
handcon_4 = ConstructHandle(Polyline=crv_4, RotationAngles=panel_4, Type="1", Weight=1)

# ----
# Handles
crv_5 = Curve(<curve referenced from the Rhino model>)
# parti editabili
# Setup
# bake
# preview on/off
# blocks
# materials
crv_6 = Curve(<curve referenced from the Rhino model>)
crv_7 = Curve(<curve referenced from the Rhino model>)
crv_8 = Curve(<curve referenced from the Rhino model>)
panel_5 = Panel("""0
90""")
panel_6 = Panel("""0
90""")
panel_7 = Panel("""0
90""")
panel_8 = Panel("""0
90""")
handcon_5 = ConstructHandle(Polyline=crv_6, RotationAngles=panel_5, Type=0, Weight=1)
handcon_6 = ConstructHandle(Polyline=crv_7, RotationAngles=panel_6, Type=0, Weight=1)
handcon_7 = ConstructHandle(Polyline=crv_5, RotationAngles=panel_7, Type=0, Weight=1)
handcon_8 = ConstructHandle(Polyline=crv_8, RotationAngles=panel_8, Type=0, Weight=1)

# ----
# obstacles
mesh = Mesh(<mesh referenced from the Rhino model>)
mesh_2 = Mesh(<mesh referenced from the Rhino model>)
mesh_3 = Mesh(<mesh referenced from the Rhino model>)

# ----
# voids
mesh_4 = Mesh(<mesh referenced from the Rhino model>)

# ----
# Environment
merge = Merge(Data1=mesh, Data2=mesh_2, Data3=mesh_3, Data4=mesh_4)

# ----
# Collision mesh (spazio occupato)
mesh_5 = Mesh(<mesh referenced from the Rhino model>)

# ----
# Collision mesh (spazio occupato)
mesh_6 = Mesh(<mesh referenced from the Rhino model>)

mesh_7 = Mesh(<mesh referenced from the Rhino model>)
mesh_8 = Mesh(<mesh referenced from the Rhino model>)
mesh_9 = Mesh(<mesh referenced from the Rhino model>)
mesh_10 = Mesh(<mesh referenced from the Rhino model>)
mesh_11 = Mesh(<mesh referenced from the Rhino model>)
mesh_12 = Mesh(<mesh referenced from the Rhino model>)

# ----
# AssemblyObject 2
number_slider = Slider(0.355, range=0..1)
name = Panel("Object2")
merge_2 = Merge(Data1=handcon, Data2=handcon_2, Data3=handcon_3, Data4=handcon_4)
handdisp = DisplayHandles(Handles=merge_2, DisplaySize=number_slider, absHTextSize=False)
aocon = ConstructAssemblyObject(Name=name, CollisionMesh=mesh_5, Direction=Vector(1, 0, 0), Handles=merge_2, Weight=1, ZLockAO=False)
mesh_13 = Mesh(<mesh referenced from the Rhino model>)
mesh_14 = Mesh(<mesh referenced from the Rhino model>)
merge_3 = Merge(Data1=mesh_7, Data2=mesh_8)
merge_4 = Merge(Data1=mesh_12, Data2=mesh_13, Data3=mesh_14, Data4=mesh_9, Data5=mesh_10, Data6=mesh_11)
mjoin = MeshJoin(Meshes=merge_3)
mjoin_2 = MeshJoin(Meshes=merge_4)
xdcon = ConstructXData(Label="geometry_H", AssemblyObject=aocon, Data=mjoin)
xdcon_2 = ConstructXData(Label="geometry_V", AssemblyObject=aocon, Data=mjoin_2)

mesh_15 = Mesh(<mesh referenced from the Rhino model>)
mesh_16 = Mesh(<mesh referenced from the Rhino model>)
mesh_17 = Mesh(<mesh referenced from the Rhino model>)
mesh_18 = Mesh(<mesh referenced from the Rhino model>)

# ----
# AssemblyObject 1
number_slider_2 = Slider(0.355, range=0..1)
merge_5 = Merge(Data1=handcon_5, Data2=handcon_6, Data3=handcon_7, Data4=handcon_8)
# maisonnette extended
# 
# <description>
# 
# code by Alessio Erioli
# 
# v 0.1
# © a3 2021 / Creative Commons Attribution-Non Commercial-ShareAlike 4.0 International License
name_2 = Panel("Maisonnette")
handdisp_2 = DisplayHandles(Handles=merge_5, DisplaySize=number_slider_2, absHTextSize=False)
aocon_2 = ConstructAssemblyObject(Name=name_2, CollisionMesh=mesh_6, Direction=Vector(1, 0, 0), Handles=merge_5, Weight=1, ZLockAO=False)
merge_6 = Merge(Data1=mesh_15, Data2=mesh_17, Data3=mesh_18, Data4=mesh_16)
mjoin_3 = MeshJoin(Meshes=merge_6)
xdcon_3 = ConstructXData(Label="actual geometry", AssemblyObject=aocon_2, Data=mjoin_3)

panel_9 = Panel("""Stick-H_LOW
Stick-V_LOW""")
xdcon_4 = ConstructXData(Label="Block Names 2", AssemblyObject=aocon, Data=panel_9)

xdcon_5 = ConstructXData(Label="Material Name 1", AssemblyObject=aocon_2, Data="Type 0")

xdcon_6 = ConstructXData(Label="Block Name 1", AssemblyObject=aocon_2, Data="Maisonnette_LOW")

panel_10 = Panel("Wood floor light")
panel_11 = Panel("Planks033B")
xdcon_7 = ConstructXData(Label="Material Name H", AssemblyObject=aocon, Data="Type 1 H")
xdcon_8 = ConstructXData(Label="Material Name V", AssemblyObject=aocon, Data="Type 1 V")

merge_7 = Merge(Data1=xdcon_7, Data2=xdcon_8)
merge_8 = Merge(Data1=xdcon, Data2=xdcon_2)
merge_9 = Merge(Data1=aocon_2, Data2=aocon)
merge_10 = Merge(Data1=xdcon_3, Data2=merge_8)
merge_11 = Merge(Data1=xdcon_5, Data2=merge_7)
merge_12 = Merge(Data1=xdcon_6, Data2=xdcon_4)

xdcon_9 = ConstructXData(Label="Material Name Stair", AssemblyObject=aocon_2, Data="Stairs")

xdcon_10 = ConstructXData(Label="Block Name Stair", AssemblyObject=aocon_2, Data="Stair_LOW")

# ---- group: selective geometry - stair
mesh_19 = Mesh(<mesh referenced from the Rhino model>)

# ----
# XData - selective geometry
panel_12 = Panel("stair clash lines")
crv_9 = Curve([<curve referenced from the Rhino model> x6])
xdcon_11 = ConstructXData(Label="stair", AssemblyObject=aocon_2, Data=mesh_19)
xdcon_12 = ConstructXData(Label=panel_12, AssemblyObject=aocon_2, Data=crv_9)

# ----
# Rules (Heuristics)
heuwri = HeuristicsWriter(AssemblyObjectsSet=merge_9, noSH=False, noSO=False, xHT=False)
pt = Point(Point(0, 22.64105822, 0))
# Simulate
heud = HeuristicDisplay(
    OriginPoint=pt,
    AssemblyObjectsSet=merge_9,
    XData=merge_10,
    HeuristicsSet=heuwri,
    XSize=1.2,
    YSize=1.2,
    TextSize=1,
    NRows=Slider(10, range=2..10),
    DisplayType="AO Types",
    ZLockFilter=False,
    OutputType="AO Types")

# ----
# Heuristics
# Settings
sender_selection_mode = ValueList({"Random": 0, "Scalar Field nearest": 1, "Scalar Field interpolated": 2, "Vector Field > nearest": 3, "Vector Field > interpolated": 4, "Vector Field <> nearest": 5, "Vector Field <> interpolated": 6, "Minimum local AABB volume": 7, "Minimum local AABB diagonal": 8, "Weighted Random Choice": 9}, selected="Vector Field > interpolated")
receiver_selection_mode = ValueList({"Random": 0, "Scalar Field nearest": 1, "Scalar Field interpolated": 2, "Dense Packing": 3}, selected="Scalar Field nearest")
heuset = HeuristicsSettings(
    HeuristicsSet=heuwri,
    CurrentHeuristics=0,
    HeuristicsMode=0,
    ReceiverSelectionMode=receiver_selection_mode,
    SenderRuleSelectionMode=sender_selection_mode)

# ----
# display environment geometries names
# IMPORTANT: Objects must be named in Rhino
cluster = Cluster(environment_geometries=merge)

step = Button()
target_number = Panel("500")
go = BooleanToggle(False)

reset_settings = Button()
reset = Button()

# ---- group: starting plane (XY implicito)
pt_2 = Point(Point(-75.48844058, 18.92322177, 0))

# ----
stair_color = ColourSwatch(SwatchColor=RGB(0, 229, 255))
list = ValueList({"Colors": 0, "Materials": 1}, selected="Colors")

# ----
# bake Mesh geometries
toggle = BooleanToggle(False)

# ----
# bake Blocks
toggle_2 = BooleanToggle(False)

# ----
# Field
mesh_20 = Mesh(<mesh referenced from the Rhino model>)
afieldn = ConstructFieldN(Geometry=mesh_20, Plane=PlaneXY(0, 0, 0), NCells="20")  # -> Field, FieldCellsDimensions, FieldPoints
merge_13 = Merge(Data1=ColourSwatch(SwatchColor=RGB(255, 255, 255)), Data2=ColourSwatch(SwatchColor=RGB(0, 0, 0)))

# ---- group: compute scalar values
crv_10 = Curve(<curve referenced from the Rhino model>)
crv_cp = CurveClosestPoint(Point=afieldn.FieldPoints, Curve=crv_10)  # -> Point, Parameter, Distance

# ----
previewlw = CustomPreviewLineweights(Geometry=crv_10, Shader=ColourSwatch(SwatchColor=RGB(255, 0, 255)), Thickness="5", Absolute=False)

# ---- group: compute vector values
pdecon = Deconstruct(Point=afieldn.FieldPoints)  # -> XComponent, YComponent, ZComponent
larger = LargerThan(FirstNumber=pdecon.YComponent, SecondNumber=Slider(35.544, range=0..100))  # -> LargerThan, OrEqualTo
Y = UnitY(Factor=1)
Z = UnitZ(Factor=1)
weave = Weave(Pattern=graft(larger.LargerThan), Stream0=Y, Stream1=Z, NullGaps=False)  # -> flatten(Weave)

# ----
afpop = PopulateField(Field=afieldn.Field, ScalarValues=crv_cp.Distance, VectorValues=weave)

# ----
# Exogenous
# (environment)
# Settings
field_scalar_threshold = Slider(0.01, range=0..1)

afcol = ColorField(Field=afpop, Colors=merge_13, Index=0, Threshold=field_scalar_threshold, FieldColorBlend=False)  # -> Field, Colors
afdecon = DeconstructField(Field=afcol.Field)  # -> Points, ScalarValues, flatten(Vectors), IWeights, Colors, Topology, TopologyWeights
multiplication = Multiplication(A=afdecon.Vectors, B=Slider(4.163, range=1..5))
vdisex = VectorDisplayEx(Point=afdecon.Points, Vector=multiplication, Colour=afdecon.Vectors, Width=2)  # disabled

exoset = ExogenousSettings(
    EnvironmentMeshes=merge,
    EnvironmentMode="2",
    Field=afcol.Field,
    FieldScalarThreshold=field_scalar_threshold,
    Sandbox={Plane=PlaneXY(0, 0, 0), X=Domain(-1, 1), Y=Domain(0, 0), Z=Domain(0, 0)},
    HasContainer=False)

aoaengine = AssemblerEngine(
    AssemblyObjectsSet=merge_9,
    StartingPlane=pt_2,
    StartingObjectType=0,
    HeuristicsSettings=heuset,
    ExogenousSettings=exoset,
    Go=go,
    Step=step,
    NIterations=Slider(100, range=10..100),
    TargetMaxNObjects=target_number,
    ResetSettings=reset_settings,
    Reset=reset,
    UseSupports=False,
    ZLockCheck=False)  # -> Assemblage, AssemblageCount

# ---- group: autostop condition
larger_2 = LargerThan(FirstNumber=aoaengine.AssemblageCount, SecondNumber=target_number)  # -> LargerThan, OrEqualTo
f_tas = ToggleAutostop(Toggle=go, Condition=larger_2.OrEqualTo)

# ----
panel_13 = Panel(aoaengine.AssemblageCount)

# ----
# Post-process
# Press play after assemblage is finished
dam = DataDam(DataA=aoaengine.Assemblage, BufferDelay=10000000, BufferMode=0)

aoadecon = DeconstructAssemblage(Assemblage=dam)  # -> AssemblageObjects, AssemblageRules, ReceiverObjectsIndexes, AvailableObjectIndexes, UnreachableObjectIndexes
associate_xdata = AssociateXData(AssemblyObjects=aoadecon.AssemblageObjects, XData=merge_10)  # "AO<>XD"
associate_xdata_2 = AssociateXData(AssemblyObjects=aoadecon.AssemblageObjects, XData=merge_11)  # "AO<>XD"
associate_xdata_3 = AssociateXData(AssemblyObjects=aoadecon.AssemblageObjects, XData=merge_12)  # "AO<>XD"

# ---- group: identify type
aoetype = ExtractType(AssemblyObject=aoadecon.AssemblageObjects)
equals = Equality(FirstNumber=aoetype, SecondNumber="0")  # -> Equality, Inequality

aoetype_2 = ExtractType(AssemblyObject=aoadecon.AssemblageObjects)
equals_2 = Equality(FirstNumber=aoetype_2, SecondNumber="1")  # -> Equality, Inequality

# ----
# filter type
cull = CullPattern(List=aoadecon.AssemblageObjects, CullPattern=equals.Equality)

# ---- group: separate types
dispatch = Dispatch(List=aoadecon.AssemblageObjects, DispatchPattern=equals_2.Equality)  # -> ListA, ListB

# ---- group: identify horizontal alignment
aoerplane = ExtractReferencePlane(AssemblyObject=cull)
deplane = DeconstructPlane(Plane=aoerplane)  # -> Origin, XAxis, YAxis, ZAxis
Z_2 = UnitZ(Factor=1)
dprod = DotProduct(VectorA=deplane.ZAxis, VectorB=Z_2, Unitize=False)
similar = Similarity(FirstNumber=dprod, SecondNumber="1", Threshold=0.1)  # -> Similarity, AbsoluteDifference

# ---- group: identify horizontal-vertical alignment
aoerplane_2 = ExtractReferencePlane(AssemblyObject=dispatch.ListA)
deplane_2 = DeconstructPlane(Plane=aoerplane_2)  # -> Origin, XAxis, YAxis, ZAxis
Z_3 = UnitZ(Factor=1)
dprod_2 = DotProduct(VectorA=deplane_2.XAxis, VectorB=Z_3, Unitize=False)
abs = Absolute(Value=dprod_2)

# ----
# identify type 1 Horizontal-Vertical
lng = ListLength(List=dispatch.ListB)
repeat = RepeatData(Data="0", Length=lng)

# ----
# filter alignment
cull_2 = CullPattern(List=cull, CullPattern=similar.Similarity)

# ---- group: regroup types
weave_2 = Weave(Pattern=equals_2.Equality, Stream0=repeat, Stream1=abs, NullGaps=False)

# ---- group: rebuild whole data tree / generate False values
lng_2 = ListLength(List=cull_2)
equals_3 = Equality(FirstNumber=lng_2, SecondNumber="-1")  # -> Equality, Inequality

# ----
item = ListItem(List=associate_xdata, Index=weave_2, Wrap=True)
item_2 = ListItem(List=associate_xdata_2, Index=weave_2, Wrap=True)
# Display/Bake
xddecon = DeconstructXData(XData=item)  # -> Label, AssemblyObjectNameReference, ReferencePlane, Data

# ----
# clash check
# controlla se le clash lines si scontrano con la geometria effettiva
associate_xdata_4 = AssociateXData(AssemblyObjects=cull_2, XData=xdcon_12)  # "AO<>XD"
mesh_21 = Mesh(xddecon.Data)
xddecon_2 = DeconstructXData(XData=associate_xdata_4)  # -> Label, AssemblyObjectNameReference, ReferencePlane, Data
mjoin_4 = MeshJoin(Meshes=flatten(mesh_21))
pshift = ShiftPaths(Data=xddecon_2.Data, Offset="-2")
clean = CleanTree(RemoveNulls=True, RemoveInvalid=True, RemoveEmpty="true", Tree=pshift)
mcx = MeshCurve(Mesh=mjoin_4, Curve=clean)  # -> Points, Faces
pshift_2 = ShiftPaths(Data=mcx.Points, Offset=-1)
lng_3 = ListLength(List=pshift_2)
equals_4 = Equality(FirstNumber=lng_3, SecondNumber="0")  # -> Equality, Inequality

# ---- group: rebuild whole data tree
merge_14 = Merge(Data1=equals_3.Equality, Data2=equals_4.Equality)
f_massbool = MassBoolean(Values=merge_14, BooleanOperator="OR", Boolean_Operator="OR")

# ----
# Adding selective geometry (stair)
cull_3 = CullPattern(List=cull_2, CullPattern=f_massbool)

associate_xdata_5 = AssociateXData(AssemblyObjects=cull_3, XData=xdcon_11)  # "AO<>XD"
associate_xdata_6 = AssociateXData(AssemblyObjects=cull_3, XData=xdcon_9)  # "AO<>XD"
xddecon_3 = DeconstructXData(XData=item_2)  # -> Label, AssemblyObjectNameReference, ReferencePlane, Data
xddecon_4 = DeconstructXData(XData=associate_xdata_5)  # -> Label, AssemblyObjectNameReference, ReferencePlane, Data
xddecon_5 = DeconstructXData(XData=associate_xdata_6)  # -> Label, AssemblyObjectNameReference, ReferencePlane, Data

# ----
# define layers by XData
merge_15 = Merge(Data1=xddecon.Label, Data2=xddecon_4.Label)
cset = CreateSet(List=flatten(merge_15))  # -> Set, Map
mindex = MemberIndex(Set=cset.Set, Member=merge_15)  # -> Index, Count
pshift_3 = ShiftPaths(Data=mindex.Index, Offset=-1)
lng_4 = ListLength(List=cset.Set)

# ----
# define object attributes for Mesh geometry
expression = Expression(x=merge_15, Expression="Format(\"Assemblage Mesh::{0}\", x)")
wheel = ColourWheel(
    lng_4,
    ColourGrips_Style=31,
    ColourGrips_Grip=[0.862194273, 2.956589375, 5.050984478, 4.003786927],
    ColourGrips_Lum=[0.1, 0.7135155935],
    ColourGrips_Range=[0.3719871144, 0.3719871144, 0.3719871144, 0.3719871144],
    ColourGrips_Sat=[0.5455872479, 0.9737899027])
merge_16 = Merge(Data1=xddecon_3.Data, Data2=xddecon_5.Data)
item_3 = ListItem(List=wheel, Index=pshift_3, Wrap=True)
f_ifroml = IndexesFromList(Data=wheel)
layer_r6 = DefineLayerR6(Name=expression, Color=item_3)
legend = Legend(Colour=wheel, Tags=f_ifroml, LegendType=1)
attributes_r6 = DefineObjectAttributesR6(Layer=layer_r6, Material=merge_16)

# ---- group: stairs block
associate_xdata_7 = AssociateXData(AssemblyObjects=cull_3, XData=xdcon_10)  # "AO<>XD"
xddecon_6 = DeconstructXData(XData=associate_xdata_7)  # -> Label, AssemblyObjectNameReference, ReferencePlane, Data

# ----
# place blocks
xddecon_7 = DeconstructXData(XData=associate_xdata_3)  # -> Label, AssemblyObjectNameReference, ReferencePlane, Data
item_4 = ListItem(List=xddecon_7.ReferencePlane, Index=weave_2, Wrap=True)
item_5 = ListItem(List=xddecon_7.Data, Index=weave_2, Wrap=True)
merge_17 = Merge(Data1=item_5, Data2=xddecon_6.Data)
inblock = InsertBlock(BlockName=merge_17, SourcePlane=item_4)

# ----
# define object attributes for blocks
wheel_2 = ColourWheel(
    lng_4,
    ColourGrips_Style=31,
    ColourGrips_Grip=[0, 2.094395102, 4.188790205, 3.141592654],
    ColourGrips_Lum=[0.1, 0.5],
    ColourGrips_Range=[0.2617993878, 0.2617993878, 0.2617993878, 0.2617993878],
    ColourGrips_Sat=[0.2, 0.6])
expression_2 = Expression(x=merge_17, Expression="Format(\"Blocks::{0}\", x)")
item_6 = ListItem(List=wheel_2, Index=pshift_3, Wrap=True)
f_ifroml_2 = IndexesFromList(Data=wheel_2)
layer_r6_2 = DefineLayerR6(Name=expression_2, Color=item_6)
legend_2 = Legend(Colour=wheel_2, Tags=f_ifroml_2, LegendType=1)
attributes_r6_2 = DefineObjectAttributesR6(Layer=layer_r6_2)

lng_5 = ListLength(List=xddecon_4.Data)

# ---- group: All actual geometries (including stairs)
merge_18 = Merge(Data1=xddecon.Data, Data2=xddecon_4.Data)

# ----
repeat_2 = RepeatData(Data=stair_color, Length=lng_5)

# ----
# Display
aoadisp = DisplayAssemblage(Assemblage=dam, ColorsOnly=False, OutputType="AO Types")  # -> ColoredCollisionMeshes, Edges, Colors, Values
merge_19 = Merge(Data1=simplify(graft(aoadisp.Colors)), Data2=simplify(repeat_2))

filter = StreamFilter(Gate=list, Stream0=merge_19, Stream1=merge_16)

f_mmeea = MeshesExtractEdgesWithToleranceAngle(Mesh=merge_18, Angle=45)  # -> InternalEdges, NakedEdges
previewlw_2 = CustomPreviewLineweights(Geometry=[f_mmeea.InternalEdges, f_mmeea.NakedEdges], Shader=ColourSwatch(SwatchColor=RGB(0, 0, 0)), Absolute=False)

previewlw_3 = CustomPreviewLineweights(Geometry=aoadisp.Edges, Shader=ColourSwatch(SwatchColor=RGB(97, 97, 97)), Absolute=False)

# ----
# Collision meshes
preview = CustomPreview(
    Geometry=aoadisp.ColoredCollisionMeshes,
    Material={diffuse=RGB(221, 160, 221), emission=RGB(66, 48, 66), shine=0.5, specular=RGB(255, 255, 255), transparency=0})  # disabled

# ----
# Actual geometries
preview_2 = CustomPreview(Geometry=merge_18, Material=filter)

bake = BakeObjects(Geometry=merge_18, Attributes=attributes_r6, Bake=toggle)
bake_2 = BakeObjects(Geometry=inblock, Attributes=attributes_r6_2, Bake=toggle_2)

# ==== cluster Cluster
environment_geometries = ClusterInput()
panel = Panel("""115,124,148
146,51,51""")

# ----
# display environment geometries names
# IMPORTANT: Objects must be named in Rhino
# This component from Human gets object attributes (name, layer, color)
objatts = ObjectAttributes(ObjectOrAttributes=environment_geometries)  # -> Name, LayerName, LayerFullPath, Color, MaterialName, LinetypeName, GroupIndices, PlotWeight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

# ----
# If an object is a void (if it's in the "voids" layer), flips the mesh before computing volume (otherwise the centroid is out of place)
panel_2 = Panel("voids")
tmatch = MatchText(Text=objatts.LayerName, Pattern=panel_2, Case=True)
dispatch = Dispatch(List=environment_geometries, DispatchPattern=tmatch)  # -> ListA, ListB
flip = MeshFlip(Mesh=dispatch.ListA)
weave = Weave(Pattern=tmatch, Stream0=dispatch.ListB, Stream1=flip, NullGaps=False)

item = ListItem(List=panel, Index=tmatch, Wrap=True)

volume = Volume(Geometry=weave)  # -> Volume, Centroid

tag = TextTag(Location=volume.Centroid, Text=objatts.Name, Colour=item)
