# Grasshopper definition animation path.gh (Grasshopper 1.0.7)
# plug-ins: froGH

# ---- group: target path da Rhino (polilinea - opzionale)
crv = Curve(<curve referenced from the Rhino model>)

# ---- group: camera path da Rhino (polilinea)
crv_2 = Curve(<curve referenced from the Rhino model>)

# ----
# 2
# animare questo slider
# 
# right click > Animate
# oppure fare una live preview attivando go e regolando la velocità (speed)
number_slider = Slider(21, range=21..120)
list = ValueList({"fixed point": 0, "along camera path": 1, "target path": 2}, selected="along camera path")
position_along_curve = Slider(0, range=0..1)
eye_anticipation = Slider(0.071, range=0..0.1)
list_2 = ValueList({"manuale/record": 0, "live animation": 1}, selected="manuale/record")

fillet = Fillet(Curve=crv, Radius=Slider(1.696, range=0..5))
# <title>
# 
# <description>
# 
# code by Alessio Erioli
# 
# v 0.1
# © a3 2021 / Creative Commons Attribution-Non Commercial-ShareAlike 4.0 International License
fillet_2 = Fillet(Curve=crv_2, Radius=Slider(1.696, range=0..5))

# ----
# attivare il controllo della telecamera
# 1
activate = BooleanToggle(False)

crv_3 = Curve(reparameterize(fillet_2))
crv_4 = Curve(reparameterize(fillet))
pt = Point(Point(-42.84454371, 99.49514485, 62.54867461))

# ---- group: live animation
reset = Button()
go = BooleanToggle(False)
speed = Slider(500, range=0..10000)

# ---- group: live animation / a simple counter
counter = CSharpScript(reset=reset, go=go, max=speed)  # -> C; inputs reset: Boolean, go: Boolean, max: Int32
# ---------- counter: C# ----------
    if(reset) count = 0;
    if (go && count < max)
    {
      count++;
      Component.ExpireSolution(true);
    }
    C = count;
# ---------- counter: C# additional code ----------
  int count;
# ---------- end counter ----------

# ---- group: live animation (continued)
division = Division(A=counter, B=speed)

# ----
filter = StreamFilter(Gate=list_2, Stream0=position_along_curve, Stream1=division)
addition = Addition(A=filter, B=eye_anticipation)
eval = EvaluateCurve(Curve=crv_4, Parameter=filter)  # -> Point, Tangent, Angle
eval_2 = EvaluateCurve(Curve=crv_3, Parameter=addition)  # -> Point, Tangent, Angle
eval_3 = EvaluateCurve(Curve=crv_3, Parameter=filter)  # -> Point, Tangent, Angle
filter_2 = StreamFilter(Gate=list, Stream0=pt, Stream1=eval_2.Point, Stream2=eval.Point)
f_camcon = CameraControl(Location=eval_3.Point, Target=filter_2, Lens=number_slider, UpVector=Vector(0, 0, 1), Activate=activate)
