# Grasshopper definition clipping plane control.gh (Grasshopper 1.0.7)
# Copyright: Co-de-iT

# <title>
# 
# <description>
# 
# code by Alessio Erioli
# 
# v 0.1
# © a3 2021 / Creative Commons Attribution-Non Commercial-ShareAlike 4.0 International License
# make a Clipping Plane in Rhino and import it here. Any clipping plane will do, the orientation will be decided here in the definition.
id = Guid(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)
pt = ConstructPoint(XCoordinate=Slider(0, range=-100..100), YCoordinate=Slider(0, range=-100..100), ZCoordinate=Slider(0, range=-100..100))
xy = XYPlane(Origin=pt)
xz = XZPlane(Origin=pt)
yz = YZPlane(Origin=pt)
pflip = FlipPlane(Plane=xy, ReverseX=False, ReverseY=False, SwapAxes=True)
c_script = CSharpScript(id=id, P=pflip)  # inputs id: Guid, P: Plane
# ---------- c_script: C# usings ----------
using System.IO;
using System.Linq;
using System.Data;
using System.Drawing;
using System.Reflection;
using System.Windows.Forms;
using System.Xml;
using System.Xml.Linq;
using System.Runtime.InteropServices;

using Rhino.DocObjects;
using Rhino.Collections;
using GH_IO;
using GH_IO.Serialization;
# ---------- c_script: C# ----------
    if (id == null) return;
    Rhino.DocObjects.ObjRef obj = new Rhino.DocObjects.ObjRef(id);
    //Rhino.DocObjects.ObjRef obj = new Rhino.DocObjects.ObjRef(doc, id);
    Rhino.DocObjects.ClippingPlaneObject cpObj = obj.Object() as Rhino.DocObjects.ClippingPlaneObject;
    cpObj.ClippingPlaneGeometry.Plane = P;
    cpObj.CommitChanges();
# ---------- end c_script ----------
