# Grasshopper definition turntable.gh (Grasshopper 1.0.7)
# Copyright: Co-de-iT
# plug-ins: froGH

geo = Geometry([<mesh referenced from the Rhino model> x4004])
activate = BooleanToggle(False)
# Turntable
# 
# automate turntable animation. Requires froGH.
# 
# code by Alessio Erioli
# 
# v 0.1
# © Co-de-iT 2020 / Creative Commons Attribution-Non Commercial-ShareAlike 4.0 International License
f_tt = Turntable(
    Geometry=geo,
    DistanceMultiplier=Slider(1.7, range=0..5),
    LensRange="21 to 120",
    LensInterpolationParameter=Slider(0.027, range=0..1),
    Direction=Slider(0, range=0..1),
    AdjustStartPoint=Slider(0.25, range=0..1),
    CameraTiltShift=Slider(0, range=-20..20),
    TargetTiltShift=Slider(0, range=-20..20),
    AnimationParameter=Slider(0, range=0..1),
    Activate=activate)
