# Grasshopper definition auto sections.gh (Grasshopper 1.0.7)
# Copyright: Co-de-iT

# ----
# section controls
# model sections display
# model sections arrangement
# callout lines
# labels
# grid
list = ValueList({"single section": 0, "multiple sections": 1}, selected="multiple sections")
single_section_position = Slider(0.251, range=0..1)
section_line_color = ColourSwatch(SwatchColor=RGB(0, 0, 0))
model_section_line_color = ColourSwatch(SwatchColor=RGB(255, 0, 0))
model_section_line_thickness = Slider(3, range=1..10)
section_surfaces_border_color = ColourSwatch(SwatchColor=RGB(255, 0, 0))
vertical_offset = Slider(0, range=-1000..1000)
separation_scale = Slider(4, range=1..10)
callout_line_end_offset = Slider(10, range=0..100)
callout_line_thickness = Slider(1, range=1..10)
callout_line_color = ColourSwatch(SwatchColor=RGB(0, 0, 0))
model_label_size = Slider(2.093, range=1..10)
grid_label_size = Slider(3.578, range=1..10)
grid_label_color = ColourSwatch(SwatchColor=RGB(0, 0, 0))
grid_scaling = Slider(1.1, range=1..2)
n_of_rows = Slider(3, range=1..20)
section_angle = Slider(0, range=0..90)
n_sections = Slider(10, range=1..30)
section_line_thickness = Slider(5, range=1..10)
section_surfaces_color = ColourSwatch(SwatchColor=RGBA(117, 117, 117, 84))
section_surface_scaling = Slider(1.2, range=1..2)
horizontal_offset = Slider(300, range=0..1000)
callout_line_start_offset = Slider(10, range=0..100)
callout_line_start_length = Slider(10, range=0..100)
callout_line_end_length = Slider(20, range=0..100)
section_direction_labels = Panel("""A
B
Plan""")
model_label_color = ColourSwatch(SwatchColor=RGB(0, 0, 0))
model_label_z_offset = Slider(-2, range=-5..0)
sectioning_direction = ValueList({"X": 0, "Y": 1, "Z": 2}, selected="X")

section_surfaces_border_thickness = Slider(2, range=1..10)

# ---- group: grid base point
pt = Point(Point(91.72658279, 6.489359024, 0))

# ----
# <title>
# 
# <description>
# 
# code by Alessio Erioli
# 
# v 0.1
# © a3 2021 / Creative Commons Attribution-Non Commercial-ShareAlike 4.0 International License
# geometry (must be meshes)
mesh = Mesh([<mesh referenced from the Rhino model> x601])
cluster = Cluster(
    geometry=mesh,
    Z=separation_scale,
    x=horizontal_offset,
    B_2=vertical_offset,
    S=model_section_line_color,
    T=model_section_line_thickness,
    i=sectioning_direction,
    A=section_angle,
    G=list,
    _0=single_section_position,
    N=n_sections,
    B=section_surface_scaling,
    callout_line_start_offset=callout_line_start_offset,
    S_3=model_label_size,
    C=model_label_color,
    callout_line_start_length=callout_line_start_length,
    callout_line_end_offset=callout_line_end_offset,
    callout_line_end_length=callout_line_end_length,
    callout_line_thickness=callout_line_thickness,
    F=model_label_z_offset,
    callout_line_color=callout_line_color,
    section_line_color=section_line_color,
    M=section_surfaces_color,
    section_line_thickness=section_line_thickness,
    S_2=section_surfaces_border_color,
    T_2=section_surfaces_border_thickness,
    G_3=sectioning_direction,
    grid_origin=pt,
    G_2=sectioning_direction,
    grid_scale=grid_scaling,
    n_rows=n_of_rows,
    S_4=grid_label_size,
    C_2=grid_label_color,
    L=section_direction_labels,
    i_2=sectioning_direction)

# ==== cluster Cluster
A = ClusterInput()
geometry = ClusterInput()
xy = XYPlane(Origin=Point(0, 0, 0))
prot = RotatePlane(Plane=xy, Angle=degrees(A))
i = ClusterInput()
N = ClusterInput()
mesh = Mesh(flatten(geometry))
G = ClusterInput()
_0 = ClusterInput()

# ---- group: generate sections
panel = Panel("""1,3
0,2
4,5""")
bbox = BoundingBox(Content=mesh, Plane=prot, UnionBox=True)  # -> Box, Box_2
item = ListItem(List=panel, Index=i, Wrap=True)
range = Range(Domain=Domain(0, 1), Steps=expr("x+1", N))
panel_2 = Panel("""0
-1""")
debrep = DeconstructBrep(Brep=bbox.Box)  # -> Faces, Edges, Vertices
split = TextSplit(Text=item, Separators=",")
cull_i = CullIndex(List=range, Indices=panel_2, Wrap=True)
item_2 = ListItem(List=debrep.Faces, Index=split, Wrap=True)
filter = StreamFilter(Gate=G, Stream0=_0, Stream1=cull_i)
evalsrf = EvaluateSurface(Surface=reparameterize(item_2), Point="0.5,0.5")  # -> Point, Normal, UDirection, VDirection, Frame
interp = InterpolateData(Data=evalsrf.Point, Parameter=filter, Interpolation=2)
item_3 = ListItem(List=evalsrf.Frame, Index=0, Wrap=True)
pl_origin = PlaneOrigin(Base=item_3, Origin=interp)  # -> graft(Plane)
deplane = DeconstructPlane(Plane=item_3)  # -> Origin, XAxis, YAxis, ZAxis
sec = MeshPlane(Mesh=mesh, Plane=pl_origin)

# ----
x = ClusterInput()
B = ClusterInput()

# ---- group: section surfaces
boxprop = BoxProperties(Box=bbox.Box_2)  # -> Center, Diagonal, Area, Volume, Degeneracy
multiplication = Multiplication(A=boxprop.Diagonal, B=B)
devec = DeconstructVector(Vector=multiplication)  # -> XComponent, YComponent, ZComponent
f_cdom = CenteredDomain(DomainLength=devec.YComponent)
f_cdom_2 = CenteredDomain(DomainLength=devec.ZComponent)
planesrf = PlaneSurface(Plane=pl_origin, XSize=f_cdom, YSize=f_cdom_2)

# ----
B_2 = ClusterInput()
grid_scale = ClusterInput()
Z = ClusterInput()

# ---- group: arrange sections on model
neg = Negative(Value=x)
volume = Volume(Geometry=bbox.Box)  # -> Volume, Centroid
multiplication_2 = Multiplication(A=deplane.XAxis, B=neg)
multiplication_3 = Multiplication(A=deplane.YAxis, B=B_2)
addition = Addition(A=multiplication_2, B=multiplication_3)
pl_origin_2 = PlaneOrigin(Base=item_3, Origin=volume.Centroid)
move = Move(Geometry=sec, Motion=addition)  # -> Geometry, Transform
scale_nu = ScaleNU(Geometry=move.Geometry, Plane=pl_origin_2, ScaleX=1, ScaleY=1, ScaleZ=Z)  # -> Geometry, Transform

# ----
G_2 = ClusterInput()
G_3 = ClusterInput()
callout_line_start_length = ClusterInput()
callout_line_start_offset = ClusterInput()
callout_line_end_length = ClusterInput()
callout_line_thickness = ClusterInput()
callout_line_color = ClusterInput()
callout_line_end_offset = ClusterInput()
n_rows = ClusterInput()
section_line_color = ClusterInput()
section_line_thickness = ClusterInput()

# ---- group: Callout lines
pshift = ShiftPaths(Data=scale_nu.Geometry, Offset=-1)
bbox_2 = BoundingBox(Content=pshift, Plane=prot, UnionBox=True)  # -> Box, Box_2
multiplication_4 = Multiplication(A=deplane.XAxis, B=callout_line_start_offset)
evalsrf_2 = EvaluateSurface(Surface=reparameterize(planesrf), Point="0,0")  # -> Point, Normal, UDirection, VDirection, Frame
box = EvaluateBox(Box=bbox_2.Box, UParameter="1", VParameter="1", WParameter="0")  # -> Plane, Point, Include
multiplication_5 = Multiplication(A=deplane.XAxis, B=callout_line_end_offset)
rev = Reverse(Vector=multiplication_4)
move_2 = Move(Geometry=box.Plane, Motion=multiplication_5)  # -> Geometry, Transform
multiplication_6 = Multiplication(A=deplane.XAxis, B=callout_line_end_length)
move_3 = Move(Geometry=evalsrf_2.Frame, Motion=rev)  # -> Geometry, Transform
multiplication_7 = Multiplication(A=deplane.XAxis, B=callout_line_start_length)
rev_2 = Reverse(Vector=multiplication_7)
move_4 = Move(Geometry=move_2.Geometry, Motion=multiplication_6)  # -> Geometry, Transform
line = LineSDL(Start=move_3.Geometry, Direction=rev_2, Length=callout_line_start_length)
move_5 = Move(Geometry=move_3.Geometry, Motion=rev_2)  # -> Geometry, Transform
line_2 = LineSDL(Start=move_2.Geometry, Direction=multiplication_6, Length=callout_line_end_length)
ln = Line(StartPoint=move_4.Geometry, EndPoint=move_5.Geometry)
merge = Merge(Data1=line_2, Data2=ln, Data3=line)
join = JoinCurves(Curves=merge, Preserve=False)
previewlw = CustomPreviewLineweights(Geometry=join, Shader=callout_line_color, Thickness=callout_line_thickness, Absolute=False)

# ----
grid_origin = ClusterInput()

# ---- group: Arrange secitons on a grid
boxprop_2 = BoxProperties(Box=bbox.Box_2)  # -> Center, Diagonal, Area, Volume, Degeneracy
multiplication_8 = Multiplication(A=boxprop_2.Diagonal, B=grid_scale)
devec_2 = DeconstructVector(Vector=multiplication_8)  # -> XComponent, YComponent, ZComponent
lng = ListLength(List=filter)
filter_2 = StreamFilter(Gate=G_2, Stream0=devec_2.ZComponent, Stream1=devec_2.ZComponent, Stream2=devec_2.XComponent)
filter_3 = StreamFilter(Gate=G_3, Stream0=devec_2.YComponent, Stream1=devec_2.XComponent, Stream2=devec_2.YComponent)
integer_division = IntegerDivision(A=lng, B=n_rows)  # -> expr("x+1", Result)
recgrid = Rectangular(Plane=grid_origin, SizeX=filter_3, SizeY=filter_2, ExtentX=integer_division, ExtentY=n_rows)  # -> flatten(Cells), Points
subtraction = Subtraction(A=lng, B="1")
subset = SubList(List=recgrid.Cells, Domain=subtraction, Wrap=True)  # -> List, Index
pcen = PolygonCenter(Polyline=subset.List)  # -> graft(CenterV), CenterE, CenterA
disc = Discontinuity(Curve=subset.List, Level=1)  # -> Points, Parameters
trim = TrimTree(Tree=sec, Depth=1)
item_4 = ListItem(List=disc.Points, Index=0, Wrap=True)
orient = Orient(Geometry=trim, Source=pl_origin, Target=pcen.CenterV)  # -> Geometry, Transform

# ----
L = ClusterInput()
i_2 = ClusterInput()

# ---- group: section labels
item_5 = ListItem(List=L, Index=i_2, Wrap=True)
f_ifroml = IndexesFromList(Data=filter)
expression = Expression(x=item_5, y=f_ifroml, Expression="Format(\"{0}-{1:00}\", x, y)")  # -> graft(R)

# ----
F = ClusterInput()

# ---- group: label position on model
pflip = FlipPlane(Plane=pl_origin, ReverseX="True", ReverseY=False, SwapAxes="False")
Z_2 = UnitZ(Factor=F)
move_6 = Move(Geometry=move_3.Geometry, Motion=Z_2)  # -> Geometry, Transform
pl_origin_3 = PlaneOrigin(Base=pflip, Origin=move_6.Geometry)
pl_origin_4 = PlaneOrigin(Base=pflip, Origin=move_2.Geometry)

# ----
edges = BrepEdges(Brep=planesrf)  # -> Naked, Interior, NonManifold
M = ClusterInput()
S = ClusterInput()
T = ClusterInput()
S_2 = ClusterInput()
T_2 = ClusterInput()
S_3 = ClusterInput()
C = ClusterInput()
S_4 = ClusterInput()
C_2 = ClusterInput()

phatch = PatternHatch(Boundaries=graft(orient.Geometry), Pattern=0, Scale=1, Angle=0)
previewlw_2 = CustomPreviewLineweights(Geometry=orient.Geometry, Shader=section_line_color, Thickness=section_line_thickness, Absolute=False)

preview = CustomPreview(Geometry=planesrf, Material=M)

previewlw_3 = CustomPreviewLineweights(Geometry=scale_nu.Geometry, Shader=section_line_color, Thickness=section_line_thickness, Absolute=False)
phatch_2 = PatternHatch(Boundaries=scale_nu.Geometry, Pattern=0, Scale=1, Angle=0)

previewlw_4 = CustomPreviewLineweights(Geometry=sec, Shader=S, Thickness=T, Absolute=False)
previewlw_5 = CustomPreviewLineweights(Geometry=edges.Naked, Shader=S_2, Thickness=T_2, Absolute=False)
tag = TextTag3D(Location=[pl_origin_3, pl_origin_4], Text=expression, Size=S_3, Colour=C, Justification=1)
tag_2 = TextTag3D(Location=item_4, Text=expression, Size=S_4, Colour=C_2, Justification=1)
