# Grasshopper definition auto sections_WIP.gh (Grasshopper 1.0.7)
# Copyright: Co-de-iT
# plug-ins: Human, froGH

# ----
# section controls
# model sections display
# model sections arrangement
# callout lines
# labels
# grid
list = ValueList({"single section": 0, "multiple sections": 1}, selected="single section")
single_section_position = Slider(0.251, range=0..1)
section_line_color = ColourSwatch(SwatchColor=RGB(0, 0, 0))
model_section_line_color = ColourSwatch(SwatchColor=RGB(255, 0, 0))
model_section_line_thickness = Slider(3, range=1..10)
section_surfaces_border_color = ColourSwatch(SwatchColor=RGB(255, 0, 0))
vertical_offset = Slider(0, range=-1000..1000)
separation_scale = Slider(4, range=1..10)
callout_line_end_offset = Slider(10, range=0..100)
callout_line_thickness = Slider(1, range=1..10)
callout_line_color = ColourSwatch(SwatchColor=RGB(0, 0, 0))
model_label_size = Slider(2.093, range=1..10)
grid_label_size = Slider(3.578, range=1..10)
grid_label_color = ColourSwatch(SwatchColor=RGB(0, 0, 0))
grid_scaling = Slider(1.1, range=1..2)
n_of_rows = Slider(3, range=1..20)
section_angle = Slider(0, range=0..90)
n_sections = Slider(10, range=1..30)
section_line_thickness = Slider(5, range=1..10)
section_surfaces_color = ColourSwatch(SwatchColor=RGBA(117, 117, 117, 84))
section_surface_scaling = Slider(1.2, range=1..2)
horizontal_offset = Slider(300, range=0..1000)
callout_line_start_offset = Slider(10, range=0..100)
callout_line_start_length = Slider(10, range=0..100)
callout_line_end_length = Slider(20, range=0..100)
section_direction_labels = Panel("""A
B
Plan""")
model_label_color = ColourSwatch(SwatchColor=RGB(0, 0, 0))
model_label_z_offset = Slider(-2, range=-5..0)
sectioning_direction = ValueList({"X": 0, "Y": 1, "Z": 2}, selected="X")

section_surfaces_border_thickness = Slider(2, range=1..10)

# ---- group: grid base point
pt = Point(Point(91.72658279, 6.489359024, 0))

# ----
# <title>
# 
# <description>
# 
# code by Alessio Erioli
# 
# v 0.1
# © a3 2021 / Creative Commons Attribution-Non Commercial-ShareAlike 4.0 International License
# geometry (must be meshes)
mesh = Mesh([<mesh referenced from the Rhino model> x601])
xy = XYPlane(Origin=Point(0, 0, 0))
prot = RotatePlane(Plane=xy, Angle=degrees(section_angle))
mesh_2 = Mesh(flatten(mesh))

# ---- group: generate sections
panel = Panel("""1,3
0,2
4,5""")
bbox = BoundingBox(Content=mesh_2, Plane=prot, UnionBox=True)  # -> Box, Box_2
item = ListItem(List=panel, Index=sectioning_direction, Wrap=True)
range = Range(Domain=Domain(0, 1), Steps=expr("x+1", n_sections))
panel_2 = Panel("""0
-1""")
debrep = DeconstructBrep(Brep=bbox.Box)  # -> Faces, Edges, Vertices
split = TextSplit(Text=item, Separators=",")
cull_i = CullIndex(List=range, Indices=panel_2, Wrap=True)
item_2 = ListItem(List=debrep.Faces, Index=split, Wrap=True)
filter = StreamFilter(Gate=list, Stream0=single_section_position, Stream1=cull_i)
evalsrf = EvaluateSurface(Surface=reparameterize(item_2), Point="0.5,0.5")  # -> Point, Normal, UDirection, VDirection, Frame
interp = InterpolateData(Data=evalsrf.Point, Parameter=filter, Interpolation=2)
item_3 = ListItem(List=evalsrf.Frame, Index=0, Wrap=True)
pl_origin = PlaneOrigin(Base=item_3, Origin=interp)  # -> graft(Plane)
deplane = DeconstructPlane(Plane=item_3)  # -> Origin, XAxis, YAxis, ZAxis
sec = MeshPlane(Mesh=mesh_2, Plane=pl_origin)

# ----
deplane_2 = DeconstructPlane(Plane=pl_origin)  # -> Origin, XAxis, YAxis, ZAxis
multiplication = Multiplication(A=deplane_2.ZAxis, B="0.01")
rectangle = Rectangle(Plane=PlaneXY(0, 0, 0), XSize=Domain(-1, 1), YSize=Domain(-2, 2), Radius=0)  # -> Rectangle, Length
pflip = FlipPlane(Plane=pl_origin, ReverseX="True", ReverseY=False, SwapAxes="False")
prot_2 = RotatePlane(Plane=pflip, Angle=degrees("90"))

# ---- group: section surfaces
boxprop = BoxProperties(Box=bbox.Box_2)  # -> Center, Diagonal, Area, Volume, Degeneracy
multiplication_2 = Multiplication(A=boxprop.Diagonal, B=section_surface_scaling)
devec = DeconstructVector(Vector=multiplication_2)  # -> XComponent, YComponent, ZComponent
f_cdom = CenteredDomain(DomainLength=devec.YComponent)
f_cdom_2 = CenteredDomain(DomainLength=devec.ZComponent)
planesrf = PlaneSurface(Plane=pl_origin, XSize=f_cdom, YSize=f_cdom_2)

# ----
move = Move(Geometry=planesrf, Motion=multiplication)  # -> Geometry, Transform
m2d_parallel = Make2DParallelView(Projection=move.Geometry)
make2d = Make2D(
    Geometry=mesh_2,
    ClippingPlanes=pflip,
    View=m2d_parallel,
    TangentEdges="true",
    TangentSeams="true",
    AutoComputeMake2D=False)  # -> VisibleCurves, VisibleIndex, VisibleType, HiddenCurves, HiddenIndex, HiddenType
crv = Curve(make2d.VisibleCurves)
crv_2 = Curve(make2d.HiddenCurves)
orient = Orient(Geometry=[crv_2, crv], Source=PlaneXY(0, 0, 0), Target=prot_2)  # -> Geometry, Transform

# ---- group: arrange sections on model
neg = Negative(Value=horizontal_offset)
volume = Volume(Geometry=bbox.Box)  # -> Volume, Centroid
multiplication_3 = Multiplication(A=deplane.XAxis, B=neg)
multiplication_4 = Multiplication(A=deplane.YAxis, B=vertical_offset)
addition = Addition(A=multiplication_3, B=multiplication_4)
pl_origin_2 = PlaneOrigin(Base=item_3, Origin=volume.Centroid)
move_2 = Move(Geometry=sec, Motion=addition)  # -> Geometry, Transform
scale_nu = ScaleNU(Geometry=move_2.Geometry, Plane=pl_origin_2, ScaleX=1, ScaleY=1, ScaleZ=separation_scale)  # -> Geometry, Transform

# ---- group: Arrange secitons on a grid
boxprop_2 = BoxProperties(Box=bbox.Box_2)  # -> Center, Diagonal, Area, Volume, Degeneracy
multiplication_5 = Multiplication(A=boxprop_2.Diagonal, B=grid_scaling)
devec_2 = DeconstructVector(Vector=multiplication_5)  # -> XComponent, YComponent, ZComponent
lng = ListLength(List=filter)
filter_2 = StreamFilter(Gate=sectioning_direction, Stream0=devec_2.ZComponent, Stream1=devec_2.ZComponent, Stream2=devec_2.XComponent)
filter_3 = StreamFilter(Gate=sectioning_direction, Stream0=devec_2.YComponent, Stream1=devec_2.XComponent, Stream2=devec_2.YComponent)
integer_division = IntegerDivision(A=lng, B=n_of_rows)  # -> expr("x+1", Result)
recgrid = Rectangular(Plane=pt, SizeX=filter_3, SizeY=filter_2, ExtentX=integer_division, ExtentY=n_of_rows)  # -> flatten(Cells), Points
subtraction = Subtraction(A=lng, B="1")
subset = SubList(List=recgrid.Cells, Domain=subtraction, Wrap=True)  # -> List, Index
pcen = PolygonCenter(Polyline=subset.List)  # -> graft(CenterV), CenterE, CenterA
disc = Discontinuity(Curve=subset.List, Level=1)  # -> Points, Parameters
trim = TrimTree(Tree=sec, Depth=1)
item_4 = ListItem(List=disc.Points, Index=0, Wrap=True)
orient_2 = Orient(Geometry=trim, Source=pl_origin, Target=pcen.CenterV)  # -> Geometry, Transform

# ---- group: Callout lines
pshift = ShiftPaths(Data=scale_nu.Geometry, Offset=-1)
bbox_2 = BoundingBox(Content=pshift, Plane=prot, UnionBox=True)  # -> Box, Box_2
multiplication_6 = Multiplication(A=deplane.XAxis, B=callout_line_start_offset)
evalsrf_2 = EvaluateSurface(Surface=reparameterize(planesrf), Point="0,0")  # -> Point, Normal, UDirection, VDirection, Frame
box = EvaluateBox(Box=bbox_2.Box, UParameter="1", VParameter="1", WParameter="0")  # -> Plane, Point, Include
multiplication_7 = Multiplication(A=deplane.XAxis, B=callout_line_end_offset)
rev = Reverse(Vector=multiplication_6)
move_3 = Move(Geometry=box.Plane, Motion=multiplication_7)  # -> Geometry, Transform
multiplication_8 = Multiplication(A=deplane.XAxis, B=callout_line_end_length)
move_4 = Move(Geometry=evalsrf_2.Frame, Motion=rev)  # -> Geometry, Transform
multiplication_9 = Multiplication(A=deplane.XAxis, B=callout_line_start_length)
rev_2 = Reverse(Vector=multiplication_9)
move_5 = Move(Geometry=move_3.Geometry, Motion=multiplication_8)  # -> Geometry, Transform
line = LineSDL(Start=move_4.Geometry, Direction=rev_2, Length=callout_line_start_length)
move_6 = Move(Geometry=move_4.Geometry, Motion=rev_2)  # -> Geometry, Transform
line_2 = LineSDL(Start=move_3.Geometry, Direction=multiplication_8, Length=callout_line_end_length)
ln = Line(StartPoint=move_5.Geometry, EndPoint=move_6.Geometry)
merge = Merge(Data1=line_2, Data2=ln, Data3=line)
join = JoinCurves(Curves=merge, Preserve=False)
previewlw = CustomPreviewLineweights(Geometry=join, Shader=callout_line_color, Thickness=callout_line_thickness, Absolute=False)

# ---- group: section labels
item_5 = ListItem(List=section_direction_labels, Index=sectioning_direction, Wrap=True)
f_ifroml = IndexesFromList(Data=filter)
expression = Expression(x=item_5, y=f_ifroml, Expression="Format(\"{0}-{1:00}\", x, y)")  # -> graft(R)

# ---- group: label position on model
pflip_2 = FlipPlane(Plane=pl_origin, ReverseX="True", ReverseY=False, SwapAxes="False")
Z = UnitZ(Factor=model_label_z_offset)
move_7 = Move(Geometry=move_4.Geometry, Motion=Z)  # -> Geometry, Transform
pl_origin_3 = PlaneOrigin(Base=pflip_2, Origin=move_7.Geometry)
pl_origin_4 = PlaneOrigin(Base=pflip_2, Origin=move_3.Geometry)

# ----
edges = BrepEdges(Brep=planesrf)  # -> Naked, Interior, NonManifold

phatch = PatternHatch(Boundaries=graft(orient_2.Geometry), Pattern=0, Scale=1, Angle=0)
previewlw_2 = CustomPreviewLineweights(Geometry=orient_2.Geometry, Shader=section_line_color, Thickness=section_line_thickness, Absolute=False)

preview = CustomPreview(Geometry=planesrf, Material=section_surfaces_color)

previewlw_3 = CustomPreviewLineweights(Geometry=scale_nu.Geometry, Shader=section_line_color, Thickness=section_line_thickness, Absolute=False)
phatch_2 = PatternHatch(Boundaries=scale_nu.Geometry, Pattern=0, Scale=1, Angle=0)

previewlw_4 = CustomPreviewLineweights(Geometry=sec, Shader=model_section_line_color, Thickness=model_section_line_thickness, Absolute=False)
previewlw_5 = CustomPreviewLineweights(Geometry=edges.Naked, Shader=section_surfaces_border_color, Thickness=section_surfaces_border_thickness, Absolute=False)
tag = TextTag3D(Location=[pl_origin_3, pl_origin_4], Text=expression, Size=model_label_size, Colour=model_label_color, Justification=1)
tag_2 = TextTag3D(Location=item_4, Text=expression, Size=grid_label_size, Colour=grid_label_color, Justification=1)
