# Grasshopper definition batch rename files.gh (Grasshopper 1.0.7)
# Copyright: Co-de-iT
# plug-ins: froGH

f_ghfilepath = GHFilePathInfo()  # -> FileName, FilePath
concat = Concatenate(FragmentA=f_ghfilepath.FilePath, FragmentB="images", FragmentC="\")
new_base_name = Panel("newPlan")
rename = BooleanToggle(False)
n_of_digits = Panel("3")
start_index = Panel("0")
path = FilePath(concat)
# <title>
# 
# <description>
# 
# code by Alessio Erioli
# 
# v 0.1
# © a3 2021 / Creative Commons Attribution-Non Commercial-ShareAlike 4.0 International License
path_to_folder = Panel(path)
c_script = CSharpScript(P=path, name=new_base_name, start=start_index, nDig=n_of_digits, go=rename)  # -> out, Files; inputs P: String, name: String, start: Int32, nDig: Int32, go: Boolean
# ---------- c_script: C# usings ----------
using System.IO;
# ---------- c_script: C# ----------
    if (!Directory.Exists(P)) return;
    string[] files = Directory.GetFiles(P);
    List<string> newNames = new List<string>();
    string extension, dFormat, newName;
    int count = start;
    if (nDig == 0) dFormat = "D" + (files.Length.ToString().Length).ToString();
    else dFormat = "D" + nDig.ToString();
    //Print(dFormat);
    foreach (string file in files)
    {
      extension = file.Split('.')[file.Split('.').Length - 1];
      newName = P + name + "_" + count.ToString(dFormat) + "." + extension;
      newNames.Add(newName);
      count++;
    }

    if (go)
      for(int i = 0; i < files.Length; i++)
        File.Move(files[i], newNames[i]);


    Files = files;
# ---------- end c_script ----------
panel = Panel(c_script.Files)
