# Grasshopper definition Block table layout.gh (Grasshopper 1.0.7)
# Copyright: Co-de-iT
# plug-ins: eleFront Rhino 6 Legacy, froGH

listblockd_r6 = ListBlockDocumentR6()
rows = Slider(5, range=1..20)
expansion = Slider(1.5, range=1..2)
inblock_r6 = InsertBlockR6(BlockName=listblockd_r6, SourcePlane=PlaneXY(0, 0, 0))
pt = Point(Point(37.13292813, 0, 0))
reverse_order = BooleanToggle(False)
xy = XYPlane(Origin=pt)
# © a3 2021 / Creative Commons Attribution-Non Commercial-ShareAlike 4.0 International License
f_ifroml = IndexesFromList(Data=inblock_r6)
# <title>
# 
# <description>
# 
# code by Alessio Erioli
# 
# v 0.1
sortongrid = SortOnGrid(
    geometry=inblock_r6,
    sorting_keys=f_ifroml,
    reverse_order=reverse_order,
    plane=xy,
    number_of_rows=rows,
    scale_x=expansion,
    scale_y=expansion)  # -> geometry_2, keys, planes, cell_size
devec = DeconstructVector(Vector=sortongrid.cell_size)  # -> XComponent, YComponent, ZComponent
multiplication = Multiplication(A=sortongrid.cell_size, B="-0.5")
multiplication_2 = Multiplication(A=devec.XComponent, B="0.025")
bbox = BoundingBox(Content=sortongrid.geometry_2, Plane=PlaneXY(0, 0, 0))  # -> Box, Box_2
move = Move(Geometry=sortongrid.planes, Motion=multiplication)  # -> Geometry, Transform
vec = VectorXYZ(XComponent=multiplication_2, YComponent=multiplication_2, ZComponent=0)  # -> Vector, Length
edges = BrepEdges(Brep=bbox.Box)  # -> Naked, Interior, NonManifold
move_2 = Move(Geometry=move.Geometry, Motion=vec.Vector)  # -> Geometry, Transform

# ---- group: blocks
bake_r6 = BakeObjectsR6(Geometry=sortongrid.geometry_2, Bake=False)

# ---- group: Bounding boxes (curves)
crv = Curve([edges.Naked, edges.Interior])

# ---- group: base points
pt_2 = Point(sortongrid.planes)

# ---- group: block names
tag = TextTag3D(Location=move_2.Geometry, Text=listblockd_r6, Size=multiplication_2, Justification=7)

# ==== cluster SortOnGrid: Sort Geometry along a grid using a sorting key (one number per geometry)
geometry = ClusterInput()
sorting_keys = ClusterInput()
reverse_order = ClusterInput()
plane = ClusterInput()
number_of_rows = ClusterInput()
scale_x = ClusterInput()
scale_y = ClusterInput()
lng = ListLength(List=geometry)
bbox = BoundingBox(Content=geometry, Plane=PlaneXY(0, 0, 0))  # -> Box, Box_2
box = EvaluateBox(Box=bbox.Box, UParameter="0.5", VParameter="0.5", WParameter="0")  # -> Plane, Point, Include
boxprop = BoxProperties(Box=bbox.Box)  # -> Center, Diagonal, Area, Volume, Degeneracy
devec = DeconstructVector(Vector=boxprop.Diagonal)  # -> XComponent, YComponent, ZComponent
division = Division(A=lng, B=number_of_rows)
sort = SortList(Keys=devec.XComponent)  # -> reverse(Keys), ValuesA
sort_2 = SortList(Keys=devec.YComponent)  # -> reverse(Keys), ValuesA
int = Integer(division)
addition = Addition(A=int, B="1")
item = ListItem(List=sort.Keys, Index=0, Wrap=True)
item_2 = ListItem(List=sort_2.Keys, Index=0, Wrap=True)
sort_3 = SortList(Keys=sorting_keys, ValuesA=geometry, ValuesB=box.Plane)  # -> Keys, ValuesA, ValuesB
multiplication = Multiplication(A=item, B=scale_x)
multiplication_2 = Multiplication(A=item_2, B=scale_y)
recgrid = Rectangular(Plane=plane, SizeX=multiplication, SizeY=multiplication_2, ExtentX=addition, ExtentY=number_of_rows)  # -> Cells, Points
subtraction = Subtraction(A=lng, B="1")
rev = ReverseList(List=sort_3.ValuesA)
rev_2 = ReverseList(List=sort_3.ValuesB)
rev_3 = ReverseList(List=sort_3.Keys)
filter = StreamFilter(Gate=reverse_order, Stream0=sort_3.ValuesA, Stream1=rev)
filter_2 = StreamFilter(Gate=reverse_order, Stream0=sort_3.ValuesB, Stream1=rev_2)
subset = SubList(List=flatten(recgrid.Cells), Domain=subtraction, Wrap=True)  # -> List, Index
filter_3 = StreamFilter(Gate=reverse_order, Stream0=sort_3.Keys, Stream1=rev_3)
vec = VectorXYZ(XComponent=multiplication, YComponent=multiplication_2, ZComponent=0)  # -> Vector, Length
pcen = PolygonCenter(Polyline=subset.List)  # -> CenterV, CenterE, CenterA
pl_origin = PlaneOrigin(Base=plane, Origin=pcen.CenterV)
orient = Orient(Geometry=filter, Source=filter_2, Target=pl_origin)  # -> Geometry, Transform
geometry_2 = ClusterOutput(orient.Geometry)
keys = ClusterOutput(filter_3)
planes = ClusterOutput(pl_origin)
cell_size = ClusterOutput(vec.Vector)
