# Grasshopper definition Clash_geometry - edge detection + corner conditions.gh (Grasshopper 1.0.7)
# plug-ins: Assembler, Human, froGH, eleFront Rhino 6 Legacy

crv = Curve([<curve referenced from the Rhino model> x2])
panel = Panel("""1
2""")
handcon = ConstructHandle(Polyline=crv, RotationAngles=0, Type=panel, Weight=1)

# ----
# XData
mesh = Mesh(<mesh referenced from the Rhino model>)
mesh_2 = Mesh(<mesh referenced from the Rhino model>)
mesh_3 = Mesh(<mesh referenced from the Rhino model>)
mesh_4 = Mesh(<mesh referenced from the Rhino model>)
mesh_5 = Mesh(<mesh referenced from the Rhino model>)

panel_2 = Panel("""0<0
1<2
2<1""")

step = Button()
target_number = Panel("1000")
go = BooleanToggle(False)

reset_settings = Button()
reset = Button()

# ---- group: starting plane (XY implicito)
pt = Point(Point(-67.19070642, -0.4783107325, 0))

# ---- group: panel geometries / case 0
# Frontiers
# panels
mesh_6 = Mesh(<mesh referenced from the Rhino model>)

# ---- group: panel geometries / case 2
mesh_7 = Mesh(<mesh referenced from the Rhino model>)

# ---- group: panel geometries / case 1
mesh_8 = Mesh(<mesh referenced from the Rhino model>)

# ---- group: panel geometries / case 3
mesh_9 = Mesh(<mesh referenced from the Rhino model>)

# ---- group: corner geometries / corner int L
mesh_10 = Mesh(<mesh referenced from the Rhino model>)

# ---- group: corner geometries / corner ext L
mesh_11 = Mesh(<mesh referenced from the Rhino model>)

# ---- group: corner geometries / corner int R
mesh_12 = Mesh(<mesh referenced from the Rhino model>)

# ---- group: corner geometries / corner ext R
mesh_13 = Mesh(<mesh referenced from the Rhino model>)

# ---- group: panel geometries
merge = Merge(Data1=mesh_6, Data2=mesh_8, Data3=mesh_7, Data4=mesh_9)

# ---- group: corner geometries
merge_2 = Merge(Data1=mesh_10, Data2=mesh_11, Data3=mesh_12, Data4=mesh_13)

# ---- group: Handle polyline
# reference Handle plane
crv_2 = Curve(<curve referenced from the Rhino model>)

# ---- group: reference plane
f_plp = PlaneFromLPolyline(Polyline=crv_2)

# ---- group: main panel clash line(s)
crv_3 = Curve(<curve referenced from the Rhino model>)

# ---- group: clash volume
# clash geometries
mesh_14 = Mesh(<mesh referenced from the Rhino model>)

# ---- group: corners / corner clash lines L
crv_4 = Curve([<curve referenced from the Rhino model> x3])

# ---- group: corners / corner clash lines R
crv_5 = Curve([<curve referenced from the Rhino model> x3])

# ---- group: corners
merge_3 = Merge(Data1=crv_4, Data2=crv_5)

# ----
# 2. find corners condition
# clash check corner conditions
# only with placed clash volumes
clash_lines_data_order = Panel("""L0
L1
L2
R0
R1
R2""")

straight = Panel("""False
False""")

# ---- group: main panel case colors
fse_fse = ColourSwatch(SwatchColor=RGB(255, 191, 0))
fse_i = ColourSwatch(SwatchColor=RGB(255, 165, 0))
i_fse = ColourSwatch(SwatchColor=RGB(255, 127, 0))
colour_swatch = ColourSwatch(SwatchColor=RGB(205, 133, 0))
merge_4 = Merge(Data1=fse_fse, Data2=fse_i, Data3=i_fse, Data4=colour_swatch)

# ---- group: corner case colors
lint = ColourSwatch(SwatchColor=RGB(166, 219, 222))
lext = ColourSwatch(SwatchColor=RGB(111, 195, 199))
rint = ColourSwatch(SwatchColor=RGB(232, 162, 162))
rext = ColourSwatch(SwatchColor=RGB(168, 103, 103))
merge_5 = Merge(Data1=lint, Data2=lext, Data3=rint, Data4=rext)

# ----
# Handles
number_slider = Slider(0.25, range=0..1)
# parameters
# Setup
# bake
# preview on/off
crv_6 = Curve([<curve referenced from the Rhino model> x4])
handcon_2 = ConstructHandle(Polyline=crv_6, RotationAngles=0, Type=0, Weight=1)

merge_6 = Merge(Data1=handcon_2, Data2=handcon)

# ----
# AssemblyObject 1
mesh_15 = Mesh(<mesh referenced from the Rhino model>)
# <title>
# 
# <description>
# 
# code by Alessio Erioli
# 
# v 0.1
# © a3 2021 / Creative Commons Attribution-Non Commercial-ShareAlike 4.0 International License
name = Panel("Box")
aocon = ConstructAssemblyObject(Name=name, CollisionMesh=mesh_15, Direction=Vector(1, 0, 0), Handles=merge_6, Weight=1, ZLockAO=False)
merge_7 = Merge(Data1=mesh, Data2=mesh_2, Data3=mesh_3, Data4=mesh_4, Data5=mesh_5)
xdcon = ConstructXData(Label="actual geometry", AssemblyObject=aocon, Data=merge_7)

handdisp = DisplayHandles(Handles=merge_6, DisplaySize=number_slider, absHTextSize=False)

# ----
# selective geometry - roof
panel_3 = Panel("roof")
mesh_16 = Mesh(<mesh referenced from the Rhino model>)
xdcon_2 = ConstructXData(Label=panel_3, AssemblyObject=aocon, Data=mesh_16)

# ----
# Rules (Heuristics)
heuwri = HeuristicsWriter(AssemblyObjectsSet=aocon, HandleCompatibility=panel_2, noSH=False, noSO=False, xHT=False)
pt_2 = Point(Point(0, 22.64105822, 0))
# Simulate
heud = HeuristicDisplay(
    OriginPoint=pt_2,
    AssemblyObjectsSet=aocon,
    XData=xdcon,
    HeuristicsSet=heuwri,
    XSize=1.2,
    YSize=1.2,
    TextSize=1,
    NRows=Slider(4, range=2..10),
    DisplayType="S-R",
    ZLockFilter=False,
    OutputType="S-R")

# ----
# Heuristics
# Settings
sender_selection_mode = ValueList({"Random": 0, "Scalar Field nearest": 1, "Scalar Field interpolated": 2, "Vector Field > nearest": 3, "Vector Field > interpolated": 4, "Vector Field <> nearest": 5, "Vector Field <> interpolated": 6, "Minimum local AABB volume": 7, "Minimum local AABB diagonal": 8, "Weighted Random Choice": 9}, selected="Scalar Field nearest")
receiver_selection_mode = ValueList({"Random": 0, "Scalar Field nearest": 1, "Scalar Field interpolated": 2, "Dense Packing": 3}, selected="Scalar Field nearest")
heuset = HeuristicsSettings(
    HeuristicsSet=heuwri,
    CurrentHeuristics=0,
    HeuristicsMode=0,
    ReceiverSelectionMode=receiver_selection_mode,
    SenderRuleSelectionMode=sender_selection_mode)

# ----
# Field
number_slider_2 = Slider(20, range=10..20)
mesh_17 = Mesh(<mesh referenced from the Rhino model>)
afieldn = ConstructFieldN(Geometry=mesh_17, Plane=PlaneXY(0, 0, 0), NCells=number_slider_2)  # -> Field, FieldCellsDimensions, FieldPoints
merge_8 = Merge(Data1=ColourSwatch(SwatchColor=RGB(255, 255, 255)), Data2=ColourSwatch(SwatchColor=RGB(0, 0, 0)))

# ---- group: compute scalar values
crv_7 = Curve(<curve referenced from the Rhino model>)
crv_cp = CurveClosestPoint(Point=afieldn.FieldPoints, Curve=crv_7)  # -> Point, Parameter, Distance

# ----
previewlw = CustomPreviewLineweights(Geometry=crv_7, Shader=ColourSwatch(SwatchColor=RGB(255, 0, 255)), Thickness="5", Absolute=False)

# ----
# Exogenous
# (environment)
# Settings
field_scalar_threshold = Slider(0.25, range=0..1)

afpop = PopulateField(Field=afieldn.Field, ScalarValues=crv_cp.Distance)
afcol = ColorField(Field=afpop, Colors=merge_8, Index=0, Threshold=field_scalar_threshold, FieldColorBlend=False)  # -> Field, Colors

exoset = ExogenousSettings(
    EnvironmentMode="2",
    Field=afcol.Field,
    FieldScalarThreshold=field_scalar_threshold,
    Sandbox={Plane=PlaneXY(0, 0, 0), X=Domain(-1, 1), Y=Domain(0, 0), Z=Domain(0, 0)},
    HasContainer=False)

aoaengine = AssemblerEngine(
    AssemblyObjectsSet=aocon,
    StartingPlane=pt,
    StartingObjectType=0,
    HeuristicsSettings=heuset,
    ExogenousSettings=exoset,
    Go=go,
    Step=step,
    NIterations=Slider(100, range=10..100),
    TargetMaxNObjects=target_number,
    ResetSettings=reset_settings,
    Reset=reset,
    UseSupports=False,
    ZLockCheck=False)  # -> Assemblage, AssemblageCount

# ---- group: autostop condition
larger = LargerThan(FirstNumber=aoaengine.AssemblageCount, SecondNumber=target_number)  # -> LargerThan, OrEqualTo
f_tas = ToggleAutostop(Toggle=go, Condition=larger.OrEqualTo)

# ----
panel_4 = Panel(aoaengine.AssemblageCount)
# Post-process
dam = DataDam(DataA=aoaengine.Assemblage, BufferDelay=10000000, BufferMode=0)

# ----
# the usual workflow...
aoadisp = DisplayAssemblage(Assemblage=dam, ColorsOnly=False, OutputType="Objects")  # -> ColoredCollisionMeshes, Edges, Colors, Values
aoadecon = DeconstructAssemblage(Assemblage=dam)  # -> AssemblageObjects, AssemblageRules, ReceiverObjectsIndexes, AvailableObjectIndexes, UnreachableObjectIndexes

# ----
# place actual geometry
# replace this part with your bespoke process
associate_xdata = AssociateXData(AssemblyObjects=aoadecon.AssemblageObjects, XData=xdcon)  # "AO<>XD"
xddecon = DeconstructXData(XData=associate_xdata)  # -> Label, AssemblyObjectNameReference, ReferencePlane, Data

# ---- group: collision geometries
preview = CustomPreview(Geometry=aoadisp.ColoredCollisionMeshes, Material=aoadisp.Colors)  # disabled
previewlw_2 = CustomPreviewLineweights(Geometry=aoadisp.Edges, Shader=ColourSwatch(SwatchColor=RGB(140, 184, 31)), Absolute=False)

# ----
# place selective geometry
# replace this part with your bespoke process
# Place roof if Handle 5 is free
aoehandles = ExtractHandles(AssemblyObject=aoadecon.AssemblageObjects)  # -> HandlesSenderPlanes, HandlesTypes, HandlesWeights, HandleOccupancy, NeighbourObjectIndex, NeighbourHandleIndex
# Post-process frontiers
panel_5 = Panel("5")
item = ListItem(List=aoehandles.HandleOccupancy, Index=panel_5, Wrap=True)
equals = Equality(FirstNumber=item, SecondNumber="0")  # -> Equality, Inequality
cull = CullPattern(List=aoadecon.AssemblageObjects, CullPattern=equals.Equality)
associate_xdata_2 = AssociateXData(AssemblyObjects=cull, XData=xdcon_2)  # "AO<>XD"
xddecon_2 = DeconstructXData(XData=associate_xdata_2)  # -> Label, AssemblyObjectNameReference, ReferencePlane, Data

mesh_18 = Mesh(xddecon.Data)
mesh_19 = Mesh(xddecon_2.Data)

# ---- group: interior geometry
f_mmeea = MeshesExtractEdgesWithToleranceAngle(Mesh=flatten(mesh_18), Angle=45)  # -> InternalEdges, NakedEdges
preview_2 = CustomPreview(Geometry=mesh_18, Material=graft(aoadisp.Colors))  # disabled
previewlw_3 = CustomPreviewLineweights(Geometry=[f_mmeea.InternalEdges, f_mmeea.NakedEdges], Shader=ColourSwatch(SwatchColor=RGB(0, 0, 0)), Absolute=False)  # disabled

# ---- group: roof
f_mmeea_2 = MeshesExtractEdgesWithToleranceAngle(Mesh=flatten(mesh_19), Angle=45)  # -> InternalEdges, NakedEdges
preview_3 = CustomPreview(Geometry=mesh_19, Material=ColourSwatch(SwatchColor=RGB(100, 189, 189)))  # disabled
previewlw_4 = CustomPreviewLineweights(Geometry=[f_mmeea_2.InternalEdges, f_mmeea_2.NakedEdges], Shader=ColourSwatch(SwatchColor=RGB(0, 0, 0)), Absolute=False)  # disabled

# ----
# Blocks workflow
pshift = ShiftPaths(Data=cull, Offset=-1)
block_name = Panel("interior geometry")
roof_block_name = Panel("roof")
aoerplane = ExtractReferencePlane(AssemblyObject=aoadecon.AssemblageObjects)
aoerplane_2 = ExtractReferencePlane(AssemblyObject=pshift)
inblock_r6 = InsertBlockR6(BlockName=block_name, SourcePlane=aoerplane)
inblock_r6_2 = InsertBlockR6(BlockName=roof_block_name, SourcePlane=aoerplane_2)
merge_9 = Merge(Data1=inblock_r6, Data2=inblock_r6_2)

# ---- group: bake blocks
bake = BooleanToggle(False)
bake_r6 = BakeObjectsR6(Geometry=merge_9, Bake=bake)

# ----
# Better block preview: This part is for blocks preview only. Deconstructing blocks into geometries helps Grasshopper in managing the preview.
deblock_r6 = DeconstructBlockR6(Block=inblock_r6)  # -> Name, Plane, Geometry
deblock_r6_2 = DeconstructBlockR6(Block=inblock_r6_2)  # -> Name, Plane, Geometry
mesh_20 = Mesh(deblock_r6.Geometry)
mesh_21 = Mesh(deblock_r6_2.Geometry)

# ---- group: roof
f_mmeea_3 = MeshesExtractEdgesWithToleranceAngle(Mesh=flatten(mesh_21), Angle=45)  # -> InternalEdges, NakedEdges
preview_4 = CustomPreview(Geometry=mesh_21, Material=ColourSwatch(SwatchColor=RGB(100, 189, 189)))
previewlw_5 = CustomPreviewLineweights(Geometry=[f_mmeea_3.InternalEdges, f_mmeea_3.NakedEdges], Shader=ColourSwatch(SwatchColor=RGB(0, 0, 0)), Absolute=False)

# ---- group: interior geometry
f_mmeea_4 = MeshesExtractEdgesWithToleranceAngle(Mesh=flatten(mesh_20), Angle=45)  # -> InternalEdges, NakedEdges
preview_5 = CustomPreview(Geometry=mesh_20, Material=ColourSwatch(SwatchColor=RGB(255, 255, 255)))
previewlw_6 = CustomPreviewLineweights(Geometry=[f_mmeea_4.InternalEdges, f_mmeea_4.NakedEdges], Shader=ColourSwatch(SwatchColor=RGB(0, 0, 0)), Absolute=False)

# ----
# find free frontier Handles
# Gets planes for free handles of a certain type. Checking Handle type is redundant in this case, but a specific Handle type can be dedicated to panel placing
aoehandles_2 = ExtractHandles(AssemblyObject=aoadecon.AssemblageObjects)  # -> HandlesSenderPlanes, HandlesTypes, HandlesWeights, HandleOccupancy, NeighbourObjectIndex, NeighbourHandleIndex

# ---- group: is type 0
target_type = Panel("0")
equals_2 = Equality(FirstNumber=aoehandles_2.HandlesTypes, SecondNumber=target_type)  # -> Equality, Inequality

# ---- group: is free
equals_3 = Equality(FirstNumber=aoehandles_2.HandleOccupancy, SecondNumber="0")  # -> Equality, Inequality

# ----
and = GateAnd(A=equals_2.Equality, B=equals_3.Equality)
cull_2 = CullPattern(List=aoehandles_2.HandlesSenderPlanes, CullPattern=and)

# ----
# 1. find suitable surfaces for frontiers
# This example checks for free frontier Handles + clash check with a line for minimum free front space.
# 
# Replace these steps with your bespoke process and conditions.
# replace this part with your bespoke process and conditions
# output must be a tree of target planes, ordered by {AO index; Handle index}
pshift_2 = ShiftPaths(Data=cull_2, Offset=-1)  # -> graft(Data)
orient = Orient(Geometry=crv_3, Source=f_plp, Target=pshift_2)  # -> Geometry, Transform
pshift_3 = ShiftPaths(Data=orient.Geometry, Offset=-1)

# ----
# clash check front space
mjoin = MeshJoin(Meshes=flatten(xddecon.Data))
mcx = MeshCurve(Mesh=mjoin, Curve=pshift_3)  # -> Points, Faces
lng = ListLength(List=mcx.Points)
equals_4 = Equality(FirstNumber=lng, SecondNumber="0")  # -> Equality, Inequality

# ---- group: clash lines & points (for debug display)
swatch = ColourSwatch(SwatchColor=RGB(255, 0, 0))
previewlw_7 = CustomPreviewLineweights(Geometry=pshift_3, Shader=swatch, Thickness="3", Absolute=False)  # disabled
f_pcd = PointCloudDisplay(Points=mcx.Points, Colors=swatch, Size="5")  # disabled

# ----
cull_3 = CullPattern(List=pshift_2, CullPattern=equals_4.Equality)

clean = CleanTree(RemoveNulls=True, RemoveInvalid=True, RemoveEmpty="true", Tree=cull_3)
orient_2 = Orient(Geometry=mesh_14, Source=f_plp, Target=clean)  # -> Geometry, Transform
orient_3 = Orient(Geometry=merge_3, Source=f_plp, Target=clean)  # -> Geometry, Transform

# ---- group: find which clash line intersects
mjoin_2 = MeshJoin(Meshes=flatten(orient_2.Geometry))
mcx_2 = MeshCurve(Mesh=mjoin_2, Curve=orient_3.Geometry)  # -> Points, Faces
lng_2 = ListLength(List=mcx_2.Points)
larger_2 = LargerThan(FirstNumber=lng_2, SecondNumber="0")  # -> LargerThan, OrEqualTo
pshift_4 = ShiftPaths(Data=larger_2.LargerThan, Offset=-1)

# ---- group: frontier clash volumes
mesh_22 = Mesh(mjoin_2)
medges = MeshEdges(Mesh=mesh_22)  # -> NakedEdges, InteriorEdges, NonManifoldEdges
preview_6 = CustomPreview(Geometry=mesh_22, Material=ColourSwatch(SwatchColor=RGB(255, 170, 0)))  # disabled
previewlw_8 = CustomPreviewLineweights(Geometry=medges.InteriorEdges, Shader=ColourSwatch(SwatchColor=RGB(0, 0, 0)), Absolute=False)  # disabled

# ---- group: splt L-R
partition = PartitionList(List=pshift_4, Size="3")

# ----
# find corners condition
# index of intersecting line - corner case: The index of the found collision line is summed with the number of collisions (0 if no collision, 1 in every other case), thus we get the following indexes:
# 
# 0 - none  (free side)
# 1 - line 0 (straight)
# 2 - line 1 (external)
# 3 - line 2 (internal)
# See Rhino file for an explanation of the corner cases
# Specify whether a detail (0 - internal, 1 - external) should be placed or not in each case.
f_ifroml = IndexesFromList(Data=partition)
cull_4 = CullPattern(List=f_ifroml, CullPattern=partition)
free = Panel("""False
True""")
external = Panel("""False
True""")
internal = Panel("""True
False""")

# ---- group: catch "bowtie" condition
# In the case of a "bowtie" (2 AOs touching at one corner), there are 2 clash lines intersecting (case 1 and 2). However, the façade condition is an internal corner, so selecting the larger index ensures the right condition - internal corner - for such cases)
sort = SortList(Keys=cull_4)  # -> reverse(Keys), ValuesA
item_2 = ListItem(List=sort.Keys, Index=0, Wrap=True)

# ----
lng_3 = ListLength(List=item_2)
addition = Addition(A=item_2, B=lng_3)

# ---- group: if X is less or equal to 2 pass 0, else pass 1
expression = Expression(x=addition, Expression="Max(x,2)-2")

# ----
weave = Weave(Pattern=addition, Stream0=free, Stream1=straight, Stream2=external, Stream3=internal, NullGaps=False)

# ---- group: merge L/R
pshift_5 = ShiftPaths(Data=expression, Offset=-1)

# ----
# 3. assing panels configurations
# find main panels case
# Corner cases: To find which of the 4 L/R corner case we're in, first we reduce corner cases to 2: Internal (case 3) and non-Internal (F/S/E - cases 0,1, and 2). The formula converts:
# 
# 0,1,2 -> 0
# 3 -> 1.
l_r_multipliers = Panel("""2
1""")
multiplication = Multiplication(A=pshift_5, B=l_r_multipliers)
corner_cases = Panel("""Finds L/R case:

0 - FSE/FSE
1 - FSE/I
2 - I/FSE
3 - I/I""")

data_order = Panel("""L-int
L-ext
R-int
R-ext""")
pshift_6 = ShiftPaths(Data=weave, Offset=-1)

# ---- group: sum L + R
ma = MassAddition(Input=multiplication)  # -> Result, PartialResults

# ----
cull_5 = CullPattern(List=merge_2, CullPattern=pshift_6)
cull_6 = CullPattern(List=merge_5, CullPattern=pshift_6)
item_3 = ListItem(List=merge, Index=ma.Result, Wrap=True)
item_4 = ListItem(List=merge_4, Index=ma.Result, Wrap=True)

# ----
# Frontiers are related to Handle conditions, not AOs. For this reason, Orient geometry directly on suitable Handles planes is preferred to Associate XData
orient_4 = Orient(Geometry=item_3, Source=f_plp, Target=clean)  # -> Geometry, Transform
orient_5 = Orient(Geometry=cull_5, Source=f_plp, Target=clean)  # -> Geometry, Transform

f_mmeea_5 = MeshesExtractEdgesWithToleranceAngle(Mesh=flatten(orient_4.Geometry), Angle=45)  # -> InternalEdges, NakedEdges
preview_7 = CustomPreview(Geometry=orient_4.Geometry, Material=item_4)  # disabled
previewlw_9 = CustomPreviewLineweights(Geometry=[f_mmeea_5.InternalEdges, f_mmeea_5.NakedEdges], Shader=ColourSwatch(SwatchColor=RGB(0, 0, 0)), Absolute=False)  # disabled

f_mmeea_6 = MeshesExtractEdgesWithToleranceAngle(Mesh=flatten(orient_5.Geometry), Angle=45)  # -> InternalEdges, NakedEdges
preview_8 = CustomPreview(Geometry=orient_5.Geometry, Material=cull_6)  # disabled
previewlw_10 = CustomPreviewLineweights(Geometry=[f_mmeea_6.InternalEdges, f_mmeea_6.NakedEdges], Shader=ColourSwatch(SwatchColor=RGB(0, 0, 0)), Absolute=False)  # disabled

# ----
# Blocks workflow
panel_block_prefix = Panel("panel")
panel_block_suffixes = Panel("""_FSE-FSE
_FSE-I
_I-FSE
_I-I""")
corner_block_suffix = Panel("corner")
corner_block_suffixes = Panel("""_int_L
_ext_L
_int_R
_ext_R""")
concat = Concatenate(FragmentA=panel_block_prefix, FragmentB=panel_block_suffixes)
concat_2 = Concatenate(FragmentA=corner_block_suffix, FragmentB=corner_block_suffixes)
item_5 = ListItem(List=concat, Index=ma.Result, Wrap=True)
cull_7 = CullPattern(List=concat_2, CullPattern=pshift_6)
inblock_r6_3 = InsertBlockR6(BlockName=item_5, SourcePlane=clean)
inblock_r6_4 = InsertBlockR6(BlockName=cull_7, SourcePlane=clean)
pshift_7 = ShiftPaths(Data=inblock_r6_3, Offset=-1)
pshift_8 = ShiftPaths(Data=inblock_r6_4, Offset=-1)
merge_10 = Merge(Data1=pshift_7, Data2=pshift_8)

# ---- group: bake frontier blocks
bake_2 = BooleanToggle(False)
bake_r6_2 = BakeObjectsR6(Geometry=merge_10, Bake=bake_2)

# ----
graft = GraftTree(Tree=cull_6, IncludeEmptyLists=True, IncludeNullItems=True)

deblock_r6_3 = DeconstructBlockR6(Block=graft(inblock_r6_4), recursive=True)  # -> Name, Plane, Geometry
# Better block preview: This part is for blocks preview only. Deconstructing blocks into geometries helps Grasshopper in managing the preview.
deblock_r6_4 = DeconstructBlockR6(Block=inblock_r6_3)  # -> Name, Plane, Geometry
mesh_23 = Mesh(deblock_r6_4.Geometry)
mesh_24 = Mesh(deblock_r6_3.Geometry)

# ---- group: main panels
f_mmeea_7 = MeshesExtractEdgesWithToleranceAngle(Mesh=flatten(mesh_23), Angle=45)  # -> InternalEdges, NakedEdges
preview_9 = CustomPreview(Geometry=mesh_23, Material=item_4)
previewlw_11 = CustomPreviewLineweights(Geometry=[f_mmeea_7.InternalEdges, f_mmeea_7.NakedEdges], Shader=ColourSwatch(SwatchColor=RGB(0, 0, 0)), Absolute=False)

f_mmeea_8 = MeshesExtractEdgesWithToleranceAngle(Mesh=flatten(mesh_24), Angle=45)  # -> InternalEdges, NakedEdges
preview_10 = CustomPreview(Geometry=mesh_24, Material=graft)
previewlw_12 = CustomPreviewLineweights(Geometry=[f_mmeea_8.InternalEdges, f_mmeea_8.NakedEdges], Shader=ColourSwatch(SwatchColor=RGB(0, 0, 0)), Absolute=False)
