# Grasshopper definition Scatterplot.gh (Grasshopper 1.0.7)
# Copyright: Co-de-iT
# plug-ins: Human, froGH

# ---- group: File selection
# try the Remote Control Panel: View > Remote Control Panel
f_ghfilepath = GHFilePathInfo()  # -> FileName, FilePath
concat = Concatenate(FragmentA=f_ghfilepath.FilePath, FragmentB="data Sets\")
file_selector = Slider(1, range=0..1)
f_dirread = DirectoryReader(DirectoryPath=concat)  # -> FileList, SubdirList
panel = Panel(f_dirread.FileList)
lng = ListLength(List=f_dirread.FileList)  # -> expr("x-1", Length)
multiplication = Multiplication(A=lng, B=file_selector)
int = Integer(multiplication)
item = ListItem(List=f_dirread.FileList, Index=int, Wrap=True)
panel_2 = Panel(item)
# Data Analysis - Scatterplot
# 
# <description>
# 
# code by Alessio Erioli
# 
# v 0.1
# © Co-de-iT 2020 / Creative Commons Attribution-Non Commercial-ShareAlike 4.0 International License
concat_2 = Concatenate(FragmentA=concat, FragmentB=item)

# ----
file = ReadFile(File=concat_2, PerLineParse=True)
point_size_feature = Slider(0.177, range=0..1)
text_size = Slider(0.617, range=0..2)
diagram_size = Slider(50, range=1..50)
id_text_size = Slider(0.592, range=0..2)
id_text_offset = Slider(0.4, range=0..1)
x_feature = Slider(0, range=0..1)
y_feature = Slider(1, range=0..1)
point_size = Slider(0.402, range=0..1)
pt = Point(Point(0, 0, 0))
split = TextSplit(Text=file, Separators=",")
flip = FlipMatrix(Data=split)
split_2 = SplitList(List=flip, Index="1")  # -> flatten(ListA), ListB
pshift = ShiftPaths(Data=split_2.ListB, Offset=-1)

# ---- group: diagram lines
X = UnitX(Factor=1)
Y = UnitY(Factor=1)
line = LineSDL(Start=pt, Direction=[X, Y], Length=diagram_size)

# ----
split_3 = SplitTree(Data=pshift, Masks=flatten("{*;0}"))  # -> Positive, Negative
split_4 = SplitList(List=split_2.ListA, Index="1")  # -> ListA, ListB

# ---- group: diagram label points
addition = Addition(A=X, B=Y)
multiplication_2 = Multiplication(A=addition, B="-0.5")
move = Move(Geometry=pt, Motion=multiplication_2)  # -> Geometry, Transform
panel_3 = Panel("""0
90""")
prot = RotatePlane(Plane=move.Geometry, Angle=degrees(panel_3))
X_2 = UnitX(Factor=1)
Y_2 = UnitY(Factor=1)
merge = Merge(Data1=X_2, Data2=Y_2)
move_2 = Move(Geometry=prot, Motion=merge)  # -> Geometry, Transform

# ----
data = Data(split_3.Negative)
tstat = TreeStatistics(Tree=split_3.Negative)  # -> Paths, Length, expr("x-1", Count)

# ---- group: data remapping
bnd = Bounds(Numbers=data)
number_slider = Slider(0.539, range=0..1)
dedomain = DeconstructDomain(Domain=bnd)  # -> Start, End
subtraction = Subtraction(A=dedomain.Start, B=number_slider)  # -> flatten(Result)
addition_2 = Addition(A=dedomain.End, B=number_slider)  # -> flatten(Result)
multiplication_3 = Multiplication(A=diagram_size, B=Slider(0.95, range=0..1))
dom = ConstructDomain(DomainStart="0.1", DomainEnd=multiplication_3)
dom_2 = ConstructDomain(DomainStart=flatten(subtraction), DomainEnd=addition_2)
remap = RemapNumbers(Value=data, Source=graft(dom_2), Target=dom)  # -> Mapped, Clipped

# ----
multiplication_4 = Multiplication(A=tstat.Count, B=x_feature)
multiplication_5 = Multiplication(A=tstat.Count, B=y_feature)
multiplication_6 = Multiplication(A=tstat.Count, B=point_size_feature)
item_2 = ListItem(List=move_2.Geometry, Index=0, Wrap=True)
max_point_size = Slider(2.153, range=0..5)
min_point_size = Slider(0.234, range=0..5)
dom_3 = ConstructDomain(DomainStart=min_point_size, DomainEnd=max_point_size)
viewer = ParamViewer(remap.Mapped)
item_3 = ListItem(List=viewer, Index=multiplication_6, Wrap=True)
branch = TreeBranch(Tree=data, Path=item_3, MaintainPaths=True)
bnd_2 = Bounds(Numbers=flatten(branch))
multiplication_7 = Multiplication(A=text_size, B="2")
remap_2 = RemapNumbers(Value=branch, Source=bnd_2, Target=dom_3)  # -> Mapped, Clipped
neg = Negative(Value=multiplication_7)
use_point_size_feature = BooleanToggle(False)
item_4 = ListItem(List=viewer, Index=multiplication_4, Wrap=True)
item_5 = ListItem(List=viewer, Index=multiplication_5, Wrap=True)
Y_3 = UnitY(Factor=neg)
item_6 = ListItem(List=split_4.ListB, Index=multiplication_4, Wrap=True)
panel_4 = Panel(item_6)
item_7 = ListItem(List=split_4.ListB, Index=multiplication_5, Wrap=True)
panel_5 = Panel(item_7)
item_8 = ListItem(List=split_4.ListB, Index=multiplication_6, Wrap=True)
panel_6 = Panel(item_8)
Y_4 = UnitY(Factor=1)
expression = Expression(x=item_8, Expression="Format(\"Point Size: {0}\", x)")
move_3 = Move(Geometry=item_2, Motion=Y_3)  # -> Geometry, Transform
branch_2 = TreeBranch(Tree=remap.Mapped, Path=item_5, MaintainPaths=True)
branch_3 = TreeBranch(Tree=remap.Mapped, Path=item_4, MaintainPaths=True)
filter = StreamFilter(Gate=use_point_size_feature, Stream0=point_size, Stream1=remap_2.Mapped)
addition_3 = Addition(A=id_text_offset, B=filter)
swatch = ColourSwatch(SwatchColor=RGB(0, 0, 0))
multiplication_8 = Multiplication(A=Y_4, B=addition_3)
panel_7 = Panel("""1
7""")
pt_2 = ConstructPoint(XCoordinate=branch_3, YCoordinate=branch_2, ZCoordinate=0)
filter_2 = StreamFilter(Gate=use_point_size_feature, Stream1=expression)
move_4 = Move(Geometry=pt_2, Motion=multiplication_8)  # -> Geometry, Transform
previewlw = CustomPreviewLineweights(Geometry=line, Shader=swatch, Absolute=False)
tag = TextTag3D(Location=move_2.Geometry, Text=[item_6, item_7], Size=text_size, Colour=swatch, Justification=panel_7)
lng_2 = ListLength(List=pt_2)
tag_2 = TextTag3D(Location=move_3.Geometry, Text=filter_2, Size=text_size, Colour=swatch, Justification="1")
wheel = ColourWheel(
    lng_2,
    ColourGrips_Style=30,
    ColourGrips_Grip=[0.636689826, 2.094395102, 4.188790205, 3.141592654],
    ColourGrips_Lum=[0.3837606541, 0.6554848017],
    ColourGrips_Range=[0.515881101, 0.515881101, 0.515881101, 0.515881101],
    ColourGrips_Sat=[0.1035496897, 0.9126757199])
tag_3 = TextTag3D(Location=move_4.Geometry, Text=split_3.Positive, Size=id_text_size, Colour=wheel, Justification=8)
dots = DotDisplay(Point=pt_2, Colour=wheel, Size=filter)
