# Grasshopper definition Spider Graph.gh (Grasshopper 1.0.7)
# Copyright: Co-de-iT
# plug-ins: Human, froGH

# ---- group: File selection
# try the Remote Control Panel: View > Remote Control Panel
f_ghfilepath = GHFilePathInfo()  # -> FileName, FilePath
concat = Concatenate(FragmentA=f_ghfilepath.FilePath, FragmentB="data Sets\")
file_selector = Slider(1, range=0..1)
f_dirread = DirectoryReader(DirectoryPath=concat)  # -> FileList, SubdirList
panel = Panel(f_dirread.FileList)
lng = ListLength(List=f_dirread.FileList)  # -> expr("x-1", Length)
multiplication = Multiplication(A=lng, B=file_selector)
int = Integer(multiplication)
item = ListItem(List=f_dirread.FileList, Index=int, Wrap=True)
panel_2 = Panel(item)
# Data Analysis - Spider Graph
# 
# <description>
# 
# code by Alessio Erioli
# 
# v 0.1
# © Co-de-iT 2020 / Creative Commons Attribution-Non Commercial-ShareAlike 4.0 International License
concat_2 = Concatenate(FragmentA=concat, FragmentB=item)

# ----
file = ReadFile(File=concat_2, PerLineParse=True)
highlight_selection = Slider(0.278, range=0..1)

diagram_radius = Slider(7.568, range=1..20)
spacing = Slider(1.8, range=1..3)
n_of_rows = Slider(4, range=1..20)
overlap = BooleanToggle(False)
text_size = Slider(0.74, range=0..2)
id_text_size = Slider(1.31, range=0..2)
pt = Point(Point(0, 0, 0))

split = TextSplit(Text=file, Separators=",")
cluster = Cluster(
    labeled_data=split,
    base_point=pt,
    diagram_radius=diagram_radius,
    spacing=spacing,
    n_of_rows=n_of_rows,
    overlap=overlap,
    id_overlap_pos=Slider(0.065, range=0..1))  # -> id_plane, test_ids, text_justification, diagram_lines, text_planes, data_labels, polylines, colors
lng_2 = ListLength(List=cluster.polylines)  # -> expr("x-1", Length)
multiplication_2 = Multiplication(A=lng_2, B=highlight_selection)
int_2 = Integer(multiplication_2)
item_2 = ListItem(List=cluster.polylines, Index=int_2, Wrap=True)
item_3 = ListItem(List=cluster.test_ids, Index=int_2, Wrap=True)
highlighted_id = Panel(item_3)
f_fmesh = FastMeshFromPolyline(Polylines=cluster.polylines)
filter = StreamFilter(Gate=overlap, Stream0="3", Stream1="1")
material = CreateMaterial(
    Diffuse=cluster.colors,
    Specular=RGB(255, 255, 255),
    Emission=RGB(0, 0, 0),
    Transparency=Slider(0.95, range=0..1),
    Shine=0)
f_mrenorm = MeshRebuildNormals(Mesh=f_fmesh)
previewlw = CustomPreviewLineweights(Geometry=item_2, Shader=ColourSwatch(SwatchColor=RGB(255, 0, 0)), Thickness="8", Absolute=False)
tag = TextTag3D(Location=cluster.id_plane, Text=cluster.test_ids, Size=id_text_size, Colour=cluster.colors, Justification=7)
preview = CustomPreview(Geometry=f_mrenorm, Material=material)
previewlw_2 = CustomPreviewLineweights(Geometry=cluster.diagram_lines, Shader=ColourSwatch(SwatchColor=RGB(117, 117, 117)), Absolute=False)
previewlw_3 = CustomPreviewLineweights(Geometry=cluster.polylines, Shader=cluster.colors, Thickness=filter, Absolute=False)
tag_2 = TextTag3D(
    Location=cluster.text_planes,
    Text=cluster.data_labels,
    Size=text_size,
    Colour=ColourSwatch(SwatchColor=RGB(0, 0, 0)),
    Justification=cluster.text_justification)

# ==== cluster Cluster
id_overlap_pos = ClusterInput()
labeled_data = ClusterInput()
base_point = ClusterInput()
diagram_radius = ClusterInput()
spacing = ClusterInput()
n_of_rows = ClusterInput()
overlap = ClusterInput()
flip = FlipMatrix(Data=labeled_data)
split = SplitList(List=flip, Index="1")  # -> flatten(ListA), ListB
pshift = ShiftPaths(Data=split.ListB, Offset=-1)
split_2 = SplitTree(Data=pshift, Masks=flatten("{*;0}"))  # -> Positive, Negative
split_3 = SplitList(List=split.ListA, Index="1")  # -> ListA, ListB
panel = Panel(split_2.Positive)
panel_2 = Panel(split_2.Negative)
data = Data(split_2.Negative)
tstat = TreeStatistics(Tree=data)  # -> Paths, Length, Count
item = ListItem(List=tstat.Length, Index=0, Wrap=True)
number_slider = Slider(0.539, range=0..1)

# ---- group: diagram
xy = XYPlane(Origin=base_point)
prot = RotatePlane(Plane=xy, Angle="PI*0.5")
cir = Circle(Plane=prot, Radius=diagram_radius)
flip_2 = FlipCurve(Curve=cir)  # -> Curve, Flag
divide = DivideCurve(Curve=flip_2.Curve, Count=tstat.Count, Kinks=False)  # -> Points, Tangents, Parameters
ln = Line(StartPoint=base_point, EndPoint=divide.Points)

# ---- group: data remapping
bnd = Bounds(Numbers=data)
dedomain = DeconstructDomain(Domain=bnd)  # -> Start, End
subtraction = Subtraction(A=dedomain.Start, B=number_slider)  # -> flatten(Result)
addition = Addition(A=dedomain.End, B=number_slider)  # -> flatten(Result)
dom = ConstructDomain(DomainStart=flatten(subtraction), DomainEnd=addition)
remap = RemapNumbers(Value=data, Source=graft(dom), Target="0.1 to 0.9")  # -> Mapped, Clipped

# ---- group: grid
integer_division = IntegerDivision(A=item, B=n_of_rows)  # -> expr("x+1", Result)
multiplication = Multiplication(A=diagram_radius, B=spacing, C="2.2")
sqgrid = Square(Plane=base_point, Size=multiplication, ExtentX=integer_division, ExtentY=n_of_rows)  # -> flatten(Cells), Points
subtraction_2 = Subtraction(A=item, B="1")
subset = SubList(List=sqgrid.Cells, Domain=subtraction_2, Wrap=True)  # -> List, Index
pcen = PolygonCenter(Polyline=subset.List)  # -> CenterV, CenterE, CenterA
vec2pt = Vector2Pt(PointA=base_point, PointB=pcen.CenterV, Unitize=False)  # -> Vector, Length

# ----
series = Series(Start="-0.01", Step="-0.01", Count=item)
Z = UnitZ(Factor=series)

# ---- group: data polylines
eval = EvaluateCurve(Curve=reparameterize(graft(ln)), Parameter=remap.Clipped)  # -> Point, Tangent, Angle
flip_3 = FlipMatrix(Data=eval.Point)
pline = PolyLine(Vertices=flip_3, Closed=True)  # -> flatten(Polyline)

# ----
pt = Point(Point(0, 0, 0))

# ---- group: text position
vec = Vector(ln)
multiplication_2 = Multiplication(A=vec, B="1.2")
move = Move(Geometry=xy, Motion=multiplication_2)  # -> Geometry, Transform

# ----
filter = StreamFilter(Gate=overlap, Stream0=vec2pt.Vector, Stream1=Z)
wheel = ColourWheel(
    item,
    ColourGrips_Style=30,
    ColourGrips_Grip=[0.636689826, 2.094395102, 4.188790205, 3.141592654],
    ColourGrips_Lum=[0.3837606541, 0.6554848017],
    ColourGrips_Range=[0.515881101, 0.515881101, 0.515881101, 0.515881101],
    ColourGrips_Sat=[0.1035496897, 0.9126757199])
curvepoint = PointOnCurve(subset.List, parameter=0)
eval_2 = EvaluateCurve(Curve=reparameterize(pline), Parameter=id_overlap_pos)  # -> Point, Tangent, Angle
move_2 = Move(Geometry=ln, Motion=graft(filter))  # -> Geometry, Transform
move_3 = Move(Geometry=move.Geometry, Motion=graft(filter))  # -> Geometry, Transform
move_4 = Move(Geometry=pline, Motion=filter)  # -> Geometry, Transform
filter_2 = StreamFilter(Gate=overlap, Stream0=curvepoint, Stream1=eval_2.Point)
pl_origin = PlaneOrigin(Base=xy, Origin=filter_2)
text_planes = ClusterOutput(move_3.Geometry)
diagram_lines = ClusterOutput(move_2.Geometry)
data_labels = ClusterOutput(split_3.ListB)
polylines = ClusterOutput(move_4.Geometry)
colors = ClusterOutput(wheel)
id_plane = ClusterOutput(pl_origin)
test_ids = ClusterOutput(split_2.Positive)
Y = UnitY(Factor=1)
f_svang = SignedVectorAngle(Vector1=Y, Vector2=move_2.Geometry, ZAxis=Vector(0, 0, 1))
smaller = SmallerThan(FirstNumber=f_svang, SecondNumber="0")  # -> SmallerThan, OrEqualTo
panel_3 = Panel("""6
4""")
item_2 = ListItem(List=panel_3, Index=smaller.SmallerThan, Wrap=True)
text_justification = ClusterOutput(item_2)
