# Grasshopper definition parallel coordinates graph.gh (Grasshopper 1.0.7)
# Copyright: Co-de-iT
# plug-ins: Human, froGH

# ---- group: File selection
# try the Remote Control Panel: View > Remote Control Panel
f_ghfilepath = GHFilePathInfo()  # -> FileName, FilePath
concat = Concatenate(FragmentA=f_ghfilepath.FilePath, FragmentB="data Sets\")
file_selector = Slider(0.5, range=0..1)
f_dirread = DirectoryReader(DirectoryPath=concat)  # -> FileList, SubdirList
panel = Panel(f_dirread.FileList)
lng = ListLength(List=f_dirread.FileList)  # -> expr("x-1", Length)
multiplication = Multiplication(A=lng, B=file_selector)
int = Integer(multiplication)
item = ListItem(List=f_dirread.FileList, Index=int, Wrap=True)
panel_2 = Panel(item)
# Data Analysis - Parallel Coordinates Graph
# 
# <description>
# 
# code by Alessio Erioli
# 
# v 0.1
# © Co-de-iT 2020 / Creative Commons Attribution-Non Commercial-ShareAlike 4.0 International License
concat_2 = Concatenate(FragmentA=concat, FragmentB=item)

# ----
file = ReadFile(File=concat_2, PerLineParse=True)
panel_3 = Panel(file)
split = TextSplit(Text=file, Separators=",")  # -> simplify(Result)
split_2 = SplitList(List=split, Index="1")  # -> ListA, ListB
flip = FlipMatrix(Data=split_2.ListB)  # -> simplify(Data)

graph_height = Slider(16, range=0..50)
column_span = Slider(10, range=0..50)

split_3 = SplitList(List=flip, Index="1")  # -> ListA, ListB
split_4 = SplitList(List=flatten(split_2.ListA), Index="1")  # -> ListA, simplify(graft(ListB))

# ---- group: normalize data (0-1)
bnd = Bounds(Numbers=split_3.ListB)
remap = RemapNumbers(Value=split_3.ListB, Source=bnd, Target=Domain(0, 1))  # -> Mapped, Clipped

# ----
lng_2 = ListLength(List=flatten(split_3.ListA))

column_label_rotation = Slider(0, range=0..1.57)
column_label_span = Slider(1.486, range=0..10)
column_label_size = Slider(0.303, range=0..1)

# ---- group: shortlist by data intervals
# filter 2
data_type_selector = Slider(1, range=0..1)
min = Slider(0.042, range=0..1)
max = Slider(0.478, range=0..1)

# filter 1
data_type_selector_2 = Slider(0.292, range=0..1)
min_2 = Slider(0.516, range=0..1)
max_2 = Slider(1, range=0..1)

# ----
column_labels = Panel(split_3.ListA)
row_labels = Panel(split_4.ListB)
series = Series(Start=0, Step=column_span, Count=lng_2)
pt = ConstructPoint(XCoordinate=series, YCoordinate=0, ZCoordinate=0)
Y = UnitY(Factor=1)
single_enter_character = Panel("")

# ---- group: column lines
line = LineSDL(Start=pt, Direction=Y, Length=graph_height)

# ----
concat_3 = Concatenate(FragmentA=column_labels, FragmentC=single_enter_character, FragmentB=bnd)
crv = Curve(reparameterize(graft(line)))
swatch = ColourSwatch(SwatchColor=RGB(0, 0, 0))

# ---- group: column labels
addition = Addition(A=graph_height, B=column_label_span)
Y_2 = UnitY(Factor=addition)
move = Move(Geometry=pt, Motion=Y_2)  # -> Geometry, Transform
xy = XYPlane(Origin=move.Geometry)
prot = RotatePlane(Plane=xy, Angle=column_label_rotation)  # -> graft(Plane)
tag = TextTag3D(Location=prot, Text=concat_3, Size=column_label_size, Colour=swatch, Justification=8)

# ----
eval = EvaluateCurve(Curve=crv, Parameter=remap.Mapped)  # -> Point, Tangent, Angle
previewlw = CustomPreviewLineweights(Geometry=line, Shader=swatch, Absolute=False)
flip_2 = FlipMatrix(Data=eval.Point)

# ---- group: graph polylines
pline = PolyLine(Vertices=flip_2, Closed=False)  # -> flatten(Polyline)
lng_3 = ListLength(List=flatten(pline))  # -> expr("x-1", Length)
range = Range(Domain=Domain(0, 1), Steps=lng_3)
gradient = Gradient(LowerLimit=0, UpperLimit=1, Parameter=range, stops=[0: RGB(255, 0, 0), 0.496: RGB(171, 171, 171), 1: RGB(42, 0, 255)])
previewlw_2 = CustomPreviewLineweights(Geometry=pline, Shader=gradient, Thickness="1", Absolute=False)  # disabled

# ---- group: highlight single curve
item_selector = Slider(0.052, range=0..1)
multiplication_2 = Multiplication(A=lng_3, B=item_selector)
int_2 = Integer(multiplication_2)
item_2 = Panel(int_2)
item_3 = ListItem(List=pline, Index=int_2, Wrap=True)
item_4 = ListItem(List=gradient, Index=int_2, Wrap=True)
display = BooleanToggle(False)
thickness = Slider(10, range=1..10)
filter = StreamFilter(Gate=display, Stream1=item_3)
previewlw_3 = CustomPreviewLineweights(Geometry=filter, Shader=item_4, Thickness=thickness, Absolute=False)

# ---- group: row labels
row_label_size = Slider(0.067, range=0..1)
row_labels_span = Slider(-0.5, range=-10..-0.5)

# ----
swatch_2 = ColourSwatch(SwatchColor=RGB(0, 0, 0))

# ---- group: row labels
item_5 = ListItem(List=flip_2, Index=0, Wrap=True)
X = UnitX(Factor=row_labels_span)
move_2 = Move(Geometry=item_5, Motion=X)  # -> Geometry, Transform
tag_2 = TextTag3D(Location=move_2.Geometry, Text=split_4.ListB, Size=row_label_size, Colour=graft(gradient), Justification=9)

# ----
thickness_2 = Slider(0.12, range=0..1)
thickness_3 = Slider(0.05, range=0..1)

# ---- group: shortlist by data intervals / selection rectangle
merge = Merge(Data1=min, Data2=max)
# ...more filters?
# More Filters?: Copy/Paste the above group (including input/output relays) and add another channel to the AND component and the Merge (for the highlight rectangle)
panel_4 = Panel("0.04")
multiplication_3 = Multiplication(A=column_span, B=panel_4)
X_2 = UnitX(Factor=multiplication_3)
rev = Reverse(Vector=X_2)
merge_2 = Merge(Data1=X_2, Data2=rev)

merge_3 = Merge(Data1=min_2, Data2=max_2)
multiplication_4 = Multiplication(A=column_span, B="0.04")
X_3 = UnitX(Factor=multiplication_4)
rev_2 = Reverse(Vector=X_3)
merge_4 = Merge(Data1=X_3, Data2=rev_2)

# ---- group: shortlist by data intervals
tstat = TreeStatistics(Tree=split_3.ListB)  # -> Paths, Length, expr("x-1", Count)

# ----
multiplication_5 = Multiplication(A=data_type_selector, B=tstat.Count)
int_3 = Integer(multiplication_5)

# ---- group: shortlist by data intervals / selection rectangle (continued)
item_6 = ListItem(List=flatten(crv), Index=int_3, Wrap=True)
eval_2 = EvaluateCurve(Curve=item_6, Parameter=merge)  # -> Point, Tangent, Angle
move_3 = Move(Geometry=eval_2.Point, Motion=merge_2)  # -> Geometry, Transform
item_7 = ListItem(List=move_3.Geometry, Index=0, Wrap=True)  # -> Item, Item1
rec_2pt = Rectangle2Pt(Plane=PlaneXY(0, 0, 0), PointA=item_7.Item, PointB=item_7.Item1, Radius=0)  # -> Rectangle, Length

# ---- group: shortlist by data intervals
tstat_2 = TreeStatistics(Tree=split_3.ListB)  # -> Paths, Length, expr("x-1", Count)

# ----
multiplication_6 = Multiplication(A=data_type_selector_2, B=tstat_2.Count)
int_4 = Integer(multiplication_6)

# ---- group: shortlist by data intervals / selection rectangle (continued)
item_8 = ListItem(List=flatten(crv), Index=int_4, Wrap=True)
eval_3 = EvaluateCurve(Curve=item_8, Parameter=merge_3)  # -> Point, Tangent, Angle
move_4 = Move(Geometry=eval_3.Point, Motion=merge_4)  # -> Geometry, Transform
item_9 = ListItem(List=move_4.Geometry, Index=0, Wrap=True)  # -> Item, Item1
rec_2pt_2 = Rectangle2Pt(Plane=PlaneXY(0, 0, 0), PointA=item_9.Item, PointB=item_9.Item1, Radius=0)  # -> Rectangle, Length

# ----
merge_5 = Merge(Data1=rec_2pt_2.Rectangle, Data2=rec_2pt.Rectangle)

# ---- group: shortlist by data intervals (continued)
item_10 = ListItem(List=tstat.Paths, Index=int_3, Wrap=True)
item_11 = ListItem(List=flatten(split_3.ListA), Index=int_3, Wrap=True)
branch = TreeBranch(Tree=split_3.ListB, Path=item_10, MaintainPaths=True)
bnd_2 = Bounds(Numbers=branch)
data_range = Panel(bnd_2)
data_label = Panel(item_11)

# ---- group: shortlist by data intervals / evaluate domain
c_script = CSharpScript(I=bnd_2, t=min)  # -> V; inputs t: Double
# ---------- c_script: C# ----------
    V = I.ParameterAt(t);
# ---------- end c_script ----------
c_script_2 = CSharpScript(I=bnd_2, t=max)  # -> V; inputs t: Double; same code as c_script

# ---- group: shortlist by data intervals (continued)
dom = ConstructDomain(DomainStart=c_script, DomainEnd=c_script_2)
restricted_values = Panel(dom)
inc = Includes(Value=branch, Domain=dom)  # -> Includes, Deviation

item_12 = ListItem(List=tstat_2.Paths, Index=int_4, Wrap=True)
item_13 = ListItem(List=flatten(split_3.ListA), Index=int_4, Wrap=True)
branch_2 = TreeBranch(Tree=split_3.ListB, Path=item_12, MaintainPaths=True)
bnd_3 = Bounds(Numbers=branch_2)
data_range_2 = Panel(bnd_3)
data_label_2 = Panel(item_13)

# ---- group: shortlist by data intervals / evaluate domain
c_script_3 = CSharpScript(I=bnd_3, t=min_2)  # -> V; inputs t: Double; same code as c_script
c_script_4 = CSharpScript(I=bnd_3, t=max_2)  # -> V; inputs t: Double; same code as c_script

# ---- group: shortlist by data intervals (continued)
dom_2 = ConstructDomain(DomainStart=c_script_3, DomainEnd=c_script_4)
restricted_values_2 = Panel(dom_2)
inc_2 = Includes(Value=branch_2, Domain=dom_2)  # -> Includes, Deviation

# ----
and = GateAnd(A=inc_2.Includes, B=inc.Includes)
weave = Weave(Pattern=graft(and), Stream0=ColourSwatch(SwatchColor=RGB(181, 181, 181)), Stream1=swatch_2, NullGaps=False)  # -> flatten(Weave)
cull = CullPattern(List=gradient, CullPattern=and)

cull_2 = CullPattern(List=pline, CullPattern=and)
display_2 = BooleanToggle(True)
filter_2 = StreamFilter(Gate=display_2, Stream1=cull_2)
previewlw_4 = CustomPreviewLineweights(
    Geometry=filter_2,
    Shader={diffuse=RGB(255, 105, 180), emission=RGB(76, 32, 54), shine=0.5, specular=RGB(255, 255, 255), transparency=0},
    Absolute=False)  # disabled

filter_3 = StreamFilter(Gate=display_2, Stream0=swatch_2, Stream1=weave)

# ---- group: data text
data_text_size = Slider(0.1, range=0..1)
tag_3 = TextTag3D(Location=eval.Point, Text=split_3.ListB, Size=data_text_size, Colour=filter_3, Justification=8)

# ----
line_with_transparency = LineWithTransparency(polyline=filter_2, thickness=thickness_2, color=cull, transparency=Slider(0.6, range=0..1))  # -> mesh, material_2
filter_4 = StreamFilter(Gate=display_2, Stream0=Slider(0.7, range=0..1), Stream1=Slider(0.93, range=0..1))
filter_5 = StreamFilter(Gate=display_2, Stream1=merge_5)
line_with_transparency_2 = LineWithTransparency(polyline=pline, thickness=thickness_3, color=gradient, transparency=filter_4)  # -> mesh, material_2
preview = CustomPreview(Geometry=line_with_transparency.mesh, Material=graft(line_with_transparency.material_2))
previewlw_5 = CustomPreviewLineweights(Geometry=filter_5, Shader=ColourSwatch(SwatchColor=RGB(255, 0, 0)), Thickness="3", Absolute=False)
preview_2 = CustomPreview(Geometry=line_with_transparency_2.mesh, Material=graft(line_with_transparency_2.material_2))

# ==== cluster LineWithTransparency
thickness = ClusterInput()
polyline = ClusterInput()
color = ClusterInput()
transparency = ClusterInput()
explode = Explode(Curve=simplify(polyline), Recursive=True)  # -> Segments, Vertices
multiplication = Multiplication(A=thickness, B=".5")
neg = Negative(Value=multiplication)
offset = OffsetCurve(Curve=graft(explode.Segments), Distance=[multiplication, neg], Corners=1)
pshift = ShiftPaths(Data=offset, Offset=-1)
item = ListItem(List=pshift, Index=0, Wrap=True)  # -> Item, Item1
flip = FlipCurve(Curve=item.Item1)  # -> Curve, Flag
merge = Merge(Data1=item.Item, Data2=flip.Curve)
end = EndPoints(Curve=merge)  # -> Start, End
merge_2 = Merge(Data1=end.Start, Data2=end.End)
conmesh = ConstructMesh(Vertices=merge_2, Faces="Q{0;2;1;3}")
material = CreateMaterial(Diffuse=color, Specular=RGB(255, 255, 255), Emission=RGB(0, 0, 0), Transparency=transparency, Shine=0)
pshift_2 = ShiftPaths(Data=conmesh, Offset=-1)
material_2 = ClusterOutput(material)
mesh = ClusterOutput(pshift_2)
