# Grasshopper definition save data to csv.gh (Grasshopper 1.0.7)
# Copyright: Co-de-iT
# plug-ins: froGH

# You can create your data files directly in Excel, using one of the .csv files provided as an example for row/column formatting
panel = Panel("data sets\")
f_ghfilepath = GHFilePathInfo()  # -> FileName, FilePath
concat = Concatenate(FragmentA=f_ghfilepath.FilePath, FragmentB=panel)

# ---- group: Save data to .csv file / labeled data
# Data Analysis - Save data to .csv
# 
# <description>
# 
# code by Alessio Erioli
# 
# v 0.1
# © Co-de-iT 2020 / Creative Commons Attribution-Non Commercial-ShareAlike 4.0 International License
data = Data(Tree({0;0;0}: ["Test ID", "Area", "Volume", "Impronta", "Direzionalità", "Estensione", "Floor factor"], {0;0;1}: ["a", "4.055608", "1.555018", "11.629065", "13.236573", "3.196002", "8.130249"], {0;0;2}: ["b", "1.064472", "8.595034", "6.501537", "12.795067", "3.725349", "9.590332"], {0;0;3}: ["c", "8.006945", "6.018649", "10.18089", "9.904479", "2.457585", "5.875481"], {0;0;4}: ["d", "8.282333", "12.011501", "7.619557", "12.521952", "3.539057", "7.938159"], {0;0;5}: ["e", "13.49223", "11.092915", "2.155688", "3.825754", "2.387194", "9.959959"]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))

# ----
panel_2 = Panel(data)

# ---- group: Save data to .csv file
save = Button()
file_name = Panel("data set C.csv")

join = TextJoin(Text=data, Join=",")  # -> flatten(Result)
f_str2file = SaveStringToFile(String=join, FilePath=concat, FileName=file_name, SaveTrigger=save)

# ----
panel_3 = Panel(join)
