# Grasshopper definition Autoplan.gh (Grasshopper 1.0.7)
# Copyright: Co-de-iT
# plug-ins: froGH, Human

# Controls
# 1
# inputs
# parameters
# semi-fixed
# parameters
# change these only in case of problems
plugins_needed = Panel(""". froGH
. Human""")

# ---- group: small assemblage (171 meshes)
# 2
# Samples
# Switch on the layers incrementally to see the correct plan for each sample:
# 
# small assemblage: only layer "small" is on
# 
# intermediate assemblage: layers "small" and "intermediate" are on
# 
# whole assemblage: layers "small", "intermediate" and "whole" are on
mesh = Mesh([<mesh referenced from the Rhino model> x176])

# ---- group: intermediate assemblage (675 meshes)
mesh_2 = Mesh([<mesh referenced from the Rhino model> x675])

# ---- group: whole assemblage (2001 meshes)
mesh_3 = Mesh([<mesh referenced from the Rhino model> x2001])

# ----
# 3
# This subdir must already exist
# - Set to Manual to browse plans with the slider above
# 
# - set to Export before starting the Export Toggle below
manual_browse_floors = Slider(0, range=0..1)
subdir = Panel("plans 2")
list = ValueList({"Manual": 0, "Export": 1}, selected="Manual")
export = BooleanToggle(False)

north_direction_degrees_0_is_y = Slider(0, range=-180..180)
text_size = Slider(2, range=1..5)
scale_ruler_values = Panel("""5
10
20
50""")
text_color = ColourSwatch(SwatchColor=RGB(0, 0, 0))

clustering_distance_m = Slider(1.5, range=0.1..10)
edge_length_threshold = Slider(1.2, range=0..2)
area_threshold = Slider(4, range=0..50)

# ----
# multiplier for viewport resolution
viewport_resolution_scale = Slider(1, range=0.5..3)
view_name_to_save_animation_from = Panel("Top")

# ----
# depth (in -Z direction); increase value to include more levels below the sectioned one
plan_z_depth = Slider(10, range=0.1..10)

start_point_index = Slider(0, range=0..100)

# ----
# Set these to move the clipping planes out of the View
cplanes_x_position = Slider(0, range=-100..100)
cplanes_y_position = Slider(0, range=-100..100)

section_height_from_average_plane = Panel("1.5")

# ----
# keep it > 0 to avoid false positives
# intercept width should be small enought to avoid wall clash
# intercept height should be related to the height necessary for a person to walk through a space
start_point_offset = Panel("0.01")
intercept_width = Panel("0.05")
intercept_height = Panel("2")
z_angle_tolerance = Panel("0.01")

# ----
# delay in milliseconds - increase only if there are missing exported images
delay = Panel("100")

# ----
# Assembler
# 
# Framework for Iterative Assemblages workflow
# 
# code by Alessio Erioli
# 
# v 1.0
# © Co-de-iT 2021 / Creative Commons Attribution-Non Commercial-ShareAlike 4.0 International License
# . make 2 Clipping Planes in Rhino
# 
# . ensure they are active in the View you want to export
# 
# . import them here (right-click > Set Multiple Guids)
# 
# Any clipping plane will do, the orientation will be decided here in the definition.
id = Guid([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])

# ---- group: input meshes here
# reference the meshes in the assemblage (or the part you want to analyze) here
mesh_4 = Mesh(mesh)

# ----
# Filtering
mjoin = MeshJoin(Meshes=mesh_4)

# ---- group: generate mesh clusters
# This component may take several seconds to compute, depending on the total amount of faces in your geometries
cluster = Cluster(
    single_joined_mesh=mjoin,
    z_angle_tolerance=z_angle_tolerance,
    height_clash_start_point_offset=start_point_offset,
    intercept_width=intercept_width,
    intercept_height=intercept_height,
    edges_length_threshold=edge_length_threshold,
    area_threshold=area_threshold,
    clustering_distance=clustering_distance_m,
    clustering_start_point_index=start_point_index)

# ----
# generate section plane position
bbox = BoundingBox(Content=cluster, Plane=PlaneXY(0, 0, 0))  # -> Box, Box_2
# automate controls
panel = Panel("0.5")
box = EvaluateBox(Box=bbox.Box, UParameter=panel, VParameter=panel, WParameter=panel)  # -> Plane, Point, Include
deplane = DeconstructPlane(Plane=box.Plane)  # -> Origin, XAxis, YAxis, ZAxis
multiplication = Multiplication(A=deplane.ZAxis, B=section_height_from_average_plane)
move = Move(Geometry=box.Plane, Motion=multiplication)  # -> Geometry, Transform
lng = ListLength(List=move.Geometry)  # -> expr("x-1", Length)
multiplication_2 = Multiplication(A=manual_browse_floors, B=lng)

lng_2 = ListLength(List=cluster)

# ---- group: counter
# this component outputs a progressive index with a specified time delay, from 0 to the total
c_script = CSharpScript(go=export, delay=delay, tot=lng_2)  # -> out, C; inputs go: Boolean, delay: Int32, tot: Int32
# ---------- c_script: C# ----------
    if (!go)
    {
      count = 0;
      first = true;
    }
    else
    {
      if (count < tot - 1)
      {
        if (count == 0 && first)
        {
          Component.ExpireSolution(true);
          first = false;
        }
        else
        {
          count++;
          System.Threading.Thread.Sleep(delay);
          Component.ExpireSolution(true);
        }
      }
    }

    C = count;
# ---------- c_script: C# additional code ----------
  int count;
  bool first;
# ---------- end c_script ----------

# ----
equals = Equality(FirstNumber=expr("x-1", lng_2), SecondNumber=c_script.C)  # -> Equality, Inequality
f_tas = ToggleAutostop(Toggle=export, Condition=equals.Equality)

filter = StreamFilter(Gate=list, Stream0=multiplication_2, Stream1=c_script.C)
int = Integer(filter)

item = ListItem(List=move.Geometry, Index=int, Wrap=True)
pdecon = Deconstruct(Point=item)  # -> XComponent, YComponent, ZComponent

# ----
# generate plan label
bbox_2 = BoundingBox(Content=mjoin, Plane=PlaneXY(0, 0, 0), UnionBox=True)  # -> Box, Box_2
box_2 = EvaluateBox(Box=bbox_2.Box, UParameter="0", VParameter="0", WParameter="0.5")  # -> Plane, Point, Include
lng_3 = ListLength(List=move.Geometry)
expression = Expression(z=pdecon.ZComponent, c=int, t=lng_3, Expression="Format(\"plan h {0:0.00}m - {1}/{2}\", z, c+1, t)")
pdecon_2 = Deconstruct(Point=box_2.Plane)  # -> XComponent, YComponent, ZComponent
multiplication_3 = Multiplication(A=text_size)
subtraction = Subtraction(A=pdecon_2.YComponent, B=multiplication_3)
pt = ConstructPoint(XCoordinate=pdecon_2.XComponent, YCoordinate=subtraction, ZCoordinate=pdecon.ZComponent)
pl_origin = PlaneOrigin(Base=box_2.Plane, Origin=pt)
tag = TextTag3D(Location=pl_origin, Text=expression, Size=text_size, Colour=text_color, Justification=1)

# ---- group: convert label into file name
# generate file name
f_ghfilepath = GHFilePathInfo()  # -> FileName, FilePath
concat = Concatenate(FragmentA=f_ghfilepath.FilePath, FragmentB=subdir)
rep = ReplaceText(Text=expression, Find=".", Replace="_", RecursiveReplace=False)
rep_2 = ReplaceText(Text=rep, Find="/", Replace="-", RecursiveReplace=False)
concat_2 = Concatenate(FragmentA=rep_2, FragmentB=".png")

# ----
saved_file_name = Panel(concat_2)

# ----
# scale ruler
multiplication_4 = Multiplication(A=text_size, B="3")
neg = Negative(Value=multiplication_4)
Y = UnitY(Factor=neg)
move_2 = Move(Geometry=pl_origin, Motion=Y)  # -> Geometry, Transform
multiplication_5 = Multiplication(A=text_size, B="1")
txt = Text(scale_ruler_values)
line = LineSDL(Start=move_2.Geometry, Direction=Y, Length=multiplication_5)
X = UnitX(Factor=txt)
move_3 = Move(Geometry=line, Motion=X)  # -> Geometry, Transform
merge = Merge(Data1=line, Data2=move_3.Geometry)
lng_4 = ListLength(List=txt)
multiplication_6 = Multiplication(A=text_size, B="0.5")
end = EndPoints(Curve=merge)  # -> Start, End
neg_2 = Negative(Value=multiplication_6)
f_dshift = DoubleShift(List=merge, Wrap=False)  # -> ForwardShift, BackwardShift
Y_2 = UnitY(Factor=neg_2)
end_2 = EndPoints(Curve=f_dshift.ForwardShift)  # -> Start, End
end_3 = EndPoints(Curve=f_dshift.BackwardShift)  # -> Start, End
panel_2 = Panel("""0
1""")
move_4 = Move(Geometry=end.End, Motion=Y_2)  # -> Geometry, Transform
ln = Line(StartPoint=end_2.Start, EndPoint=end_3.Start)
ln_2 = Line(StartPoint=end_2.End, EndPoint=end_3.End)
repeat = RepeatData(Data=panel_2, Length=lng_4)
multiplication_7 = Multiplication(A=text_size, B="0.8")
p_n_c = PickNChoose(Pattern=repeat, Stream0=ln, Stream1=ln_2)
merge_2 = Merge(Data1="0", Data2=txt)
previewlw = CustomPreviewLineweights(Geometry=p_n_c, Shader=text_color, Absolute=False)
previewlw_2 = CustomPreviewLineweights(Geometry=merge, Shader=text_color, Absolute=False)
tag_2 = TextTag3D(Location=move_4.Geometry, Text=merge_2, Size=multiplication_7, Colour=text_color, Justification=2)

# ---- group: planes for Clipping planes
# position clipping planes
pt_2 = ConstructPoint(XCoordinate=cplanes_x_position, YCoordinate=cplanes_y_position, ZCoordinate=pdecon.ZComponent)
neg_3 = Negative(Value=plan_z_depth)
pl_origin_2 = PlaneOrigin(Base=item, Origin=pt_2)
Z = UnitZ(Factor=neg_3)
move_5 = Move(Geometry=pl_origin_2, Motion=Z)  # -> Geometry, Transform
pflip = FlipPlane(Plane=pl_origin_2, ReverseX=False, ReverseY=False, SwapAxes=True)
merge_3 = Merge(Data1=pflip, Data2=move_5.Geometry)

# ----
f_vc2f = ViewCaptureToFile(
    FilePath=concat,
    FileName=concat_2,
    ViewportName=view_name_to_save_animation_from,
    Scale=viewport_resolution_scale,
    Grid=False,
    Axes=False,
    Widget=False,
    Capture=export)

# ---- group: clipping plane control
panel_3 = Panel("don't worry if it's orange")
c_script_2 = CSharpScript(id=id, P=merge_3)  # inputs id: Guid, P: Plane
# ---------- c_script_2: C# usings ----------
using System.IO;
using System.Linq;
using System.Data;
using System.Drawing;
using System.Reflection;
using System.Windows.Forms;
using System.Xml;
using System.Xml.Linq;
using System.Runtime.InteropServices;

using Rhino.DocObjects;
using Rhino.Collections;
using GH_IO;
using GH_IO.Serialization;
# ---------- c_script_2: C# ----------
    if (id == null) return;
    Rhino.DocObjects.ObjRef obj = new Rhino.DocObjects.ObjRef(id);
    //Rhino.DocObjects.ObjRef obj = new Rhino.DocObjects.ObjRef(doc, id);
    Rhino.DocObjects.ClippingPlaneObject cpObj = obj.Object() as Rhino.DocObjects.ClippingPlaneObject;
    cpObj.ClippingPlaneGeometry.Plane = P;
    cpObj.CommitChanges();
# ---------- end c_script_2 ----------

# ----
# N direction
panel_4 = Panel("-4.25")
multiplication_8 = Multiplication(A=text_size, B=panel_4, C="2")
num = Number(north_direction_degrees_0_is_y)
multiplication_9 = Multiplication(A=text_size, B="2")
Y_3 = UnitY(Factor=multiplication_8)
X_2 = UnitX(Factor=multiplication_9)
Y_4 = UnitY(Factor=1)
Z_2 = UnitZ(Factor=1)
addition = Addition(A=Y_3, B=X_2)
vrot = Rotate(Vector=Y_4, Axis=Z_2, Angle=degrees(num))
move_6 = Move(Geometry=pl_origin, Motion=addition)  # -> Geometry, Transform
line_2 = LineSDL(Start=move_6.Geometry, Direction=vrot, Length=multiplication_9)
cir = Circle(Plane=move_6.Geometry, Radius=multiplication_9)
previewlw_3 = CustomPreviewLineweights(Geometry=line_2, Shader=text_color, Thickness="3", Absolute=False)
previewlw_4 = CustomPreviewLineweights(Geometry=cir, Shader=text_color, Absolute=False)

# ==== cluster Cluster
intercept_width = ClusterInput()
single_joined_mesh = ClusterInput()
z_angle_tolerance = ClusterInput()
intercept_height = ClusterInput()
edges_length_threshold = ClusterInput()
clustering_start_point_index = ClusterInput()
area_threshold = ClusterInput()
clustering_distance = ClusterInput()
height_clash_start_point_offset = ClusterInput()

# ----
# remove faces with normals NOT pointing in the direction of the global Z
# (with a tolerance)
mesh = Mesh(single_joined_mesh)
tri = Triangulate(Mesh=mesh)  # -> Mesh, Count
c_script = CSharpScript(M=tri.Mesh)  # -> Mf; inputs M: Mesh
# ---------- c_script: C# ----------
    Mf = ExplodeMesh(M);
# ---------- c_script: C# additional code ----------
  List<Mesh> ExplodeMesh(Mesh M)
  {
    List<Mesh> meshes = new List<Mesh>();

    Mesh single;
    int a, b, c, d;
    bool color = M.VertexColors.Count > 0;
    for(int i = 0; i < M.Faces.Count; i++)
    {
      a = M.Faces[i].A;
      b = M.Faces[i].B;
      c = M.Faces[i].C;
      d = M.Faces[i].D;

      single = new Mesh();

      single.Vertices.Add(M.Vertices[a]);
      single.Vertices.Add(M.Vertices[b]);
      single.Vertices.Add(M.Vertices[c]);
      if (color)
      {
        single.VertexColors.Add(M.VertexColors[a]);
        single.VertexColors.Add(M.VertexColors[b]);
        single.VertexColors.Add(M.VertexColors[c]);
      }
      if(c != d)
      {
        single.Vertices.Add(M.Vertices[d]);
        if (color) single.VertexColors.Add(M.VertexColors[d]);
        single.Faces.AddFace(0, 1, 2, 3);
      }else
        single.Faces.AddFace(0, 1, 2);

      single.RebuildNormals();
      meshes.Add(single);
    }

    return meshes;
  }
# ---------- end c_script ----------
facen = FaceNormals(Mesh=c_script)  # -> Centers, flatten(Normals)
Z = UnitZ(Factor=1)
angle = Angle(VectorA=facen.Normals, VectorB=Z)  # -> Angle, Reflex
smaller = SmallerThan(FirstNumber=angle.Angle, SecondNumber=z_angle_tolerance)  # -> SmallerThan, OrEqualTo
cull = CullPattern(List=c_script, CullPattern=smaller.SmallerThan)

# ----
# exclude faces with obstacles along the normal
# intercept distance should be related to the height necessary for a person to walk through a space
num = Number(intercept_height)
num_2 = Number(height_clash_start_point_offset)
mesh_2 = Mesh(single_joined_mesh)
facen_2 = FaceNormals(Mesh=cull)  # -> Centers, Normals
Z_2 = UnitZ(Factor=num_2)
move = Move(Geometry=facen_2.Centers, Motion=Z_2)  # -> Geometry, Transform
line = LineSDL(Start=move.Geometry, Direction=facen_2.Normals, Length=num)  # -> flatten(Line)
mcx = MeshCurve(Mesh=mesh_2, Curve=line)  # -> Points, Faces
lng = ListLength(List=mcx.Points)
equals = Equality(FirstNumber=lng, SecondNumber="0")  # -> flatten(Equality), flatten(Inequality)
cull_2 = CullPattern(List=cull, CullPattern=equals.Equality)

f_cdom = CenteredDomain(DomainLength=intercept_width)  # disabled
box = DomainBox(Base=PlaneXY(0, 0, 0), X=f_cdom, Y=f_cdom, Z=num)  # disabled
mbox = MeshBox(Base=box, XCount="1", YCount="1", ZCount="1")  # disabled
move_2 = Move(Geometry=mbox, Motion=move.Geometry)  # -> flatten(Geometry), Transform; disabled
mmx = MeshMesh(MeshA=mesh_2, MeshB=move_2.Geometry)  # disabled

# ----
# remove faces with small edges (most probably walls, slab thicknesses or pillars)
# flag faces (True = potentially remove)
mjoin = MeshJoin(Meshes=cull_2)
num_3 = Number(edges_length_threshold)

panel = Panel("small bottleneck")
alignvert = AlignVertices(Mesh=mjoin, Tolerance=0.01)  # -> Result, Count

weld = WeldMesh(Mesh=alignvert.Result, Angle=3.141592654)
f_mc_fpm = MeshConnectivityFaceProximityMap(Mesh=weld)  # -> ConnectedVertices, ConnectedEdges, ConnectedFaces
f_medges = ExtractMeshEdges(Mesh=weld)  # -> Edges, WeldStatus, EdgeStatus
len = Length(Curve=f_medges.Edges)
item = ListItem(List=len, Index=f_mc_fpm.ConnectedEdges, Wrap=True)
item_2 = ListItem(List=f_medges.EdgeStatus, Index=f_mc_fpm.ConnectedEdges, Wrap=True)
sort = SortList(Keys=item, ValuesA=item_2)  # -> Keys, ValuesA
item_3 = ListItem(List=sort.Keys, Index=0, Wrap=True)
smaller_2 = SmallerThan(FirstNumber=item_3, SecondNumber=num_3)  # -> flatten(SmallerThan), OrEqualTo
item_4 = ListItem(List=sort.Keys, Index=0, Wrap=True)

# ---- group: is one of the longest 2 edges naked?
panel_2 = Panel("""-1
-2""")
item_5 = ListItem(List=sort.ValuesA, Index=panel_2, Wrap=True)
not = GateNot(A=item_5)
f_massbool = MassBoolean(Values=not, BooleanOperator="OR", Boolean_Operator="OR")  # -> flatten(Result)

# ---- group: long/short edge length > threshold
# Check for aspect ratio
item_6 = ListItem(List=sort.Keys, Index=0, Wrap=True)  # -> Item1, Item
division = Division(A=item_6.Item1, B=item_6.Item)
larger = LargerThan(FirstNumber=division, SecondNumber="2")  # -> flatten(LargerThan), OrEqualTo

# ----
and = GateAnd(A=smaller_2.SmallerThan, B=f_massbool, C=larger.LargerThan)

# ---- group: flagged faces
bool = Boolean(and)

# ----
# If at least one flagged faces neighbour is flagged remove face
item_7 = ListItem(List=bool, Index=f_mc_fpm.ConnectedFaces, Wrap=True)
f_massbool_2 = MassBoolean(Values=item_7, BooleanOperator="OR", Boolean_Operator="OR")

# ---- group: connected edges to flagged faces & lengths
# Connected edges to flagged faces & their length
panel_3 = Panel("1")
equals_2 = Equality(FirstNumber=item_2, SecondNumber=panel_3)  # -> Equality, Inequality

# ----
and_2 = GateAnd(A=equals_2.Equality, B=item_7)

# ---- group: connected edges to flagged faces & lengths (continued)
cull_3 = CullPattern(List=item, CullPattern=and_2)

# ----
# Checks if one of the connected edges to flagged faces is longer than the smallest edge
larger_2 = LargerThan(FirstNumber=cull_3, SecondNumber=item_4)  # -> LargerThan, OrEqualTo
f_massbool_3 = MassBoolean(Values=larger_2.LargerThan, BooleanOperator="OR", Boolean_Operator="OR")

and_3 = GateAnd(A=f_massbool_2, B=f_massbool_3)
and_4 = GateAnd(A=and, B=flatten(and_3))
cullf = CullFaces(Mesh=weld, Pattern=and_4)

panel_4 = Panel("disjoint separate chunks")
disjoint = DisjointMesh(Mesh=cullf)

# ----
# filter meshes below a certain area threshold (cull small pieces)
num_4 = Number(area_threshold)
area = Area(Geometry=disjoint)  # -> Area, Centroid
larger_3 = LargerThan(FirstNumber=area.Area, SecondNumber=num_4)  # -> LargerThan, OrEqualTo
cull_4 = CullPattern(List=disjoint, CullPattern=larger_3.LargerThan)

# ----
# sort mesh chunks by Z (for clarity)
area_2 = Area(Geometry=cull_4)  # -> Area, Centroid
pdecon = Deconstruct(Point=area_2.Centroid)  # -> XComponent, YComponent, ZComponent
sort_2 = SortList(Keys=pdecon.ZComponent, ValuesA=cull_4)  # -> Keys, flatten(ValuesA)

# ----
# group meshes by floor height (approximated to the grouping distance)
group_by_distance = GroupByDistance(mesh=sort_2.ValuesA, num=clustering_distance, start_point_index=clustering_start_point_index)

mesh_3 = Mesh(group_by_distance)
mesh_clusters = ClusterOutput(mesh_3)

# ==== cluster GroupByDistance
mesh = ClusterInput()
num = ClusterInput()
start_point_index = ClusterInput()
num_2 = Number(num)

mesh_2 = Mesh(mesh)
area = Area(Geometry=mesh_2)  # -> Area, Centroid
pdecon = Deconstruct(Point=area.Centroid)  # -> XComponent, YComponent, ZComponent

# ---- group: OLD method / "normalize" heights (start from 0)
bnd = Bounds(Numbers=pdecon.ZComponent)  # disabled
dedomain = DeconstructDomain(Domain=bnd)  # -> Start, End; disabled
subtraction = Subtraction(A=pdecon.ZComponent, B=dedomain.Start)  # disabled

# ----
f_ifroml = IndexesFromList(Data=pdecon.ZComponent)
# group meshes by floor height (approximated to the grouping distance)
pt = ConstructPoint(XCoordinate=0, YCoordinate=0, ZCoordinate=pdecon.ZComponent)
sort = SortList(Keys=pdecon.ZComponent, ValuesA=f_ifroml)  # -> Keys, ValuesA
item = ListItem(List=sort.ValuesA, Index=start_point_index, Wrap=True)
f_ptscbd = ClusterizePointsByDistance(Points=pt, Index=item, ClusterizationDistance=num_2)  # -> ClusteredPoints, ClusteredIndices

# ---- group: OLD method
division = Division(A=subtraction, B=num_2)  # disabled
round = Round(Number=division)  # -> Nearest, Floor, Ceiling; disabled
cset = CreateSet(List=round.Nearest)  # -> Set, Map; disabled
f_ifroml_2 = IndexesFromList(Data=cset.Set)  # disabled
mindex = MemberIndex(Set=cset.Map, Member=f_ifroml_2)  # -> Index, Count; disabled

# ----
item_2 = ListItem(List=mesh_2, Index=f_ptscbd.ClusteredIndices, Wrap=True)
mjoin = MeshJoin(Meshes=item_2)  # -> flatten(Mesh)

mesh_3 = Mesh(mjoin)
mesh_4 = ClusterOutput(mesh_3)
