# Grasshopper definition Extract horizontal faces.gh (Grasshopper 1.0.7)
# Copyright: Co-de-iT
# plug-ins: froGH, Human

# inputs
# parameters
# change these only in case of problems
plugins_needed = Panel(""". froGH
. Human""")

# ---- group: small assemblage (171 meshes)
# Assembler
# 
# Framework for Iterative Assemblages workflow
# 
# code by Alessio Erioli
# 
# v 1.0
# © Co-de-iT 2021 / Creative Commons Attribution-Non Commercial-ShareAlike 4.0 International License
# Samples
mesh = Mesh([<mesh referenced from the Rhino model> x176])

# ---- group: intermediate assemblage (675 meshes)
# semi-fixed
# parameters
mesh_2 = Mesh([<mesh referenced from the Rhino model> x675])

# ---- group: entire assemblage (2001 meshes)
mesh_3 = Mesh([<mesh referenced from the Rhino model> x2001])

# ----
_3d_model_position_along_x = Slider(-10, range=-100..0)
dimension_text_size = Slider(0.8, range=0..1)
dimension_offset = Slider(-10, range=-100..0)

clustering_distance_m = Slider(1.5, range=0.1..10)
edge_length_threshold = Slider(1.2, range=0..2)
area_threshold = Slider(4, range=0..50)

start_point_index = Slider(0, range=0..100)

grid_expansion = Slider(1.219, range=1..2)
grid_text_size = Slider(2.3, range=1..10)
n_of_rows = Slider(5, range=2..20)

# ----
# super accuracy detects and culls horizontal faces for which the intercept height is fully inside another mesh.
# 
# WARNING: the process is EXTREMELY SLOW (especially for a large amount of Mesh faces).
# 
# This feature is RARELY necessary
# super accuracy computing times: small: 5 sec
# 
# intermediate: 56 sec
# 
# large: 11.3 min
# 
# Computing times on Intel i7 - 32Gb RAM
super_accuracy = BooleanToggle(False)

mesh_edges_color = ColourSwatch(SwatchColor=RGB(0, 0, 0))
dimension_color = ColourSwatch(SwatchColor=RGB(0, 0, 0))
highlight_color = ColourSwatch(SwatchColor=RGB(255, 0, 0))
text_color = ColourSwatch(SwatchColor=RGB(0, 0, 0))

# ----
# keep it > 0 to avoid false positives
# intercept width should be small enought to avoid wall clash
# intercept height should be related to the height necessary for a person to walk through a space
start_point_offset = Panel("0.01")
intercept_width = Panel("0.05")
intercept_height = Panel("2")
z_angle_tolerance = Panel("0.01")

# ---- group: input meshes here
# Controls
# reference the meshes in the assemblage (or the part you want to analyze) here
mesh_4 = Mesh(mesh)

# ----
item_selector = Slider(0.152, range=0..1)
coloring_value = ValueList({"Z height": 0, "area": 1, "diagonal": 2, "area/diagonal": 3}, selected="area")
# Align levels aligns clusters in conformity to the 3D model. If False, clusters are centered in their grid cells.
# 
# Align levels is ignored if Display is set to single meshes
sorting_value = ValueList({"Z height": 0, "area": 1, "diagonal": 2, "area/diagonal": 3}, selected="Z height")
gradient_type = ValueList({"Hue": 0, "Rainbow": 1, "Random": 2, "Heat": 3}, selected="Heat")
# edge length threshold - edges below this length are considered potential structural depths
# 
# area threshold - faces with area lower than this are culled
# 
# clustering distance - distance to consider faces as part of the same level - 1.5 means that faces that are as far a 3m in Z can be part of the same level
# 
# Start point index - index of point to start clustering - change only in case of non-satisfactory clustering
display = ValueList({"single meshes": 0, "level clusters": 1}, selected="level clusters")
order = ValueList({"Ascending": 0, "Descending": 1}, selected="Ascending")
align_levels = BooleanToggle(True)

# ----
# Filtering
mjoin = MeshJoin(Meshes=mesh_4)

# ---- group: generate mesh clusters
# This component may take several seconds to compute, depending on the total amount of faces in your geometries
cluster = Cluster(
    single_joined_mesh=mjoin,
    z_angle_tolerance=z_angle_tolerance,
    height_clash_start_point_offset=start_point_offset,
    intercept_width=intercept_width,
    intercept_height=intercept_height,
    super_accuracy=super_accuracy,
    edges_length_threshold=edge_length_threshold,
    area_threshold=area_threshold,
    clustering_distance=clustering_distance_m,
    clustering_start_point_index=start_point_index)  # -> single_meshes, mesh_clusters

# ----
filter = StreamFilter(Gate=display, Stream0=cluster.single_meshes, Stream1=cluster.mesh_clusters)

# ----
# compute values for sorting criteria
area = Area(Geometry=filter)  # -> Area, Centroid
bbox = BoundingBox(Content=filter, Plane=PlaneXY(0, 0, 0))  # -> Box, Box_2
boxprop = BoxProperties(Box=bbox.Box)  # -> Center, Diagonal, Area, Volume, Degeneracy
pdecon = Deconstruct(Point=boxprop.Center)  # -> XComponent, YComponent, ZComponent
vlen = VectorLength(Vector=boxprop.Diagonal)
division = Division(A=area.Area, B=vlen)

# ----
# Sorting & Coloring
panel = Panel("select sorting criteria")
filter_2 = StreamFilter(Gate=sorting_value, Stream0=pdecon.ZComponent, Stream1=area.Area, Stream2=vlen, Stream3=division)

# ----
# Align & Display 2D
f_ifroml = IndexesFromList(Data=area.Area)

panel_2 = Panel("generate value-based colors")
filter_3 = StreamFilter(Gate=coloring_value, Stream0=pdecon.ZComponent, Stream1=area.Area, Stream2=vlen, Stream3=division)

# ---- group: find bounds
bnd = Bounds(Numbers=flatten(filter_3))

# ----
remap = RemapNumbers(Value=filter_3, Source=bnd, Target=Domain(0, 1))  # -> Mapped, Clipped

# ---- group: Hue
gradient = Gradient(
    LowerLimit=0,
    UpperLimit=1,
    Parameter=remap.Mapped,
    stops=[0: RGB(21, 0, 33), 0.326: RGB(150, 66, 114), 0.664: RGB(224, 186, 187), 1: RGB(255, 255, 255)])

# ---- group: Rainbow
gradient_2 = Gradient(
    LowerLimit=0,
    UpperLimit=1,
    Parameter=remap.Mapped,
    stops=[0: RGB(243, 57, 0), 0.1: RGB(236, 27, 60), 0.2: RGB(210, 0, 118), 0.3: RGB(103, 0, 120), 0.4: RGB(39, 72, 161), 0.5: RGB(1, 192, 229), 0.6: RGB(18, 178, 90), 0.7: RGB(79, 186, 8), 0.8: RGB(220, 237, 32), 0.9: RGB(247, 159, 20), 1: RGB(243, 57, 0)])

# ---- group: heat
gradient_3 = Gradient(LowerLimit=0, UpperLimit=1, Parameter=remap.Mapped, stops=[0: RGB(0, 128, 0), 0.5: RGB(255, 255, 0), 1: RGB(255, 0, 0)])

# ---- group: Random
jitter = Jitter(List=gradient_2, Jitter=1, Seed=2)  # -> Values, Indices

# ----
filter_4 = StreamFilter(Gate=gradient_type, Stream0=gradient, Stream1=gradient_2, Stream2=jitter.Values, Stream3=gradient_3)

# ----
# align horizontal faces to 3D model
bbox_2 = BoundingBox(Content=filter, Plane=PlaneXY(0, 0, 0), UnionBox=True)  # -> Box, Box_2
box = EvaluateBox(Box=bbox_2.Box, UParameter="1", VParameter="0", WParameter="0")  # -> Plane, Point, Include
X = UnitX(Factor=_3d_model_position_along_x)
rev = Reverse(Vector=box.Point)
addition = Addition(A=rev, B=X)

# ---- group: avoid Z-fighting
Z = UnitZ(Factor="0.01")
addition_2 = Addition(A=addition, B=Z)

# ---- group: align Assemblage
mesh_5 = Mesh(mesh_4)
move = Move(Geometry=mesh_5, Motion=addition)  # -> Geometry, Transform

# ----
move_2 = Move(Geometry=filter, Motion=addition_2)  # -> Geometry, Transform

panel_3 = Panel("display Z dimensions")
bbox_3 = BoundingBox(Content=move_2.Geometry, Plane=PlaneXY(0, 0, 0), UnionBox=True)  # -> Box, Box_2
vec = VectorXYZ(XComponent=dimension_offset, YComponent=0, ZComponent=0)  # -> Vector, Length
box_2 = EvaluateBox(Box=bbox_3.Box, UParameter="0", VParameter=0.5, WParameter=0.5)  # -> Plane, Point, Include
addition_3 = Addition(A=box_2.Point, B=vec.Vector)
area_2 = Area(Geometry=move_2.Geometry)  # -> Area, Centroid
yz = YZPlane(Origin=addition_3)
xz = XZPlane(Origin=box_2.Point)
project = Project(Geometry=area_2.Centroid, Plane=yz)  # -> Geometry, Transform
project_2 = Project(Geometry=area_2.Centroid, Plane=xz)  # -> Geometry, Transform
project_3 = Project(Geometry=project.Geometry, Plane=xz)  # -> Geometry, Transform
expression = Expression(x=pdecon.ZComponent, Expression="Format(\"{0:+0.00;-0.00}\",x)")
ln = Line(StartPoint=project_2.Geometry, EndPoint=project_3.Geometry)
subcrv = SubCurve(BaseCurve=reparameterize(ln), Domain="0.1 to 0.97")

# ----
# Align & Display 3D
pl_origin = PlaneOrigin(Base=xz, Origin=project_3.Geometry)
mesh_6 = Mesh(move.Geometry)
mesh_7 = Mesh(move_2.Geometry)

f_mmeea = MeshesExtractEdgesWithToleranceAngle(Mesh=mesh_6, Angle=45)  # -> InternalEdges, NakedEdges
previewlw = CustomPreviewLineweights(Geometry=[f_mmeea.NakedEdges, f_mmeea.InternalEdges], Shader=mesh_edges_color, Thickness="2", Absolute=False)

f_mmeea_2 = MeshesExtractEdgesWithToleranceAngle(Mesh=mesh_7, Angle=45)  # -> InternalEdges, NakedEdges
previewlw_2 = CustomPreviewLineweights(Geometry=[f_mmeea_2.NakedEdges, f_mmeea_2.InternalEdges], Shader=mesh_edges_color, Thickness="4", Absolute=False)

# ----
# 3D model
swatch = ColourSwatch(SwatchColor=RGBA(255, 255, 255, 150))
preview = CustomPreview(Geometry=mesh_6, Material=swatch)

# ----
# Horizontal faces
preview_2 = CustomPreview(Geometry=mesh_7, Material=filter_4)

# ----
# Z dimensions
previewlw_3 = CustomPreviewLineweights(Geometry=subcrv, Shader=dimension_color, Absolute=False)
tag = TextTag3D(Location=pl_origin, Text=expression, Size=dimension_text_size, Colour=dimension_color, Justification=9)

# ----
# sort floor meshes on a grid
sort = SortList(Keys=filter_2, ValuesA=filter, ValuesB=filter_4, ValuesC=pdecon.ZComponent, ValuesD=area.Area, ValuesE=f_ifroml)  # -> Keys, ValuesA, ValuesB, ValuesC, ValuesD, ValuesE
lng = ListLength(List=sort.ValuesA)
int = Integer(n_of_rows)
integer_division = IntegerDivision(A=lng, B=int)  # -> expr("x+1", Result)
subtraction = Subtraction(A=lng, B="1")
multiplication = Multiplication(A=align_levels, B=display)

# ---- group: find largest span
bbox_4 = BoundingBox(Content=sort.ValuesA, Plane=PlaneXY(0, 0, 0), UnionBox=False)  # -> Box, Box_2
boxprop_2 = BoxProperties(Box=bbox_4.Box)  # -> Center, Diagonal, Area, Volume, Degeneracy
devec = DeconstructVector(Vector=boxprop_2.Diagonal)  # -> XComponent, YComponent, ZComponent
sort_2 = SortList(Keys=devec.YComponent)  # -> reverse(Keys), ValuesA
sort_3 = SortList(Keys=devec.XComponent)  # -> reverse(Keys), ValuesA
item = ListItem(List=sort_2.Keys, Index=0, Wrap=True)
item_2 = ListItem(List=sort_3.Keys, Index=0, Wrap=True)
vec_2 = VectorXYZ(XComponent=item_2, YComponent=item, ZComponent=0)  # -> Vector, Length

# ---- group: find aligned planes
bbox_5 = BoundingBox(Content=sort.ValuesA, Plane=PlaneXY(0, 0, 0), UnionBox=True)  # -> Box, Box_2
boxprop_3 = BoxProperties(Box=bbox_5.Box)  # -> Center, Diagonal, Area, Volume, Degeneracy
project_4 = Project(Geometry=boxprop_3.Center, Plane=boxprop_2.Center)  # -> Geometry, Transform

# ----
filter_5 = StreamFilter(Gate=multiplication, Stream0=boxprop_2.Center, Stream1=project_4.Geometry)

multiplication_2 = Multiplication(A=vec_2.Vector, B=grid_expansion)
devec_2 = DeconstructVector(Vector=multiplication_2)  # -> XComponent, YComponent, ZComponent
recgrid = Rectangular(Plane=PlaneXY(0, 0, 0), SizeX=devec_2.XComponent, SizeY=devec_2.YComponent, ExtentX=integer_division, ExtentY=int)  # -> flatten(Cells), Points
subset = SubList(List=recgrid.Cells, Domain=subtraction, Wrap=True)  # -> List, Index

int_2 = Integer(order)
lng_2 = ListLength(List=sort.ValuesA)  # -> expr("x-1", Length)
panel_4 = Panel("highlight item")
multiplication_3 = Multiplication(A=item_selector, B=lng_2)
filter_6 = StreamFilter(Gate=int_2, Stream0=sort.ValuesE, Stream1=reverse(sort.ValuesE))
int_3 = Integer(multiplication_3)
item_3 = ListItem(List=filter_6, Index=int_3, Wrap=True)
item_4 = ListItem(List=move_2.Geometry, Index=item_3, Wrap=True)
panel_5 = Panel("""0 to 0.05
0.95 to 1""")

item_shown = Panel(int_3)

filter_7 = StreamFilter(Gate=int_2, Stream0=subset.List, Stream1=reverse(subset.List))
pcen = PolygonCenter(Polyline=filter_7)  # -> CenterV, CenterE, CenterA
orient = Orient(Geometry=sort.ValuesA, Source=filter_5, Target=pcen.CenterV)  # -> Geometry, Transform

filter_8 = StreamFilter(Gate=int_2, Stream0=orient.Geometry, Stream1=reverse(orient.Geometry))
item_5 = ListItem(List=filter_8, Index=int_3, Wrap=True)

expression_2 = Expression(x=sort.ValuesC, Expression="Format(\"{0:+0.00;-0.00}\",x)")
panel_6 = Panel("grid captions")
expression_3 = Expression(x=sort.ValuesD, Expression="Format(\"{0:0.00}\",x)")
expression_4 = Expression(x=expression_2, y=expression_3, Expression="Format(\"Level {0} m, area: {1} mq\", x, y)")
multiplication_4 = Multiplication(A=multiplication_2, B="{-0.5,-0.5,0}")
addition_4 = Addition(A=pcen.CenterV, B=multiplication_4)

# ---- group: "brackets"
# this component might get red, but it shoudln't be a problem
merge = Merge(Data1=item_4, Data2=item_5)  # -> flatten(Result)
bbox_6 = BoundingBox(Content=merge, Plane=PlaneXY(0, 0, 0))  # -> Box, Box_2
edges = BrepEdges(Brep=bbox_6.Box)  # -> Naked, Interior, NonManifold
subcrv_2 = SubCurve(BaseCurve=reparameterize(graft([edges.Naked, edges.Interior])), Domain=panel_5)  # -> flatten(Curve)

# ---- group: callout polyline
boxprop_4 = BoxProperties(Box=bbox_6.Box_2)  # -> Center, Diagonal, Area, Volume, Degeneracy
item_6 = ListItem(List=boxprop_4.Center, Index=0, Wrap=True)  # -> Item, Item1
box_3 = Box2Pt(PointA=item_6.Item, PointB=item_6.Item1, Plane=PlaneXY(0, 0, 0))
edges_2 = BrepEdges(Brep=box_3)  # -> Naked, Interior, NonManifold
panel_7 = Panel("""7
6
10""")
item_7 = ListItem(List=edges_2.Interior, Index=panel_7, Wrap=True)

# ---- group: display naked edges
f_mmeea_3 = MeshesExtractEdgesWithToleranceAngle(Mesh=orient.Geometry, Angle=45)  # -> InternalEdges, NakedEdges
previewlw_4 = CustomPreviewLineweights(Geometry=[f_mmeea_3.NakedEdges, f_mmeea_3.InternalEdges], Shader=mesh_edges_color, Thickness="3", Absolute=False)

# ----
previewlw_5 = CustomPreviewLineweights(Geometry=subcrv_2, Shader=highlight_color, Thickness="5", Absolute=False)

# ----
# Horizontal surfaces on grid
preview_3 = CustomPreview(Geometry=orient.Geometry, Material=sort.ValuesB)

# ----
# Highlight callout
previewlw_6 = CustomPreviewLineweights(Geometry=item_7, Shader=highlight_color, Absolute=False)

# ----
# Grid labels
tag_2 = TextTag3D(Location=addition_4, Text=expression_4, Size=grid_text_size, Colour=text_color, Justification=7)

# ==== cluster Cluster
intercept_width = ClusterInput()
single_joined_mesh = ClusterInput()
z_angle_tolerance = ClusterInput()
intercept_height = ClusterInput()
super_accuracy = ClusterInput()
edges_length_threshold = ClusterInput()
clustering_start_point_index = ClusterInput()
area_threshold = ClusterInput()
clustering_distance = ClusterInput()
height_clash_start_point_offset = ClusterInput()

# ----
# remove faces with normals NOT pointing in the direction of the global Z
# (with a tolerance)
mesh = Mesh(single_joined_mesh)
tri = Triangulate(Mesh=mesh)  # -> Mesh, Count
c_script = CSharpScript(M=tri.Mesh)  # -> Mf; inputs M: Mesh
# ---------- c_script: C# ----------
    Mf = ExplodeMesh(M);
# ---------- c_script: C# additional code ----------
  List<Mesh> ExplodeMesh(Mesh M)
  {
    List<Mesh> meshes = new List<Mesh>();

    Mesh single;
    int a, b, c, d;
    bool color = M.VertexColors.Count > 0;
    for(int i = 0; i < M.Faces.Count; i++)
    {
      a = M.Faces[i].A;
      b = M.Faces[i].B;
      c = M.Faces[i].C;
      d = M.Faces[i].D;

      single = new Mesh();

      single.Vertices.Add(M.Vertices[a]);
      single.Vertices.Add(M.Vertices[b]);
      single.Vertices.Add(M.Vertices[c]);
      if (color)
      {
        single.VertexColors.Add(M.VertexColors[a]);
        single.VertexColors.Add(M.VertexColors[b]);
        single.VertexColors.Add(M.VertexColors[c]);
      }
      if(c != d)
      {
        single.Vertices.Add(M.Vertices[d]);
        if (color) single.VertexColors.Add(M.VertexColors[d]);
        single.Faces.AddFace(0, 1, 2, 3);
      }else
        single.Faces.AddFace(0, 1, 2);

      single.RebuildNormals();
      meshes.Add(single);
    }

    return meshes;
  }
# ---------- end c_script ----------
facen = FaceNormals(Mesh=c_script)  # -> Centers, flatten(Normals)
Z = UnitZ(Factor=1)
angle = Angle(VectorA=facen.Normals, VectorB=Z)  # -> Angle, Reflex
smaller = SmallerThan(FirstNumber=angle.Angle, SecondNumber=z_angle_tolerance)  # -> SmallerThan, OrEqualTo
cull = CullPattern(List=c_script, CullPattern=smaller.SmallerThan)

f_cdom = CenteredDomain(DomainLength=intercept_width)  # disabled
panel = Panel("1")  # disabled

# ----
# exclude faces with obstacles along the normal
# intercept distance should be related to the height necessary for a person to walk through a space
num = Number(intercept_height)
num_2 = Number(height_clash_start_point_offset)
mesh_2 = Mesh(single_joined_mesh)
facen_2 = FaceNormals(Mesh=cull)  # -> Centers, Normals
Z_2 = UnitZ(Factor=num_2)
move = Move(Geometry=facen_2.Centers, Motion=Z_2)  # -> Geometry, Transform
line = LineSDL(Start=move.Geometry, Direction=facen_2.Normals, Length=num)  # -> flatten(Line)
mcx = MeshCurve(Mesh=mesh_2, Curve=line)  # -> Points, Faces
lng = ListLength(List=mcx.Points)
equals = Equality(FirstNumber=lng, SecondNumber="0")  # -> flatten(Equality), flatten(Inequality)
cull_2 = CullPattern(List=cull, CullPattern=equals.Equality)
cull_3 = CullPattern(List=flatten(move.Geometry), CullPattern=equals.Equality)
Z_3 = UnitZ(Factor="0.1")
filter = StreamFilter(Gate=super_accuracy, Stream1=mesh_2)
move_2 = Move(Geometry=cull_3, Motion=Z_3)  # -> Geometry, Transform

box = DomainBox(Base=PlaneXY(0, 0, 0), X=f_cdom, Y=f_cdom, Z=num)  # disabled
mbox = MeshBox(Base=box, XCount=panel, YCount=panel, ZCount=panel)  # disabled
move_3 = Move(Geometry=mbox, Motion=move.Geometry)  # -> flatten(Geometry), Transform; disabled
mmx = MeshMesh(MeshA=mesh_2, MeshB=move_3.Geometry)  # disabled

panel_2 = Panel("HEAVY bottleneck")
f_mpinside = MeshPointInside(Mesh=filter, Point=move_2.Geometry)  # -> flatten(Inside), MeshWindingNumber

not = GateNot(A=f_mpinside.Inside)
cull_4 = CullPattern(List=cull_2, CullPattern=not)
filter_2 = StreamFilter(Gate=super_accuracy, Stream0=cull_2, Stream1=cull_4)

# ----
# remove faces with small edges (most probably walls, slab thicknesses or pillars)
# flag faces (True = potentially remove)
mjoin = MeshJoin(Meshes=filter_2)
num_3 = Number(edges_length_threshold)

panel_3 = Panel("small bottleneck")
alignvert = AlignVertices(Mesh=mjoin, Tolerance=0.01)  # -> Result, Count

weld = WeldMesh(Mesh=alignvert.Result, Angle=3.141592654)
f_mc_fpm = MeshConnectivityFaceProximityMap(Mesh=weld)  # -> ConnectedVertices, ConnectedEdges, ConnectedFaces
f_medges = ExtractMeshEdges(Mesh=weld)  # -> Edges, WeldStatus, EdgeStatus
len = Length(Curve=f_medges.Edges)
item = ListItem(List=len, Index=f_mc_fpm.ConnectedEdges, Wrap=True)
item_2 = ListItem(List=f_medges.EdgeStatus, Index=f_mc_fpm.ConnectedEdges, Wrap=True)
sort = SortList(Keys=item, ValuesA=item_2)  # -> Keys, ValuesA
item_3 = ListItem(List=sort.Keys, Index=0, Wrap=True)
smaller_2 = SmallerThan(FirstNumber=item_3, SecondNumber=num_3)  # -> flatten(SmallerThan), OrEqualTo
item_4 = ListItem(List=sort.Keys, Index=0, Wrap=True)

# ---- group: is one of the longest 2 edges naked?
panel_4 = Panel("""-1
-2""")
item_5 = ListItem(List=sort.ValuesA, Index=panel_4, Wrap=True)
not_2 = GateNot(A=item_5)
f_massbool = MassBoolean(Values=not_2, BooleanOperator="OR", Boolean_Operator="OR")  # -> flatten(Result)

# ---- group: long/short edge length > threshold
# Check for aspect ratio
item_6 = ListItem(List=sort.Keys, Index=0, Wrap=True)  # -> Item1, Item
division = Division(A=item_6.Item1, B=item_6.Item)
larger = LargerThan(FirstNumber=division, SecondNumber="2")  # -> flatten(LargerThan), OrEqualTo

# ----
and = GateAnd(A=smaller_2.SmallerThan, B=f_massbool, C=larger.LargerThan)

# ---- group: flagged faces
bool = Boolean(and)

# ----
# If at least one flagged faces neighbour is flagged remove face
item_7 = ListItem(List=bool, Index=f_mc_fpm.ConnectedFaces, Wrap=True)
f_massbool_2 = MassBoolean(Values=item_7, BooleanOperator="OR", Boolean_Operator="OR")

# ---- group: connected edges to flagged faces & lengths
# Connected edges to flagged faces & their length
panel_5 = Panel("1")
equals_2 = Equality(FirstNumber=item_2, SecondNumber=panel_5)  # -> Equality, Inequality

# ----
and_2 = GateAnd(A=equals_2.Equality, B=item_7)

# ---- group: connected edges to flagged faces & lengths (continued)
cull_5 = CullPattern(List=item, CullPattern=and_2)

# ----
# Checks if one of the connected edges to flagged faces is longer than the smallest edge
larger_2 = LargerThan(FirstNumber=cull_5, SecondNumber=item_4)  # -> LargerThan, OrEqualTo
f_massbool_3 = MassBoolean(Values=larger_2.LargerThan, BooleanOperator="OR", Boolean_Operator="OR")

and_3 = GateAnd(A=f_massbool_2, B=f_massbool_3)
and_4 = GateAnd(A=and, B=flatten(and_3))
cullf = CullFaces(Mesh=weld, Pattern=and_4)

panel_6 = Panel("disjoint separate chunks")
disjoint = DisjointMesh(Mesh=cullf)

# ----
# filter meshes below a certain area threshold (cull small pieces)
num_4 = Number(area_threshold)
area = Area(Geometry=disjoint)  # -> Area, Centroid
larger_3 = LargerThan(FirstNumber=area.Area, SecondNumber=num_4)  # -> LargerThan, OrEqualTo
cull_6 = CullPattern(List=disjoint, CullPattern=larger_3.LargerThan)

# ----
# sort mesh chunks by Z (for clarity)
area_2 = Area(Geometry=cull_6)  # -> Area, Centroid
pdecon = Deconstruct(Point=area_2.Centroid)  # -> XComponent, YComponent, ZComponent
sort_2 = SortList(Keys=pdecon.ZComponent, ValuesA=cull_6)  # -> Keys, flatten(ValuesA)

# ----
# group meshes by floor height (approximated to the grouping distance)
group_by_distance = GroupByDistance(mesh=sort_2.ValuesA, num=clustering_distance, start_point_index=clustering_start_point_index)

mesh_3 = Mesh(group_by_distance)
mesh_4 = Mesh(sort_2.ValuesA)
mesh_clusters = ClusterOutput(mesh_3)
single_meshes = ClusterOutput(mesh_4)

# ==== cluster GroupByDistance
mesh = ClusterInput()
num = ClusterInput()
start_point_index = ClusterInput()
num_2 = Number(num)

mesh_2 = Mesh(mesh)
area = Area(Geometry=mesh_2)  # -> Area, Centroid
pdecon = Deconstruct(Point=area.Centroid)  # -> XComponent, YComponent, ZComponent

# ---- group: OLD method / "normalize" heights (start from 0)
bnd = Bounds(Numbers=pdecon.ZComponent)  # disabled
dedomain = DeconstructDomain(Domain=bnd)  # -> Start, End; disabled
subtraction = Subtraction(A=pdecon.ZComponent, B=dedomain.Start)  # disabled

# ----
f_ifroml = IndexesFromList(Data=pdecon.ZComponent)
# group meshes by floor height (approximated to the grouping distance)
pt = ConstructPoint(XCoordinate=0, YCoordinate=0, ZCoordinate=pdecon.ZComponent)
sort = SortList(Keys=pdecon.ZComponent, ValuesA=f_ifroml)  # -> Keys, ValuesA
item = ListItem(List=sort.ValuesA, Index=start_point_index, Wrap=True)
f_ptscbd = ClusterizePointsByDistance(Points=pt, Index=item, ClusterizationDistance=num_2)  # -> ClusteredPoints, ClusteredIndices

# ---- group: OLD method
division = Division(A=subtraction, B=num_2)  # disabled
round = Round(Number=division)  # -> Nearest, Floor, Ceiling; disabled
cset = CreateSet(List=round.Nearest)  # -> Set, Map; disabled
f_ifroml_2 = IndexesFromList(Data=cset.Set)  # disabled
mindex = MemberIndex(Set=cset.Map, Member=f_ifroml_2)  # -> Index, Count; disabled

# ----
item_2 = ListItem(List=mesh_2, Index=f_ptscbd.ClusteredIndices, Wrap=True)
mjoin = MeshJoin(Meshes=item_2)  # -> flatten(Mesh)

mesh_3 = Mesh(mjoin)
mesh_4 = ClusterOutput(mesh_3)
