# Grasshopper definition PP extract horizontal faces.gh (Grasshopper 1.0.7)
# Copyright: Co-de-iT
# plug-ins: froGH, Human

# parameters
plugins_needed = Panel(""". froGH
. Human""")

# ---- group: small assemblage (171 meshes)
# reference the meshes in the assemblage (or the part you want to analyze) here
mesh = Mesh([<mesh referenced from the Rhino model> x176])

# ---- group: intermediate assemblage (509 meshes)
mesh_2 = Mesh([<mesh referenced from the Rhino model> x592])

# ---- group: entire assemblage (2001 meshes)
# keep it > 0 to avoid false positives
# intercept distance should be related to the height necessary for a person to walk through a space
mesh_3 = Mesh([<mesh referenced from the Rhino model> x2001])

# ----
length_threshold_for_small_edges = Slider(1.2, range=0..2)
grouping_distance_m = Slider(1.5, range=0.1..10)
area_threshold = Slider(4, range=0..50)

# ---- group: input meshes here
# Assembler
# 
# Framework for Iterative Assemblages workflow
# 
# code by Alessio Erioli
# 
# v 1.0
# © Co-de-iT 2021 / Creative Commons Attribution-Non Commercial-ShareAlike 4.0 International License
mesh_4 = Mesh(mesh)

# ----
start_point_offset = Panel("0.01")
angle_tolerance = Panel("0.01")

intercept_distance = Panel("2")
mjoin = MeshJoin(Meshes=mesh_4)
display = ValueList({"single meshes": 0, "level clusters": 1, "level regions": 2}, selected="level regions")

coloring_value = ValueList({"Z height": 0, "area": 1, "diagonal": 2, "area/diagonal": 3}, selected="area")
item_selector = Slider(0.748, range=0..1)
sorting_value = ValueList({"Z height": 0, "area": 1, "diagonal": 2, "area/diagonal": 3}, selected="area")
gradient_type = ValueList({"Hue": 0, "Rainbow": 1, "Random": 2, "Heat": 3}, selected="Heat")
order = ValueList({"Ascending": 0, "Descending": 1}, selected="Descending")

table_expansion = Slider(1.1, range=1..2)
n_of_rows = Slider(10, range=2..50)

mesh_edge_color = ColourSwatch(SwatchColor=RGB(0, 0, 0))
dimension_color = ColourSwatch(SwatchColor=RGB(0, 0, 0))
highlight_color = ColourSwatch(SwatchColor=RGB(250, 0, 0))
text_color = ColourSwatch(SwatchColor=RGB(0, 0, 0))

# ----
# Filtering
# filter meshes below a certain area threshold (cull small pieces)
# remove faces with small edges (most probably walls, slab thicknesses or pillars)
# remove faces with normals NOT pointing in the direction of the global Z
# (with a tolerance)
# exclude faces with obstacles along the normal
# weld meshes and disjoint separate chunks
# sorry, I'd rather not do clusters but this definition is already messy enough as it is!
remove_non_horizontal_faces = RemoveNonHorizontalFaces(mesh=mjoin, angle_tolerance=angle_tolerance)
remove_occluded_faces = RemoveOccludedFaces(mesh=remove_non_horizontal_faces, num_2=start_point_offset, num=intercept_distance)

# ----
# this might be the second bottleneck
remove_thicknesses_approx = RemoveThicknessesApprox(mesh=remove_occluded_faces, num=length_threshold_for_small_edges)

# ----
# this might be a bottleneck
weld_and_separate_chunks = WeldAndSeparateChunks(mesh=remove_thicknesses_approx)

filter_small_pieces = FilterSmallPieces(mesh=weld_and_separate_chunks, num=area_threshold)

# ----
# sort meshes by Z (for clarity)
mesh_5 = Mesh(filter_small_pieces)
area = Area(Geometry=mesh_5)  # -> Area, Centroid
pdecon = Deconstruct(Point=area.Centroid)  # -> XComponent, YComponent, ZComponent
sort = SortList(Keys=pdecon.ZComponent, ValuesA=mesh_5)  # -> Keys, ValuesA

# ----
# group meshes by floor height (approximated to the grouping distance)
# sorry, I'd rather not do clusters but this definition is already messy enough as it is!
group_by_distance = GroupByDistance(mesh=sort.ValuesA, num=grouping_distance_m)

panel = Panel("Creates coplanar regions")
# Due to limitations in the algorithm and the complexity of the problem, regions DO NOT represent fully connected spaces (though they might give an indication of the potential)
create_regions = CreateRegions(mesh=mjoin, mesh_clusters=group_by_distance, grouping_distance=grouping_distance_m)

filter = StreamFilter(Gate=display, Stream0=sort.ValuesA, Stream1=group_by_distance, Stream2=create_regions)

area_2 = Area(Geometry=filter)  # -> Area, Centroid
bbox = BoundingBox(Content=filter, Plane=PlaneXY(0, 0, 0))  # -> Box, Box_2
boxprop = BoxProperties(Box=bbox.Box)  # -> Center, Diagonal, Area, Volume, Degeneracy
pdecon_2 = Deconstruct(Point=boxprop.Center)  # -> XComponent, YComponent, ZComponent
vlen = VectorLength(Vector=boxprop.Diagonal)
division = Division(A=area_2.Area, B=vlen)

# ----
# Sorting & Coloring
panel_2 = Panel("sorting criteria")
panel_3 = Panel("generate value-based colors")
panel_4 = Panel("select sorting criteria")
filter_2 = StreamFilter(Gate=sorting_value, Stream0=pdecon_2.ZComponent, Stream1=area_2.Area, Stream2=vlen, Stream3=division)

filter_3 = StreamFilter(Gate=coloring_value, Stream0=pdecon_2.ZComponent, Stream1=area_2.Area, Stream2=vlen, Stream3=division)

# ---- group: find bounds
bnd = Bounds(Numbers=filter_3)
dedomain = DeconstructDomain(Domain=bnd)  # -> Start, End

# ---- group: Hue
gradient = Gradient(
    LowerLimit=dedomain.Start,
    UpperLimit=dedomain.End,
    Parameter=filter_3,
    stops=[0: RGB(21, 0, 33), 0.326: RGB(150, 66, 114), 0.664: RGB(224, 186, 187), 1: RGB(255, 255, 255)])

# ---- group: Rainbow
gradient_2 = Gradient(
    LowerLimit=dedomain.Start,
    UpperLimit=dedomain.End,
    Parameter=filter_3,
    stops=[0: RGB(243, 57, 0), 0.1: RGB(236, 27, 60), 0.2: RGB(210, 0, 118), 0.3: RGB(103, 0, 120), 0.4: RGB(39, 72, 161), 0.5: RGB(1, 192, 229), 0.6: RGB(18, 178, 90), 0.7: RGB(79, 186, 8), 0.8: RGB(220, 237, 32), 0.9: RGB(247, 159, 20), 1: RGB(243, 57, 0)])

# ---- group: heat
gradient_3 = Gradient(
    LowerLimit=dedomain.Start,
    UpperLimit=dedomain.End,
    Parameter=filter_3,
    stops=[0: RGB(0, 128, 0), 0.5: RGB(255, 255, 0), 1: RGB(255, 0, 0)])

# ---- group: Random
jitter = Jitter(List=gradient_2, Jitter=1, Seed=2)  # -> Values, Indices

# ----
filter_4 = StreamFilter(Gate=gradient_type, Stream0=gradient, Stream1=gradient_2, Stream2=jitter.Values, Stream3=gradient_3)

# ---- group: align meshes
position_along_x = Slider(-10, range=-100..0)
bbox_2 = BoundingBox(Content=filter, Plane=PlaneXY(0, 0, 0), UnionBox=True)  # -> Box, Box_2
box = EvaluateBox(Box=bbox_2.Box, UParameter="1", VParameter="0", WParameter="0")  # -> Plane, Point, Include
X = UnitX(Factor=position_along_x)
rev = Reverse(Vector=box.Point)
addition = Addition(A=rev, B=X)

# ---- group: avoid Z-fighting
Z = UnitZ(Factor="0.01")
addition_2 = Addition(A=addition, B=Z)

# ---- group: align Assemblage
mesh_6 = Mesh(mesh_4)
move = Move(Geometry=mesh_6, Motion=addition)  # -> Geometry, Transform

# ---- group: align meshes (continued)
move_2 = Move(Geometry=filter, Motion=addition_2)  # -> Geometry, Transform

# ----
dimension_offset = Slider(-0.4, range=-100..0)
bbox_3 = BoundingBox(Content=move_2.Geometry, Plane=PlaneXY(0, 0, 0), UnionBox=True)  # -> Box, Box_2
vec = VectorXYZ(XComponent=dimension_offset, YComponent=0, ZComponent=0)  # -> Vector, Length
box_2 = EvaluateBox(Box=bbox_3.Box, UParameter="0", VParameter=0.5, WParameter=0.5)  # -> Plane, Point, Include
addition_3 = Addition(A=box_2.Point, B=vec.Vector)
area_3 = Area(Geometry=move_2.Geometry)  # -> Area, Centroid
yz = YZPlane(Origin=addition_3)
xz = XZPlane(Origin=box_2.Point)
project = Project(Geometry=area_3.Centroid, Plane=yz)  # -> Geometry, Transform
project_2 = Project(Geometry=area_3.Centroid, Plane=xz)  # -> Geometry, Transform
project_3 = Project(Geometry=project.Geometry, Plane=xz)  # -> Geometry, Transform
expression = Expression(x=pdecon_2.ZComponent, Expression="Format(\"{0:+0.00;-0.00}\",x)")
dimension_text_size = Slider(0.594, range=0..1)
ln = Line(StartPoint=project_2.Geometry, EndPoint=project_3.Geometry)
subcrv = SubCurve(BaseCurve=reparameterize(ln), Domain="0.1 to 0.97")

# ----
# Align & Display 3D
panel_5 = Panel("display Z dimensions")
mesh_7 = Mesh(move.Geometry)
mesh_8 = Mesh(move_2.Geometry)
pl_origin = PlaneOrigin(Base=xz, Origin=project_3.Geometry)
preview = CustomPreview(Geometry=mesh_7, Material=ColourSwatch(SwatchColor=RGBA(255, 255, 255, 150)))
preview_2 = CustomPreview(Geometry=mesh_8, Material=filter_4)
previewlw = CustomPreviewLineweights(Geometry=subcrv, Shader=dimension_color, Absolute=False)
tag = TextTag3D(Location=pl_origin, Text=expression, Size=dimension_text_size, Colour=dimension_color, Justification=9)

# ---- group: display naked edges
f_mmeea = MeshesExtractEdgesWithToleranceAngle(Mesh=mesh_8, Angle=45)  # -> InternalEdges, NakedEdges
previewlw_2 = CustomPreviewLineweights(Geometry=[f_mmeea.NakedEdges, f_mmeea.InternalEdges], Shader=mesh_edge_color, Thickness="3", Absolute=False)

# ---- group: display edges
f_mmeea_2 = MeshesExtractEdgesWithToleranceAngle(Mesh=mesh_7, Angle=45)  # -> InternalEdges, NakedEdges
previewlw_3 = CustomPreviewLineweights(Geometry=[f_mmeea_2.NakedEdges, f_mmeea_2.InternalEdges], Shader=mesh_edge_color, Thickness="3", Absolute=False)

# ----
# Align & Display 2D
# sort floor meshes on a grid
f_ifroml = IndexesFromList(Data=area_2.Area)
panel_6 = Panel("highlight item")
panel_7 = Panel("grid captions")

sort_2 = SortList(Keys=filter_2, ValuesA=filter, ValuesB=filter_4, ValuesC=pdecon_2.ZComponent, ValuesD=area_2.Area, ValuesE=f_ifroml)  # -> Keys, ValuesA, ValuesB, ValuesC, ValuesD, ValuesE
lng = ListLength(List=sort_2.ValuesA)
integer_division = IntegerDivision(A=lng, B=n_of_rows)  # -> expr("x+1", Result)
subtraction = Subtraction(A=lng, B="1")

# ---- group: find largest span
bbox_4 = BoundingBox(Content=sort_2.ValuesA, Plane=PlaneXY(0, 0, 0), UnionBox=False)  # -> Box, Box_2
boxprop_2 = BoxProperties(Box=bbox_4.Box)  # -> Center, Diagonal, Area, Volume, Degeneracy
devec = DeconstructVector(Vector=boxprop_2.Diagonal)  # -> XComponent, YComponent, ZComponent
sort_3 = SortList(Keys=devec.YComponent)  # -> reverse(Keys), ValuesA
sort_4 = SortList(Keys=devec.XComponent)  # -> reverse(Keys), ValuesA
item = ListItem(List=sort_3.Keys, Index=0, Wrap=True)
item_2 = ListItem(List=sort_4.Keys, Index=0, Wrap=True)
vec_2 = VectorXYZ(XComponent=item_2, YComponent=item, ZComponent=0)  # -> Vector, Length

# ----
multiplication = Multiplication(A=vec_2.Vector, B=table_expansion)
devec_2 = DeconstructVector(Vector=multiplication)  # -> XComponent, YComponent, ZComponent
recgrid = Rectangular(Plane=PlaneXY(0, 0, 0), SizeX=devec_2.XComponent, SizeY=devec_2.YComponent, ExtentX=integer_division, ExtentY=n_of_rows)  # -> flatten(Cells), Points
subset = SubList(List=recgrid.Cells, Domain=subtraction, Wrap=True)  # -> List, Index
filter_5 = StreamFilter(Gate=order, Stream0=subset.List, Stream1=reverse(subset.List))
pcen = PolygonCenter(Polyline=filter_5)  # -> CenterV, CenterE, CenterA
orient = Orient(Geometry=sort_2.ValuesA, Source=boxprop_2.Center, Target=pcen.CenterV)  # -> Geometry, Transform

# ----
# this component might get red, but it shoudln't be a problem
lng_2 = ListLength(List=sort_2.ValuesA)  # -> expr("x-1", Length)
multiplication_2 = Multiplication(A=item_selector, B=lng_2)
filter_6 = StreamFilter(Gate=order, Stream0=orient.Geometry, Stream1=reverse(orient.Geometry))
filter_7 = StreamFilter(Gate=order, Stream0=sort_2.ValuesE, Stream1=reverse(sort_2.ValuesE))
int = Integer(multiplication_2)
item_3 = ListItem(List=filter_7, Index=int, Wrap=True)
item_4 = ListItem(List=move_2.Geometry, Index=item_3, Wrap=True)
item_5 = ListItem(List=filter_6, Index=int, Wrap=True)
merge = Merge(Data1=item_4, Data2=item_5)  # -> flatten(Result)
bbox_5 = BoundingBox(Content=merge, Plane=PlaneXY(0, 0, 0))  # -> Box, Box_2
edges = BrepEdges(Brep=bbox_5.Box)  # -> Naked, Interior, NonManifold
panel_8 = Panel("""0 to 0.05
0.95 to 1""")
subcrv_2 = SubCurve(BaseCurve=reparameterize(graft([edges.Naked, edges.Interior])), Domain=panel_8)  # -> flatten(Curve)

item_shown = Panel(int)

expression_2 = Expression(x=sort_2.ValuesC, Expression="Format(\"{0:+0.00;-0.00}\",x)")
expression_3 = Expression(x=sort_2.ValuesD, Expression="Format(\"{0:0.00}\",x)")
expression_4 = Expression(x=expression_2, y=expression_3, Expression="Format(\"Level {0} m, area: {1} mq\", x, y)")
multiplication_3 = Multiplication(A=multiplication, B="{-0.5,-0.5,0}")
text_size = Slider(2.3, range=1..10)
addition_4 = Addition(A=pcen.CenterV, B=multiplication_3)

# ---- group: callout polyline
boxprop_3 = BoxProperties(Box=bbox_5.Box_2)  # -> Center, Diagonal, Area, Volume, Degeneracy
item_6 = ListItem(List=boxprop_3.Center, Index=0, Wrap=True)  # -> Item, Item1
box_3 = Box2Pt(PointA=item_6.Item, PointB=item_6.Item1, Plane=PlaneXY(0, 0, 0))
panel_9 = Panel("""7
6
10""")
edges_2 = BrepEdges(Brep=box_3)  # -> Naked, Interior, NonManifold
item_7 = ListItem(List=edges_2.Interior, Index=panel_9, Wrap=True)

# ---- group: display naked edges
f_mmeea_3 = MeshesExtractEdgesWithToleranceAngle(Mesh=orient.Geometry, Angle=45)  # -> InternalEdges, NakedEdges
previewlw_4 = CustomPreviewLineweights(Geometry=[f_mmeea_3.NakedEdges, f_mmeea_3.InternalEdges], Shader=mesh_edge_color, Thickness="3", Absolute=False)

# ----
preview_3 = CustomPreview(Geometry=orient.Geometry, Material=sort_2.ValuesB)
previewlw_5 = CustomPreviewLineweights(Geometry=subcrv_2, Shader=highlight_color, Thickness="5", Absolute=False)
previewlw_6 = CustomPreviewLineweights(Geometry=item_7, Shader=highlight_color, Absolute=False)
tag_2 = TextTag3D(Location=addition_4, Text=expression_4, Size=text_size, Colour=text_color, Justification=7)

# ==== cluster RemoveOccludedFaces
mesh = ClusterInput()
num = ClusterInput()
num_2 = ClusterInput()
num_3 = Number(num)
num_4 = Number(num_2)

# ----
# intercept distance should be related to the height necessary for a person to walk through a space
mesh_2 = Mesh(mesh)
c_script = CSharpScript(M=mesh_2)  # -> Mf; inputs M: Mesh
# ---------- c_script: C# ----------
    Mf = ExplodeMesh(M);
# ---------- c_script: C# additional code ----------
  List<Mesh> ExplodeMesh(Mesh M)
  {
    List<Mesh> meshes = new List<Mesh>();

    Mesh single;
    int a, b, c, d;
    bool color = M.VertexColors.Count > 0;
    for(int i = 0; i < M.Faces.Count; i++)
    {
      a = M.Faces[i].A;
      b = M.Faces[i].B;
      c = M.Faces[i].C;
      d = M.Faces[i].D;

      single = new Mesh();

      single.Vertices.Add(M.Vertices[a]);
      single.Vertices.Add(M.Vertices[b]);
      single.Vertices.Add(M.Vertices[c]);
      if (color)
      {
        single.VertexColors.Add(M.VertexColors[a]);
        single.VertexColors.Add(M.VertexColors[b]);
        single.VertexColors.Add(M.VertexColors[c]);
      }
      if(c != d)
      {
        single.Vertices.Add(M.Vertices[d]);
        if (color) single.VertexColors.Add(M.VertexColors[d]);
        single.Faces.AddFace(0, 1, 2, 3);
      }else
        single.Faces.AddFace(0, 1, 2);


      meshes.Add(single);
    }

    return meshes;
  }
# ---------- end c_script ----------
tri = Triangulate(Mesh=c_script)  # -> Mesh, Count
# exclude faces with obstacles along the normal
Z = UnitZ(Factor=num_4)
facen = FaceNormals(Mesh=tri.Mesh)  # -> Centers, Normals
move = Move(Geometry=facen.Centers, Motion=Z)  # -> Geometry, Transform
line = LineSDL(Start=move.Geometry, Direction=facen.Normals, Length=num_3)
mcx = MeshCurve(Mesh=mesh_2, Curve=line)  # -> Points, Faces

pshift = ShiftPaths(Data=mcx.Points, Offset=-1)

lng = ListLength(List=pshift)
equals = Equality(FirstNumber=lng, SecondNumber="0")  # -> flatten(Equality), flatten(Inequality)
cullf = CullFaces(Mesh=mesh_2, Pattern=equals.Inequality)

mesh_3 = Mesh(cullf)
mesh_4 = ClusterOutput(mesh_3)

# ==== cluster RemoveThicknessesApprox
mesh = ClusterInput()
num = ClusterInput()
num_2 = Number(num)

mesh_2 = Mesh(mesh)

f_mc_fpm = MeshConnectivityFaceProximityMap(Mesh=mesh_2)  # -> ConnectedVertices, ConnectedEdges, ConnectedFaces
f_medges = ExtractMeshEdges(Mesh=mesh_2)  # -> Edges, WeldStatus, EdgeStatus
item = ListItem(List=f_medges.Edges, Index=f_mc_fpm.ConnectedEdges, Wrap=True)
item_2 = ListItem(List=f_medges.EdgeStatus, Index=f_mc_fpm.ConnectedEdges, Wrap=True)

# ----
# remove faces with small edges (most probably walls, slab thicknesses or pillars)
len = Length(Curve=item)
sort = SortList(Keys=len, ValuesA=item_2)  # -> Keys, ValuesA
item_3 = ListItem(List=sort.Keys, Index=0, Wrap=True)
pshift = ShiftPaths(Data=item_3, Offset=-1)
smaller = SmallerThan(FirstNumber=pshift, SecondNumber=num_2)  # -> SmallerThan, OrEqualTo

# ---- group: is one of the longest 2 edges naked?
panel = Panel("""-1
-2""")
item_4 = ListItem(List=sort.ValuesA, Index=panel, Wrap=True)
f_massbool = MassBoolean(Values=item_4, BooleanOperator="OR", Boolean_Operator="OR")
pshift_2 = ShiftPaths(Data=f_massbool, Offset=-1)
equals = Equality(FirstNumber=pshift_2, SecondNumber="0")  # -> Equality, Inequality

# ----
and = GateAnd(A=smaller.SmallerThan, B=equals.Equality)
cullf = CullFaces(Mesh=mesh_2, Pattern=and)

mesh_3 = Mesh(cullf)
mesh_4 = ClusterOutput(mesh_3)

# ==== cluster WeldAndSeparateChunks
mesh = ClusterInput()

mesh_2 = Mesh(mesh)
panel = Panel("fix normals")

# ----
# weld them and disjoint separate chunks
# this component is the bottleneck
alignvert = AlignVertices(Mesh=mesh_2, Tolerance=0.01)  # -> Result, Count

weld = WeldMesh(Mesh=alignvert.Result, Angle=3.141592654)
disjoint = DisjointMesh(Mesh=weld)

unim = UnifyMesh(Mesh=disjoint)  # -> Result, Count

mesh_3 = Mesh(unim.Result)
mesh_4 = ClusterOutput(mesh_3)

# ==== cluster FilterSmallPieces
mesh = ClusterInput()
num = ClusterInput()
num_2 = Number(num)

mesh_2 = Mesh(mesh)
# filter meshes below a certain area threshold (cull small pieces)
area = Area(Geometry=mesh_2)  # -> Area, Centroid
larger = LargerThan(FirstNumber=area.Area, SecondNumber=num_2)  # -> LargerThan, OrEqualTo
cull = CullPattern(List=mesh_2, CullPattern=larger.LargerThan)

mesh_3 = Mesh(cull)
mesh_4 = ClusterOutput(mesh_3)

# ==== cluster GroupByDistance
mesh = ClusterInput()
num = ClusterInput()
num_2 = Number(num)

mesh_2 = Mesh(mesh)
area = Area(Geometry=mesh_2)  # -> Area, Centroid
pdecon = Deconstruct(Point=area.Centroid)  # -> XComponent, YComponent, ZComponent

# ---- group: OLD method / "normalize" heights (start from 0)
bnd = Bounds(Numbers=pdecon.ZComponent)  # disabled
dedomain = DeconstructDomain(Domain=bnd)  # -> Start, End; disabled
subtraction = Subtraction(A=pdecon.ZComponent, B=dedomain.Start)  # disabled

# ----
f_ifroml = IndexesFromList(Data=pdecon.ZComponent)
# group meshes by floor height (approximated to the grouping distance)
pt = ConstructPoint(XCoordinate=0, YCoordinate=0, ZCoordinate=pdecon.ZComponent)
sort = SortList(Keys=pdecon.ZComponent, ValuesA=f_ifroml)  # -> Keys, ValuesA
item = ListItem(List=sort.ValuesA, Index=0, Wrap=True)
f_ptscbd = ClusterizePointsByDistance(Points=pt, Index=item, ClusterizationDistance=num_2)  # -> ClusteredPoints, ClusteredIndices

# ---- group: OLD method
division = Division(A=subtraction, B=num_2)  # disabled
round = Round(Number=division)  # -> Nearest, Floor, Ceiling; disabled
cset = CreateSet(List=round.Nearest)  # -> Set, Map; disabled
f_ifroml_2 = IndexesFromList(Data=cset.Set)  # disabled
mindex = MemberIndex(Set=cset.Map, Member=f_ifroml_2)  # -> Index, Count; disabled

# ----
item_2 = ListItem(List=mesh_2, Index=f_ptscbd.ClusteredIndices, Wrap=True)
mjoin = MeshJoin(Meshes=item_2)  # -> flatten(Mesh)

mesh_3 = Mesh(mjoin)
mesh_4 = ClusterOutput(mesh_3)

# ==== cluster RemoveNonHorizontalFaces
angle_tolerance = ClusterInput()
mesh = ClusterInput()

mesh_2 = Mesh(mesh)
# remove faces with normals NOT pointing in the direction of the global Z
# (with a tolerance)
facen = FaceNormals(Mesh=mesh_2)  # -> Centers, Normals
Z = UnitZ(Factor=1)
angle = Angle(VectorA=facen.Normals, VectorB=Z)  # -> Angle, Reflex

smaller = SmallerThan(FirstNumber=angle.Angle, SecondNumber=angle_tolerance)  # -> SmallerThan, OrEqualTo

not = GateNot(A=smaller.SmallerThan)
cullf = CullFaces(Mesh=mesh_2, Pattern=not)

mesh_3 = Mesh(cullf)
mesh_4 = ClusterOutput(mesh_3)

# ==== cluster CreateRegions: Creates Regions from floor clusters
grouping_distance = ClusterInput()
mesh = ClusterInput()
mesh_clusters = ClusterInput()
area = Area(Geometry=mesh_clusters)  # -> Area, Centroid
orient = Orient(Geometry=mesh_clusters, Source=area.Centroid, Target=PlaneXY(0, 0, 0))  # -> Geometry, Transform
disjoint = DisjointMesh(Mesh=orient.Geometry)

# ---- group: extract naked perimeters
c_script = CSharpScript(M=disjoint)  # -> nE; inputs M: Mesh
# ---------- c_script: C# ----------
   nE = M.GetNakedEdges();
# ---------- end c_script ----------

# ----
xy = XYPlane(Origin=Point(0, 0, 0))
pshift = ShiftPaths(Data=c_script, Offset=-1)
project = Project(Geometry=pshift, Plane=xy)  # -> Geometry, Transform

# ---- group: remove non-planar curves
planar = Planar(Curve=project.Geometry)  # -> Planar, Plane, Deviation
cull = CullPattern(List=project.Geometry, CullPattern=planar.Planar)

# ----
runion = RegionUnion(Curves=cull)
pshift_2 = ShiftPaths(Data=runion, Offset=-1)

# ---- group: detect islands
disc = Discontinuity(Curve=pshift_2, Level=1)  # -> Points, Parameters
pshift_3 = ShiftPaths(Data=disc.Points, Offset=-1)
lng = ListLength(List=disc.Points)
crossref = CrossReference(ListA=pshift_3, ListB=pshift_2, CrossMode=1)  # -> ListA, ListB
pshift_4 = ShiftPaths(Data=lng, Offset=-1)
incurve = PointInCurve(Point=crossref.ListA, Curve=crossref.ListB)  # -> Relationship, Point
lng_2 = ListLength(List=pshift_2)
partition = PartitionList(List=incurve.Relationship, Size=pshift_4)
multiplication = Multiplication(A=lng, B="2")
ma = MassAddition(Input=partition)  # -> Result, PartialResults
pshift_5 = ShiftPaths(Data=multiplication, Offset=-1)
pshift_6 = ShiftPaths(Data=ma.Result, Offset=-1)
dup = DuplicateData(Data=pshift_5, Number=lng_2, Order=True)  # -> simplify(Data)
partition_2 = PartitionList(List=pshift_6, Size=lng_2)
partition_3 = PartitionList(List=dup, Size=lng_2)
equals = Equality(FirstNumber=partition_2, SecondNumber=partition_3)  # -> Equality, Inequality
path_mapper = PathMapper(equals.Equality, source="{A;B;C}(i)", target="{A;B;i}(C)")
lng_3 = ListLength(List=pshift_2)
dup_2 = DuplicateData(Data=pshift_2, Number=lng_3, Order=True)  # -> simplify(Data)
partition_4 = PartitionList(List=dup_2, Size=lng_3)
cull_2 = CullPattern(List=partition_4, CullPattern=equals.Equality)
f_massbool = MassBoolean(Values=path_mapper, BooleanOperator="OR", Boolean_Operator="OR")
graft = GraftTree(Tree=pshift_2, IncludeEmptyLists=True, IncludeNullItems=True)
merge = Merge(Data1=cull_2, Data2=graft)
not = GateNot(A=f_massbool)
cull_3 = CullPattern(List=merge, CullPattern=not)

# ----
boundary = BoundarySurfaces(Edges=cull_3)
mesh_2 = MeshBrep(
    Brep=boundary,
    Settings={GridMaxCount=0, GridMinCount=16, JaggedSeams=False, MaxEdgeLength=0, MinEdgeLength=0.0001, MinTolerance=0, Refine=True, RefineAngle=0, RelativeTolerance=0.65, SimplePlanes=True, Tolerance=0})
pshift_7 = ShiftPaths(Data=mesh_2, Offset=-1)
mjoin = MeshJoin(Meshes=pshift_7)  # -> flatten(Mesh)
f_mrenorm = MeshRebuildNormals(Mesh=mjoin)
inverse = InverseTransform(Transform=orient.Transform)
transform = Transform(Geometry=f_mrenorm, Transform=inverse)
area_2 = Area(Geometry=mesh_clusters)  # -> Area, Centroid
area_3 = Area(Geometry=transform)  # -> Area, Centroid
vec2pt = Vector2Pt(PointA=area_3.Centroid, PointB=area_2.Centroid, Unitize=False)  # -> Vector, Length
expression = Expression(x=vec2pt.Vector, Expression="{0,0,x.Z}")
move = Move(Motion=expression)  # -> Geometry, Transform
move_2 = Move(Geometry=transform, Motion=expression)  # -> Geometry, Transform
mesh_regions = ClusterOutput(move_2.Geometry)

# ---- group: subtract wall sections (inactive)
Z = UnitZ(Factor=grouping_distance)  # disabled
move_3 = Move(Geometry=area.Centroid, Motion=Z)  # -> Geometry, Transform; disabled
xy_2 = XYPlane(Origin=move_3.Geometry)  # disabled
sec = MeshPlane(Mesh=mesh, Plane=xy_2)  # disabled
rev = Reverse(Vector=Z)  # disabled
pshift_8 = ShiftPaths(Data=cull_3, Offset=-1)  # disabled
lng_4 = ListLength(List=pshift_8)  # disabled

panel = Panel("filter non-closed polylines")  # disabled
area_4 = Area(Geometry=sec)  # -> Area, Centroid; disabled
null = NullItem(Item=area_4.Area)  # -> NullFlags, InvalidFlags, Description; disabled

cull_4 = CullPattern(List=sec, CullPattern=invert(null.NullFlags))  # disabled
move_4 = Move(Geometry=cull_4, Motion=rev)  # -> Geometry, Transform; disabled
orient_2 = Orient(Geometry=move_4.Geometry, Source=graft(area.Centroid), Target=PlaneXY(0, 0, 0))  # -> Geometry, Transform; disabled
panel_2 = Panel(orient_2.Geometry)  # disabled
runion_2 = RegionUnion(Curves=orient_2.Geometry)  # disabled
pshift_9 = ShiftPaths(Data=runion_2, Offset=-1)  # disabled
lng_5 = ListLength(List=pshift_9)  # disabled
dup_3 = DuplicateData(Data=pshift_9, Number=lng_4, Order=True)  # disabled
pshift_10 = ShiftPaths(Data=dup_3, Offset=-1)  # disabled
partition_5 = PartitionList(List=pshift_10, Size=lng_5)  # disabled
rdiff = RegionDifference(CurvesA=cull_3, CurvesB=partition_5)  # disabled
pshift_11 = ShiftPaths(Data=rdiff, Offset=-1)  # disabled
