# Grasshopper definition Isovist path analysis.gh (Grasshopper 1.0.7)
# Copyright: Co-de-iT
# plug-ins: froGH, Human

# ---- group: isovist path
# Isovist path analysis
crv = Curve(<curve referenced from the Rhino model>)

# ---- group: Obstacles (actual geometries)
mesh = Mesh([<mesh referenced from the Rhino model> x2176])

# ---- group: base point for analysis plane
pt = Point(Point(71.8350264, -18.98025945, 11.5))

# ----
mjoin = MeshJoin(Meshes=flatten(mesh))
xy = XYPlane(Origin=pt)
# © a3 2021 / Creative Commons Attribution-Non Commercial-ShareAlike 4.0 International License
number_slider = Slider(0.714, range=0..1)
project = Project(Geometry=crv, Plane=xy)  # -> Geometry, Transform
sampling_distance = Slider(2, range=0.5..5)

# ---- group: isovist (point along curve)
eval = EvaluateCurve(Curve=reparameterize(project.Geometry), Parameter=number_slider)  # -> Point, Tangent, Angle

# ----
# <title>
# 
# <description>
# 
# code by Alessio Erioli
# 
# v 0.1
swatch = ColourSwatch(SwatchColor=RGB(0, 255, 255))
previewlw = CustomPreviewLineweights(Geometry=project.Geometry, Shader=swatch, Thickness="3", Absolute=False)
dots = DotDisplay(Point=eval.Point, Colour=RGB(0, 0, 0), Size="0.25")

len = Length(Curve=project.Geometry)
division = Division(A=len, B=sampling_distance)
int = Integer(division)
divide = DivideCurve(Curve=project.Geometry, Count=int, Kinks=False)  # -> Points, Tangents, Parameters
# Isovist shape from a point
ivist = IsoVist(Plane=eval.Point, Count=Slider(50, range=10..100), Radius=Slider(50, range=0..100), Obstacles=mjoin)  # -> Points, Distance, Index
pline = PolyLine(Vertices=ivist.Points, Closed="true")  # -> flatten(Polyline)
f_fmesh = FastMeshFromPolyline(Polylines=pline)
f_mrenorm = MeshRebuildNormals(Mesh=f_fmesh)

preview = CustomPreview(Geometry=f_mrenorm, Material=ColourSwatch(SwatchColor=RGBA(0, 255, 255, 155)))

# ----
# These values should be ok for 99% of cases - feel free to adjust them, but be careful
number_slider_2 = Slider(50, range=0..100)

dam = DataDam(DataA=divide.Points, BufferDelay=10000000, BufferMode=0)
# This definition computes inherent geometrical or relational properties of Isovists as ‘measures’ and display spatial representations of how such measures are distributed in space as ‘fields’.
# 
# ‘Local’ isovist measures relate to occupant experience within space.
# 
# For more info on the formulas and meaning of each of the above measurements, visit:
# 
# https://isovists.org/user-guide-category/4-how-the-calculations-work/
panel = Panel("""Area
Perimeter
Average radial
Vista Length (Max radial)
Compactness
Drift
Variance
Skewness""")

# ---- group: Data
list = ValueList({"Area": 0, "Perimeter": 1, "Average radial": 2, "Vista Length (Max radial)": 3, "Compactness": 4, "Drift": 5, "Variance": 6, "Skewness": 7}, selected="Area")

# ----
ivist_2 = IsoVist(Plane=dam, Count=Slider(50, range=10..100), Radius=number_slider_2, Obstacles=mjoin)  # -> Points, Distance, Index
gate = StreamGate(Stream=ivist_2.Points, Gate=list)  # -> Target0, Target1, Target2, Target3, Target4, Target5, Target6, Target7
gate_2 = StreamGate(Stream=ivist_2.Distance, Gate=list)  # -> Target0, Target1, Target2, Target3, Target4, Target5, Target6, Target7
gate_3 = StreamGate(Stream=dam, Gate=list)  # -> Target0, Target1, Target2, Target3, Target4, Target5, Target6, Target7
item = ListItem(List=panel, Index=list, Wrap=True)

# ---- group: Perimeter
pline_2 = PolyLine(Vertices=gate.Target1, Closed="true")  # -> flatten(Polyline)
len_2 = Length(Curve=pline_2)

# ---- group: Drift
pline_3 = PolyLine(Vertices=gate.Target5, Closed="true")  # -> flatten(Polyline)
pcen = PolygonCenter(Polyline=pline_3)  # -> CenterV, CenterE, CenterA
dist = Distance(PointA=gate_3.Target5, PointB=pcen.CenterA)

# ---- group: Variance / Average radial
avr = Average(Input=gate_2.Target6)

# ---- group: Skewness / Average radial
avr_2 = Average(Input=gate_2.Target7)

# ---- group: Area
pdecon = Deconstruct(Point=graft(gate_3.Target0))  # -> XComponent, YComponent, ZComponent
pdecon_2 = Deconstruct(Point=gate.Target0)  # -> XComponent, YComponent, ZComponent
subtraction = Subtraction(A=pdecon_2.XComponent, B=pdecon.XComponent)
subtraction_2 = Subtraction(A=pdecon.YComponent, B=pdecon_2.YComponent)
sqr = Square(Value=subtraction)
lng = ListLength(List=gate.Target0)
sqr_2 = Square(Value=subtraction_2)
addition = Addition(A=sqr, B=sqr_2)
one_over_x = OneOverX(Value=lng)
ma = MassAddition(Input=addition)  # -> Result, PartialResults
pi = Pi(Factor=1)
multiplication = Multiplication(A=ma.Result, B=pi, C=one_over_x)  # -> flatten(Result)

# ---- group: Max radial
sort = SortList(Keys=gate_2.Target3)  # -> Keys, ValuesA
item_2 = ListItem(List=sort.Keys, Index=0, Wrap=True)  # -> flatten(Item1), flatten(Item)

# ---- group: Compactness / Area
pdecon_3 = Deconstruct(Point=graft(gate_3.Target4))  # -> XComponent, YComponent, ZComponent
pdecon_4 = Deconstruct(Point=gate.Target4)  # -> XComponent, YComponent, ZComponent
subtraction_3 = Subtraction(A=pdecon_4.XComponent, B=pdecon_3.XComponent)
subtraction_4 = Subtraction(A=pdecon_3.YComponent, B=pdecon_4.YComponent)
sqr_3 = Square(Value=subtraction_3)
lng_2 = ListLength(List=gate.Target4)
sqr_4 = Square(Value=subtraction_4)
addition_2 = Addition(A=sqr_3, B=sqr_4)
one_over_x_2 = OneOverX(Value=lng_2)
ma_2 = MassAddition(Input=addition_2)  # -> Result, PartialResults
pi_2 = Pi(Factor=1)
multiplication_2 = Multiplication(A=ma_2.Result, B=pi_2, C=one_over_x_2)  # -> flatten(Result)

# ---- group: Compactness
pline_4 = PolyLine(Vertices=gate.Target4, Closed="true")  # -> flatten(Polyline)
len_3 = Length(Curve=pline_4)
compactness = Expression(A=multiplication_2, P=len_3, Expression="4 * π * A/pow(P,2)")

# ---- group: Variance
subtraction_5 = Subtraction(A=gate_2.Target6, B=avr)
sqr_5 = Square(Value=subtraction_5)
avr_3 = Average(Input=sqr_5)
sqrt = SquareRoot(Value=avr_3)  # -> flatten(Result)

# ---- group: Average radial
avr_4 = Average(Input=gate_2.Target2)  # -> flatten(ArithmeticMean)

# ----
pline_5 = PolyLine(Vertices=ivist_2.Points, Closed="true")  # -> flatten(Polyline)
pcen_2 = PolygonCenter(Polyline=pline_5)  # -> CenterV, CenterE, CenterA

# ----
# Drift: the vector connecting the sampling vertex V to the center of the isovist area
# 
# Directionality: considering the isovist rays from a sampling vertex V as vectors from V to the intersection point, the average of those vectors
list_2 = ValueList({"Drift": 0, "Directionality": 1}, selected="Drift")

# ---- group: View drift/directionality
vec2pt = Vector2Pt(PointA=graft(dam), PointB=ivist_2.Points, Unitize=False)  # -> Vector, Length
avr_5 = Average(Input=vec2pt.Vector)  # -> flatten(ArithmeticMean)
number_slider_3 = Slider(0.589, range=0..10)
number_slider_4 = Slider(0.108, range=0..10)
vec2pt_2 = Vector2Pt(PointA=dam, PointB=pcen_2.CenterA, Unitize=False)  # -> Vector, Length
filter = StreamFilter(Gate=list_2, Stream0=vec2pt_2.Vector, Stream1=avr_5)
vlen = VectorLength(Vector=filter)
bnd = Bounds(Numbers=vlen)
dom = ConstructDomain(DomainStart=number_slider_4, DomainEnd=number_slider_3)
remap = RemapNumbers(Value=vlen, Source=bnd, Target=dom)  # -> Mapped, Clipped
amp = Amplitude(Vector=filter, Amplitude=remap.Mapped)
gradient = Gradient(
    LowerLimit=number_slider_4,
    UpperLimit=number_slider_3,
    Parameter=remap.Mapped,
    stops=[0: RGB(0, 128, 0), 0.5: RGB(255, 255, 0), 1: RGB(255, 0, 0)])

# ---- group: Legend Steps
number_slider_5 = Slider(10, range=10..50)

# ---- group: Legend position
pt_2 = Point(Point(82.84578353, -45.23741473, 0))

# ----
pln = Plane(xy)
item_3 = ListItem(List=dam, Index=0, Wrap=True)  # -> Item, Item1
range = Range(Domain=Domain(0, 1), Steps=number_slider_5)
project_2 = Project(Geometry=pt_2, Plane=pln)  # -> Geometry, Transform
dist_2 = Distance(PointA=item_3.Item, PointB=item_3.Item1)
gradient_2 = Gradient(
    LowerLimit=0,
    UpperLimit=1,
    Parameter=range,
    stops=[0.055: RGB(0, 0, 128), 0.252: RGB(1, 192, 229), 0.498: RGB(79, 186, 8), 0.751: RGB(220, 237, 32), 0.951: RGB(255, 0, 0)])
gradient_3 = Gradient(LowerLimit=0, UpperLimit=1, Parameter=range, stops=[0: RGB(0, 0, 0), 1: RGB(255, 255, 255)])
list_3 = ValueList({"Isovist classic": 0, "Grayscale": 1}, selected="Isovist classic")
pl_origin = PlaneOrigin(Base=pln, Origin=project_2.Geometry)
deplane = DeconstructPlane(Plane=pl_origin)  # -> Origin, XAxis, YAxis, ZAxis

# ---- group: avoid visual Z conflict
Z = UnitZ(Factor="0.05")
move = Move(Geometry=dam, Motion=Z)  # -> Geometry, Transform

# ----
multiplication_3 = Multiplication(A=deplane.YAxis, B="-1")
rectangle = Rectangle(Plane=pl_origin, XSize=Slider(1.5, range=0..50), YSize=Slider(20, range=0..50), Radius=0)  # -> Rectangle, Length
multiplication_4 = Multiplication(A=dist_2, B=Slider(0.2, range=0..1))
filter_2 = StreamFilter(Gate=list_3, Stream0=gradient_2, Stream1=gradient_3)
move_2 = Move(Geometry=pl_origin, Motion=multiplication_3)  # -> Geometry, Transform

min_size = Slider(0.1, range=0..1)
max_size = Slider(1, range=0..1)

multiplication_5 = Multiplication(A=sampling_distance, B="0.5")
# vector display
# (turn on if needed)
vdisex = VectorDisplayEx(Point=move.Geometry, Vector=amp, Colour=gradient, Width=2)  # disabled
# legend title
tag = TextTag3D(
    Location=move_2.Geometry,
    Text=item,
    Size=Slider(1, range=0.1..2),
    Colour=ColourSwatch(SwatchColor=RGB(0, 0, 0)),
    Justification=1)
multiplication_6 = Multiplication(A=multiplication_5, B=min_size)
multiplication_7 = Multiplication(A=multiplication_5, B=max_size)
dom_2 = ConstructDomain(DomainStart=multiplication_6, DomainEnd=multiplication_7)

# ---- group: Skewness
subtraction_6 = Subtraction(A=gate_2.Target7, B=avr_2)
cube = Cube(Value=subtraction_6)

# ----
# Isovist data computation
avr_6 = Average(Input=cube)

# ---- group: Skewness (continued)
cbrt = CubeRoot(Value=avr_6)  # -> flatten(Result)

# ----
filter_3 = StreamFilter(
    Gate=list,
    Stream0=multiplication,
    Stream1=len_2,
    Stream2=avr_4,
    Stream3=item_2.Item1,
    Stream4=compactness,
    Stream5=dist,
    Stream6=sqrt,
    Stream7=cbrt)
bnd_2 = Bounds(Numbers=filter_3)
remap_2 = RemapNumbers(Value=filter_3, Source=bnd_2, Target=Domain(0, 1))  # -> Mapped, Clipped
range_2 = Range(Domain=bnd_2, Steps=number_slider_5)
expression = Expression(x=range_2, Expression="Format(\"{0:0.00}\", x)")
gradient_4 = Gradient(
    LowerLimit=0,
    UpperLimit=1,
    Parameter=remap_2.Mapped,
    stops=[0.055: RGB(0, 0, 128), 0.252: RGB(1, 192, 229), 0.498: RGB(79, 186, 8), 0.751: RGB(220, 237, 32), 0.951: RGB(255, 0, 0)])
gradient_5 = Gradient(LowerLimit=0, UpperLimit=1, Parameter=remap_2.Mapped, stops=[0: RGB(0, 0, 0), 1: RGB(255, 255, 255)])
expression_2 = Expression(x=filter_3, Expression="Format(\"{0:0.00}\", x)")
filter_4 = StreamFilter(Gate=list_3, Stream0=gradient_4, Stream1=gradient_5)

# ----
# data display
# (turn on if needed)
tag_2 = TextTag3D(
    Location=move.Geometry,
    Text=expression_2,
    Size=multiplication_4,
    Colour=ColourSwatch(SwatchColor=RGB(10, 160, 194)),
    Justification=5)  # disabled

# ----
# legend
legend = Legend(Colour=filter_2, Tags=expression, Rectangle=rectangle.Rectangle, LegendType=1)
remap_3 = RemapNumbers(Value=remap_2.Mapped, Source=Domain(0, 1), Target=dom_2)  # -> Mapped, Clipped
# dot display
dots_2 = DotDisplay(Point=dam, Colour=filter_4, Size=remap_3.Mapped)
