# Grasshopper definition Isovist plan analysis.gh (Grasshopper 1.0.7)
# Copyright: Co-de-iT
# plug-ins: froGH, Human

grid_plane_angle = Slider(0, range=-3.142..3.142)
grid_y_extension = Slider(46.214, range=0..100)
cell_size_resolution = Slider(1, range=0.1..10)
grid_x_extension = Slider(65.866, range=0..200)

# ---- group: Obstacles (actual geometries)
# Isovist plan analysis
mesh = Mesh([<mesh referenced from the Rhino model> x2176])

# ---- group: base point for analysis plane
pt = Point(Point(71.8350264, -18.98025945, 11.5))

# ---- group: Test geometry / Sample Geometry
mesh_2 = Mesh([<mesh referenced from the Rhino model> x7])

# ---- group: Test geometry
pt_2 = Point(Point(0.1, 0.1, 9.5))
cell_size_resolution_2 = Slider(0.25, range=0.1..10)
division = Division(A="9.8", B=cell_size_resolution_2)
division_2 = Division(A="9.8", B=cell_size_resolution_2)
rectangle = Rectangle(Plane=pt_2, XSize="9.8", YSize="9.8", Radius=0)  # -> Rectangle, Length
int = Integer(division)
int_2 = Integer(division_2)
mjoin = MeshJoin(Meshes=flatten(mesh_2))
mplane = MeshPlane(Boundary=rectangle.Rectangle, WidthCount=int, HeightCount=int_2)  # -> Mesh, Area
n_cells = Panel([int, int_2])

# ----
prot = RotatePlane(Plane=pt, Angle=grid_plane_angle)
division_3 = Division(A=grid_x_extension, B=cell_size_resolution)
division_4 = Division(A=grid_y_extension, B=cell_size_resolution)
# <title>
# 
# <description>
# 
# code by Alessio Erioli
# 
# v 0.1
# © a3 2021 / Creative Commons Attribution-Non Commercial-ShareAlike 4.0 International License
case = ValueList({"Actual": 0, "Test Geometry": 1}, selected="Actual")
mjoin_2 = MeshJoin(Meshes=flatten(mesh))
rectangle_2 = Rectangle(Plane=prot, XSize=grid_x_extension, YSize=grid_y_extension, Radius=0)  # -> Rectangle, Length
int_3 = Integer(division_3)
int_4 = Integer(division_4)
n_cells_2 = Panel([int_3, int_4])
mplane_2 = MeshPlane(Boundary=rectangle_2.Rectangle, WidthCount=int_3, HeightCount=int_4)  # -> Mesh, Area

# ---- group: Obstacles
filter = StreamFilter(Gate=case, Stream0=mjoin_2, Stream1=mjoin)

# ---- group: Grid
filter_2 = StreamFilter(Gate=case, Stream0=mplane_2.Mesh, Stream1=mplane.Mesh)

# ---- group: only cells within the plan
# Height to be considered as part of the same level (pointing down)
number_slider = Slider(3, range=1..20)

facen = FaceNormals(Mesh=filter_2)  # -> Centers, Normals
panel = Panel("3")
line = LineSDL(Start=facen.Centers, Direction="0,0,-1", Length=number_slider)
mcx = MeshCurve(Mesh=filter, Curve=line)  # -> Points, Faces
lng = ListLength(List=mcx.Points)  # -> flatten(Length)
equals = Equality(FirstNumber=lng, SecondNumber="0")  # -> Equality, Inequality
cullf = CullFaces(Mesh=filter_2, Pattern=equals.Equality)

# ---- group: Analysis area
list = ValueList({"Full grid": 0, "Plan only": 1}, selected="Plan only")

# ----
filter_3 = StreamFilter(Gate=list, Stream0=filter_2, Stream1=cullf)

# ----
# These values should be ok for 99% of cases - feel free to adjust them, but be careful
number_slider_2 = Slider(55, range=0..100)

demesh = DeconstructMesh(Mesh=filter_3)  # -> Vertices, Faces, Colours, Normals

# ---- group: Display Sample points (debug)
f_pcd = PointCloudDisplay(Points=demesh.Vertices, Size="2")

# ----
# This definition computes inherent geometrical or relational properties of Isovists as ‘measures’ and display spatial representations of how such measures are distributed in space as ‘fields’.
# 
# ‘Local’ isovist measures relate to occupant experience within space.
# 
# For more info on the formulas and meaning of each of the above measurements, visit:
# 
# https://isovists.org/user-guide-category/4-how-the-calculations-work/
panel_2 = Panel("""Area
Perimeter
Average radial
Vista Length (Max radial)
Compactness
Drift
Variance
Skewness""")

# ---- group: Data
list_2 = ValueList({"Area": 0, "Perimeter": 1, "Average radial": 2, "Vista Length (Max radial)": 3, "Compactness": 4, "Drift": 5, "Variance": 6, "Skewness": 7}, selected="Area")

# ----
ivist = IsoVist(Plane=demesh.Vertices, Count=Slider(60, range=10..360), Radius=number_slider_2, Obstacles=filter)  # -> Points, Distance, Index
gate = StreamGate(Stream=ivist.Points, Gate=list_2)  # -> Target0, Target1, Target2, Target3, Target4, Target5, Target6, Target7
gate_2 = StreamGate(Stream=ivist.Distance, Gate=list_2)  # -> Target0, Target1, Target2, Target3, Target4, Target5, Target6, Target7
gate_3 = StreamGate(Stream=demesh.Vertices, Gate=list_2)  # -> Target0, Target1, Target2, Target3, Target4, Target5, Target6, Target7
item = ListItem(List=panel_2, Index=list_2, Wrap=True)

# ---- group: Perimeter
pline = PolyLine(Vertices=gate.Target1, Closed="true")  # -> flatten(Polyline)
len = Length(Curve=pline)

# ---- group: Drift
pline_2 = PolyLine(Vertices=gate.Target5, Closed="true")  # -> flatten(Polyline)
pcen = PolygonCenter(Polyline=pline_2)  # -> CenterV, CenterE, CenterA
dist = Distance(PointA=gate_3.Target5, PointB=pcen.CenterA)

# ---- group: Variance / Average radial
avr = Average(Input=gate_2.Target6)

# ---- group: Skewness / Average radial
avr_2 = Average(Input=gate_2.Target7)

# ---- group: Area
pdecon = Deconstruct(Point=graft(gate_3.Target0))  # -> XComponent, YComponent, ZComponent
pdecon_2 = Deconstruct(Point=gate.Target0)  # -> XComponent, YComponent, ZComponent
subtraction = Subtraction(A=pdecon_2.XComponent, B=pdecon.XComponent)
subtraction_2 = Subtraction(A=pdecon.YComponent, B=pdecon_2.YComponent)
sqr = Square(Value=subtraction)
lng_2 = ListLength(List=gate.Target0)
sqr_2 = Square(Value=subtraction_2)
addition = Addition(A=sqr, B=sqr_2)
one_over_x = OneOverX(Value=lng_2)
ma = MassAddition(Input=addition)  # -> Result, PartialResults
pi = Pi(Factor=1)
multiplication = Multiplication(A=ma.Result, B=pi, C=one_over_x)  # -> flatten(Result)

# ---- group: Max radial
sort = SortList(Keys=gate_2.Target3)  # -> Keys, ValuesA
item_2 = ListItem(List=sort.Keys, Index=0, Wrap=True)  # -> flatten(Item1), flatten(Item)

# ---- group: Compactness / Area
pdecon_3 = Deconstruct(Point=graft(gate_3.Target4))  # -> XComponent, YComponent, ZComponent
pdecon_4 = Deconstruct(Point=gate.Target4)  # -> XComponent, YComponent, ZComponent
subtraction_3 = Subtraction(A=pdecon_4.XComponent, B=pdecon_3.XComponent)
subtraction_4 = Subtraction(A=pdecon_3.YComponent, B=pdecon_4.YComponent)
sqr_3 = Square(Value=subtraction_3)
lng_3 = ListLength(List=gate.Target4)
sqr_4 = Square(Value=subtraction_4)
addition_2 = Addition(A=sqr_3, B=sqr_4)
one_over_x_2 = OneOverX(Value=lng_3)
ma_2 = MassAddition(Input=addition_2)  # -> Result, PartialResults
pi_2 = Pi(Factor=1)
multiplication_2 = Multiplication(A=ma_2.Result, B=pi_2, C=one_over_x_2)  # -> flatten(Result)

# ---- group: Compactness
pline_3 = PolyLine(Vertices=gate.Target4, Closed="true")  # -> flatten(Polyline)
len_2 = Length(Curve=pline_3)
compactness = Expression(A=multiplication_2, P=len_2, Expression="4 * π * A/pow(P,2)")

# ---- group: Variance
subtraction_5 = Subtraction(A=gate_2.Target6, B=avr)
sqr_5 = Square(Value=subtraction_5)
avr_3 = Average(Input=sqr_5)
sqrt = SquareRoot(Value=avr_3)  # -> flatten(Result)

# ---- group: Average radial
avr_4 = Average(Input=gate_2.Target2)  # -> flatten(ArithmeticMean)

# ----
pline_4 = PolyLine(Vertices=ivist.Points, Closed="true")  # -> flatten(Polyline)
pcen_2 = PolygonCenter(Polyline=pline_4)  # -> CenterV, CenterE, CenterA

# ----
# Drift: the vector connecting the sampling vertex V to the center of the isovist area
# 
# Directionality: considering the isovist rays from a sampling vertex V as vectors from V to the intersection point, the average of those vectors
list_3 = ValueList({"Drift": 0, "Directionality": 1}, selected="Drift")

# ---- group: View drift/directionality
vec2pt = Vector2Pt(PointA=graft(demesh.Vertices), PointB=ivist.Points, Unitize=False)  # -> Vector, Length
avr_5 = Average(Input=vec2pt.Vector)  # -> flatten(ArithmeticMean)
number_slider_3 = Slider(0.589, range=0..10)
number_slider_4 = Slider(0.108, range=0..10)
vec2pt_2 = Vector2Pt(PointA=demesh.Vertices, PointB=pcen_2.CenterA, Unitize=False)  # -> Vector, Length
filter_4 = StreamFilter(Gate=list_3, Stream0=vec2pt_2.Vector, Stream1=avr_5)
vlen = VectorLength(Vector=filter_4)
bnd = Bounds(Numbers=vlen)
dom = ConstructDomain(DomainStart=number_slider_4, DomainEnd=number_slider_3)
remap = RemapNumbers(Value=vlen, Source=bnd, Target=dom)  # -> Mapped, Clipped
amp = Amplitude(Vector=filter_4, Amplitude=remap.Mapped)
gradient = Gradient(
    LowerLimit=number_slider_4,
    UpperLimit=number_slider_3,
    Parameter=remap.Mapped,
    stops=[0: RGB(0, 128, 0), 0.5: RGB(255, 255, 0), 1: RGB(255, 0, 0)])

# ---- group: Legend Steps
number_slider_5 = Slider(10, range=10..50)

# ---- group: Legend position
pt_3 = Point(Point(82.84578353, -45.23741473, 0))

# ----
pln = Plane(prot)
item_3 = ListItem(List=demesh.Vertices, Index=0, Wrap=True)  # -> Item, Item1
range = Range(Domain=Domain(0, 1), Steps=number_slider_5)
project = Project(Geometry=pt_3, Plane=pln)  # -> Geometry, Transform
dist_2 = Distance(PointA=item_3.Item, PointB=item_3.Item1)
gradient_2 = Gradient(
    LowerLimit=0,
    UpperLimit=1,
    Parameter=range,
    stops=[0.055: RGB(0, 0, 128), 0.252: RGB(1, 192, 229), 0.498: RGB(79, 186, 8), 0.751: RGB(220, 237, 32), 0.951: RGB(255, 0, 0)])
gradient_3 = Gradient(LowerLimit=0, UpperLimit=1, Parameter=range, stops=[0: RGB(0, 0, 0), 1: RGB(255, 255, 255)])
list_4 = ValueList({"Isovist classic": 0, "Grayscale": 1}, selected="Isovist classic")
pl_origin = PlaneOrigin(Base=pln, Origin=project.Geometry)
deplane = DeconstructPlane(Plane=pl_origin)  # -> Origin, XAxis, YAxis, ZAxis

# ---- group: avoid visual Z conflict
Z = UnitZ(Factor="0.05")
move = Move(Geometry=demesh.Vertices, Motion=Z)  # -> Geometry, Transform

# ----
multiplication_3 = Multiplication(A=deplane.YAxis, B="-1")
rectangle_3 = Rectangle(Plane=pl_origin, XSize=Slider(1.5, range=0..50), YSize=Slider(20, range=0..50), Radius=0)  # -> Rectangle, Length
multiplication_4 = Multiplication(A=dist_2, B=Slider(0.2, range=0..1))
filter_5 = StreamFilter(Gate=list_4, Stream0=gradient_2, Stream1=gradient_3)
move_2 = Move(Geometry=pl_origin, Motion=multiplication_3)  # -> Geometry, Transform
# vector display
# (turn on if needed)
vdisex = VectorDisplayEx(Point=move.Geometry, Vector=amp, Colour=gradient, Width=2)  # disabled
# legend title
tag = TextTag3D(
    Location=move_2.Geometry,
    Text=item,
    Size=Slider(1, range=0.1..2),
    Colour=ColourSwatch(SwatchColor=RGB(0, 0, 0)),
    Justification=1)
range_2 = Range(Domain=Domain(0, 1), Steps=Slider(10, range=10..30))

# ---- group: Analysis area display
medges = MeshEdges(Mesh=filter_2)  # -> NakedEdges, InteriorEdges, NonManifoldEdges
join = JoinCurves(Curves=medges.NakedEdges, Preserve=False)

# ----
offset = OffsetCurve(Curve=join, Distance=1, Corners=1)

# ---- group: Analysis area display (continued)
dash = DashPattern(Curve=offset, Pattern="0.25")  # -> Dashes, Gaps
previewlw = CustomPreviewLineweights(Geometry=dash.Dashes, Shader=ColourSwatch(SwatchColor=RGB(117, 117, 117)), Absolute=False)

# ---- group: Skewness
subtraction_6 = Subtraction(A=gate_2.Target7, B=avr_2)
cube = Cube(Value=subtraction_6)

# ----
# Isovist data computation
avr_6 = Average(Input=cube)

# ---- group: Skewness (continued)
cbrt = CubeRoot(Value=avr_6)  # -> flatten(Result)

# ----
filter_6 = StreamFilter(
    Gate=list_2,
    Stream0=multiplication,
    Stream1=len,
    Stream2=avr_4,
    Stream3=item_2.Item1,
    Stream4=compactness,
    Stream5=dist,
    Stream6=sqrt,
    Stream7=cbrt)
bnd_2 = Bounds(Numbers=filter_6)
remap_2 = RemapNumbers(Value=filter_6, Source=bnd_2, Target=Domain(0, 1))  # -> Mapped, Clipped
range_3 = Range(Domain=bnd_2, Steps=number_slider_5)
expression = Expression(x=range_3, Expression="Format(\"{0:0.00}\", x)")
gradient_4 = Gradient(
    LowerLimit=0,
    UpperLimit=1,
    Parameter=remap_2.Mapped,
    stops=[0.055: RGB(0, 0, 128), 0.252: RGB(1, 192, 229), 0.498: RGB(79, 186, 8), 0.751: RGB(220, 237, 32), 0.951: RGB(255, 0, 0)])
gradient_5 = Gradient(LowerLimit=0, UpperLimit=1, Parameter=remap_2.Mapped, stops=[0: RGB(0, 0, 0), 1: RGB(255, 255, 255)])
expression_2 = Expression(x=filter_6, Expression="Format(\"{0:0.00}\", x)")
filter_7 = StreamFilter(Gate=list_4, Stream0=gradient_4, Stream1=gradient_5)
mcol = MeshColours(Mesh=filter_3, Colours=filter_7)

# ----
# data display
# (turn on if needed)
tag_2 = TextTag3D(
    Location=move.Geometry,
    Text=expression_2,
    Size=multiplication_4,
    Colour=ColourSwatch(SwatchColor=RGB(10, 160, 194)),
    Justification=5)  # disabled

# ----
# legend
legend = Legend(Colour=filter_5, Tags=expression, Rectangle=rectangle_3.Rectangle, LegendType=1)
filter_8 = StreamFilter(Gate=list_4, Stream1=mcol)
f_miso = MeshIsocurves(Mesh=filter_8, ColorChannel=0, Isovalue=range_2)

# ----
# isocurves display
# (only for grayscale gradient)
previewlw_2 = CustomPreviewLineweights(Geometry=f_miso, Shader=ColourSwatch(SwatchColor=RGB(255, 0, 204)), Thickness="2", Absolute=False)
