# Grasshopper definition base part_2 AO_env-Field_multiple start.gh (Grasshopper 1.0.7)
# Copyright: Co-de-iT
# plug-ins: Assembler, Human, froGH

# ----
# Handles
# Handle che sembrano visivamente identiche potrebbero non esserlo: la normale potrebbe puntare all'interno della Collision Mesh.
# 
# In questi casi, potete usare il comando "Flip" in Rhino per invertire il verso della polilinea.
crv = Curve(<curve referenced from the Rhino model>)
crv_2 = Curve(<curve referenced from the Rhino model>)
# 0
# 1
crv_3 = Curve(<curve referenced from the Rhino model>)
# parti editabili
# Setup
# bake
# preview on/off
# nel disegnare le L polylines per le Handles la sequenza dei punti è fondamentale, e deve essere fatta in modo che la normale sia sempre USCENTE relativamente alla Collision Mesh
# 2
crv_4 = Curve(<curve referenced from the Rhino model>)
# Il componente Display Handle visualizza la normale come una linea nera puntinata. Utilizzatelo per verificate la direzione della normale
crv_5 = Curve(<curve referenced from the Rhino model>)
panel = Panel("""0
90""")
handcon = ConstructHandle(Polyline=crv, RotationAngles=0, Type="1", Weight=1)
handcon_2 = ConstructHandle(Polyline=crv_2, RotationAngles=0, Type="1", Weight=1)
handcon_3 = ConstructHandle(Polyline=crv_3, RotationAngles=0, Type=0, Weight=1)
handcon_4 = ConstructHandle(Polyline=crv_5, RotationAngles=0, Type=0, Weight=1)
handcon_5 = ConstructHandle(Polyline=crv_4, RotationAngles=0, Type=0, Weight=1)

# ----
# Handles
crv_6 = Curve(<curve referenced from the Rhino model>)
crv_7 = Curve(<curve referenced from the Rhino model>)
crv_8 = Curve(<curve referenced from the Rhino model>)
crv_9 = Curve(<curve referenced from the Rhino model>)
panel_6 = Panel("""0
180""")
handcon_6 = ConstructHandle(Polyline=crv_6, RotationAngles=panel_6, Type="2", Weight=1)
handcon_7 = ConstructHandle(Polyline=crv_7, RotationAngles=0, Type=0, Weight=1)
handcon_8 = ConstructHandle(Polyline=crv_9, RotationAngles=0, Type=0, Weight=1)
handcon_9 = ConstructHandle(Polyline=crv_8, RotationAngles=0, Type=0, Weight=1)

# ----
# Environment
mesh = Mesh(<mesh referenced from the Rhino model>)
mesh_2 = Mesh(<mesh referenced from the Rhino model>)
mesh_3 = Mesh(<mesh referenced from the Rhino model>)
mesh_4 = Mesh(<mesh referenced from the Rhino model>)
mesh_5 = Mesh(<mesh referenced from the Rhino model>)
merge = Merge(Data1=mesh_2, Data2=mesh_3, Data3=mesh_5, Data4=mesh, Data5=mesh_4)

crv_10 = Curve(<curve referenced from the Rhino model>)
crv_11 = Curve(<curve referenced from the Rhino model>)
crv_12 = Curve(<curve referenced from the Rhino model>)

# ---- group: Field box
mesh_6 = Mesh(<mesh referenced from the Rhino model>)

# ---- group: compute scalar values / Scalar values curve
crv_13 = Curve(crv_10)

# ----
previewlw = CustomPreviewLineweights(Geometry=crv_13, Shader=ColourSwatch(SwatchColor=RGB(255, 0, 255)), Thickness="5", Absolute=False)

# ----
# Collision mesh (spazio occupato)
mesh_7 = Mesh(<mesh referenced from the Rhino model>)

# ----
# AssemblyObject 01
number_slider = Slider(0.355, range=0..1)
merge_2 = Merge(Data1=handcon_5, Data2=handcon_3, Data3=handcon_4, Data4=handcon_2, Data5=handcon)
# <title>
# 
# <description>
# 
# code by Alessio Erioli
# 
# v 0.1
# © a3 2021 / Creative Commons Attribution-Non Commercial-ShareAlike 4.0 International License
name = Panel("Part_01")
handdisp = DisplayHandles(Handles=merge_2, DisplaySize=number_slider, absHTextSize=False)
aocon = ConstructAssemblyObject(Name=name, CollisionMesh=mesh_7, Direction=Vector(1, 0, 0), Handles=merge_2, Weight=1, ZLockAO=False)

# ----
# Collision mesh (spazio occupato)
mesh_8 = Mesh(<mesh referenced from the Rhino model>)

# ----
# AssemblyObject 02
number_slider_2 = Slider(0.355, range=0..1)
merge_3 = Merge(Data1=handcon_9, Data2=handcon_7, Data3=handcon_8, Data4=handcon_6)
name_2 = Panel("Part_02")
handdisp_2 = DisplayHandles(Handles=merge_3, DisplaySize=number_slider_2, absHTextSize=False)
aocon_2 = ConstructAssemblyObject(Name=name_2, CollisionMesh=mesh_8, Direction=Vector(1, 0, 0), Handles=merge_3, Weight=1, ZLockAO=False)

# ---- group: config c1
mesh_9 = Mesh([<mesh referenced from the Rhino model> x26])

# ---- group: config c2
mesh_10 = Mesh([<mesh referenced from the Rhino model> x13])

# ---- group: floor
mesh_11 = Mesh(<mesh referenced from the Rhino model>)

# ---- group: short wall 1
mesh_12 = Mesh(<mesh referenced from the Rhino model>)

# ---- group: short wall 2
mesh_13 = Mesh(<mesh referenced from the Rhino model>)

# ---- group: floor 1
mesh_14 = Mesh(<mesh referenced from the Rhino model>)

# ---- group: floor
mesh_15 = Mesh(<mesh referenced from the Rhino model>)

# ---- group: floor 2
mesh_16 = Mesh(<mesh referenced from the Rhino model>)

# ---- group: floor 3
mesh_17 = Mesh(<mesh referenced from the Rhino model>)

# ---- group: wall
mesh_18 = Mesh(<mesh referenced from the Rhino model>)

# ---- group: pillars
mesh_19 = Mesh([<mesh referenced from the Rhino model> x2])

# ----
# XData
merge_4 = Merge(Data1=mesh_11, Data2=mesh_12, Data3=mesh_13)
mjoin = MeshJoin(Meshes=flatten(merge_4))
xdcon = ConstructXData(Label="geometry1", AssemblyObject=aocon, Data=mjoin)
xdcon_2 = ConstructXData(Label="c1", AssemblyObject=aocon, Data=mesh_9)
xdcon_3 = ConstructXData(Label="c2", AssemblyObject=aocon, Data=mesh_10)

# ----
# XData
merge_5 = Merge(Data1=mesh_15, Data2=mesh_18)
merge_6 = Merge(Data1=mesh_14, Data2=mesh_16, Data3=mesh_17, Data4=mesh_19)
mjoin_2 = MeshJoin(Meshes=flatten(merge_5))
mjoin_3 = MeshJoin(Meshes=flatten(merge_6))
xdcon_4 = ConstructXData(Label="geometryV", AssemblyObject=aocon_2, Data=mjoin_3)
xdcon_5 = ConstructXData(Label="geometryH", AssemblyObject=aocon_2, Data=mjoin_2)

merge_7 = Merge(Data1=xdcon_5, Data2=xdcon_4)
swatch = ColourSwatch(SwatchColor=RGBA(204, 204, 204, 75))
merge_8 = Merge(Data1=aocon, Data2=aocon_2)
merge_9 = Merge(Data1=xdcon, Data2=xdcon_2, Data3=xdcon_3, Data4=merge_7)

pt = Point(Point(-79.61875306, 67.38915221, 0))
pt_2 = Point(Point(-110.0751849, 25.50634885, 0))
pt_3 = Point(Point(-55.54210674, -19.88865892, 22.52532712))
pt_4 = Point(Point(-110.0751849, 57.3488268, 32.18591981))
yz = YZPlane(Origin=pt_4)
xz = XZPlane(Origin=pt_3)
prot = RotatePlane(Plane=yz, Angle=degrees("90"))
merge_10 = Merge(Data1=pt, Data2=pt_2)
ao = AssemblyObject(aocon)
ao_2 = AssemblyObject(aocon_2)
merge_11 = Merge(Data1=xz, Data2=prot)
aoerplane = ExtractReferencePlane(AssemblyObject=ao)
xy = XYPlane(Origin=merge_10)
aoerplane_2 = ExtractReferencePlane(AssemblyObject=ao_2)
orient = Orient(Geometry=ao, Source=aoerplane, Target=xy)  # -> Geometry, Transform
orient_2 = Orient(Geometry=ao_2, Source=aoerplane_2, Target=merge_11)  # -> Geometry, Transform
merge_12 = Merge(Data1=orient.Geometry, Data2=orient_2.Geometry)

# ---- group: origin point
pt_5 = Point(Point(0, 20, 0))

# ----
# Rules (Heuristics)
heuwri = HeuristicsWriter(AssemblyObjectsSet=merge_8, noSH=False, noSO=False, xHT=False)
# Simulation
heud = HeuristicDisplay(
    OriginPoint=pt_5,
    AssemblyObjectsSet=merge_8,
    XData=merge_9,
    HeuristicsSet=heuwri,
    XSize=1.2,
    YSize=1.2,
    TextSize=1,
    NRows=Slider(5, range=2..10),
    DisplayType="AO Types",
    ZLockFilter=False)

# ----
# Heuristics
# Settings
sender_selection_mode = ValueList({"Random": 0, "Scalar Field nearest": 1, "Scalar Field interpolated": 2, "Vector Field > nearest": 3, "Vector Field > interpolated": 4, "Vector Field <> nearest": 5, "Vector Field <> interpolated": 6, "Minimum local AABB volume": 7, "Minimum local AABB diagonal": 8, "Weighted Random Choice": 9}, selected="Scalar Field nearest")
receiver_selection_mode = ValueList({"Random": 0, "Scalar Field nearest": 1, "Scalar Field interpolated": 2, "Dense Packing": 3}, selected="Scalar Field nearest")
heuset = HeuristicsSettings(
    HeuristicsSet=heuwri,
    CurrentHeuristics=0,
    HeuristicsMode=0,
    ReceiverSelectionMode=receiver_selection_mode,
    SenderRuleSelectionMode=sender_selection_mode)

# ----
# display environment geometries names
# IMPORTANT: Objects must be named in Rhino
cluster = Cluster(environment_geometries=merge)

step = Button()
go = BooleanToggle(False)
target_number = Panel("600")

reset_settings = Button()

# ---- group: starting plane (XY implicito)
pt_6 = Point(Point(-62.53285728, -28.21013159, 0))

# ----
# se si cambia qualcosa a monte (eccetto per gli XData) resettare l'engine
reset = Button()

# ---- group: Orientation Colour Legend
# Post-processing
# Orientation Display: Orientation colors components according to their Direction Vector (input D in Construct AO)
# 
# Colors are represented as RGB (Red, Green, Blue channels), with values from 0 to 255 for each channel.
# 
# Direction vectors coordinates range from -1 to 1. Es: 1,0,0 is the X direction vector, 0,0,-1 is the negative Z direction.
# 
# Colors use the x, y, z coordinates as R, G, B respectively, with coordinate -1 corresponding to a color value of 0 and 1 to 255; 0 corresponds to 128.
# 
# Ex: the direction vector X is translated into the color 255, 128, 128 (salmon red), while -X is 0, 128, 128 (blue-green).
image = ImageSampler(
    FilePath="C:\Users\aless\Documents\_Università\a3\a3 2023-24\_GitHub copy\code\20231031_c05_GH-Assembler 3\Orientation Colour legend.png",
    Filter="Colour",
    Interpolate=False,
    Umax=1,
    Umin=0,
    Vmax=1,
    Vmin=0,
    Wrap=1)

# ----
color_by = ValueList({"Assembler": 0, "Clusters": 1}, selected="Clusters")

# ----
# Field
number_slider_3 = Slider(20, range=10..30)
afieldn = ConstructFieldN(Geometry=mesh_6, Plane=PlaneXY(0, 0, 0), NCells=number_slider_3)  # -> Field, FieldPoints
merge_13 = Merge(Data1=ColourSwatch(SwatchColor=RGB(255, 0, 255)), Data2=ColourSwatch(SwatchColor=RGB(0, 0, 0)))

# ---- group: compute vector values
pdecon = Deconstruct(Point=afieldn.FieldPoints)  # -> XComponent, YComponent, ZComponent
larger = LargerThan(FirstNumber=pdecon.ZComponent, SecondNumber=Slider(35.544, range=0..100))  # -> LargerThan, OrEqualTo
Y = UnitY(Factor=1)
X = UnitX(Factor=1)
weave = Weave(Pattern=graft(larger.LargerThan), Stream0=Y, Stream1=X, NullGaps=False)  # -> flatten(Weave)

# ---- group: compute scalar values
crv_cp = CurveClosestPoint(Point=afieldn.FieldPoints, Curve=crv_13)  # -> Point, Parameter, Distance

# ----
sqr = Square(Value=crv_cp.Distance)
sqrt = SquareRoot(Value=crv_cp.Distance)

afpop = PopulateField(Field=afieldn.Field, ScalarValues=sqrt, VectorValues=weave)

# ----
# Exogenous
# (environment)
# Settings
field_scalar_threshold = Slider(0.382, range=0..1)

afcol = ColorField(Field=afpop, Colors=merge_13, Index=0, Threshold=field_scalar_threshold, FieldColorBlend=False)  # -> Field, Colors
afdecon = DeconstructField(Field=afcol.Field)  # -> Points, flatten(ScalarValues), flatten(Vectors), IWeights, Colors, Topology, TopologyWeights
multiplication = Multiplication(A=afdecon.Vectors, B=Slider(3.63, range=1..5))
vdisex = VectorDisplayEx(Point=afdecon.Points, Vector=multiplication, Colour=afdecon.Vectors, Width=2)

# ---- group: Text Scalar
expression = Expression(x=afdecon.ScalarValues, Expression="Format(\"{0:0.00}\", x)")
tag = TextTag3D(Location=afdecon.Points, Text=expression, Size=Slider(1.5, range=1..3), Justification=7)  # disabled

# ----
exoset = ExogenousSettings(
    EnvironmentMode="2",
    Field=afcol.Field,
    FieldScalarThreshold=field_scalar_threshold,
    Sandbox={Plane=PlaneXY(0, 0, 0), X=Domain(-1, 1), Y=Domain(0, 0), Z=Domain(0, 0)},
    HasContainer=False)

aoaengine = AssemblerEngine(
    AssemblyObjectsSet=merge_8,
    PreviousAssemblage=merge_12,
    StartingPlane=PlaneXY(0, 0, 0),
    StartingObjectType=0,
    HeuristicsSettings=heuset,
    ExogenousSettings=exoset,
    Go=go,
    Step=step,
    NIterations=Slider(100, range=10..100),
    TargetMaxNObjects=target_number,
    ResetSettings=reset_settings,
    Reset=reset,
    UseSupports=False,
    ZLockCheck=False)  # -> Assemblage, AssemblageCount

# ---- group: autostop condition
larger_2 = LargerThan(FirstNumber=aoaengine.AssemblageCount, SecondNumber=target_number)  # -> LargerThan, OrEqualTo
f_tas = ToggleAutostop(Toggle=go, Condition=larger_2.OrEqualTo)

# ----
dam = DataDam(DataA=aoaengine.Assemblage, BufferDelay=10000000, BufferMode=0)
n_of_ao = Panel(aoaengine.AssemblageCount)
aoadecon = DeconstructAssemblage(Assemblage=dam)  # -> AssemblageObjects, AssemblageRules, ReceiverObjectsIndexes, AvailableObjectIndexes, UnreachableObjectIndexes
associate_xdata = AssociateXData(AssemblyObjects=aoadecon.AssemblageObjects, XData=merge_9)  # "AO<>XD"

# ---- group: Extract Topology
aoatopo = ExtractTopology(Assemblage=dam)  # -> HandleOccupancy, NeighbourObjectIndex, NeighbourHandleIndex

# ---- group: filter only connected Handles
equals = Equality(FirstNumber=aoatopo.HandleOccupancy, SecondNumber="1")  # -> Equality, Inequality
cull = CullPattern(List=aoatopo.NeighbourObjectIndex, CullPattern=equals.Equality)  # -> simplify(List)

# ---- group: froGH - Clusterizer
f_clstr = Clusterizer(TopologyData=cull)

# ----
aoadisp = DisplayAssemblage(Assemblage=dam, ColorsOnly=False, OutputType="Occupancy")  # -> ColoredCollisionMeshes, Edges, Colors, Values
graft = GraftTree(Tree=aoadisp.Colors, IncludeEmptyLists=True, IncludeNullItems=True)  # -> simplify(Tree)

preview = CustomPreview(
    Geometry=aoadisp.ColoredCollisionMeshes,
    Material={diffuse=RGB(221, 160, 221), emission=RGB(66, 48, 66), shine=0.5, specular=RGB(255, 255, 255), transparency=0})  # disabled
# edges (bordi) delle collision Meshes
previewlw_2 = CustomPreviewLineweights(Geometry=aoadisp.Edges, Shader=ColourSwatch(SwatchColor=RGB(128, 128, 128)), Absolute=False)

# ----
# identify type 1 Horizontal-Vertical
data = Data(aoadecon.AssemblageObjects)

# ---- group: identify type
aoetype = ExtractType(AssemblyObject=data)
equals_2 = Equality(FirstNumber=aoetype, SecondNumber="1")  # -> Equality, Inequality

# ---- group: separate types
dispatch = Dispatch(List=data, DispatchPattern=equals_2.Equality)  # -> ListA, ListB

# ---- group: identify horizontal-vertical alignment
aoerplane_3 = ExtractReferencePlane(AssemblyObject=dispatch.ListA)
deplane = DeconstructPlane(Plane=aoerplane_3)  # -> Origin, XAxis, YAxis, ZAxis
Z = UnitZ(Factor=1)
dprod = DotProduct(VectorA=deplane.XAxis, VectorB=Z, Unitize=False)
abs = Absolute(Value=dprod)

# ----
lng = ListLength(List=dispatch.ListB)
repeat = RepeatData(Data="0", Length=lng)

# ---- group: regroup types
weave_2 = Weave(Pattern=equals_2.Equality, Stream0=repeat, Stream1=abs, NullGaps=False)

# ----
item = ListItem(List=associate_xdata, Index=weave_2, Wrap=True)
xddecon = DeconstructXData(XData=item)  # -> Label, AssemblyObjectNameReference, ReferencePlane, Data

# ----
# Utilizzate questo componente per fare il bake su Rhino
mesh_20 = Mesh(xddecon.Data)

f_mmeea = MeshesExtractEdgesWithToleranceAngle(Mesh=mesh_20, Angle=45)  # -> InternalEdges, NakedEdges
# edges (bordi) delle geometrie effettive
previewlw_3 = CustomPreviewLineweights(Geometry=[f_mmeea.InternalEdges, f_mmeea.NakedEdges], Shader=ColourSwatch(SwatchColor=RGB(0, 0, 0)), Absolute=False)

# ----
# This snippet is useful for assemblages starting from different points (i.e. when using AOpa with sparse starting AO)
# identify clusters of connected objects
# This part considers connected clusters of objects (objects that are connected through their handles), displaying each cluster in a different color. If two cluster establish a connection, they will merge into one.
aoadecon_2 = DeconstructAssemblage(Assemblage=dam)  # -> AssemblageObjects, AssemblageRules, ReceiverObjectsIndexes, AvailableObjectIndexes, UnreachableObjectIndexes
tstat = TreeStatistics(Tree=aoadecon_2.AssemblageObjects)  # -> Paths, Length, Count
dpath = DeconstructPath(Branch=tstat.Paths)  # -> flatten(Indices)
tstat_2 = TreeStatistics(Tree=f_clstr)  # -> Paths, Length, Count
f_ifromn = IndexesFromNumber(Amount=tstat_2.Count)
gradient = Gradient(
    LowerLimit=0,
    UpperLimit=tstat_2.Count,
    Parameter=f_ifromn,
    stops=[0: RGB(243, 57, 0), 0.1: RGB(236, 27, 60), 0.2: RGB(210, 0, 118), 0.3: RGB(103, 0, 120), 0.4: RGB(39, 72, 161), 0.5: RGB(1, 192, 229), 0.6: RGB(18, 178, 90), 0.7: RGB(79, 186, 8), 0.8: RGB(220, 237, 32), 0.9: RGB(247, 159, 20), 1: RGB(243, 57, 0)])
n_of_clusters = Panel(tstat_2.Count)

# ---- group: find cluster index
mindex = MemberIndex(Set=f_clstr, Member=dpath)  # -> Index, Count
flip = FlipMatrix(Data=mindex.Count)
int = Integer("1")
mindex_2 = MemberIndex(Set=flip, Member=int)  # -> Index, Count
pshift = ShiftPaths(Data=mindex_2.Index, Offset=-1)

# ----
item_2 = ListItem(List=gradient, Index=pshift, Wrap=True)

filter = StreamFilter(Gate=color_by, Stream0=graft, Stream1=item_2)
# visualizzazione delle geometrie effettive
preview_2 = CustomPreview(Geometry=mesh_20, Material=filter)

# ==== cluster Cluster
environment_geometries = ClusterInput()

# ----
# display environment geometries names
# IMPORTANT: Objects must be named in Rhino
# This component from Human gets object attributes (name, layer, color)
objatts = ObjectAttributes(ObjectOrAttributes=environment_geometries)  # -> Name, LayerName, LayerFullPath, Color, MaterialName, LinetypeName, GroupIndices, PlotWeight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

# ----
# If an object is a void (if it's in the "voids" layer), flips the mesh before computing volume (otherwise the centroid is out of place)
panel = Panel("voids")
tmatch = MatchText(Text=objatts.LayerName, Pattern=panel, Case=True)
dispatch = Dispatch(List=environment_geometries, DispatchPattern=tmatch)  # -> ListA, ListB
flip = MeshFlip(Mesh=dispatch.ListA)
weave = Weave(Pattern=tmatch, Stream0=dispatch.ListB, Stream1=flip, NullGaps=False)

volume = Volume(Geometry=weave)  # -> Volume, Centroid

tag = TextTag(Location=volume.Centroid, Text=objatts.Name, Colour=objatts.Color)
