# Grasshopper definition PP_circulation - shortest path(s)_ShortestWalk.gh (Grasshopper 1.0.7)
# Copyright: Co-de-iT
# plug-ins: Shortest Walk in Gh, Human, froGH, Assembler

cp_from_xdata = Relay()
# shortest walk - AssemblyObjects connections or circulation path
assemblage = Relay()
# Data Dam: Click on the play symbol (when present) to manually update the data
dam = DataDam(DataA=assemblage, BufferDelay=10000000, BufferMode=0)
# <title>
# 
# <description>
# 
# code by Alessio Erioli
# 
# v 0.1
# © a3 2021 / Creative Commons Attribution-Non Commercial-ShareAlike 4.0 International License
aoadecon = DeconstructAssemblage(Assemblage=dam)  # -> AssemblageObjects, AssemblageRules, ReceiverObjectsIndexes, AvailableObjectIndexes, UnreachableObjectIndexes

# ---- group: AO Reference Planes
# AO connectivity network: Creates the connectivity network between AssemblyObjects by connecting centres of reference planes with connected handles.
# 
# This network does not necessarily coincide with the spatial connectivity network, just tells how the Assembly Objects are connected to each other.
aoplane = ExtractReferencePlane(AssemblyObject=aoadecon.AssemblageObjects)  # -> graft(ReferencePlane)

# ---- group: AO Extract Handles
# Handle Occupancy: hO - Handle Occupancy
# 
# 0 - available
# 1 - connected
# -1 - occluded
# 
# nO - neighbour AssemblyObject index (-1 if Handle is available)
# 
# nH - neighbour Handle index (-1 if Handle is available or occluded)
aoehandles = ExtractHandles(AssemblyObject=aoadecon.AssemblageObjects)  # -> HandlesSenderPlanes, HandlesTypes, HandlesWeights, HandleOccupancy, NeighbourObjectIndex, NeighbourHandleIndex

# ---- group: exclude occluded Handles
equals = Equality(FirstNumber=aoehandles.HandleOccupancy, SecondNumber="-1")  # -> Equality, Inequality
cull = CullPattern(List=aoehandles.HandlesSenderPlanes, CullPattern=equals.Inequality)

# ----
list = ValueList({"AO connectivity": 0, "Circulation path": 1}, selected="Circulation path")

ln = Line(StartPoint=aoplane, EndPoint=cull)

filter = StreamFilter(Gate=list, Stream0=ln, Stream1=cp_from_xdata)
line = Line(simplify(filter))
dam_2 = DataDam(DataA=line, BufferDelay=10000000, BufferMode=0)
line_2 = Line(dam_2)
# find n random walks
line_3 = Line(flatten(line_2))

# ----
# note on shortest path: Whle connectivity network will always show a path (all objects are connected at least to another object, so a path between any two points always exists), circulation path might fail to find a path if the 2 points are on isolated clusters.
line_4 = Line(flatten(line))
f_tln = Topologizer(LinesNetwork=line_4, Decimals=3)  # -> Points, LinePointsData, Point2PointsConnectivity, LineDirectionAtEachPoint
pt = Point(Point(-90.36212464, 88.40040785, 47.6056749))
pt_2 = Point(Point(-92.61501577, 23.63506542, 50.43064752))
cp = ClosestPoint(Point=pt, Cloud=f_tln.Points)  # -> ClosestPoint, CPIndex, Distance
cp_2 = ClosestPoint(Point=pt_2, Cloud=f_tln.Points)  # -> ClosestPoint, CPIndex, Distance
ln_2 = Line(StartPoint=pt_2, EndPoint=cp_2.ClosestPoint)
ln_3 = Line(StartPoint=pt, EndPoint=cp.ClosestPoint)
ln_4 = Line(StartPoint=cp.ClosestPoint, EndPoint=cp_2.ClosestPoint)
merge = Merge(Data1=pt, Data2=pt_2)
shortwalk = ShortestWalk(Curves=line_4, WantedPath=ln_4)  # -> ShortestWalk, Succession, Direction, Length
start = ColourSwatch(SwatchColor=RGB(255, 0, 0))
end = ColourSwatch(SwatchColor=RGB(0, 153, 255))
panel = Panel("""start
end""")
tag = TextTag(Location=merge, Text=panel)
previewlw = CustomPreviewLineweights(Geometry=shortwalk.ShortestWalk, Shader=ColourSwatch(SwatchColor=RGB(255, 212, 0)), Thickness="8", Absolute=False)
dots = DotDisplay(Point=[cp.ClosestPoint, cp_2.ClosestPoint], Colour=[start, end], Size="1")

# ---- group: extract indexes of involved objects
f_ifroml = IndexesFromList(Data=line_4)
unflatten = UnflattenTree(Tree=f_ifroml, Guide=line)
mindex = MemberIndex(Set=unflatten, Member=shortwalk.Succession)  # -> Index, Count
f_massbool = MassBoolean(Values=mindex.Count, BooleanOperator="OR", Boolean_Operator="OR")

# ----
data = Data(aoadecon.AssemblageObjects)
# finding objects involved in the shortest walk: the steps are:
# 
# . generate an index for each of the lines in the network
# 
# . rebuild the original tree structure for the indexes (this puts the index of each line in a branch which index corresponds to the Object the line belongs to)
# 
# . check in which branches are the indexes involved in the shortest walk (see how Member Index works below)
cull_2 = CullPattern(List=data, CullPattern=f_massbool)

# ---- group: how Member Index works / set to search from
int = Integer(Tree({0;0;0}: [2, 1, 5, 8, 7], {0;0;1}: [7, 8, 8, 6, 2], {0;0;2}: [7, 8, 8, 6, 2], {0;0;3}: [2, 1, 5, 8, 7], {0;0;4}: [7, 8, 8, 6, 2]))

# ---- group: shortest path workflows
f_tln_2 = Topologizer(LinesNetwork=line_3, Decimals=3)  # -> Points, LinePointsData, Point2PointsConnectivity, LineDirectionAtEachPoint
lng = ListLength(List=f_tln_2.Point2PointsConnectivity)
number_slider = Slider(1000, range=2..1000)
equals_2 = Equality(FirstNumber=lng, SecondNumber="1")  # -> flatten(Equality), Inequality
cull_3 = CullPattern(List=f_tln_2.Points, CullPattern=equals_2.Equality)
lng_2 = ListLength(List=cull_3)  # -> expr("x-1", Length)
random = Random(Range=lng_2, Number=number_slider, Seed="0")
random_2 = Random(Range=lng_2, Number=number_slider, Seed=2)
item = ListItem(List=cull_3, Index=random_2, Wrap=True)
item_2 = ListItem(List=cull_3, Index=random, Wrap=True)
ln_5 = Line(StartPoint=item_2, EndPoint=item)
shortwalk_2 = ShortestWalk(Curves=line_3, WantedPath=ln_5)  # -> ShortestWalk, Succession, Direction, Length
max_thickness = Slider(15, range=0..100)

# ---- group: objects involved in shortest path
f_ifroml_2 = IndexesFromList(Data=line_3)
unflatten_2 = UnflattenTree(Tree=f_ifroml_2, Guide=line_2)
mindex_2 = MemberIndex(Set=unflatten_2, Member=shortwalk_2.Succession)  # -> Index, simplify(Count)
ma = MassAddition(Input=mindex_2.Count)  # -> Result, PartialResults
larger = LargerThan(FirstNumber=ma.Result, SecondNumber="0")  # -> flatten(LargerThan), OrEqualTo
f_ifroml_3 = IndexesFromList(Data=larger.LargerThan)
cull_4 = CullPattern(List=f_ifroml_3, CullPattern=larger.LargerThan)

# ---- group: shortest path workflows / determine frequency
cset = CreateSet(List=flatten(shortwalk_2.Succession))  # -> Set, Map
c_script = CSharpScript(S=flatten(shortwalk_2.Succession), M=cset.Set)  # -> I, N; inputs S: list of Int32, M: list of Int32
# ---------- c_script: C# ----------
    int[] freq = new int[M.Count];
    DataTree<int> ind = new DataTree<int>();
    GH_Path path;
    int index = Component.RunCount - 1;
    if (index < 0) index = 0;
    for(int i = 0; i < M.Count; i++)
    {
      path = new GH_Path(index, i);
      for(int j = 0; j < S.Count; j++)
      {
        if (S[j] == M[i])
        {
          ind.Add(j, path);
          freq[i]++;
        }
      }
    }
    I = ind;
    N = freq;
# ---------- end c_script ----------

# ---- group: shortest path workflows / remap by length
bnd = Bounds(Numbers=shortwalk_2.Length)
remap = RemapNumbers(Value=shortwalk_2.Length, Source=bnd, Target=Domain(0, 1))  # -> Mapped, Clipped

# ---- group: shortest path workflows / remap by frequency
bnd_2 = Bounds(Numbers=c_script.N)
remap_2 = RemapNumbers(Value=c_script.N, Source=bnd_2, Target=Domain(0, 1))  # -> Mapped, Clipped

# ---- group: shortest path workflows (continued)
item_3 = ListItem(List=line_3, Index=cset.Set, Wrap=True)
gradient = Gradient(LowerLimit=0, UpperLimit=1, Parameter=remap_2.Mapped, stops=[0: RGB(255, 255, 255), 1: RGB(187, 0, 255)])
multiplication = Multiplication(A=remap_2.Mapped, B=max_thickness)
previewlw_2 = CustomPreviewLineweights(Geometry=item_3, Shader=gradient, Thickness=multiplication, Absolute=False)

# ---- group: how Member Index works
# This tells us if any number occurs in any of the provided sets (each branch is considered one separate set).
# 
# The first branch tells us that in the first set 5 and 1 occur one time each, while the other numbers occur 0 times.
members = Panel("""5
9
1
3""")
panel_2 = Panel(int)

# ---- group: how Member Index works / members to search for
int_2 = Integer(members)

# ---- group: how Member Index works (continued)
mindex_3 = MemberIndex(Set=int, Member=int_2)  # -> Index, Count
numbers_of_occurrences = Panel(mindex_3.Count)
