# Grasshopper definition PP_cluster by distance.gh (Grasshopper 1.0.7)
# Copyright: Co-de-iT
# plug-ins: Assembler, froGH

required_plugins = Panel(". froGH")

# ----
# these must have matching data structure
assemblyobject_geometries = Relay()
assemblyobjects = Relay()

# ---- group: index of starting point
number_slider = Slider(66, range=0..200)

# ---- group: clustering distance
number_slider_2 = Slider(30, range=0..30)

# ----
# Assembler
# 
# Framework for Iterative Assemblages workflow
# 
# code by Alessio Erioli
# 
# v 1.0
# © Co-de-iT 2021 / Creative Commons Attribution-Non Commercial-ShareAlike 4.0 International License
aoplane = ExtractReferencePlane(AssemblyObject=flatten(assemblyobjects))

# ---- group: froGH - Clusterize points by distance
f_ptscbd = ClusterizePointsByDistance(Points=aoplane, Index=number_slider, ClusterizationDistance=number_slider_2)  # -> ClusteredPoints, ClusteredIndices

# ---- group: generate random clusters colors for better display
tstat = TreeStatistics(Tree=f_ptscbd.ClusteredPoints)  # -> Paths, Length, Count
n_of_clusters = Panel(tstat.Count)
f_ifromn = IndexesFromNumber(Amount=tstat.Count)
jitter = Jitter(List=f_ifromn, Jitter=1, Seed=2)  # -> Values, Indices
gradient = Gradient(
    LowerLimit=0,
    UpperLimit=1,
    Parameter=jitter.Values,
    stops=[0: RGB(243, 57, 0), 0.1: RGB(236, 27, 60), 0.2: RGB(210, 0, 118), 0.3: RGB(103, 0, 120), 0.4: RGB(39, 72, 161), 0.5: RGB(1, 192, 229), 0.6: RGB(18, 178, 90), 0.7: RGB(79, 186, 8), 0.8: RGB(220, 237, 32), 0.9: RGB(247, 159, 20), 1: RGB(243, 57, 0)])

# ---- group: sort cluster indexes by AssemblyObject
tstat_2 = TreeStatistics(Tree=assemblyobjects)  # -> Paths, Length, Count
dpath = DeconstructPath(Branch=tstat_2.Paths)  # -> flatten(Indices)
mindex = MemberIndex(Set=f_ptscbd.ClusteredIndices, Member=dpath)  # -> Index, Count
flip = FlipMatrix(Data=mindex.Count)
int = Integer("1")
mindex_2 = MemberIndex(Set=flip, Member=int)  # -> Index, Count
pshift = ShiftPaths(Data=mindex_2.Index, Offset=-1)

# ---- group: display clusters and connections
# activate these for debugging purposes
avr = Average(Input=f_ptscbd.ClusteredPoints)  # disabled
ln = Line(StartPoint=f_ptscbd.ClusteredPoints, EndPoint=avr)  # disabled
preview = CustomPreview(Geometry=f_ptscbd.ClusteredPoints, Material=graft(gradient))  # disabled
preview_2 = CustomPreview(Geometry=ln, Material=graft(gradient))  # disabled

# ----
item = ListItem(List=gradient, Index=pshift, Wrap=True)
preview_3 = CustomPreview(Geometry=assemblyobject_geometries, Material=item)
