# Grasshopper definition PP_cluster connected objects.gh (Grasshopper 1.0.7)
# Copyright: Co-de-iT
# plug-ins: Assembler, froGH

required_plugins = Panel(". froGH")

# ----
# Assembler
# 
# Framework for Iterative Assemblages workflow
# 
# code by Alessio Erioli
# 
# v 1.0
# © Co-de-iT 2021 / Creative Commons Attribution-Non Commercial-ShareAlike 4.0 International License
# This snippet is useful for assemblages starting from different points (i.e. when using AOpa with sparse starting AO)
# display clusters of connected objects
# This part considers connected clusters of objects (objects that are connected through their handles), displaying each cluster in a different color. If two cluster establish a connection, they will merge into one.
geometry_to_display = Relay()
assemblage = Relay()
aoadecon = DeconstructAssemblage(Assemblage=assemblage)  # -> AssemblageObjects, AssemblageRules, ReceiverObjectsIndexes, AvailableObjectIndexes, UnreachableObjectIndexes
tstat = TreeStatistics(Tree=aoadecon.AssemblageObjects)  # -> Paths, Length, Count
dpath = DeconstructPath(Branch=tstat.Paths)  # -> flatten(Indices)
int = Integer("1")

# ---- group: Extract Topology
aoatopo = ExtractTopology(Assemblage=assemblage)  # -> HandleOccupancy, NeighbourObjectIndex, NeighbourHandleIndex

# ---- group: filter only connected Handles
equals = Equality(FirstNumber=aoatopo.HandleOccupancy, SecondNumber="1")  # -> Equality, Inequality
cull = CullPattern(List=aoatopo.NeighbourObjectIndex, CullPattern=equals.Equality)  # -> simplify(List)

# ---- group: froGH - Clusterizer
f_clstr = Clusterizer(TopologyData=cull)

# ----
mindex = MemberIndex(Set=f_clstr, Member=dpath)  # -> Index, Count
tstat_2 = TreeStatistics(Tree=f_clstr)  # -> Paths, Length, Count
n_of_clusters = Panel(tstat_2.Count)
flip = FlipMatrix(Data=mindex.Count)
f_ifromn = IndexesFromNumber(Amount=tstat_2.Count)
mindex_2 = MemberIndex(Set=flip, Member=int)  # -> Index, Count
gradient = Gradient(
    LowerLimit=0,
    UpperLimit=tstat_2.Count,
    Parameter=f_ifromn,
    stops=[0: RGB(243, 57, 0), 0.1: RGB(236, 27, 60), 0.2: RGB(210, 0, 118), 0.3: RGB(103, 0, 120), 0.4: RGB(39, 72, 161), 0.5: RGB(1, 192, 229), 0.6: RGB(18, 178, 90), 0.7: RGB(79, 186, 8), 0.8: RGB(220, 237, 32), 0.9: RGB(247, 159, 20), 1: RGB(243, 57, 0)])
pshift = ShiftPaths(Data=mindex_2.Index, Offset=-1)
item = ListItem(List=gradient, Index=pshift, Wrap=True)
preview = CustomPreview(Geometry=geometry_to_display, Material=item)
