# Grasshopper definition PP_AO type+dir_statistics.gh (Grasshopper 1.0.7)
# Copyright: Co-de-iT
# plug-ins: Assembler, froGH, Human

# Assemblage statistics (count, directional analysis)
required_plugins = Panel(""". froGH
. Human""")
assemblage = Relay()
aoadecon = DeconstructAssemblage(Assemblage=assemblage)  # -> AssemblageObjects, AssemblageRules, ReceiverObjectsIndexes, AvailableObjectIndexes, UnreachableObjectIndexes

line_length = Slider(10, range=1..20)
scale_factor = Slider(2.5, range=1..5)
list = ValueList({"numbers": 0, "%": 1}, selected="%")
pt = Point(Point(-180, 64, 0))

# ----
# Assembler
# 
# Framework for Iterative Assemblages workflow
# 
# code by Alessio Erioli
# 
# v 1.0
# © Co-de-iT 2021 / Creative Commons Attribution-Non Commercial-ShareAlike 4.0 International License
aoplane = ExtractReferencePlane(AssemblyObject=aoadecon.AssemblageObjects)

# ---- group: objects statistics / Extract AO Type
aotype = ExtractType(AssemblyObject=aoadecon.AssemblageObjects)

# ---- group: objects statistics
aoset = ExtractAOSet(Assemblage=assemblage)
f_ifroml = IndexesFromList(Data=aoset)
mindex = MemberIndex(Set=aotype, Member=f_ifroml)  # -> Index, Count
expression = Expression(x=f_ifroml, y=mindex.Count, Expression="Format(\"type {0}: {1}\", x, y)")
pt_2 = Point(Point(-240, 66, 0))
xy = XYPlane(Origin=pt_2)
join = TextJoin(Text=expression)

# ----
deplane = DeconstructPlane(Plane=aoplane)  # -> Origin, XAxis, YAxis, ZAxis

# ---- group: Direction Octagon
# sorry, I'd rather not do clusters but this was too messy!
cluster = Cluster(vec=deplane.ZAxis, pt=pt, num=line_length, num_2=scale_factor, int=list)  # -> mesh_2, pt_4, txt_2, crv_2, num_6

# ----
gradient = Gradient(LowerLimit=0, UpperLimit=1, Parameter=cluster.num_6, stops=[0: RGB(0, 128, 0), 0.5: RGB(255, 255, 0), 1: RGB(255, 0, 0)])
preview = CustomPreview(
    Geometry=cluster.mesh_2,
    Material={diffuse=RGB(221, 160, 221), emission=RGB(66, 48, 66), shine=0.5, specular=RGB(255, 255, 255), transparency=0})
previewlw = CustomPreviewLineweights(Geometry=cluster.crv_2, Shader=gradient, Absolute=False)
tag = TextTag3D(Location=cluster.pt_4, Text=cluster.txt_2, Size="2.5", Colour=gradient, Justification=5)
tag_2 = TextTag3D(Location=xy, Text=join, Size="3", Colour=ColourSwatch(SwatchColor=RGB(0, 0, 0)), Justification=7)

# ==== cluster Cluster
vec = ClusterInput()
pt = ClusterInput()
num = ClusterInput()
num_2 = ClusterInput()
int = ClusterInput()
vec_2 = Vector(vec)
pt_2 = Point(pt)
num_3 = Number(num)
num_4 = Number(num_2)
int_2 = Integer(int)

# ---- group: direction octahedron
expression = Expression(V=vec_2, Expression="V.X*100+V.Y*10+V.Z")
panel = Panel("""1,0,0
0,1,0
0,0,1""")
panel_2 = Panel("""-100
-10
-1
100
10
1""")
rev = Reverse(Vector=panel)
merge = Merge(Data1=rev, Data2=panel)
int_3 = Integer(expression)
int_4 = Integer(panel_2)
vec_3 = Vector(merge)
lng = ListLength(List=vec_2)
mindex = MemberIndex(Set=int_3, Member=int_4)  # -> Index, Count
one_over_x = OneOverX(Value=lng)
line = LineSDL(Start=pt_2, Direction=vec_3, Length=num_3)
multiplication = Multiplication(A=mindex.Count, B=one_over_x)
vec_4 = Vector(line)
eval = EvaluateCurve(Curve=reparameterize(line), Parameter=multiplication)  # -> Point, Tangent, Angle
expression_2 = Expression(x=multiplication, Expression="Format(\"{0}%\", round(x*100,1))")
bnd = Bounds(Numbers=multiplication)
multiplication_2 = Multiplication(A=vec_4, B="1.5")
scale = Scale(Geometry=eval.Point, Center=pt_2, Factor=num_4)  # -> Geometry, Transform
remap = RemapNumbers(Value=multiplication, Source=bnd, Target=Domain(0, 1))  # -> Mapped, Clipped
move = Move(Geometry=pt_2, Motion=multiplication_2)  # -> Geometry, Transform
panel_3 = Panel("""T{0,2,1}
T{2,3,1}
T{2,4,3}
T{2,0,4}
T{0,1,5}
T{1,3,5}
T{3,4,5}
T{4,0,5}""")
col = Colour(vec_3)
conmesh = ConstructMesh(Vertices=scale.Geometry, Faces=panel_3, Colours=col)
filter = StreamFilter(Gate=int_2, Stream0=mindex.Count, Stream1=expression_2)
unweld = UnweldMesh(Mesh=conmesh, Angle="0")

# ----
mesh = Mesh(unweld)
pt_3 = Point(move.Geometry)
txt = Text(filter)
crv = Curve(line)
num_5 = Number(remap.Mapped)
mesh_2 = ClusterOutput(mesh)
pt_4 = ClusterOutput(pt_3)
txt_2 = ClusterOutput(txt)
crv_2 = ClusterOutput(crv)
num_6 = ClusterOutput(num_5)
