# Grasshopper definition PP_find applied rule in assemblage.gh (Grasshopper 1.0.7)
# Copyright: Co-de-iT
# plug-ins: Assembler

# ----
# <title>
# 
# <description>
# 
# code by Alessio Erioli
# 
# v 0.1
# © a3 2021 / Creative Commons Attribution-Non Commercial-ShareAlike 4.0 International License
colors = Relay()
assemblage = Relay()
hes = Relay()
lng = ListLength(List=hes)
subtraction = Subtraction(A=lng, B="1")
multiplication = Multiplication(A=subtraction, B=Slider(0.889, range=0..1))
int = Integer(multiplication)
item = ListItem(List=hes, Index=int, Wrap=True)
panel = Panel(int)
aoadecon = DeconstructAssemblage(Assemblage=assemblage)  # -> AssemblageObjects, AssemblageRules, ReceiverObjectsIndexes, AvailableObjectIndexes, UnreachableObjectIndexes
rule_observed = Panel(item)
tstat = TreeStatistics(Tree=aoadecon.AssemblageRules)  # -> Paths, Length, Count
tmatch = MatchText(Text=aoadecon.AssemblageRules, Pattern=item, Case=True)
cull = CullPattern(List=tstat.Paths, CullPattern=flatten(tmatch))
branch = TreeBranch(Tree=aoadecon.ReceiverObjectsIndexes, Path=cull, MaintainPaths=True)  # -> flatten(Branch)
isolate_aos = BooleanToggle(False)
sift = SiftPattern(List=colors, SiftPattern=isolate_aos)  # -> Output0, Output1

# ---- group: color senders
lng_2 = ListLength(List=cull)
dpath = DeconstructPath(Branch=cull)  # -> flatten(Indices)
repeat = RepeatData(Data=ColourSwatch(SwatchColor=RGB(199, 160, 32)), Length=lng_2)
replace = ReplaceItems(List=sift.Output0, Item=repeat, Indices=dpath, Wrap=False)

# ---- group: AOs / senders
branch_2 = TreeBranch(Tree=aoadecon.AssemblageObjects, Path=cull, MaintainPaths=True)

# ---- group: AOs / receivers
branch_3 = TreeBranch(Tree=aoadecon.AssemblageObjects, Path=branch, MaintainPaths=True)

# ---- group: color receivers
lng_3 = ListLength(List=branch)
repeat_2 = RepeatData(Data=ColourSwatch(SwatchColor=RGB(91, 112, 138)), Length=lng_3)

# ---- group: color receivers / components that have been both s & r
mindex = MemberIndex(Set=dpath, Member=branch)  # -> Index, Count
larger = LargerThan(FirstNumber=mindex.Count, SecondNumber="0")  # -> LargerThan, OrEqualTo
weave = Weave(
    Pattern=graft(larger.LargerThan),
    Stream0=graft(repeat_2),
    Stream1=ColourSwatch(SwatchColor=RGB(153, 124, 137)),
    NullGaps=False)  # -> flatten(Weave)

# ---- group: color receivers (continued)
replace_2 = ReplaceItems(List=replace, Item=weave, Indices=branch, Wrap=False)
