# Grasshopper definition PP_rules statistics.gh (Grasshopper 1.0.7)
# Copyright: Co-de-iT
# plug-ins: Assembler, Human, froGH

required_plugins = Panel(""". froGH
. Human""")
rules_from_heuristic_writer = Relay()
assemblage = Relay()
aoset = Relay()
aoadecon = DeconstructAssemblage(Assemblage=assemblage)  # -> AssemblageObjects, AssemblageRules, ReceiverObjectsIndexes, AvailableObjectIndexes, UnreachableObjectIndexes
txt = Text(flatten(aoadecon.AssemblageRules))
lng = ListLength(List=txt)
# number of iterations
panel = Panel(lng)
# Assembler
# 
# Framework for Iterative Assemblages workflow
# 
# code by Alessio Erioli
# 
# v 1.0
# © Co-de-iT 2021 / Creative Commons Attribution-Non Commercial-ShareAlike 4.0 International License
# rules used in the Assemblage at each iteration
# (sorted by iteration)
panel_2 = Panel(txt)
cset = CreateSet(List=txt)  # -> Set, Map
mindex = MemberIndex(Set=rules_from_heuristic_writer, Member=cset.Set)  # -> flatten(Index), Count
# set of unique rules
panel_3 = Panel(cset.Set)
# indexes of the used rules
# in the list generated by the Heuristics Writer
panel_4 = Panel(mindex.Index)
lng_2 = ListLength(List=cset.Set)
mindex_2 = MemberIndex(Set=txt, Member=cset.Set)  # -> Index, Count
# number of unique rules used
panel_5 = Panel(lng_2)
# indexes of the iteration at which a certain rule was applied
# (branch index is the rule index)
# rule index
panel_6 = Panel(mindex_2.Index)
# iteration index
# how may times a rule has been used
panel_7 = Panel(mindex_2.Count)
sort = SortList(Keys=mindex.Index, ValuesA=mindex_2.Count)  # -> Keys, ValuesA

# ---- group: use the same base point as Heuristic Display
pt = Point()

# ----
number_slider = Slider(1, range=0..1)
number_slider_2 = Slider(50, range=1..50)
# draw boxes on rules display
heudex = HeuristicsDisplayEx(OriginPoint=pt, AssemblyObjectsSet=aoset, HeuristicsSet=rules_from_heuristic_writer, XSize=1.2, YSize=1.2, NRows=10)  # -> AssemblyObjectPairs, HeuristicsSetTree, CoherencePattern, flatten(TextBasePoints)
bnd = Bounds(Numbers=sort.ValuesA)
dom = ConstructDomain(DomainStart=number_slider, DomainEnd=number_slider_2)
remap = RemapNumbers(Value=sort.ValuesA, Source=bnd, Target=dom)  # -> Mapped, Clipped
gradient = Gradient(
    LowerLimit=number_slider,
    UpperLimit=number_slider_2,
    Parameter=remap.Mapped,
    stops=[0: RGB(0, 128, 0), 0.5: RGB(255, 255, 0), 1: RGB(255, 0, 0)])

# ---- group: base plane
# draw histogram
pt_2 = Point(Point(0, -40, 0))
xz = XZPlane(Origin=pt_2)
xy = XYPlane(Origin=pt_2)

# ----
item = ListItem(List=heudex.TextBasePoints, Index=sort.Keys, Wrap=True)

# ---- group: boxes
multiplication = Multiplication(A=remap.Mapped, B=Slider(0.2, range=0.1..1))
f_cdom = CenteredDomain(DomainLength=multiplication)
box = DomainBox(Base=item, X=f_cdom, Y=f_cdom, Z=remap.Mapped)
preview = CustomPreview(Geometry=box, Material=gradient)

# ----
max_height = Slider(40, range=1..50)
min_height = Slider(0.1, range=0..1)
deplane = DeconstructPlane(Plane=xy)  # -> Origin, XAxis, YAxis, ZAxis
line = LineSDL(Start=deplane.Origin, Direction=deplane.XAxis, Length=Slider(100, range=1..100))
bnd_2 = Bounds(Numbers=sort.ValuesA)
dom_2 = ConstructDomain(DomainStart=min_height, DomainEnd=max_height)
divide = DivideCurve(Curve=line, Count=expr("x-1", lng_2), Kinks=False)  # -> Points, Tangents, Parameters
remap_2 = RemapNumbers(Value=sort.ValuesA, Source=bnd_2, Target=dom_2)  # -> Mapped, Clipped
vec = Vector("0,-.1,0")
gradient_2 = Gradient(
    LowerLimit=min_height,
    UpperLimit=max_height,
    Parameter=remap_2.Mapped,
    stops=[0: RGB(0, 128, 0), 0.5: RGB(255, 255, 0), 1: RGB(255, 0, 0)])
addition = Addition(A=divide.Points, B=vec)
swatch = ColourSwatch(SwatchColor=RGB(0, 0, 0))
line_2 = LineSDL(Start=divide.Points, Direction=deplane.YAxis, Length=remap_2.Mapped)
previewlw = CustomPreviewLineweights(Geometry=line, Shader=swatch, Absolute=False)
previewlw_2 = CustomPreviewLineweights(Geometry=line_2, Shader=gradient_2, Thickness="5", Absolute=False)

pl_origin = PlaneOrigin(Base=xz, Origin=addition)

tag = TextTag3D(Location=pl_origin, Text=sort.Keys, Size=Slider(0.333, range=0..1), Colour=swatch, Justification="2")
