# Grasshopper definition count and select by value category.gh (Grasshopper 1.0.7)
# Copyright: Co-de-iT
# plug-ins: Assembler

assemblage = Relay()
# Assembler
# 
# Framework for Iterative Assemblages workflow
# 
# code by Alessio Erioli
# 
# v 1.0
# © Co-de-iT 2021 / Creative Commons Attribution-Non Commercial-ShareAlike 4.0 International License
aoadisp = DisplayAssemblage(Assemblage=assemblage, ColorsOnly=False, OutputType="Local Density")  # -> ColoredCollisionMeshes, Edges, Colors, Values
n_of_categories = Slider(6, range=1..10)
aoadecon = DeconstructAssemblage(Assemblage=assemblage)  # -> AssemblageObjects, AssemblageRules, ReceiverObjectsIndexes, AvailableObjectIndexes, UnreachableObjectIndexes
bnd = Bounds(Numbers=aoadisp.Values)
values_domain = Panel(bnd)
div = DivideDomain(Domain=bnd, Count=n_of_categories)
series = Series(Start=0, Step=1, Count=n_of_categories)
fdom = FindDomain(Domains=div, Number=aoadisp.Values, Strict=False)  # -> Index, Neighbour
int = Integer(series)
category_index_for_each_ao = Panel(fdom.Index)
category_indexes = Panel(series)
mindex = MemberIndex(Set=fdom.Index, Member=int)  # -> simplify(Index), Count

# ---- group: display isolated categories
category_to_select = Slider(0, range=0..5)
branch = TreeBranch(Tree=mindex.Index, Path=category_to_select, MaintainPaths=True)
item = ListItem(List=flatten(aoadecon.AssemblageObjects), Index=branch, Wrap=True)
aoecmesh = ExtractCollisionMesh(AssemblyObject=item)
preview = CustomPreview(
    Geometry=aoecmesh,
    Material={diffuse=RGB(221, 160, 221), emission=RGB(66, 48, 66), shine=0.5, specular=RGB(255, 255, 255), transparency=0})

# ----
ao_indexes_for_each_category = Panel(mindex.Index)
occurrences_for_each_category = Panel(mindex.Count)
