# Grasshopper definition random place people.gh (Grasshopper 1.0.7)
# Copyright: Co-de-iT
# plug-ins: eleFront Rhino 6 Legacy

# from populated plane
pt = Point(Point(-4.246709002, -40.27259332, 0))

# ---- group: every potential positioning part
# from baked mesh assemblage
mesh = Mesh(<mesh referenced from the Rhino model>)

# ---- group: everything (required for clash checking)
mesh_2 = Mesh(<mesh referenced from the Rhino model>)

# ----
xy = XYPlane(Origin=pt)
mjoin = MeshJoin(Meshes=mesh_2)

# ---- group: explode mesh
# Assembler
# 
# Framework for Iterative Assemblages workflow
# 
# code by Alessio Erioli
# 
# v 1.0
# © Co-de-iT 2021 / Creative Commons Attribution-Non Commercial-ShareAlike 4.0 International License
c_script = CSharpScript(M=mesh)  # -> flatten(MF); inputs M: Mesh
# ---------- c_script: C# usings ----------
using System.Threading.Tasks;
# ---------- c_script: C# ----------
    if(M == null || !M.IsValid) return;

    Mesh[] exploded = new Mesh[M.Faces.Count];

    Parallel.For(0, M.Faces.Count, i =>
      {
      MeshFace f = M.Faces[i];
      Mesh mf = new Mesh();
      if (f.IsQuad)
      {
        mf.Vertices.Add(M.Vertices[f.A]);
        mf.Vertices.Add(M.Vertices[f.B]);
        mf.Vertices.Add(M.Vertices[f.C]);
        mf.Vertices.Add(M.Vertices[f.D]);
        mf.Faces.AddFace(0, 1, 2, 3);
      }
      else
      {
        mf.Vertices.Add(M.Vertices[f.A]);
        mf.Vertices.Add(M.Vertices[f.B]);
        mf.Vertices.Add(M.Vertices[f.C]);
        mf.Faces.AddFace(0, 1, 2);
      }
      exploded[i] = mf;

      });

    MF = exploded;
# ---------- end c_script ----------

# ----
rectangle = Rectangle(Plane=xy, XSize=Slider(-200, range=-200..200), YSize=Slider(200, range=-200..200), Radius=0)  # -> Rectangle, Length

# ---- group: area threshold
area = Area(Geometry=c_script)  # -> Area, Centroid
larger = LargerThan(FirstNumber=area.Area, SecondNumber="10")  # -> LargerThan, OrEqualTo

# ----
pop2d = Populate2D(Region=rectangle.Rectangle, Count="200", Seed=1)
cull = CullPattern(List=c_script, CullPattern=larger.LargerThan)

# ---- group: randomize rotation and displacement from center
lng = ListLength(List=pop2d)
displace_amount = Slider(0.961, range=0..1)
random = Random(Range="0 to 2*Pi", Number=lng, Seed=2, Integers=False)
prot = RotatePlane(Plane=pop2d, Angle=random)
deplane = DeconstructPlane(Plane=prot)  # -> Origin, XAxis, YAxis, ZAxis
multiplication = Multiplication(A=deplane.XAxis, B=displace_amount)
move = Move(Geometry=prot, Motion=multiplication)  # -> Geometry, Transform

# ----
list = ValueList({"from existing geometry": 0, "from plane selection": 1}, selected="from existing geometry")
names_of_blocks_to_place = Panel("""Umarell
Zdoura
person 1
person 2
person 3
couple
person 4""")
lng_2 = ListLength(List=names_of_blocks_to_place)  # -> expr("x-1", Length)

# ----
# blocks will be placed on surfaces of area greater than this amount
facen = FaceNormals(Mesh=cull)  # -> flatten(Centers), flatten(Normals)

# ---- group: pick horizontal faces, normals up
Z = UnitZ(Factor=1)
angle = Angle(VectorA=facen.Normals, VectorB=Z)  # -> Angle, Reflex
smaller = SmallerThan(FirstNumber=angle.Angle, SecondNumber="0.005")  # -> SmallerThan, OrEqualTo

# ----
cull_2 = CullPattern(List=facen.Centers, CullPattern=smaller.SmallerThan)

# ---- group: randomize rotation and displacement from center
lng_3 = ListLength(List=cull_2)
displace_amount_2 = Slider(0.8, range=0..1)
random_2 = Random(Range="0 to 2*Pi", Number=lng_3, Seed=2, Integers=False)
prot_2 = RotatePlane(Plane=cull_2, Angle=random_2)
deplane_2 = DeconstructPlane(Plane=prot_2)  # -> Origin, XAxis, YAxis, ZAxis
multiplication_2 = Multiplication(A=deplane_2.XAxis, B=displace_amount_2)
move_2 = Move(Geometry=prot_2, Motion=multiplication_2)  # -> Geometry, Transform

# ---- group: check if position is unobstructed
pt_2 = Point(move_2.Geometry)
addition = Addition(A=pt_2, B="{0,0,0.01}")
pl_origin = PlaneOrigin(Base=move_2.Geometry, Origin=addition)  # -> graft(Plane)

# ---- group: check if position is unobstructed / check by lines
deplane_3 = DeconstructPlane(Plane=pl_origin)  # -> Origin, XAxis, YAxis, ZAxis
neg = Negative(Value="0.5")
addition_2 = Addition(A=deplane_3.Origin, B="{0,0,1.2}")
relay = Relay([neg, "0.5"])
multiplication_3 = Multiplication(A=deplane_3.XAxis, B=relay)
move_3 = Move(Geometry=addition_2, Motion=multiplication_3)  # -> Geometry, Transform
pline = PolyLine(Vertices=move_3.Geometry, Closed=False)
line = LineSDL(Start=deplane_3.Origin, Direction=Vector(0, 0, 1), Length="2.2")

# ----
arrpolar = PolarArray(Geometry=pline, Plane=pl_origin, Count=Slider(3, range=2..10), Angle=6.283185307)  # -> Geometry, Transform
pshift = ShiftPaths(Data=arrpolar.Geometry, Offset=-1)

# ---- group: check if position is unobstructed / check by lines (continued)
merge = Merge(Data1=pshift, Data2=line)
mcx = MeshCurve(Mesh=mjoin, Curve=merge)  # -> Points, Faces
pshift_2 = ShiftPaths(Data=mcx.Points, Offset=-1)

# ---- group: check if position is unobstructed (continued)
lng_4 = ListLength(List=pshift_2)  # -> flatten(Length)
equals = Equality(FirstNumber=lng_4, SecondNumber="0")  # -> Equality, Inequality

# ----
cull_3 = CullPattern(List=move_2.Geometry, CullPattern=equals.Equality)

# ---- group: random reduce
to_reduce = Slider(0, range=0..1)
lng_5 = ListLength(List=cull_3)
multiplication_4 = Multiplication(A=lng_5, B=to_reduce)
reduce = RandomReduce(List=cull_3, Reduction=multiplication_4, Seed=1)

# ----
filter = StreamFilter(Gate=list, Stream0=reduce, Stream1=move.Geometry)
pln = Plane(filter)
lng_6 = ListLength(List=pln)
random_3 = Random(Range=lng_2, Number=lng_6, Seed=Slider(2, range=0..10), Integers=True)

# ---- group: index distribution
bar_graph = BarGraph(random_3, BarColor=RGB(255, 0, 90))

# ----
item = ListItem(List=names_of_blocks_to_place, Index=random_3, Wrap=True)

# ---- group: summon blocks and bake them
inblock = InsertBlock(BlockName=item, SourcePlane=pln)
bake = BooleanToggle(False)
bake_2 = BakeObjects(Geometry=inblock, Bake=bake)

# ---- group: preview blocks
preview = CustomPreview(Geometry=inblock, Material=ColourSwatch(SwatchColor=RGB(0, 0, 0)))
