# Grasshopper definition rule browser.gh (Grasshopper 1.0.7)
# Copyright: Co-de-iT
# plug-ins: Assembler, froGH

# Assembler
# 
# Framework for Iterative Assemblages workflow
# 
# code by Alessio Erioli
# 
# v 1.0
# © Co-de-iT 2021 / Creative Commons Attribution-Non Commercial-ShareAlike 4.0 International License
# connettere qui gli stessi inputs di Heuristics Display
heudex = HeuristicsDisplayEx(OriginPoint=Point(0, 0, 0), XSize=1.2, YSize=1.2, NRows=10)  # -> AssemblyObjectPairs, HeuristicsSetTree, CoherencePattern, TextBasePoints
aoecmesh = ExtractCollisionMesh(AssemblyObject=heudex.AssemblyObjectPairs)

# ---- group: scorrere per guardare le regole
number_slider = Slider(0, range=0..1)

# ----
mjoin = MeshJoin(Meshes=aoecmesh)  # -> flatten(Mesh)
lng = ListLength(List=mjoin)  # -> expr("x-1", Length)

# ---- group: livello di zoom
number_slider_2 = Slider(0, range=-1..1)

# ---- group: attivare per zoom
toggle = BooleanToggle(False)

# ----
multiplication = Multiplication(A=lng, B=number_slider)
item = ListItem(List=mjoin, Index=multiplication, Wrap=True)
f_ztoobj = ZoomToObject(Geometry=item, ZoomFactor=number_slider_2, Activate=toggle)
