# Grasshopper definition 00_intro.gh (Grasshopper 1.0.7)
# Copyright: Co-de-iT

# fare doppio click o RMB per editare
panel = Panel("""Questo >

è uno sketch""")
# Questo è uno Scribble
# fare doppio click per editare
# fare doppio click o RMB per editare
panel_2 = Panel("Questo è un panel")
# Dal menu Display, attivare:
# 
# . Draw icons
# . Draw fancy wires
# . Sunglasses
# components... where?!?
# I (o le) componenti di GH si possono inserire nel canvas in 2 modi:
# 
# . selezionandoli dal ribbon
# 
# . cercandoli per nome dopo un doppio click (LMB) in una zona vuota del canvas
# convenzioni: LMB - Left Mouse Button
# 
# RMB - Right Mouse Button
# 
# MMB - Middle Mouse Button (or mouse wheel)
# fare doppio click in questa zona (o qualunque area vuota del canvas)
# nel campo che appare digitare "point" e poi invio.
# Provare anche "panel", "text", "data", "line";
# provare a cercare i componenti per creare cerchi, ellissi, box, ...
# tenendo premuti CTRL+ALT
# cliccare tenendo premuto il LMB su questo componente
txt = Text()
# input(s)
# processes data
# (does something)
# RMB click in ciascuna delle 3 zone espone un menu contestuale differente:
# 
# . input/output: menu relativo a ciascun input o output
# 
# . parte centrale: menu relativo al componente
ln = Line()
# 00_intro
# 
# GH intro
# 
# code by Alessio Erioli
# 
# v 0.1
# © a3 2021 / Creative Commons Attribution-Non Commercial-ShareAlike 4.0 International License
# component anatomy
# stores data
# GH components - 2 general kinds:
# 
# . components that STORE data
# 
# 
# 
# 
# . components that PROCESS data
# output(s)
pt = Point()
# passing data
# press + drag LMB (Left Mouse Button)
# release LMB on cable snap
# i dati in GH viaggiano SEMPRE* da SINISTRA A DESTRA (dall'output di un componente all'input del sucessivo)
# 
# 
# * - salvo rare eccezioni (che non vedremo)
panel_3 = Panel("some data")
data = Data()
panel_4 = Panel("3")
panel_5 = Panel("2")
# Una definizione è realizzata costruendo una catena di operazioni e dati, mantenendo l'ordine da sinistra a destra. Ad esempio, per creare un cerchio:
# 
# . costruisco un punto a partire da coordinate XYZ
# . uso il punto come centro per un piano XY
# . uso il piano ed un parametro numerico come raggio per costruire un cerchio
panel_6 = Panel("0")

# ----
# E' fondamentale rispettare il TIPO di dato che un input richiede. Posizionandosi con il mouse sopra la lettera dell'input compare un pop-up che fornisce informazioni circa il tipo di dato richiesto
num = Number()
pt_2 = ConstructPoint(XCoordinate=0, YCoordinate=0, ZCoordinate=0)
pt_3 = Point()
xy = XYPlane(Origin=Point(0, 0, 0))

# ----
# 1
pt_4 = ConstructPoint(XCoordinate=0, YCoordinate=0, ZCoordinate=0)
number_slider = Slider(4.052, range=1..10)
# logic
# 2
xy_2 = XYPlane(Origin=Point(0, 0, 0))
# 3
cir = Circle(Plane=PlaneXY(0, 0, 0), Radius=1)
# data > geometry
# structures > superstructures
# sub-objects > objects
# 
# complexity increases
number_slider_2 = Slider(1.044, range=1..10)
# construction
pt_5 = ConstructPoint(XCoordinate="3", YCoordinate="2", ZCoordinate="0")
xy_3 = XYPlane(Origin=pt_5)
# basic definition structure
cir_2 = Circle(Plane=xy_3, Radius=number_slider_2)
# (non)destructive
# modifications
Z = UnitZ(Factor=1)
# manipulation
move = Move(Geometry=cir_2, Motion=Z)  # -> Geometry, Transform
# deconstruction/analysis
divide = DivideCurve(Curve=move.Geometry, Count=10, Kinks=False)  # -> Points, Tangents, Parameters
area = Area(Geometry=move.Geometry)  # -> Area, Centroid
panel_7 = Panel(divide.Points)
panel_8 = Panel(area.Area)
# geometry > data
# structures > substructures
# objects > sub-objects
# 
# complexity is deconstructed
panel_9 = Panel(area.Centroid)
# quando un componente viene selezionato,
# viene applicata una sfumatura di verde
panel_10 = Panel("ah")
# component display colors
# data missing
pt_6 = Point()
# ok, preview off
pt_7 = Point(Point(0, 0, 0))
# disabled
pt_8 = Point(Point(0, 0, 0))  # disabled
# ok, preview on
pt_9 = Point(Point(0, 0, 0))
# error
pt_10 = Point(panel_10)
number_slider_3 = Slider(0.342, range=0..1)

# ----
# data
# press (while dragging the cable):
# SHIFT to add cables
# CTRL to remove
num_2 = Number(number_slider_3)
# Gruppi: E' possibile dare ordine visivo alla definizione raggruppando tra loro componenti.
# 
# . Per creare un gruppo: selezionare i componenti desiderati e premere CTRL+G
# 
# . Per modificare l'aspetto di un gruppo (colore, contorni): click con RMB in una parte dell'area colorata del gruppo e selezionare dal menu contestuale
# 
# . Per eliminare un gruppo: click con LMB in una parte dell'area colorata del gruppo e premere DEL
int = Integer(number_slider_3)

panel_11 = Panel([num_2, int])
# Le entità geometriche possono essere:
# 
# . referenziate da Rhino
# 
# . create direttamente in GH a partire dai dati necessari
panel_12 = Panel("1")
# referenced from Rhino geometry
# created with coordinates in Grasshopper
panel_13 = Panel("14")
# from XYZ data
panel_14 = Panel("16")
pt_11 = ConstructPoint(XCoordinate=panel_13, YCoordinate=panel_14, ZCoordinate=panel_12)
# geometry
pt_12 = Point(<point referenced from the Rhino model>)
pt_13 = Point(Point(14, 12, 3))
ln_2 = Line()
pl_3pt = Plane3Pt()
# Preview permette di visualizzare la geometria di Grasshopper in Rhino. Disattivare la preview nasconde la visualizzazione in Rhino, ma il componente continua a funzionare.
# 
# Enabled significa che il componente sta facendo il suo lavoro. Disable ne interrompe il funzionamento, che può essere riattivato con enable.
# Keyboard shortcuts: Una volta selezionati i componenti desiderati:
# 
# Preview on/off toggle: CTRL + Q
# 
# Enable/Disable toggle: CTRL + E
# 
# 
# ATTENZIONE: CTRL + W chiude il file, con solo un messaggio di warning se le ultime modifiche non sono state salvate!
number_slider_4 = Slider(2.238, range=1..10)
# preview/disable
pt_14 = ConstructPoint(XCoordinate="20", YCoordinate="0", ZCoordinate="0")
xy_4 = XYPlane(Origin=pt_14)
cir_3 = Circle(Plane=xy_4, Radius=number_slider_4)
panel_15 = Panel(cir_3)
Z_2 = UnitZ(Factor=Slider(6.379, range=1..10))
crv = Curve(cir_3)
# bake
extr = Extrude(Base=crv, Direction=Z_2)
# RMB sull'icona, poi selezionare Bake...
# 
# oppure
# 
# Selezionare il componente e premere MMB
# 
# Compare un menu radiale con diverse opzioni, tra cui Bake
geo = Geometry(extr)
# MMB/Wheel menu
# cluster
# 
# group
# preview off
# 
# preview on
# Preferences
# enable    disable
# Navigate
# Bake
# 
#       zoom to preview geometry
# Find
# Disable/Enable solver
# 
# Recompute
image = ImageSampler(
    FilePath="C:\Users\aless\Documents\GitHub\a3_Co.De.S_2022-23\code\_utilities\Guides\GH intro\2022-10-09 12_11_03-Grasshopper - 00_intro_.png",
    Filter="Colour",
    Interpolate=True,
    Umax=1,
    Umin=0,
    Vmax=1,
    Vmin=0,
    Wrap=1)
