# Grasshopper definition 01_objects and data.gh (Grasshopper 1.0.7)
# Copyright: Co-de-iT

# ----
# inputs
# number slider
# invocare uno slider: si può invocare uno slider facendo doppio click in un'area vuota del canvas e digitando nel campo che appare:
# 0<<1
# 15
# 15.000
# -10<42
# -5<1<20
# -1<0.250<2
number_slider = Slider(0.25, range=0..1)
# parameter components
# panel
multiline_data = Panel("""Hello
Grasshopper!""")
single_line_data = Panel("""Hello
Grasshopper!""")
# toggle e button
toggle = BooleanToggle(False)
# value list
list = ValueList({"One": 1, "Two": 2, "Three": 2² - 1, "Four": Sqrt(16)}, selected="One")
# colour swatch
swatch = ColourSwatch(SwatchColor=RGB(255, 255, 255))
number_slider_2 = Slider(0.25, range=0..1)
number_slider_3 = Slider(15, range=0..100)
number_slider_4 = Slider(15, range=0..100)
number_slider_5 = Slider(-10, range=-10..42)
number_slider_6 = Slider(1, range=-5..20)
number_slider_7 = Slider(1.25, range=-1..2)
panel = Panel(toggle)
panel_2 = Panel(Button())
panel_3 = Panel(list)
panel_4 = Panel(swatch)
panel_5 = Panel(number_slider)

# ----
# 00_objects and data
# 
# GH intro - base file for objects and data
# 
# code by Alessio Erioli
# 
# v 0.1
# © a3 2021 / Creative Commons Attribution-Non Commercial-ShareAlike 4.0 International License
# geometric data
pt = Point(<point referenced from the Rhino model>)
vec = Vector(Vector(-1, 1, 1))
pln = Plane(Plane(origin=(0, 0, 0), x=(0.7071067812, -0.7071067812, 0), y=(0.7071067812, 0.7071067812, 0)))

crv = Curve([<curve referenced from the Rhino model> x2])
line = Line(Line((0, 0, 0), (5, 5, 0)))

srf = Surface([<surface referenced from the Rhino model> x2])
brep = Brep([<brep referenced from the Rhino model> x2])

# ----
# Esercizio: creare geometrie in Rhino, inserire il componente appropriato in GH e referenziare le geometrie nel rispettivo componente
vec_2 = Vector(Vector(-1, 1, 1))
vdisex = VectorDisplayEx(Point="0,0,0", Vector=vec_2, Colour=RGB(0, 0, 0), Width=2)

# ----
# data casting
# In alcuni casi è possibile convertire un tipo di dato in un altro. Questa conversione viene chiamata casting
# punti e vettori sono intercambiabili
# Questo perché un punto può essere considerato come la posizione della freccia di un vettore con la coda ancorata in 0,0,0.
# i valori booleani True/False sono convertibili nei numeri interi 1 e 0 e viceversa
# I panels convertono tutto a testo (string), non conservano il tipo di dato in input
# per questi tipi di dati la conversione è possibile perché GH riesce ad interpretare il testo all'interno del panel (si tratta però di uno spreco di risorse in quanto avvengono 2 conversioni superflue: dato > testo e testo > dato)
# come regola generale MAI usare i panels come bypass
# surfaces, Breps, meshes
number_slider_8 = Slider(0.42, range=0..1)
toggle_2 = BooleanToggle(False)
# 2 o 3 numeri separati da virgole sono interpretati come coordinate di punti o vettori
panel_6 = Panel("1.2,-1")
int = Integer(number_slider_8)
int_2 = Integer("42")
num = Number("2.718")
bool = Boolean(toggle_2)
int_3 = Integer(toggle_2)
num_2 = Number(toggle_2)
panel_7 = Panel(int_3)
panel_8 = Panel(num_2)
panel_9 = Panel(int)
panel_10 = Panel(number_slider_8)
panel_11 = Panel(bool)
pt_2 = Point(["0,-1,5", panel_6])
vec_3 = Vector(["0,-1,5", panel_6])
bool_2 = Boolean(int_3)
panel_12 = Panel(bool_2)
pt_3 = Point(Point(1, 2, 3))
line_2 = Line(Line((0, 0, 0), (5, 5, 0)))
vec_4 = Vector(pt_3)
pt_4 = Point(vec_4)
crv_2 = Curve(line_2)
vec_5 = Vector(line_2)
num_3 = Number(line_2)
panel_13 = Panel(vec_4)
panel_14 = Panel(pt_3)
panel_15 = Panel(pt_4)
panel_16 = Panel(line_2)
panel_17 = Panel(crv_2)
panel_18 = Panel(vec_5)
panel_19 = Panel(num_3)
num_4 = Number(panel_19)
vec_6 = Vector(panel_18)

# ----
# Tutte le superfici sono convertibili a  Brep, ma non tutte le Brep sono convertibili a superfici (vedi polisuperfici ed estrusioni)
# Superfici e Brep vengono automaticamente convertite a mesh (ma senza controllo sui parametri di conversione)
srf_2 = Surface(<surface referenced from the Rhino model>)
brep_2 = Brep(srf_2)
mesh = Mesh(srf_2)
brep_3 = Brep(<brep referenced from the Rhino model>)
srf_3 = Surface(brep_3)
mesh_2 = Mesh(brep_3)

srf_4 = Surface(brep_2)

# ----
# Le mesh non possono essere automaticamente convertite in superfici o Brep
mesh_3 = Mesh(<mesh referenced from the Rhino model>)
brep_4 = Brep(mesh_3)
srf_5 = Surface(mesh_3)

line_3 = Line(panel_16)
crv_3 = Curve(panel_17)

# ----
# (relevant) data types
# single item
# list
# Il relay è un "ripetitore di segnale", serve a tenere ordine visivo con i cavi
# "vedere" i vettori: I vettori non hanno preview in quanto non hanno una posizione definita. Per visualizzarli occorre utilizare componenti specifici del gruppo Display, specificando il punto di ancoraggio per la coda del vettore.
mesh_4 = Mesh([<mesh referenced from the Rhino model> x2])
geo = Geometry([pt, vec, pln, crv, line, srf, brep, mesh_4])
# non-geometric data
panel_20 = Panel("True")

bool_3 = Boolean(panel_20)
int_4 = Integer("42")
num_5 = Number("3.14")
txt = Text("Hi there!")

panel_21 = Panel(bool_3)
merge = Merge(Data1=bool_3, Data2=int_4, Data3=num_5, Data4=txt, Data5=geo)
data = Data([bool_3, int_4, num_5, txt, geo])
panel_22 = Panel(merge)
panel_23 = Panel(data)
