# Grasshopper definition 02_lists.gh (Grasshopper 1.0.7)
# Copyright: Co-de-iT

# 01_lists
# 
# Lists logic and basic operations
# 
# code by Alessio Erioli
# 
# v 0.1
# ci sono solo DataTree
# Anche se l'aspetto dei cavi è diverso per dato singolo, lista e DataTree, in realtà in Grasshopper TUTTO è organizzato in DataTrees: dati singoli e liste sono casi particolari di Data Tree.
panel = Panel("topics avanzati (opzionali)")

# ----
# split & sublist
series = Series(Start=0, Step=1, Count=10)
X = UnitX(Factor="1.5")
pt = ConstructPoint(XCoordinate="17", YCoordinate=series, ZCoordinate=0)
wrap = BooleanToggle(True)
move = Move(Geometry=pt, Motion=X)  # -> Geometry, Transform
dom = ConstructDomain(DomainStart=Slider(2, range=0..10), DomainEnd=Slider(7, range=0..10))
split = SplitList(List=pt, Index=Slider(4, range=0..10))  # -> ListA, ListB
subset = SubList(List=move.Geometry, Domain=dom, Wrap=wrap)  # -> List, Index
preview = CustomPreview(Geometry=split.ListA, Material=ColourSwatch(SwatchColor=RGB(255, 0, 0)))
preview_2 = CustomPreview(Geometry=split.ListB, Material=ColourSwatch(SwatchColor=RGB(0, 0, 255)))
preview_3 = CustomPreview(Geometry=subset.List, Material=ColourSwatch(SwatchColor=RGB(255, 212, 0)))

# ----
# selection
number_slider = Slider(10, range=0..10)
series_2 = Series(Start=Slider(0, range=0..10), Step=Slider(1, range=0..3), Count=number_slider)
wrap_2 = BooleanToggle(True)
pt_2 = ConstructPoint(XCoordinate="4", YCoordinate=series_2, ZCoordinate=0)
panel_2 = Panel(series_2)
item = ListItem(List=pt_2, Index=Slider(5, range=-5..20), Wrap=wrap_2)
data = Data(["A", "B", "C", "D", "E", "F", "G", "H", "I", "J"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])
lng = ListLength(List=data)
lng_2 = ListLength(List=series_2)
panel_3 = Panel(item)
cir = Circle(Plane=item, Radius="0.5")
panel_4 = Panel(lng)
panel_5 = Panel(lng_2)
preview_4 = CustomPreview(Geometry=[cir, item], Material=ColourSwatch(SwatchColor=RGB(0, 0, 0)))
points = PointList(Points=pt_2, Size=Slider(0.35, range=0..1))

# ----
# single item
# Un dato singolo è il caso più semplice di Data Tree: un solo ramo, contenente un solo dato
num = Number(42)
# single item
# item index
panel_6 = Panel(num)
# © a3 2021 / Creative Commons Attribution-Non Commercial-ShareAlike 4.0 International License
# branch index
viewer = ParamViewer(panel_6)
viewer_2 = ParamViewer(panel_6)

# ----
# list
# Una lista è un DataTree con un solo ramo e n dati, indicizzati da 0 a n-1. Un dato singolo può anche essere considerato un caso particolare di lista (per n=1)
num_2 = Number([0, 1, 2, 3, 4, 5, 6, 7, 8, 9])
# branch index
# item index
# list
panel_7 = Panel(num_2)
viewer_3 = ParamViewer(panel_7)
viewer_4 = ParamViewer(panel_7)

# ----
# shift
number_slider_2 = Slider(0, range=-10..10)
series_3 = Series(Start=0, Step=1, Count="12")
shift = ShiftList(List=series_3, Shift=number_slider_2, Wrap=Toggle(True))
panel_8 = Panel(shift)

# ----
# tree
# Il DataTree è una "lista di liste", nel caso più generale comprende m rami, ognuno dei quali contiene una lista.
# Gli elementi di una lista vengono processati insieme; ogni ramo viene processato in modo indipendente.
# branch index: Il suo formato è {A;B;C;...}
# 
# Da sinistra a destra si passa dal livello più generale a quello più specifico ed annidato
# item index: va da 0 a n-1 (n= numero di elementi nella lista)
# tree
# i rami rossi con punti arancioni rappresentano le liste del DataTree (dove sono effettivamente i dati)
num_3 = Number(Tree({0;0;0}: [0, 1, 2], {0;0;1}: [1, 2, 3], {0;0;2}: [2, 3, 4], {0;0;3}: [3, 4, 5]))
panel_9 = Panel(num_3)
viewer_5 = ParamViewer(panel_9)
viewer_6 = ParamViewer(panel_9)

# ----
# insert/replace
series_4 = Series(Start=0, Step=1, Count=10)
series_5 = Series(Start=0, Step=1, Count=10)
replace = ReplaceItems(List=series_4, Item=">new item", Indices=Slider(4, range=0..20), Wrap=Toggle(True))
ins = InsertItems(List=series_5, Item=">new item", Indices=Slider(4, range=0..20), Wrap=Toggle(True))
panel_10 = Panel(ins)
panel_11 = Panel(replace)

# ----
# filtering and selective processing
series_6 = Series(Start=0, Step=1, Count=10)
panel_12 = Panel("""True
False""")
cull = CullPattern(List=series_6, CullPattern=panel_12)
dispatch = Dispatch(List=series_6, DispatchPattern=panel_12)  # -> ListA, ListB
panel_13 = Panel(cull)
panel_14 = Panel(dispatch.ListA)
panel_15 = Panel(dispatch.ListB)
multiplication = Multiplication(A=dispatch.ListA, B="2")
panel_16 = Panel(multiplication)
weave = Weave(Pattern=panel_12, Stream0=dispatch.ListB, Stream1=multiplication, NullGaps=False)
# boolean masks/patterns
# Dispatch
# dati
# mask (pattern)
# True / 1
# False / 0
# A
# 
# 
# D
# E
# 
# G
# A
# B
# C
# D
# E
# F
# G
# 1
# 0
# 0
# 1
# 1
# 0
# 1
# True
# False
# False
# True
# True
# False
# True
# B
# C
# 
# 
# F
panel_17 = Panel(weave)
# Una maschera (mask o pattern) booleana è una sequenza per filtrare una serie di dati associando a ciascun dato un valore True o False.
# Culling
# A
# B
# C
# D
# E
# F
# G
# Lo scopo è dividere un flusso di dati in due a seconda di una condizione (es. separare i numeri sopra e sotto una certa soglia), in modo da processare separatamente i due flussi (dispatch) o tenere solo uno dei due (cull).
series_7 = Series(Start=0, Step=1, Count=10)
panel_18 = Panel(series_7)
pt_3 = ConstructPoint(XCoordinate="6", YCoordinate=series_7, ZCoordinate=0)
panel_19 = Panel("""1
0
0""")
panel_20 = Panel("""True
False
False""")
dispatch_2 = Dispatch(List=pt_3, DispatchPattern=panel_20)  # -> ListA, ListB
cir_2 = Circle(Plane=dispatch_2.ListA, Radius="0.4")
polygon = Polygon(Plane=dispatch_2.ListB, Radius="0.4", Segments="3", FilletRadius=0)  # -> Polygon, Length

# ----
# data matching
# I dati vengono processati per indice corrispondente. Se una lista ha elementi in eccesso, questi vengono processati con l'ultimo della lista più corta.
number_slider_3 = Slider(10, range=1..10)
series_8 = Series(Start=0, Step=1, Count=number_slider_3)
series_9 = Series(Start=0, Step=1, Count=Slider(10, range=1..10))
panel_21 = Panel(series_8)
panel_22 = Panel(series_9)
multiplication_2 = Multiplication(A=series_8, B=series_9)
panel_23 = Panel(multiplication_2)
pt_4 = ConstructPoint(XCoordinate=0, YCoordinate=series_8, ZCoordinate=0)
pt_5 = ConstructPoint(XCoordinate="2", YCoordinate=series_9, ZCoordinate=0)
ln = Line(StartPoint=pt_4, EndPoint=pt_5)

# ----
# sift-combine
# zoom in to add channels
series_10 = Series(Start=0, Step=1, Count=10)
panel_24 = Panel(series_10)
mod = Modulus(A=series_10, B="3")
panel_25 = Panel(mod)
sift = SiftPattern(List=series_10, SiftPattern=mod)  # -> Output0, Output1, Output2
_0 = Panel(sift.Output0)
_1 = Panel(sift.Output1)
_2 = Panel(sift.Output2)
combine = CombineData(Input0=sift.Output0, Input1=sift.Output1, Input2=sift.Output2)  # -> Result, Index
# index masks/patterns
panel_26 = Panel(combine.Result)
# mask (pattern)
# dati
# 1
# 2
# 0
# A
# 
# C
# A
# B
# C
# D
# E
# F
# G
# 0
# 1
# 0
# 2
# 1
# 1
# 2
# B
# 
# 
# E
# F
# D
# 
# 
# G
panel_27 = Panel(combine.Index)
# Quando i casi possibili sono più di due (es. dividere per orientamento: N, S, E, O), si associa a ciscun dato un indice corrispondente (0, 1, 2, etc.). I valori booleani sono un caso particolare di questo filtraggio, data la corrispondenza False=0 e True=1
series_11 = Series(Start=0, Step=1, Count=10)
panel_28 = Panel(series_11)
pt_6 = ConstructPoint(XCoordinate="20", YCoordinate=series_11, ZCoordinate=0)
mod_2 = Modulus(A=series_11, B="3")
panel_29 = Panel(mod_2)
sift_2 = SiftPattern(List=pt_6, SiftPattern=mod_2)  # -> Output0, Output1, Output2
Z = UnitZ(Factor=1)
X_2 = UnitX(Factor=1)
Y = UnitY(Factor=1)
line = LineSDL(Start=sift_2.Output0, Direction=X_2, Length="0.8")
line_2 = LineSDL(Start=sift_2.Output1, Direction=Y, Length="0.8")
line_3 = LineSDL(Start=sift_2.Output2, Direction=Z, Length="0.8")
combine_2 = CombineData(Input0=line, Input1=line_2, Input2=line_3)  # -> Result, Index
pipe = Pipe(Curve=combine_2.Result, Radius="0.05", Caps=1)

cull_2 = CullPattern(List=pt_3, CullPattern=panel_20)
line_4 = LineSDL(Start=cull_2, Direction=Vector(0, 0, 1), Length=1)

# ----
# sort
number_slider_4 = Slider(2, range=0..10)
random = Random(Range="0 to 9", Number="10", Seed=number_slider_4)
number_slider_5 = Slider(0.35, range=0..1)
pt_7 = ConstructPoint(XCoordinate="8", YCoordinate=random, ZCoordinate=0)
points_2 = PointList(Points=pt_7, Size=number_slider_5)
sort = SortList(Keys=random, ValuesA=pt_7)  # -> Keys, ValuesA
X_3 = UnitX(Factor=1)
move_2 = Move(Geometry=sort.ValuesA, Motion=X_3)  # -> Geometry, Transform
points_3 = PointList(Points=move_2.Geometry, Size=number_slider_5)
preview_5 = CustomPreview(Geometry=move_2.Geometry, Material=ColourSwatch(SwatchColor=RGB(255, 255, 255)))

# ----
# duplicate/repeat
number_slider_6 = Slider(5, range=2..10)
panel_30 = Panel("""Hello
Grasshopper""")
panel_31 = Panel("""Hello
Grasshopper""")
dup = DuplicateData(Data=panel_31, Number=Slider(2, range=2..10), Order=Toggle(True))
repeat = RepeatData(Data=panel_30, Length=number_slider_6)
panel_32 = Panel(dup)
panel_33 = Panel(repeat)

# ----
# merge, dispatch & weave
panel_34 = Panel("5")
series_12 = Series(Start=0, Step=1, Count=10)
series_13 = Series(Start=0, Step=1, Count=10)
charseq = CharSequence(Count=panel_34, CharPool="ABCDEFGHIJKLMNOPQRSTUVWXYZ", Format="{0}")
series_14 = Series(Start=0, Step=1, Count=panel_34)
panel_35 = Panel(series_13)
panel_36 = Panel(series_12)
dispatch_3 = Dispatch(List=series_13, DispatchPattern=[True, False])  # -> ListA, ListB
merge = Merge(Data1=series_14, Data2=charseq)
panel_37 = Panel(dispatch_3.ListA)
panel_38 = Panel(dispatch_3.ListB)
panel_39 = Panel(merge)

dispatch_4 = Dispatch(List=series_12, DispatchPattern=[True, False])  # -> ListA, ListB
weave_2 = Weave(Pattern=[0, 1], Stream0=dispatch_4.ListB, Stream1=dispatch_4.ListA, NullGaps=False)

panel_40 = Panel(weave_2)
