# Grasshopper definition 03_geometries.gh (Grasshopper 1.0.7)
# Copyright: Co-de-iT

# circle
crv = Curve(<curve referenced from the Rhino model>)
# closed polyline
crv_2 = Curve(<curve referenced from the Rhino model>)
# curves
crv_3 = Curve([<curve referenced from the Rhino model> x3])
# line
crv_4 = Curve(<curve referenced from the Rhino model>)
# polyline
crv_5 = Curve(<curve referenced from the Rhino model>)
# NURBS curve
crv_6 = Curve(<curve referenced from the Rhino model>)
# Positional checks
pt = Point(Point(-0.6196495134, 21.7632131, 0))
line = Line(crv_4)
# <title>
# 
# <description>
# 
# code by Alessio Erioli
# 
# v 0.1
# © a3 2021 / Creative Commons Attribution-Non Commercial-ShareAlike 4.0 International License
panel = Panel(crv_3)
merge = Merge(Data1=crv_2, Data2=crv)
crv_7 = Curve(crv_2)
end = EndPoints(Curve=crv_7)  # -> Start, End
explode = Explode(Curve=crv_7, Recursive=True)  # -> Segments, Vertices
cp = ControlPoints(Curve=crv_7)  # -> Points, Weights, Knots
crv_cp = CurveClosestPoint(Point=pt, Curve=crv_2)  # -> Point, Parameter, Distance
planar = Planar(Curve=crv_7)  # -> Planar, Plane, Deviation
incurves = PointInCurves(Point=pt, Curves=merge)  # -> Relationship, Index, Point
incurve = PointInCurve(Point=pt, Curve=crv_2)  # -> Relationship, Point
cls = Closed(Curve=crv_7)  # -> Closed, Periodic
points = PointList(Points=explode.Vertices, Size="0.5")
pt_2 = Point(Point(15, 0, 5))
# Breps
box = CenterBox(Base=pt_2, X="5", Y="5", Z="5")
pt_3 = Point(Point(15.34389919, 11.2231975, 6.558608285))
brep = Brep(box)
# from Rhino
brep_2 = Brep(<brep referenced from the Rhino model>)
merge_2 = Merge(Data1=brep, Data2=brep_2)
brepsinc = PointInBreps(Brep=merge_2, Point=pt_3, Strict=False)  # -> Inside, Index
brep_cp = BrepClosestPoint(Point=pt_3, Brep=brep_2)  # -> Point, Normal, Distance
brepinc = PointInBrep(Brep=brep, Point=pt_3, Strict=False)
debrep = DeconstructBrep(Brep=brep)  # -> Faces, Edges, Vertices
join = BrepJoin()  # -> Breps, Closed
panel_2 = Panel(brepsinc.Inside)
panel_3 = Panel(brepinc)
panel_4 = Panel(brepsinc.Index)
panel_5 = Panel(debrep.Edges)
panel_6 = Panel(debrep.Faces)
panel_7 = Panel(debrep.Vertices)
srf = Surface(reparameterize(debrep.Faces))
evalsrf = EvaluateSurface(Surface=srf, Point="0.5,0.5")  # -> Point, Normal, UDirection, VDirection, Frame
vdisex = VectorDisplayEx(Point=evalsrf.Point, Vector=evalsrf.Normal, Colour=RGB(0, 0, 0), Width=2)
number_slider = Slider(1, range=1..10)
# Meshes
pt_4 = Point(Point(30, 0, 5))
box_2 = CenterBox(Base=pt_4, X="5", Y="5", Z="5")
mbox = MeshBox(Base=box_2, XCount=number_slider, YCount=number_slider, ZCount=number_slider)
# from Rhino
mesh = Mesh(<mesh referenced from the Rhino model>)
mesh_2 = Mesh(mbox)
mjoin = MeshJoin()
disjoint = DisjointMesh()
pt_5 = Point(Point(28.99000487, 9.550876059, 6.558608285))

# ---- group: Welding
alignvert = AlignVertices(Tolerance=0.01)  # -> Result, Count
weld = WeldMesh(Mesh=alignvert.Result, Angle=3.141592654)

# ----
unweld = UnweldMesh(Angle=1.570796327)
flipm = FlipMesh(VertexNormals=True, FaceNormals=True, FaceOrientation=True)
unim = UnifyMesh()  # -> Result, Count
minc = MeshInclusion(Point=pt_5, Strict=False)
meshcp = MeshClosestPoint(Point=pt_5)  # -> Point, Index, Parameter
panel_8 = Panel(minc)
mesh_3 = Mesh(mesh_2)
facen = FaceNormals(Mesh=mesh_3)  # -> Centers, Normals
demesh = DeconstructMesh(Mesh=mesh_3)  # -> Vertices, Faces, Colours, Normals
demesh_2 = DeconstructMesh(Mesh=mesh_3)  # -> Vertices, Faces, Colours, Normals
medges = MeshEdges(Mesh=mesh_3)  # -> NakedEdges, InteriorEdges, NonManifoldEdges
panel_9 = Panel(demesh.Faces)
panel_10 = Panel(demesh.Vertices)
panel_11 = Panel(demesh.Colours)
panel_12 = Panel(demesh.Normals)
vdisex_2 = VectorDisplayEx(Point=demesh_2.Vertices, Vector=demesh_2.Normals, Colour=ColourSwatch(SwatchColor=RGB(255, 255, 255)), Width=2)
vdisex_3 = VectorDisplayEx(Point=facen.Centers, Vector=facen.Normals, Colour=RGB(0, 0, 0), Width=2)
