# Grasshopper definition 04_transformations.gh (Grasshopper 1.0.7)
# Copyright: Co-de-iT

pt = Point(Point(5.525269689, 3.045311665, 2.694545202))
pt_2 = Point(Point(-10, 0, 11.11595327))
# Orientation
# 
# simple orientation explanation
# 
# code by Alessio Erioli
# 
# v 0.1
# © a3 2021 / Creative Commons Attribution-Non Commercial-ShareAlike 4.0 International License
mesh = Mesh(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)
xy = XYPlane(Origin=pt)
yz = YZPlane(Origin=pt_2)

# ---- group: animate orientation
cluster = Cluster(geo=mesh, pln=xy, pln_2=yz, num=Slider(0, range=0..1))

# ----
orient = Orient(Geometry=mesh, Source=xy, Target=yz)  # -> Geometry, Transform
geo = Geometry(cluster)
medges = MeshEdges(Mesh=cluster)  # -> NakedEdges, InteriorEdges, NonManifoldEdges
preview = CustomPreview(Geometry=geo, Material=ColourSwatch(SwatchColor=RGB(255, 255, 255)))
geo_2 = Geometry(mesh)
X = UnitX(Factor="20")
move = Move(Geometry=geo_2, Motion=X)  # -> Geometry, Transform
pi = Pi(Factor=Slider(0.5, range=0..1))
pt_3 = Point(Point(0, 0, 0))
xz = XZPlane(Origin=Point(0, 0, 0))
rotate = Rotate(Geometry=move.Geometry, Angle=pi, Plane=pt_3)  # -> Geometry, Transform
pt_4 = Point(Point(0, 0, 0))
scale = Scale(Geometry=rotate.Geometry, Center=pt_4, Factor=Slider(0.432, range=0..1))  # -> Geometry, Transform

# ==== cluster Cluster
geo = ClusterInput()
pln = ClusterInput()
num = ClusterInput()
pln_2 = ClusterInput()
geo_2 = Geometry(geo)
pln_3 = Plane(pln)
num_2 = Number(num)
pln_4 = Plane(pln_2)
deplane = DeconstructPlane(Plane=pln_3)  # -> Origin, XAxis, YAxis, ZAxis
deplane_2 = DeconstructPlane(Plane=pln_4)  # -> Origin, XAxis, YAxis, ZAxis
interp = InterpolateData(Data=[deplane.Origin, deplane_2.Origin], Parameter=num_2, Interpolation=2)
interp_2 = InterpolateData(Data=[deplane.XAxis, deplane_2.XAxis], Parameter=num_2, Interpolation=2)
interp_3 = InterpolateData(Data=[deplane.YAxis, deplane_2.YAxis], Parameter=num_2, Interpolation=2)
pl = ConstructPlane(Origin=interp, XAxis=interp_2, YAxis=interp_3)
orient = Orient(Geometry=geo_2, Source=pln_3, Target=pl)  # -> Geometry, Transform
G = ClusterOutput(orient.Geometry)
