# Grasshopper definition 05_operators.gh (Grasshopper 1.0.7)
# Copyright: Co-de-iT

panel = Panel("-10.196152,-9.5,0;-7.598076,-9.5,0;-6.299038,-7.25,0;-8.897114,-7.25,0;-5,-9.5,0;-3.700962,-9.5,0;-3.051443,-8.375,0;-4.350481,-8.375,0;-2.401924,-9.5,0;-1.752405,-9.5,0;-1.427645,-8.9375,0;-2.077164,-8.9375,0;-1.102886,-9.5,0;0.196152,-9.5,0;-0.453367,-9.5,0;-0.128607,-8.9375,0;-0.778126,-8.9375,0;-1.752405,-8.375,0;-0.453367,-8.375,0;-1.102886,-8.375,0;-0.778126,-7.8125,0;-1.427645,-7.8125,0;-3.700962,-7.25,0;-1.102886,-7.25,0;-2.401924,-7.25,0;-1.752405,-6.125,0;-3.051443,-6.125,0;-7.598076,-5,0;-2.401924,-5.0,0;-5,-5,0;-5,-0.5,0;-3.700962,-2.75,0;-6.299038,-2.75,0")
# operators
# arithmetic
number_slider = Slider(0.25, range=0..10)
# trigonometric
number_slider_2 = Slider(255, range=0..360)
# utilities
number_slider_3 = Slider(1.5, range=0..2)
# comparison
number_slider_4 = Slider(20, range=0..100)
panel_2 = Panel("""120
alpha
13°,15°,25°
one more line
4-3-1943""")
division = Division(A="2", B="3")
# logic (Boolean)
toggle = BooleanToggle(False)
series = Series(Start=0, Step=1, Count=10)
series_2 = Series(Start=0, Step=1, Count=10)
# string/text
panel_3 = Panel("Grasshopper")
pt = Point(Point(20, 10, 0))
pt_2 = Point(Point(10, 0, 0))
pt_3 = Point(Point(10, 10, 0))
num = Number("0.666667")
num_2 = Number(division)
panel_4 = Panel(num_2)
panel_5 = Panel(series)
rad = Radians(Degrees=number_slider_2)
pi = Pi(Factor=number_slider_3)
not = GateNot(A=Toggle(False))
# 02 - operators
# 
# Operators in GH
# 
# code by Alessio Erioli
# 
# v 0.1
# © a3 2021 / Creative Commons Attribution-Non Commercial-ShareAlike 4.0 International License
addition = Addition(A=number_slider, B=Slider(5.313, range=0..10))
subtraction = Subtraction()
multiplication = Multiplication()
division_2 = Division()
mod = Modulus(A=Slider(20, range=0..100), B=Slider(12, range=0..100))
neg = Negative()
abs = Absolute()
larger = LargerThan(SecondNumber=0)  # -> LargerThan, OrEqualTo
smaller = SmallerThan(FirstNumber=number_slider_4, SecondNumber=Slider(20, range=0..100))  # -> SmallerThan, OrEqualTo
and = GateAnd(A=toggle, B="True")
or = GateOr(A="0", B="1")
concat = Concatenate(FragmentA="Hello", FragmentB=panel_3)
split = TextSplit(Text="0.5,1,0.3;0.2,-0.45,2.6", Separators=";")
join = TextJoin(Text=panel_2, Join="-")
ma = MassAddition(Input=series_2)  # -> Result, PartialResults
equals = Equality(FirstNumber=num, SecondNumber=num_2)  # -> Equality, Inequality
avr = Average(Input=series)
interp = InterpolateData(Data=[pt_2, pt_3, pt], Parameter=Slider(0, range=0..1), Interpolation=2)
panel_6 = Panel(pi)
panel_7 = Panel(or)
panel_8 = Panel(concat)
panel_9 = Panel(and)
panel_10 = Panel(not)
panel_11 = Panel(split)
# <<< per questo (ed altri motivi legati alla precisione) non useremo mai Equality su una misura o dato con decimali, ma useremo altri metodi di confronto basati su soglie di tolleranza
panel_12 = Panel(equals.Equality)
panel_13 = Panel(ma.Result)
panel_14 = Panel(interp)
panel_15 = Panel(ma.PartialResults)
panel_16 = Panel([smaller.SmallerThan, smaller.OrEqualTo])
panel_17 = Panel(mod)
panel_18 = Panel(avr)
sqr = Square()
sqrt = SquareRoot()
panel_19 = Panel(addition)
panel_20 = Panel(join)
split_2 = TextSplit(Text=split, Separators=",")
sin = Sine(Value=rad)
cos = Cosine(Value=rad)
int = Integer([panel_9, panel_7, panel_10])
panel_21 = Panel(sin)
panel_22 = Panel(cos)
pt_4 = Point(panel_11)
panel_23 = Panel(split_2)
one_over_x = OneOverX()
pt_5 = Point([Point(38.33869234, -3.892560228, -0.3298932013), Point(44.41665463, 2.737039969, -4.111530999), Point(36.81205147, 4.516898365, -0.1741205133), Point(44.46371395, 4.451836482, 4.720496992), Point(44.53516213, -4.873142443, 4.639904331), Point(36.87265342, 0.1008270891, -4.849754767)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])
panel_24 = Panel(int)
asin = ArcSine(Value=sin)
acos = ArcCosine(Value=cos)
pline = PolyLine(Vertices=pt_4, Closed=False)
avr_2 = Average(Input=pt_5)
panel_25 = Panel(acos)
panel_26 = Panel(asin)
deg = Degrees(Radians=asin)
deg_2 = Degrees(Radians=acos)
ln = Line(StartPoint=pt_5, EndPoint=avr_2)

panel_27 = Panel(deg)
panel_28 = Panel(deg_2)

vec = Vector(Vector(3, 0, 0))
vec_2 = Vector(Vector(4, 4, 0))
# vector operations
pt_6 = Point(Point(3, 0, 0))
pt_7 = Point(Point(0, 4, 0))
panel_29 = Panel(vec)
panel_30 = Panel(vec_2)
vec_3 = Vector(pt_6)
vec_4 = Vector(pt_7)
# le operazioni +,-,*,/ funzionano anche su punti e vettori
panel_31 = Panel("2")
addition_2 = Addition(A=vec_3, B=vec_4)
multiplication_2 = Multiplication(A=vec_3, B=panel_31)
dprod = DotProduct(VectorA=vec, VectorB=vec_2, Unitize=Toggle(False))
angle = Angle(VectorA=vec, VectorB=vec_2)  # -> Angle, Reflex
xprod = CrossProduct(VectorA=vec, VectorB=vec_2, Unitize=Toggle(False))  # -> Vector, Length
subtraction_2 = Subtraction(A=vec_3, B=vec_4)
acos_2 = ArcCosine(Value=dprod)
pt_8 = Point(subtraction_2)
pt_9 = Point(addition_2)
panel_32 = Panel(angle.Angle)
panel_33 = Panel(angle.Reflex)
panel_34 = Panel(xprod.Vector)
cos_2 = Cosine(Value=angle.Angle)
deg_3 = Degrees(Radians=acos_2)
panel_35 = Panel(dprod)
# Cross product: Il Cross product genera il vettore perpendicolare ai due, la cui intensità è il prodotto delle due intensità in input e del seno dell'angolo compreso (1 se i vettori sono ortogonali)
panel_36 = Panel(cos_2)
# Dot product e Vector Angle: Il Dot product tra due vettori di lunghezza unitaria è il Coseno dell'angolo compreso tra due vettori.
# 
# In generale è la lunghezza del segmento ottenuto proiettando il vettore A su B moltiplicato per l'intensità di B:
# 
# a . b = |a|*|b|*cos(ang)
panel_37 = Panel(deg_3)
