# Grasshopper definition 07_Data Matching.gh (Grasshopper 1.0.7)
# Copyright: Co-de-iT

# Data Matching: Il data matching tra due (o più) liste mette tra loro a confronto i dati con indice corrispondente. In caso di liste con lunghezza differente, i dati in eccesso della lista più lunga vengono confrontati con l'ultimo della lista più corta.
# 
# Nel caso dei Data Trees (che sono "liste di liste") questo criterio viene applicato due volte:
# 
# . prima ai rami (branches): rami con indice corrispondente verranno confrontati tra loro; in caso di Trees con numero di rami differente, i rami in eccesso verranno confrontati con l'ultimo del Tree più piccolo;
# 
# . poi agli elementi delle liste all'interno dei rami (vedi sopra)
# list <> singe item
panel = Panel("""A
B
C""")
# list <> list (equal length)
panel_2 = Panel("""A
B
C""")
panel_3 = Panel("""0
1
2""")
# list <> list (different length)
panel_4 = Panel("""A
B
C
D
E""")
panel_5 = Panel("""0
1
2""")
concat = Concatenate(FragmentA=panel, FragmentB="0")
concat_2 = Concatenate(FragmentA=panel_2, FragmentB=panel_3)
concat_3 = Concatenate(FragmentA=panel_4, FragmentB=panel_5)
# Data matching
# 
# Interazione tra strutture dati: dato singolo, lista, Data Tree
# 
# code by Alessio Erioli
# 
# v 0.1
# © a3 2021 / Creative Commons Attribution-Non Commercial-ShareAlike 4.0 International License
panel_6 = Panel(concat)
panel_7 = Panel(concat_2)
panel_8 = Panel(concat_3)
txt = Text(Tree({0;0}: ["A", "B", "C"], {0;1}: ["D", "E", "F"]))
txt_2 = Text(Tree({0;0}: ["A", "B", "C"], {0;1}: ["D", "E", "F"]))
txt_3 = Text(Tree({0;0}: ["A", "B", "C"], {0;1}: ["D", "E", "F"]))
int = Integer(Tree({0;0}: [0, 1, 2], {0;1}: [3, 4, 5]))
# tree <> singe item
panel_9 = Panel(txt)
# tree <> list
# M=2
# N=3
# N=3
panel_10 = Panel(txt_2)
# tree <> tree (same structure)
# M=2
# N=3
panel_11 = Panel(txt_3)
panel_12 = Panel(int)
# M=1
# N=3
panel_13 = Panel("""0
1
2""")
concat_4 = Concatenate(FragmentA=txt_2, FragmentB=panel_13)
concat_5 = Concatenate(FragmentA=txt_3, FragmentB=int)
concat_6 = Concatenate(FragmentA=panel_9, FragmentB="0")
panel_14 = Panel(concat_4)
# Per convenienza indicheremo con M il numero dei rami (branches) e N il numero di elementi (items) contenuti nella lista.
# 
# In questo caso ogni Data Tree ha M = 2 rami e N = 3 elementi per ciascuna lista
panel_15 = Panel(concat_5)
panel_16 = Panel(concat_6)
int_2 = Integer([0, 1, 2])
# Entwine
panel_17 = Panel("""A
B
C
D
E""")
panel_18 = Panel("""0
1
2""")
panel_19 = Panel("""-
/
#
@
§""")
# Merge
panel_20 = Panel("""A
B
C
D
E""")
panel_21 = Panel("""0
1
2""")
panel_22 = Panel(int_2)
panel_23 = Panel("""A
B
C
D
E""")
entwine = Entwine(Branch00=panel_17, Branch01=panel_18, Branch02=panel_19, FlattenInputs=True)
merge = Merge(Data1=panel_20, Data2=panel_21)
merge_2 = Merge(Data1=panel_23, Data2=panel_22)
panel_24 = Panel(entwine)
panel_25 = Panel(merge)
panel_26 = Panel(merge_2)

# ----
# tree <> tree (same M, different Ns)
# tree <> tree (different M, different Ns)
int_3 = Integer(Tree({0;0}: [0, 1, 2], {0;1}: [3, 4], {0;2}: [5, 6, 7, 8]))
txt_4 = Text(Tree({0;0}: ["A", "B", "C"], {0;1}: ["D", "E", "F"], {0;2}: ["G", "H", "I"]))
int_4 = Integer(Tree({0;0}: [0, 1, 2], {0;1}: [3, 4]))
txt_5 = Text(Tree({0;0}: ["A", "B", "C"], {0;1}: ["D", "E", "F"], {0;2}: ["G", "H", "I"]))
panel_27 = Panel(int_4)
panel_28 = Panel(txt_4)
panel_29 = Panel(int_3)
# BORDERLINE cases
panel_30 = Panel(txt_5)
concat_7 = Concatenate(FragmentA=txt_4, FragmentB=int_4)
concat_8 = Concatenate(FragmentA=txt_5, FragmentB=int_3)
panel_31 = Panel(concat_7)
panel_32 = Panel(concat_8)

# ----
# tree <> tree (different M, different Ns, different branch indices)
# Casi come questo (estremo) non dovrebbero nemmeno mai presentarsi.
# 
# I rami vengono confrontati per il loro ordine sequenziale (il primo ramo del Data Tree A con il primo del Data Tree B etc.), sempre con la regola di confrontare i rami in eccesso del Data Tree che ne ha di più con l'ultimo del Data Tree che ne ha di meno.
# Gli indici vengono ereditati dal DataTree con più rami.
int_5 = Integer(Tree({3}: [3, 4], {4}: [5, 6, 7, 8]))
txt_6 = Text(Tree({0;0}: ["A", "B", "C"], {0;1}: ["D", "E", "F"], {0;2}: ["G", "H", "I"]))
# WORRISOME case
panel_33 = Panel(txt_6)
panel_34 = Panel(int_5)
concat_9 = Concatenate(FragmentA=txt_6, FragmentB=int_5)
panel_35 = Panel(concat_9)
