# Grasshopper definition 08_Interpolation.gh (Grasshopper 1.0.7)
# Copyright: Co-de-iT
# plug-ins: Human

# ----
# <title>
# 
# <description>
# 
# code by Alessio Erioli
# 
# v 0.1
grid = ValueList({"rectangular": 0, "hexagonal": 1}, selected="rectangular")
geometry = ValueList({"single point": 0, "single curve": 1, "multiple points": 2, "multiple curves": 3}, selected="single point")
values = ValueList({"continuous": 0, "discrete": 1}, selected="continuous")

crv = Curve(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)
pt = Point(Point(15.13943064, 38.86957801, 0))
pt_2 = Point(Point(24.69196363, 25.23108864, 0))
pt_3 = Point(Point(42.97586734, 25.23108864, 0))
pt_4 = Point(Point(12.63282846, 10.73443562, 0))
crv_2 = Curve([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])
# © a3 2021 / Creative Commons Attribution-Non Commercial-ShareAlike 4.0 International License
recgrid = Rectangular(Plane=PlaneXY(0, 0, 0), SizeX="1", SizeY="1", ExtentX="50", ExtentY="50")  # -> Cells, Points
hexgrid = Hexagonal(Plane=PlaneXY(0, 0, 0), Size="1", ExtentX="35", ExtentY="30")  # -> Cells, Points
merge = Merge(Data1=pt, Data2=pt_3, Data3=pt_4)
filter = StreamFilter(Gate=grid, Stream0=recgrid.Points, Stream1=hexgrid.Points)
filter_2 = StreamFilter(Gate=geometry, Stream0=pt_2, Stream1=crv, Stream2=merge, Stream3=crv_2)

previewlw = CustomPreviewLineweights(Geometry=filter_2, Shader=ColourSwatch(SwatchColor=RGB(255, 0, 0)), Thickness="3", Absolute=False)

pt_5 = Point(filter)
pull = PullPoint(Point=filter, Geometry=filter_2, ClosestOnly=True)  # -> ClosestPoint, Distance

# ----
# limit/cutoff
# Try them one at a time or combined in chain
high_cutoff = Slider(10, range=10..100)
low_cutoff = Slider(2.864, range=0..20)
min = Minimum(A=pull.Distance, B=high_cutoff)
max = Maximum(A=min, B=low_cutoff)

# ----
# remap values (normalize)
num = Number(pull.Distance)
bnd = Bounds(Numbers=flatten(num))
remap = RemapNumbers(Value=num, Source=bnd, Target=Domain(0, 1))  # -> Mapped, Clipped

bar_graph = BarGraph(num, BarColor=RGB(255, 0, 90))
bar_graph_2 = BarGraph(remap.Mapped, BarColor=RGB(0, 208, 255))

# ----
# manipulate distribution
sqrt = SquareRoot(Value=remap.Mapped)
sqr = Square(Value=remap.Mapped)
graph = GraphMapper(remap.Mapped, x0=0, x1=1, y0=0, y1=1)

# ----
# min-Max values
min_2 = Slider(0.05, range=0..1)
max_2 = Slider(0.5, range=0..1)
dom = ConstructDomain(DomainStart=min_2, DomainEnd=max_2)

bar_graph_3 = BarGraph(graph, BarColor=RGB(0, 93, 255))

# ----
# discrete
# or input your own list. Number of values should match number of cases.
n_cases = Slider(4, range=2..10)
subtraction = Subtraction(A=n_cases, B="1")
range = Range(Domain=dom, Steps=subtraction)
multiplication = Multiplication(A=graph, B=subtraction)
panel = Panel(range)
panel_2 = Panel("""0.5
0.1
0.05
1""")
int = Integer(multiplication)
item = ListItem(List=range, Index=int, Wrap=True)

# ----
# continuous
remap_2 = RemapNumbers(Value=graph, Source=Domain(0, 1), Target=dom)  # -> Mapped, Clipped

bar_graph_4 = BarGraph(remap_2.Mapped, BarColor=RGB(255, 187, 0))
bar_graph_5 = BarGraph(item, BarColor=RGB(221, 255, 0))
filter_3 = StreamFilter(Gate=values, Stream0=remap_2.Mapped, Stream1=item)

cir = Circle(Plane=pt_5, Radius=filter_3)
previewlw_2 = CustomPreviewLineweights(Geometry=cir, Shader=ColourSwatch(SwatchColor=RGB(0, 0, 0)), Absolute=False)
