# Grasshopper definition filtering and routing.gh (Grasshopper 1.0.7)
# Copyright: Co-de-iT

geo = Geometry([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])
demesh = DeconstructMesh(Mesh=geo)  # -> Vertices, Faces, Colours, Normals
# FILTER C
# FILTER B
# filters in parallel
# Filters can also be arranged in parallel,
# or, better, CONDITIONS can be arranged in parallel,
# using boolean operators to combine patterns
# filtering condition A
# filtering condition B
# filtering condition C
input_data = Relay()
# examples
series = Series(Start=0, Step=1, Count=10)

# ----
# filters in serial chain
# FILTER A
# FILTER B
external_data_optional = Relay()

# ----
# mandatory connection
# optional connection
# filtering condition
# (generates a True/False boolean pattern)
# A Filter passes only the data with corresponding True (or 1) value in the pattern
# Filters are useful when I need to single out part of the data flow to selectively operate on it. An advantage is that they can be modular and easily composed to form more complex filters (see below)
external_data_optional_2 = Relay()
# A guide to FILTERING & ROUTING
# FILTERING is the act of selecting specific items from a data flow
# 
# ROUTING is the act of arranging your data flow in multiple flows
# 
# Both operate by means of CONDITIONS
# Conditions
# 1/5 - CONDITION: A CONDITION is a question that admits a limited set of answers, either a Yes/No (but in logical terms it's True/False, or 1/0), or an integer number when the possible options are more than 2.
# 
# The CONDITION question must be asked to all of the data items we want to filter or route, which means that for each item in the data flow I must have a corresponding pattern value (whether True/False or numerical integer).
# 
# More generally, the filtering/branching pattern must match the structure and number of items of the input data, so that each of its values can be associated to the corresponding item for filtering/routing.
# Boolean patterns (or masks)
# Boolean patterns or masks are sequences of True/False values associated to some data, one value for each data item, and with the same structure.
# 
# Filter operations retain only the data items associated with True values.
# False
# True
# True
# False
# False
# True
# False
# A
# B
# C
# D
# E
# F
# G
# boolean
# pattern
# data
# Filter (Cull Pattern) structure
input_data_2 = Relay()
# A
# B
# C
# D
# E
# F
# G
# B
# C
# F
# Filtering
# result
# (Cull pattern)
# Filtering
# component
output_filtered_data = Relay()

item = ListItem(List=demesh.Colours, Index=0, Wrap=True)  # -> flatten(Item)
volume = Volume(Geometry=geo)  # -> Volume, Centroid

# ----
# Composite Filters
# Filters can be modular and commutative,
# which means, if they are not co-dependent,
# they can be combined in serial chains.
# the order of a filter in a chain does not affect
# the final result, but it might affect computation time
# filtering condition
# (generates a True/False boolean pattern)
input_data_3 = Relay()
# FILTER
# FILTER C
cull = CullPattern(List=input_data_3, CullPattern=[False, False, True, True])

panel = Panel(series)

# ----
# get the blue spheres
argb = SplitARGB(Colour=item)  # -> Alpha, Red, Green, Blue
# Filtering with Cull is a one-way operation, the original data structure cannot be reconstructed.
# 
# If you need to recompose the data structure after your selective operation, use a Router instead of a Filter.
panel_2 = Panel("1")
# get the spheres with volume larger than
# the threshold
larger = LargerThan(FirstNumber=volume.Volume, SecondNumber=Slider(0.631, range=0..5))  # -> LargerThan, OrEqualTo
equals = Equality(FirstNumber=argb.Blue, SecondNumber=panel_2)  # -> Equality, Inequality
# These are also examples of combining filters in parallel (see below)
not = GateNot(A=equals.Equality)
# get the spheres with volume larger than
# the threshold OR blue
or = GateOr(A=larger.LargerThan, B=equals.Equality)
# Try the different patterns in the input P of Cull Pattern
# get the spheres with volume larger than
# the threshold AND blue
and = GateAnd(A=larger.LargerThan, B=equals.Equality)
# get the spheres with volume larger than
# the threshold AND NOT blue
and_2 = GateAnd(A=larger.LargerThan, B=not)

larger_2 = LargerThan(FirstNumber=series, SecondNumber=Slider(6.351, range=0..10))  # -> LargerThan, OrEqualTo
boolean_pattern = Panel(larger_2.LargerThan)
# do something with these items
cull_2 = CullPattern(List=series, CullPattern=larger_2.LargerThan)
cull_3 = CullPattern(List=geo, CullPattern=and)
# FILTER A
# boolean
# operator
# (AND, OR, XOR, etc.)
cull_4 = CullPattern(List=input_data, CullPattern=[False, False, True, True])
panel_3 = Panel(cull_2)
# do something with these items
# (in this case I only move them along Z)
move = Move(Geometry=cull_3, Motion=Vector(0, 0, 10))  # -> Geometry, Transform
geo_2 = Geometry([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])
series_2 = Series(Start=0, Step=1, Count=10)
# examples
series_3 = Series(Start=0, Step=1, Count=10)

# ----
# <title>
# 
# <description>
# 
# code by Alessio Erioli
# 
# v 0.1
# © a3 2021 / Creative Commons Attribution-Non Commercial-ShareAlike 4.0 International License
# most common comparers
larger_3 = LargerThan(SecondNumber=0)  # -> LargerThan, OrEqualTo
# 2/5 - design with numbers: CONDITIONS are part of a design strategy, so there's no "standard manual" for them - they are a key part of translating design intention into algorithms.
# 
# But the common ground here is that they always must boil down to primitive data (like boolean or integer values), no matter how complex the objects we want to filter or route.
# 
# This means that a condition must operate on numerical values at some point, making use of comparers like smaller than, larger than or equal to.
# 3/5 - example: For example, if I want to know if a list of objects (a, b, c...) is close or far from another object X:
# 
# . first, I have to define what's "near" and "far" -> a numerical threshold ("near" is below threshold, "far" is above)
# 
# . then, I have to compute the distance between each object and the object X: a distance can only be computed between points, so I have to define a point for each of my objects (they should allow comparison, so I must compute them in the same way): the mass centroid is usually a good choice
# 
# . the distances are compared with the threshold using smaller than, producing a True ("near") or False ("far") pattern
# 
# . with that pattern, I can filter only the near objects or route them in near and far separated flows.
# Routing operations send data items on separate channels according to the True/False associated value.
smaller = SmallerThan(SecondNumber=0)  # -> SmallerThan, OrEqualTo
# False
# True
# True
# False
# False
# True
# False
# A
# B
# C
# D
# E
# F
# G
similar = Similarity(Threshold=0.1)  # -> Similarity, AbsoluteDifference
equals_2 = Equality()  # -> Equality, Inequality

# ----
# Branching/Routing condition
# (generates a True/False boolean pattern
# or a list of 0 and 1)
# A Boolean Router sorts data in 2 channels:
# 
# . one with corresponding True (or 1) value in the pattern
# 
# . one with corresponding False (or 0) value in the pattern
# Boolean Routers are useful when I need to split my data into 2 different subsets to perform different operations on each subset.
# 
# It can be considered a special case of a Case Router, with only 2 output channels.
external_data_optional_3 = Relay()
# boolean
# pattern
# data
# Boolean Router (Dispatch) structure
input_data_4 = Relay()
output_data_false_0 = Relay()
# Routing
# result
# (Dispatch)
# A
# D
# E
# G
# Routing
# component
output_data_true_1 = Relay()

# ----
# Nested Boolean Routers
# Boolean Routers can be nested, allowing
# complex sub-filtering while retaining the
# original data structure at the end
# Branching/Routing
# condition
input_data_5 = Relay()
pattern = Relay()
dispatch = Dispatch(List=input_data_5, DispatchPattern=pattern)  # -> ListA, ListB
weave = Weave(Pattern=pattern, Stream0=dispatch.ListB, Stream1=dispatch.ListA, NullGaps=False)

panel_4 = Panel(series_3)
# route the spheres based on volume threshold
volume_2 = Volume(Geometry=geo_2)  # -> Volume, Centroid

# ----
# Branching/Routing
# condition'
operation_a_input = Relay()
pattern_2 = Relay()
# The same nesting can also happen on all the "operation B" data streams
dispatch_2 = Dispatch(List=operation_a_input, DispatchPattern=pattern_2)  # -> ListA, ListB
weave_2 = Weave(Pattern=pattern_2, Stream0=dispatch_2.ListB, Stream1=dispatch_2.ListA, NullGaps=False)

# ----
# same result
# Branching/Routing
# condition''
operation_a_input_2 = Relay()
pattern_3 = Relay()
dispatch_3 = Dispatch(List=operation_a_input_2, DispatchPattern=pattern_3)  # -> ListA, ListB
# ... etc.
weave_3 = Weave(Pattern=pattern_3, Stream0=dispatch_3.ListB, Stream1=dispatch_3.ListA, NullGaps=False)

larger_4 = LargerThan(FirstNumber=series_2, SecondNumber=Slider(4.929, range=0..10))  # -> LargerThan, OrEqualTo
# Recomposing the data flow (Boolean and Case Routers only)
panel_5 = Panel(series_2)
larger_5 = LargerThan(FirstNumber=volume_2.Volume, SecondNumber=Slider(1.227, range=0..5))  # -> LargerThan, OrEqualTo
larger_6 = LargerThan(FirstNumber=series_3, SecondNumber=Slider(5.401, range=0..10))  # -> LargerThan, OrEqualTo
dispatch_4 = Dispatch(List=geo_2, DispatchPattern=larger_5.LargerThan)  # -> ListA, ListB
dispatch_5 = Dispatch(List=series_2, DispatchPattern=larger_4.LargerThan)  # -> ListA, ListB
# Weave can reconstruct the original data structure using the same branching/routing pattern, remembering to wire the channels correctly (0 False, 1 True)
panel_6 = Panel("3.6")
boolean_pattern_2 = Panel(larger_6.LargerThan)
# do something with these items
swatch = ColourSwatch(SwatchColor=RGB(255, 255, 255))
# do something else with these items
# The operations (both those on data and those used to produce the pattern) are not relevant per se in this guide, what matters is to understand how to selectively organize, filter and split data.
# 
# More complex operations on the data require just the same filtering or branching structure.
# 
# In more technical words, the topology of the data and operations matters more than their nature.
swatch_2 = ColourSwatch(SwatchColor=RGB(0, 0, 0))
multiplication = Multiplication(A=dispatch_5.ListB, B="2")
division = Division(A=dispatch_5.ListA, B=panel_6)

# ----
# most common boolean operators
and_3 = GateAnd()
# 4/5 - composite conditions: Sometimes, conditions require more than one comparison. For example, I want the objects of color blue near to another object X.
# 
# This means I have to perform 2 checks for each object:
# 
# . is it near (below distance threshold)?
# . is it blue?
# 
# Then, those conditions must be composed using boolean operators, in this case AND because I want object that are near AND blue.
# 
# If I wanted objects that are blue OR near, I have to use the OR operator.
# 
# If I wanted the objects that are near AND NOT blue... well, you can figure out the rest.
# B
# C
# F
or_2 = GateOr()
# 5/5 - examples of common comparison values: So, which values to choose for comaprisons?
# 
# . values might come directly associated with an object: an integer number (i.e. an index), or a floating point number (i.e. representing a weight)
# 
# . or they might be computed from geometric features as a number (i.e. area, volume), a point (i.e. centroid, reference plane origin), or a vector (i.e. average normal, vertex normal, face normal)
# 
# Geometrically speaking, the 2 basic comparisons are position and orientation, meaning: distance between points and angle between vectors.
not_2 = GateNot()

# ----
# do something with these items
# do something else with these items
dispatch_6 = Dispatch(List=series_3, DispatchPattern=larger_6.LargerThan)  # -> ListA, ListB
mcol = MeshColours(Mesh=dispatch_4.ListB, Colours=swatch_2)
mcol_2 = MeshColours(Mesh=dispatch_4.ListA, Colours=swatch)

# ----
# Sift is a more generalized case of dispatch that allows more than 2 output channels. In its default state it has 2 options and it works like dispatch.
# REMINDER: booleans can always be cast to integers (0 False, 1 True)
number_slider = Slider(3.5, range=0..10)
series_4 = Series(Start=0, Step=1, Count=10)
panel_7 = Panel(series_4)
larger_7 = LargerThan(FirstNumber=series_4, SecondNumber=number_slider)  # -> LargerThan, OrEqualTo
boolean_pattern_3 = Panel(larger_7.LargerThan)
int = Integer(larger_7.LargerThan)
sift = SiftPattern(List=series_4, SiftPattern=larger_7.LargerThan)  # -> Output0, Output1
boolean_pattern_4 = Panel(int)

weave_4 = Weave(Pattern=larger_4.LargerThan, Stream0=multiplication, Stream1=division, NullGaps=False)
# Recomposing the original data structure is not always necessary, but if you have to, here are some ways to do it.
# 
# Dispatch is usually complemented by a Weave component, while with Sift there are options to use either Combine or Weave (both have their caveats - see examples below).
# 
# Again, no need to use these if you don't need to recompose the original data structure!
panel_8 = Panel(weave_4)
panel_9 = Panel(dispatch_6.ListA)
panel_10 = Panel(dispatch_6.ListB)
series_5 = Series(Start=0, Step=1, Count=10)
series_6 = Series(Start=0, Step=1, Count=10)
# examples
series_7 = Series(Start=0, Step=1, Count=10)
geo_3 = Geometry([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])

# ----
# Branching/Routing condition
# (generates a list of integers like 0, 1, 2...)
# ... etc.
# An Case Router sorts data in multiple channels, according to the corresponding integer value in the pattern (0, 1, 2, ...)
# Case Routers are useful when I need to split my data into more than 2 different subsets, to perform different operations on each subset.
# 
# It can be considered as a more general case of a Boolean Router.
external_data_optional_4 = Relay()
# Integer patterns (or masks)
# Integer patterns or masks are sequences of integer values associated to some data, one value for each data item, and with the same structure.
# 
# They are used in Case Routing operations when the possible cases are 3 or more, sending data items on separate channels according to their corresponding associated index.
# 0
# 0
# 1
# 1
# 2
# 0
# 2
# 1
# A
# B
# C
# D
# E
# F
# G
# 1
# 2
# integer
# pattern
# data
# Case Router (Sift) structure
input_data_6 = Relay()
# A
# E
# B
# C
# G
# Case Routing
# result
# (Sift)
# D
# F
# Routing
# component
output_data_0 = Relay()
output_data_1 = Relay()
output_data_2 = Relay()

panel_11 = Panel(series_5)
panel_12 = Panel(series_7)
# Nested Case Routers
# This is tricky to show, but it is exactly the same
# Bolean Router logic, only with more channels
# involved. For such complex setups, I advise
# using the safer option with Clean Tree + Weave
panel_13 = Panel("3")

# ----
# Sift has a different way of treating data: it replaces removed data in each channel with <null> values
# 
# This can be problematic if you are not aware of this behavior, so be careful!
panel_14 = Panel(sift.Output1)
panel_15 = Panel(sift.Output0)

volume_3 = Volume(Geometry=geo_3)  # -> Volume, Centroid
# divide distance from each centroid to a point in 4 domains and use the domain index as a sift pattern
# Again, the operations that build the integer pattern are not relevant per se. What's relevant is to build a pattern with one index per object.
pt = Point(Point(35.13165775, 2.031802394, 0))
dist = Distance(PointA=volume_3.Centroid, PointB=pt)
bnd = Bounds(Numbers=dist)
div = DivideDomain(Domain=bnd, Count="4")
fdom = FindDomain(Domains=div, Number=dist, Strict=False)  # -> Index, Neighbour

mod = Modulus(A=series_6, B=panel_13)
mod_2 = Modulus(A=series_5, B="3")
mod_3 = Modulus(A=series_7, B="3")
integer_pattern = Panel(mod_2)
integer_pattern_2 = Panel(mod_3)
sift_2 = SiftPattern(List=series_5, SiftPattern=mod_2)  # -> Output0, Output1, Output2

# ----
# Safer Option
# A safer (although more complicated) option is to purge nulls from each output using clean tree BEFORE performing any operation, using Weave with multiple channels and the initial pattern to recompose the original data structure.
sift_3 = SiftPattern(List=series_6, SiftPattern=mod)  # -> Output0, Output1, Output2
clean = CleanTree(RemoveNulls=True, RemoveInvalid=True, RemoveEmpty=False, Tree=sift_3.Output2)
clean_2 = CleanTree(RemoveNulls=True, RemoveInvalid=True, RemoveEmpty=False, Tree=sift_3.Output0)
clean_3 = CleanTree(RemoveNulls=True, RemoveInvalid=True, RemoveEmpty=False, Tree=sift_3.Output1)
multiplication_2 = Multiplication(A=clean_2, B="1")
addition = Addition(A=clean_3, B="0")
pow = Power(A=clean, B="1")
weave_5 = Weave(Pattern=mod, Stream0=multiplication_2, Stream1=addition, Stream2=pow, NullGaps=False)
panel_16 = Panel(weave_5)

# ----
# do something with these items
# do something else with these items
# do something other with these items
sift_4 = SiftPattern(List=series_7, SiftPattern=mod_3)  # -> Output0, Output1, Output2
# Combine Data automatically reconstructs the original data structure if nulls are preserved (this is not always the case: see below)
panel_17 = Panel("3.6")
sift_5 = SiftPattern(List=geo_3, SiftPattern=fdom.Index)  # -> Output0, Output1, Output2, Output3

# ----
# BEWARE
# Some operations (like multiplication), do not preserve null values - in those cases Combined cannot be used, as it would deliver wrong results.
integer_pattern_3 = Panel(sift_2.Output2)
multiplication_3 = Multiplication(A=sift_2.Output2, B="2")
integer_pattern_4 = Panel(multiplication_3)

division_2 = Division(A=sift_2.Output0, B=panel_17)
pow_2 = Power(A=sift_2.Output2, B="3")
sqrt = SquareRoot(Value=sift_2.Output1)
# do something with these items
# do something else with these items
swatch_3 = ColourSwatch(SwatchColor=RGB(255, 255, 255))
combine = CombineData(Input0=division_2, Input1=sqrt, Input2=pow_2)  # -> Result, Index
panel_18 = Panel(sift_4.Output0)
# ... etc.
panel_19 = Panel(sift_4.Output2)
panel_20 = Panel(sift_4.Output1)
mcol_3 = MeshColours(Mesh=sift_5.Output0, Colours=swatch_3)
# ... etc.
mcol_4 = MeshColours(Mesh=sift_5.Output2, Colours=ColourSwatch(SwatchColor=RGB(61, 61, 61)))
# There is a better and more concise way to do this, but for this example I preferred the way of clarity of structure of operations.
mcol_5 = MeshColours(Mesh=sift_5.Output1, Colours=ColourSwatch(SwatchColor=RGB(178, 178, 178)))
mcol_6 = MeshColours(Mesh=sift_5.Output3, Colours=ColourSwatch(SwatchColor=RGB(0, 0, 0)))
panel_21 = Panel(combine.Index)
panel_22 = Panel(combine.Result)
