# Grasshopper definition orientation.gh (Grasshopper 1.0.7)
# Copyright: Co-de-iT
# plug-ins: froGH, Human

# reference vector (fundamental direction)
# So... is an object horizontal, vertical, or...?
Z = UnitZ(Factor=1)
# single condition
# Recognizing an object orientation might be tricky.
# 
# To check for orientation, we must check the angle between two vectors, one related to the object and the other one of our fundamental directions (the reference direction).
# 
# Instead of the Vector angle (range 0 to Pi, difficult to manage), we can take a related value, the dot product, which is the cosine of the angle between vectors (range -1 to 1, much better).
# 
# Why is that better? Because two parallel vector have dot product either 1 or -1 (if their arrows are pointing in the same or opposite direction), while 2 perpendicular vectors have always dot product 0. Much easier than Pi/2.
# object-related vectors
vec = Vector([Vector(1, 0, 0), Vector(0, -1, 0), Vector(0, 0, 1), Vector(0, 0, -1)])

# ---- group: Direction vectors
# W
# E
# S
# N
# D
# U
panel = Panel("-1")
# A guide to ORIENTATION
# Directions
# Let's consider, for the sake of simplicity, only the axis directions in a XYZ space.
# 
# We can recognize 6 different directions: +X, +Y, +Z and -X, -Y, -Z.
# 
# In axis order, and considering N = +Y, we have the following:
X = UnitX(Factor=panel)
X_2 = UnitX(Factor=1)
Y = UnitY(Factor=panel)
Y_2 = UnitY(Factor=1)
Z_2 = UnitZ(Factor=panel)
# How many orientations?
Z_3 = UnitZ(Factor=1)
merge = Merge(Data1=X, Data2=X_2, Data3=Y, Data4=Y_2, Data5=Z_2, Data6=Z_3)

# ----
dprod = DotProduct(VectorA=vec, VectorB=Z, Unitize=False)
angle = Angle(VectorA=vec, VectorB=Z)  # -> Angle, Reflex

# ---- group: Internalized Mesh
# Now, let's consider a sample geometry that has no symmetry in X, Y, or Z, so that we can recognize its orientation in space along our 6 directions.
# 
# This object has, under our 6 directions, 24 unique orientations in space: for each direction, there are 4 possible rotations. For example, considering an orientation plane with its Z pointing up (along the global Z), its X axis can be oriented along the global X, or the global Y, or the global -X, or the global -Y (4 rotations in total).
# Recognizing orientation
mesh = Mesh(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)

# ----
panel_2 = Panel(angle.Angle)
cos = Cosine(Value=angle.Angle)
panel_3 = Panel(cos)
panel_4 = Panel(dprod)

# ----
# try to change the reference vector (eventually applying -1 to switch direction) ot see which objects are selected
panel_5 = Panel("-1")
Y_3 = UnitY(Factor=panel_5)
Z_4 = UnitZ(Factor=1)
X_3 = UnitX(Factor=1)

# ---- group: Direction vectors as colors
# Vectors X, Y, Z coordinates are translated into R, G, B values respectively
col = Colour(merge)

# ---- group: display mesh edges (with tolerance angle)
f_mmeea = MeshesExtractEdgesWithToleranceAngle(Mesh=mesh, Angle=45)  # -> InternalEdges, NakedEdges
previewlw = CustomPreviewLineweights(Geometry=f_mmeea.InternalEdges, Shader=ColourSwatch(SwatchColor=RGB(0, 0, 0)), Absolute=False)

# ----
# orientation
# 
# identify and recognise orientation in space
# 
# code by Alessio Erioli
# 
# v 0.1
# © a3 2021 / Creative Commons Attribution-Non Commercial-ShareAlike 4.0 International License
direction_vectors = Panel(merge)

# ---- group: display original mesh
preview = CustomPreview(Geometry=mesh, Material=ColourSwatch(SwatchColor=RGB(255, 255, 255)))

# ----
direction_vectors_as_colors = Panel(col)
abs = Absolute(Value=dprod)

# ----
# Parsing condition
# (generates a True/False boolean pattern
# or a list of 0 and 1)
external_data_optional = Relay()
# recognize this guy?
# 
# You got it! It's a Boolean Parser!
# 
# (see filtering and parsing.gh)
input_data = Relay()
# Parsing
# component
output_data_false_0 = Relay()
output_data_true_1 = Relay()

# ----
# The dot product between two vectors can only narrow our search to a group of orientations: one of the 6 columns, or even two of them if we consider arrow direction irrelevant (bidirectional option).
# 
# Below are a few conditions:
# 
# . one that finds vectors that are parallel to the reference vector (considering arrow direction)
# 
# . one that finds vectors that are parallel to the reference vector (discarding arrow direction)
# 
# . one that finds vectors that are perpendicular to the reference vector
panel_6 = Panel("1")
# The examples below show how to search for orientations with a single condition and a combined multiple condition.
# 
# Play with the examples to understand and gain more confidence with the concept of orientation in 3D space.
panel_7 = Panel("0")
similar = Similarity(FirstNumber=dprod, SecondNumber=panel_7, Threshold=0.1)  # -> Similarity, AbsoluteDifference
similar_2 = Similarity(FirstNumber=dprod, SecondNumber=panel_6, Threshold=0.1)  # -> Similarity, AbsoluteDifference
similar_3 = Similarity(FirstNumber=abs, SecondNumber="1", Threshold=0.1)  # -> Similarity, AbsoluteDifference
# find vectors perpendicular to the reference vector
panel_8 = Panel(similar.Similarity)
# find vectors parallel to the reference vector (considering arrow direction)
panel_9 = Panel(similar_2.Similarity)
# find vectors parallel to the reference vector discarding arrow direction)
panel_10 = Panel(similar_3.Similarity)
# multiple condition
# In order to recognize specific orientations, I need at least 2 perpendicular vectors related to each object (for example, from its related orientation plane) and 2 perpendicular reference vectors
# object-related planes
pln = Plane([PlaneYZ(0, 0, 0), Plane(origin=(0, 0, 0), x=(0, 0, -1), y=(1, 0, 0)), PlaneXY(0, 0, 0), Plane(origin=(0, 0, 0), x=(-1, 0, 0), y=(0, 1, 0))])
X_4 = UnitX(Factor=1)
# reference vectors (fundamental directions)
Y_4 = UnitY(Factor=1)
deplane = DeconstructPlane(Plane=pln)  # -> Origin, XAxis, YAxis, ZAxis
# I can apply the appropriate conditions for the case I am searching (here are two conditions searching for parallel vectors)
dprod_2 = DotProduct(VectorA=deplane.XAxis, VectorB=X_4, Unitize=False)
dprod_3 = DotProduct(VectorA=deplane.YAxis, VectorB=Y_4, Unitize=False)
similar_4 = Similarity(FirstNumber=dprod_3, SecondNumber="1", Threshold=0.1)  # -> Similarity, AbsoluteDifference
similar_5 = Similarity(FirstNumber=dprod_2, SecondNumber="1", Threshold=0.1)  # -> Similarity, AbsoluteDifference
# finally, I must compose my boolean masks into a single one using a boolean operator (in this case AND, to filter objects that satisfy BOTH conditions)
panel_11 = Panel(similar_5.Similarity)
panel_12 = Panel(similar_4.Similarity)
and = GateAnd(A=similar_5.Similarity, B=similar_4.Similarity)
# visualizing the 24 orientations of an object
mesh_2 = Mesh(mesh)
vec_2 = Vector(merge)
col_2 = Colour(col)
panel_13 = Panel(and)

# ----
# try to change the reference vector (eventually applying -1 to switch direction) ot see which objects are selected
panel_14 = Panel("-1")
X_5 = UnitX(Factor=1)
Y_5 = UnitY(Factor=panel_14)
Z_5 = UnitZ(Factor=1)

X_6 = UnitX(Factor="40")

# ----
# recognizing and visualizing the 6 basic directions
# This is a simple mesh box, divided into its faces.
# 
# We can use it to recognize which of our 6 fundamental directions is the closest orientation to each face, and display its color on that face
# The index is then used to choose the corresponding direction color
mesh_3 = Mesh([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])

# ---- group: Face direction
facen = FaceNormals(Mesh=mesh_3)  # -> flatten(Centers), flatten(Normals)

# ----
# This part computes the Vector angle between each face normal and all the direction vectors, sorts values in descending order and picks the index of the smallest one.
angle_2 = Angle(VectorA=graft(facen.Normals), VectorB=merge)  # -> Angle, Reflex
f_ifroml = IndexesFromList(Data=merge)
sort = SortList(Keys=angle_2.Angle, ValuesA=f_ifroml)  # -> Keys, ValuesA
item = ListItem(List=sort.ValuesA, Index=0, Wrap=True)  # -> flatten(Item)

panel_15 = Panel(angle_2.Angle)
panel_16 = Panel(item)
item_2 = ListItem(List=col, Index=item, Wrap=True)

# ---- group: Display direction
vdisex = VectorDisplayEx(Point=facen.Centers, Vector=facen.Normals, Colour=item_2, Width="5")

# ---- group: color individual mesh faces by orientation
preview_2 = CustomPreview(Geometry=mesh_3, Material=item_2)

# ----
# objects satisfying the condition
swatch = ColourSwatch(SwatchColor=RGB(242, 224, 58))

X_7 = UnitX(Factor="80")

# ----
# This part displays all 24 possible orientation of an object if we recognise 6 basic directions.
# 
# Don't worry about learning it unless you are already VERY confident with Grasshopper - it is not in the scope of this example to explain all that happens here, the useful explanations are in other parts.
volume = Volume(Geometry=mesh_2)  # -> Volume, Centroid
xy = XYPlane(Origin=volume.Centroid)

# ---- group: Generate all direction orientation planes
rotations = Panel("""0
0.5*Pi
Pi
1.5*Pi""")
pl = PlaneNormal(Origin=volume.Centroid, ZAxis=vec_2)
prot = RotatePlane(Plane=graft(pl), Angle=rotations)

# ---- group: Arrange planes in a grid
lng = ListLength(List=vec_2)
lng_2 = ListLength(List=rotations)
x_spacing = Panel("6")
y_spacing = Panel("6")
x_offset = Panel("8")
series = Series(Start=x_offset, Step=x_spacing, Count=lng)
series_2 = Series(Start=0, Step=y_spacing, Count=lng_2)
X_8 = UnitX(Factor=series)
Y_6 = UnitY(Factor=series_2)
addition = Addition(A=graft(X_8), B=Y_6)
move = Move(Geometry=prot, Motion=addition)  # -> Geometry, Transform

# ---- group: display orientation planes XYZ axis
deplane_2 = DeconstructPlane(Plane=move.Geometry)  # -> Origin, XAxis, YAxis, ZAxis
merge_2 = Merge(Data1=graft(deplane_2.XAxis), Data2=graft(deplane_2.YAxis), Data3=graft(deplane_2.ZAxis))
multiplication = Multiplication(A=merge_2, B="2.75")
merge_3 = Merge(
    Data1=ColourSwatch(SwatchColor=RGB(255, 0, 0)),
    Data2=ColourSwatch(SwatchColor=RGB(85, 255, 0)),
    Data3=ColourSwatch(SwatchColor=RGB(0, 111, 255)))
panel_17 = Panel("3")
vdisex_2 = VectorDisplayEx(Point=graft(deplane_2.Origin), Vector=multiplication, Colour=merge_3, Width=panel_17)

# ---- group: place labels
item_3 = ListItem(List=move.Geometry, Index=0, Wrap=True)
labels = Panel("""Zo = -X
Zo = X
Zo = -Y
Zo = Y
Zo = -Z
Zo = Z""")
Y_7 = UnitY(Factor="-4")
pt = Point(item_3)
addition_2 = Addition(A=pt, B=Y_7)
swatch_2 = ColourSwatch(SwatchColor=RGB(0, 0, 0))
panel_18 = Panel("0.5")
xy_2 = XYPlane(Origin=addition_2)
tag = TextTag3D(Location=xy_2, Text=graft(labels), Size=panel_18, Colour=swatch_2, Justification=2)

# ---- group: display XYZ axis and text for the examples
X_9 = UnitX(Factor="40")
move_2 = Move(Geometry=xy_2, Motion=X_9)  # -> Geometry, Transform
tag_2 = TextTag3D(Location=move_2.Geometry, Text=graft(labels), Size=panel_18, Colour=swatch_2, Justification=2)
move_3 = Move(Geometry=deplane_2.Origin, Motion=X_9)  # -> Geometry, Transform
move_4 = Move(Geometry=move_2.Geometry, Motion=X_9)  # -> Geometry, Transform
vdisex_3 = VectorDisplayEx(Point=graft(move_3.Geometry), Vector=multiplication, Colour=merge_3, Width=panel_17)
move_5 = Move(Geometry=move_3.Geometry, Motion=X_9)  # -> Geometry, Transform
tag_3 = TextTag3D(Location=move_4.Geometry, Text=graft(labels), Size=panel_18, Colour=swatch_2, Justification=2)
vdisex_4 = VectorDisplayEx(Point=graft(move_5.Geometry), Vector=multiplication, Colour=merge_3, Width=panel_17)

# ----
pln_2 = Plane(flatten(move.Geometry))
move_6 = Move(Geometry=pln_2, Motion=X_6)  # -> Geometry, Transform

# ----
# try to change the condition to filter perpendicular objects or to disregard arrow direction (see above)
deplane_3 = DeconstructPlane(Plane=move_6.Geometry)  # -> Origin, XAxis, YAxis, ZAxis
dprod_4 = DotProduct(VectorA=deplane_3.ZAxis, VectorB=Z_4, Unitize=False)
similar_6 = Similarity(FirstNumber=dprod_4, SecondNumber="1", Threshold=0.1)  # -> Similarity, AbsoluteDifference

panel_19 = Panel(dprod_4)
# objects NOT satisfying the condition
panel_20 = Panel(similar_6.Similarity)

pln_3 = Plane(flatten(move.Geometry))
move_7 = Move(Geometry=pln_3, Motion=X_7)  # -> Geometry, Transform

# ----
# try to change the condition by setting comparison values to 0 or -1, or to use the absolute value of the Dot Product, or use the OR gate instead of AND
deplane_4 = DeconstructPlane(Plane=move_7.Geometry)  # -> Origin, XAxis, YAxis, ZAxis
dprod_5 = DotProduct(VectorA=deplane_4.XAxis, VectorB=X_5, Unitize=False)
dprod_6 = DotProduct(VectorA=deplane_4.ZAxis, VectorB=Z_5, Unitize=False)
similar_7 = Similarity(FirstNumber=dprod_5, SecondNumber="1", Threshold=0.1)  # -> Similarity, AbsoluteDifference
similar_8 = Similarity(FirstNumber=dprod_6, SecondNumber="1", Threshold=0.1)  # -> Similarity, AbsoluteDifference
and_2 = GateAnd(A=similar_7.Similarity, B=similar_8.Similarity)
or = GateOr(A=similar_7.Similarity, B=similar_8.Similarity)

deplane_5 = DeconstructPlane(Plane=move.Geometry)  # -> Origin, XAxis, YAxis, ZAxis
orient = Orient(Geometry=mesh_2, Source=xy, Target=move.Geometry)  # -> Geometry, Transform

# ----
# So, what does "horizontal" (or "vertical") means?
# 
# In the most general case... depends.
# 
# In the simplest definition, and for the sake of simplicity, we usually assume XY as the base horizontal plane, so we define "horizontal" any orientation where the object reference plane has its Z parallel to the global Z, and for "vertical" any orientation where the object reference plane Z axis is perpendicular to the global Z.
# 
# This definitions work for most cases, but checking for orientation might get more complex and specific, according to what we want to achieve (or try).
# single condition
# let's copy the samples from the orientation table and move them where we can see them clearly
mesh_4 = Mesh(flatten(orient.Geometry))
move_8 = Move(Geometry=mesh_4, Motion=X_6)  # -> Geometry, Transform

dispatch = Dispatch(List=move_8.Geometry, DispatchPattern=similar_6.Similarity)  # -> ListA, ListB

preview_3 = CustomPreview(Geometry=dispatch.ListA, Material=swatch)

preview_4 = CustomPreview(Geometry=dispatch.ListB, Material=ColourSwatch(SwatchColor=RGB(82, 82, 82)))

relay = Relay([dispatch.ListA, dispatch.ListB])

# ---- group: display mesh edges (with tolerance angle)
f_mmeea_2 = MeshesExtractEdgesWithToleranceAngle(Mesh=relay, Angle=45)  # -> InternalEdges, NakedEdges
previewlw_2 = CustomPreviewLineweights(Geometry=f_mmeea_2.InternalEdges, Shader=ColourSwatch(SwatchColor=RGB(0, 0, 0)), Absolute=False)

# ----
# multiple condition
# let's copy the samples from the orientation table and move them where we can see them clearly
mesh_5 = Mesh(flatten(orient.Geometry))
move_9 = Move(Geometry=mesh_5, Motion=X_7)  # -> Geometry, Transform

# ---- group: find Z axis orientation (by smallest vector angle)
angle_3 = Angle(VectorA=graft(deplane_5.ZAxis), VectorB=vec_2)  # -> Angle, Reflex
panel_21 = Panel("""0
1
2
3
4
5""")
sort_2 = SortList(Keys=angle_3.Angle, ValuesA=panel_21)  # -> Keys, ValuesA
item_4 = ListItem(List=sort_2.ValuesA, Index=0, Wrap=True)

# ----
dispatch_2 = Dispatch(List=move_9.Geometry, DispatchPattern=and_2)  # -> ListA, ListB

item_5 = ListItem(List=col_2, Index=item_4, Wrap=True)
pshift = ShiftPaths(Data=item_5, Offset=-1)

# ---- group: display mesh edges (with tolerance angle)
f_mmeea_3 = MeshesExtractEdgesWithToleranceAngle(Mesh=orient.Geometry, Angle=45)  # -> InternalEdges, NakedEdges
previewlw_3 = CustomPreviewLineweights(Geometry=f_mmeea_3.InternalEdges, Shader=ColourSwatch(SwatchColor=RGB(0, 0, 0)), Absolute=False)

# ---- group: display meshes colors by orientation
preview_5 = CustomPreview(Geometry=orient.Geometry, Material=pshift)

# ----
# objects satisfying the condition
swatch_3 = ColourSwatch(SwatchColor=RGB(58, 239, 242))
preview_6 = CustomPreview(Geometry=dispatch_2.ListA, Material=swatch_3)

# ----
# objects NOT satisfying the condition
swatch_4 = ColourSwatch(SwatchColor=RGB(212, 212, 212))
preview_7 = CustomPreview(Geometry=dispatch_2.ListB, Material=swatch_4)

relay_2 = Relay([dispatch_2.ListA, dispatch_2.ListB])

# ---- group: display mesh edges (with tolerance angle)
f_mmeea_4 = MeshesExtractEdgesWithToleranceAngle(Mesh=relay_2, Angle=45)  # -> InternalEdges, NakedEdges
previewlw_4 = CustomPreviewLineweights(Geometry=f_mmeea_4.InternalEdges, Shader=ColourSwatch(SwatchColor=RGB(0, 0, 0)), Absolute=False)
