# Grasshopper definition point inclusion checks.gh (Grasshopper 1.0.7)
# Copyright: Co-de-iT
# plug-ins: froGH

pop2d = Populate2D(Region={Plane=PlaneXY(0, 0, 0), Size=Domain2(u=0..20, v=0..10)}, Count="5", Seed=1)
lng = ListLength(List=pop2d)
random = Random(Range="1 to 5", Number=lng, Seed="0")
random_2 = Random(Range="1 to 5", Number=lng, Seed="1")
random_3 = Random(Range="1 to 5", Number=lng, Seed="2")
box = CenterBox(Base=pop2d, X=random, Y=random_2, Z=random_3)
X = UnitX(Factor="40")
# <title>
# 
# <description>
# 
# code by Alessio Erioli
# 
# v 0.1
# © Co-de-iT 2020 / Creative Commons Attribution-Non Commercial-ShareAlike 4.0 International License
item = ListItem(List=box, Index=0, Wrap=True)
move = Move(Geometry=box, Motion=X)  # -> Geometry, Transform
Y = UnitY(Factor="30")
item_2 = ListItem(List=box, Index=0, Wrap=True)
mesh = Mesh(move.Geometry)
move_2 = Move(Geometry=item, Motion=Y)  # -> Geometry, Transform
Y_2 = UnitY(Factor="20")

# ----
# Points checked for inclusion
pt = Point(Point(54.97209817, 1.982130609, 0))
pt_2 = Point(Point(59.08169186, 8.876566129, 0))
pt_3 = Point(Point(44.64090628, 0.7046935243, 0))
merge = Merge(Data1=pt, Data2=pt_2, Data3=pt_3)

move_3 = Move(Geometry=item_2, Motion=Y_2)  # -> Geometry, Transform
mesh_2 = Mesh(move_2.Geometry)

# ----
# Points checked for inclusion
pt_4 = Point(Point(12.45710099, 8.876566129, 0))
pt_5 = Point(Point(5.526661588, 8.876566129, 0))
pt_6 = Point(Point(22.32283544, 1.764989682, 0))
merge_2 = Merge(Data1=pt_5, Data2=pt_4, Data3=pt_6)

medges = MeshEdges(Mesh=mesh)  # -> NakedEdges, InteriorEdges, NonManifoldEdges
minc = MeshInclusion(Mesh=mesh, Point=graft(merge), Strict=False)

# ----
# Point checked for inclusion
pt_7 = Point(Point(0.08806904168, 29.610445, 0))

# ----
# Point checked for inclusion
pt_8 = Point(Point(-0.7410463151, 21.00185967, 0))

# ---- group: find mesh index and replace null with -1
f_ifroml = IndexesFromList(Data=minc)
cull = CullPattern(List=f_ifroml, CullPattern=minc)
null = NullItem(Item=cull)  # -> NullFlags, InvalidFlags, Description
weave = Weave(Pattern=null.NullFlags, Stream0=cull, Stream1="-1", NullGaps=False)  # -> flatten(Weave)

# ----
minc_2 = MeshInclusion(Mesh=mesh_2, Point=pt_7, Strict=False)
brepinc = PointInBrep(Brep=move_3.Geometry, Point=pt_8, Strict=False)
edges = BrepEdges(Brep=box)  # -> Naked, Interior, NonManifold
brepsinc = PointInBreps(Brep=box, Point=merge_2, Strict=False)  # -> Inside, Index
weave_2 = Weave(
    Pattern=minc_2,
    Stream0=ColourSwatch(SwatchColor=RGBA(115, 115, 115, 59)),
    Stream1=ColourSwatch(SwatchColor=RGB(255, 255, 255)),
    NullGaps=False)
weave_3 = Weave(
    Pattern=brepinc,
    Stream0=ColourSwatch(SwatchColor=RGBA(79, 79, 79, 59)),
    Stream1=ColourSwatch(SwatchColor=RGB(195, 255, 0)),
    NullGaps=False)
panel = Panel(minc_2)
panel_2 = Panel(brepinc)
panel_3 = Panel(brepsinc.Inside)
move_4 = Move(Geometry=merge_2, Motion=Vector(0, 0, 10))  # -> Geometry, Transform
item_3 = ListItem(List=box, Index=brepsinc.Index, Wrap="false")
Z = UnitZ(Factor=1)
# How to check if a point is inside....
# a single mesh
preview = CustomPreview(Geometry=mesh_2, Material=weave_2)
# a single BRep
preview_2 = CustomPreview(Geometry=move_3.Geometry, Material=weave_3)
panel_4 = Panel(brepsinc.Index)
line = LineSDL(Start=merge_2, Direction=Z, Length="8")
# multiple BReps (multiple points)
preview_3 = CustomPreview(Geometry=item_3, Material=ColourSwatch(SwatchColor=RGBA(20, 138, 156, 139)))
tag = TextTag3D(
    Location=move_4.Geometry,
    Text=brepsinc.Index,
    Size=Slider(3.838, range=0..5),
    Colour=ColourSwatch(SwatchColor=RGB(0, 0, 0)),
    Justification=5)
panel_5 = Panel(weave)
move_5 = Move(Geometry=merge, Motion=Vector(0, 0, 10))  # -> Geometry, Transform
item_4 = ListItem(List=mesh, Index=weave, Wrap="false")
Z_2 = UnitZ(Factor=1)
line_2 = LineSDL(Start=merge, Direction=Z_2, Length="8")
tag_2 = TextTag3D(
    Location=move_5.Geometry,
    Text=weave,
    Size=Slider(3.838, range=0..5),
    Colour=ColourSwatch(SwatchColor=RGB(255, 255, 255)),
    Justification=5)
# multiple meshes (multiple points)
preview_4 = CustomPreview(Geometry=item_4, Material=ColourSwatch(SwatchColor=RGBA(118, 83, 153, 139)))
